# Grasshopper definition 220307_仮完成_obara.gh (Grasshopper 1.0.7)
# plug-ins: baues-toolbox Info

number_slider = Slider(0.1, range=0..0.1)
list = ValueList({"Window": D, "exterior Wall": E, "interior Wall": I, "exterior Roof": R, "interior Roof": C, "ground floor": G}, selected="exterior Wall")
windows = Surface([<surface referenced from the Rhino model> x2])
rooms = Brep([<brep referenced from the Rhino model> x3])
assignclass = CSharpScript(geos=flatten(rooms), tol=number_slider, windows=windows)  # -> out, Room, Faces, Windows, test; inputs geos: list of Brep, tol: Double, windows: list of Surface
# ---------- assignclass: C# usings ----------
using Rhino.Geometry.Collections;
using Rhino.Geometry.Intersect;
using System.Threading.Tasks;
# ---------- assignclass: C# ----------
    List<Room> roomList = new List<Room>();
    List<Face> faceList = new List<Face>();
    //Brep同士をsplitする
    //TODO:思ったような動きをしてくれない
    List<Brep> splitGeos = new List<Brep>();

    /*
    for (int i = 0; i < geos.Count; i = i + 1){
      List<Brep> cutterBreps = geos.FindAll(geo => geo != geos[i]);
      Print("{0}", cutterBreps.Count);
      foreach(Brep cutterBrep in cutterBreps){
        Brep[] splitGeo = geos[i].Split(cutterBrep, 0.1);
        bool test1 = splitGeo[0].Join(splitGeo[1], 0.1, false);
        Print("{0}", test1);
        //for (int j = 1; j < splitGeo.Count; j = j + 1){
        //  splitGeo[0].Join(geos[j], 0.1, false);
        //}
        //foreach(Brep geo in splitGeo){
        //splitGeos.Add(geo);
        //}
        splitGeos.Add(splitGeo[0]);
      }
    }
    Print("{0}", splitGeos);
    test = splitGeos;
    */

    //Roomに対する処理
    foreach(Brep geo in geos){
      Room temp = new Room(geo);

      BrepSurfaceList srfs = geo.Surfaces;
      foreach(Surface srf in srfs){
        Vector3d normal = srf.NormalAt(0.5, 0.5);
        Vector3d tempNormal = reviseNormal(srf, temp);
        Face face = new Face(temp.id, srf, normal, tempNormal);
        //Print("{0}", face.centerPt);
        faceList.Add(face);
        //Print("{0}", face);
        temp.addFace(face);
      }
      roomList.Add(temp);
    }
    //Print("{0}", roomList);
    //Room = roomList;

    //Faces = faceList;
    //FaceのboundaryConditionを計算する処理
    List<Face> faceListBC = new List<Face>();
    //理解が進んだらboundary conditionは違うコンポーネントにうつす
    for (int i = 0; i < faceList.Count; i++){
      //テストするsurfaceを選択する
      var testFace = faceList[i];

      //違うparentを持つfaceを取得する
      List<Face> targetFaces = faceList
        .FindAll(face => face.parent != testFace.parent);
      //.Select(face => face.geometry);

      //TODO: Selectメソッドにmigrateする
      List<Surface> targetSurfaces = new List<Surface>();

      foreach(Face face in targetFaces){
        targetSurfaces.Add(face.geometry);
      }
      //Print("{0}", targetSurfaces);

      //testFacesに対して、normal directionのテストを行う
      Point3d testPt = new Point3d(testFace.centerPt);
      testPt += testFace.normal * -tol / 2;
      Ray3d testRay = new Ray3d(testPt, testFace.normal);


      if (shootIt(testRay, targetSurfaces, tol, 2)){
        //testFace.bc = boundaryCondition.interiorWall;
        testFace.bc = "interior";
        //どのfaceにtouchしているのかをチェック
        //testFace.centerPtから一番近いtargetSurfacesが隣接しているsurfaceだと判断する
        Face adjacentFace = getClosestFaceFromFace(testFace, targetFaces);
        testFace.adjacencyId = adjacentFace.parent;
        //Print("{0}", testFace.id);
        //Print("{0}", adjacentFace.id);

      }else{
        //z座標<=0であれば、bc=groundとする
        //testFace.bc = boundaryCondition.outdoor;
        if(testFace.centerPt.Z <= tol){
          testFace.bc = "ground";
        }else{
          testFace.bc = "outdoor";
        }
        testFace.adjacencyId = 0;
      }
      testFace.setElementType();
      testFace.setConstructionId();
      Print("{0}", testFace.elementType);
      faceListBC.Add(testFace);

    }

    //Roomに属するfaceの属性(wall,ceiling,roof)を集計するロジック
    foreach(Room room in roomList){
      List<Face> faces = room.getFaces();
      Print("{0}", faces.Count);
      foreach(Face face in faces){
        room.groupChildFaces(face);
      }
    }
    //Print("{0}", roomList[0].roofs.Count);

    Room = roomList;

    //windowがどのwallの上にあるかどうかを判断するロジック
    List<Face> externalFaces = faceListBC
      .FindAll(face => face.bc == "outdoor");
    //Print("{0}", externalFaces.Count);

    List<Window> windowList = new List<Window>();
    foreach (Surface windowGeo in windows){
      //それぞれのwindowに対して一番近いexternalFacesをwindowが属するfaceとする
      int parentId = 0;
      double tiltAngle = 0;
      double closestDistance = 10000;
      Window window = new Window(windowGeo);
      foreach(Face exFace in externalFaces){
        double distance = window.centerPt.DistanceTo(exFace.centerPt);
        //Print("{0}", distance);
        if (distance < closestDistance){
          parentId = exFace.id;
          tiltAngle = exFace.tiltAngle;
          closestDistance = distance;
        }
      }

      if (closestDistance < 10000){
        window.parent = parentId;
        window.tiltAngle = tiltAngle;
        //Print("{0}", window.parent);
      }else{
        //エラー処理を加える
      }
      windowList.Add(window);
    }

    //WindowをfaceにAddする
    List<Face> faceListWindow = new List<Face>();
    foreach(Face face in faceListBC){
      foreach(Window window in windowList){
        if(window.parent == face.id){
          face.addWindows(window);
        }
      }
      faceListWindow.Add(face);
    }

    Faces = faceListBC;
    Windows = windowList;
# ---------- assignclass: C# additional code ----------
  private Vector3d reviseNormal(Surface srf, Room parent){
    //モデルによってはsurfaceのvectorの方向が意図と逆に向いている場合があるのでそれを修正
    Point3d centroid = parent.centroid;
    AreaMassProperties areaMp = AreaMassProperties.Compute(srf);
    Point3d centerPt = areaMp.Centroid;
    Vector3d normal = srf.NormalAt(0.5, 0.5);
    //Point3d testPt = new Point(centerPt.X + normal.X, centerPt.Y + normal.Y, centerPt.Z + normal.Z);
    Point3d testPt = centerPt + normal;
    //Print("{0}", centerPt);
    //Print("{0}", testPt);
    double baseDistance = centroid.DistanceTo(centerPt);
    double testDistance = centroid.DistanceTo(testPt);
    if (baseDistance > testDistance){
      Vector3d revNormal = new Vector3d(-normal.X, -normal.Y, -normal.Z);
      //Print("{0}", normal);
      //Print("{0}", revNormal);
      return revNormal;
    }else{
      return normal;
    }

  }
  private Face getClosestFaceFromFace(Face originFace, List<Face> Faces){
    //TはFaceかWindowとしたい。ジェネリクスがよくわかっていないので

    Face closestFace = null;
    double closestDistance = 10000;
    foreach(Face face in Faces){
      //faceがwallであればwallのみでテストする
      double distance = 10000;
      if (originFace.face == "wall" && face.face == "wall"){
        distance = originFace.centerPt.DistanceTo(face.centerPt);
        //Print("{0}", distance);
      }else if (originFace.face != "wall" && face.face != "wall"){
        distance = originFace.centerPt.DistanceTo(face.centerPt);
      }
      if (distance < closestDistance){
        closestFace = face;
        closestDistance = distance;
      }
    }
    Print("{0}", closestDistance);
    return closestFace;
  }
  private bool shootIt(Ray3d ray, List<Surface> srfs, double tol, int bounce){
    Point3d[] intersectPts = Intersection.RayShoot(ray, srfs, 1);
    //Print("{0}", intersectPts.Length);
    if (intersectPts.Length > 0){
      //Print("{0}", ray.Position.DistanceTo(intersectPts[0]));
      if (ray.Position.DistanceTo(intersectPts[0]) <= tol){
        return true;
      }else{
        return false;
      }
    }else{
      return false;
    }

  }

  //基底クラスを作成する
  public class baseGeo{
    public Guid guid;
    public int id;
    public int displayName;

    //staticコンストラクタをどう継承すべきか理解必要

  }


  public class Room{
    public Guid guid;
    public int id;
    public string displayName;
    public Brep geometry;
    public Point3d centroid;
    private List<Face> _faceList;
    public static int _totalRooms;
    public BrepVertexList vertices;
    public Point3d minPt;
    public Point3d maxPt;
    public List<Face> sWalls;
    public List<Face> wWalls;
    public List<Face> nWalls;
    public List<Face> eWalls;
    public List<Face> floors;
    public List<Face> roofs;

    static Room(){
      _totalRooms = 0;
    }

    public Room(Brep geometry){
      this.guid = Guid.NewGuid();
      _totalRooms += 1;
      this.id = _totalRooms;
      //this.displayName = _totalRooms;
      this._faceList = new List<Face>();
      this.geometry = geometry;
      BrepVertexList vertices = geometry.Vertices;
      this.vertices = vertices;
      this.minPt = getMinCoord(vertices);
      this.maxPt = getMaxCoord(vertices);
      this.sWalls = new List<Face>();
      this.wWalls = new List<Face>();
      this.nWalls = new List<Face>();
      this.eWalls = new List<Face>();
      this.floors = new List<Face>();
      this.roofs = new List<Face>();
      VolumeMassProperties vmp = VolumeMassProperties.Compute(geometry);
      this.centroid = vmp.Centroid;
      //TODO:どのタイミングで
    }

    public void addFace(Face face){
      _faceList.Add(face);
    }

    public void groupChildFaces(Face face){
      if (face.face == "wall"){
        switch(face.direction){
          case "S":
            this.sWalls.Add(face);
            break;
          case "N":
            this.nWalls.Add(face);
            break;
          case "W":
            this.wWalls.Add(face);
            break;
          case "E":
            this.eWalls.Add(face);
            break;
        }
      }else if(face.face == "roof"){
        this.roofs.Add(face);
      }else if(face.face == "floor"){
        this.floors.Add(face);
      }
    }

    public List<int> getDirectionList(){
      List<int> directionList = new List<int>();
      directionList.Add(this.sWalls.Count);
      directionList.Add(this.wWalls.Count);
      directionList.Add(this.nWalls.Count);
      directionList.Add(this.eWalls.Count);
      directionList.Add(this.floors.Count);
      directionList.Add(this.roofs.Count);
      int total = this.sWalls.Count + this.wWalls.Count + this.nWalls.Count + this.eWalls.Count + this.floors.Count + this.roofs.Count;
      directionList.Add(total);

      return directionList;//[S,W,N,E,F,CR,total]
    }

    public List<Face> getFaces(){
      return _faceList;
    }

    //public static string generateDisplayName{
    //}
    private Point3d getMinCoord(BrepVertexList vertices){
      Point3d origin = new Point3d(0, 0, 0);
      int i = 0;
      int minId = 0;
      double minValue = 1000;
      foreach(BrepVertex vertex in vertices){

        Point3d checkPt = vertex.Location;
        double distance = origin.DistanceTo(checkPt);
        //Print("{0}:{1}", i, distance);
        if (distance < minValue){
          minId = i;
          minValue = distance;
        }
        i += 1;
      }
      //Print("{0}:{1}", minId, minValue);

      return vertices[minId].Location;
    }

    private Point3d getMaxCoord(BrepVertexList vertices){
      Point3d origin = new Point3d(0, 0, 0);
      int i = 0;
      int maxId = 0;
      double maxValue = -1000;
      foreach(BrepVertex vertex in vertices){

        Point3d checkPt = vertex.Location;
        double distance = origin.DistanceTo(checkPt);
        //Print("{0}:{1}", i, distance);
        if (distance > maxValue){
          maxId = i;
          maxValue = distance;
        }
        i += 1;
      }
      //Print("{0}:{1}", minId, minValue);

      return vertices[maxId].Location;
    }
  }

  public class Window{
    public Guid guid;
    public int id;
    public string displayName;
    public int parent {get; set;}
    public Surface geometry { get; private set; }
    public Vector3d normal {get; private set;}
    public Point3d centerPt;
    public double tiltAngle;
    public int constructionId; //とりあえず外壁1,内壁2,床(室内）3,屋根4,床（地面）5, 窓6　THERBのelement Idに相当
    public double area;
    public static int _totalWindows;

    static Window(){
      _totalWindows = 0;
    }

    public Window(Surface geometry){
      this.guid = Guid.NewGuid();
      _totalWindows += 1;
      this.id = _totalWindows;
      this.geometry = geometry;
      AreaMassProperties areaMp = AreaMassProperties.Compute(geometry);
      this.centerPt = areaMp.Centroid;
      this.area = areaMp.Area;
      this.constructionId = 6;
    }
  }

  public class Face{
    public Guid guid;
    public int id;
    public string displayName;
    //public faceType face{get; private set;}
    public string face{get; private set;}
    //public boundaryCondition bc{get; set;}
    public string bc{get; set;}
    public string elementType{get; set;}
    public int constructionId; //とりあえず外壁1,内壁2,床(室内）3,屋根4,床（地面）5, 窓6　THERBのelement Idに相当
    public int parent;
    public Surface geometry { get; private set; }
    public List<Point3d> vertices;
    public Vector3d normal {get; private set;}
    public Vector3d tempNormal;
    public Point3d centerPt;
    public double tiltAngle;
    public double area;
    public string direction;
    public int adjacencyId; //隣接しているRoomのId 外気に接している場合には0
    public List<Window> windows {get; private set;}
    public List<int> windowIds;
    public static int _totalFaces;

    static Face(){
      _totalFaces = 0;
    }

    public Face(int parent, Surface geometry, Vector3d normal, Vector3d tempNormal){
      this.guid = Guid.NewGuid();
      _totalFaces += 1;
      this.id = _totalFaces;
      this.geometry = geometry;
      this.parent = parent;
      AreaMassProperties areaMp = AreaMassProperties.Compute(geometry);
      this.centerPt = areaMp.Centroid;
      this.area = areaMp.Area;
      this.normal = tempNormal;

      //方角、床、天井を判別するためにはtempNormalを使う
      this.face = getFaceType(tempNormal);
      this.direction = defineDirection(tempNormal);

      //TODO: this logic has to be elaborated
      if (this.face == "wall"){
        this.tiltAngle = 90;
      }else{
        this.tiltAngle = 0;
      }
      this.windows = new List<Window>();
      this.windowIds = new List<int>();
    }

    private string defineDirection(Vector3d normal){
      if (this.face == "floor"){
        return "F";
      }else if (this.face == "roof"){
        return "CR";
      }

      Vector3d northAngle = new Vector3d(0, 1, 0);
      Vector3d westAngle = new Vector3d(-1, 0, 0);

      double angle1 = (180 / Math.PI) * (Vector3d.VectorAngle(normal, northAngle));
      double angle2 = (180 / Math.PI) * (Vector3d.VectorAngle(normal, westAngle));

      //Print("{0}:{1}", normal, angle1);

      if (angle1 < 45){
        return "N";
      }else if(angle1 == 45 && angle2 == 45){
        return "N";
      }else if (angle1 > 135){
        return "S";
      }else if(angle1 == 135 && angle2 == 135){
        return "S";
      }else if(angle2 <= 45){
        return "W";
      }else{
        return "E";
      }
    }

    public string getFaceType(Vector3d normal){

      //better to add filter logic for internal wall
      double Z = normal.Z;
      int roofAngle = 10;
      if (Z > Math.Cos((Math.PI / 180) * roofAngle)){
        //return faceType.roof;
        return "roof";
      }else if(Z < -Math.Cos((Math.PI / 180) * 85)){
        //return faceType.floor;
        return "floor";
      }else{
        //string direction = defineDirection(normal);
        //Print("{0}:{1}", normal, direction);
        //return faceType.wall;
        return "wall";
      }
    }

    public void addWindows(Window window){
      this.windows.Add(window);
      this.windowIds.Add(window.id);
    }

    public void setElementType(){
      string firstPhrase = "";
      if (this.bc == "outdoor"){
        firstPhrase = "exterior";
      }else{
        firstPhrase = this.bc;
      }
      this.elementType = firstPhrase + this.face;
    }

    public void setConstructionId(){
      //Print("{0}", this.elementType);
      switch(this.elementType){
        case "exteriorwall":
          this.constructionId = 1;
          break;
        case "interiorwall":
          this.constructionId = 2;
          break;
        case "interiorroof":
          this.constructionId = 3;
          break;
        case "interiorfloor":
          this.constructionId = 3;
          break;
        case "exteriorroof":
          this.constructionId = 4;
          break;
        case "groundroof":
          this.constructionId = 5;
          break;
        case "groundfloor":
          this.constructionId = 5;
          break;
      }
    }
  }

  public enum faceType{
    wall,
    roof,
    floor
  }

  public enum elementType{
    exteriorWall,
    interiorWall,
    roof,
    floor,
    groundWall,
    groundFloor
  }

  public enum boundaryCondition{
    outdoor,
    ground,
    interiorWall
  }

  private string defineDirection(Vector3d normal){
    Vector3d northAngle = new Vector3d(0, 1, 0);
    Vector3d westAngle = new Vector3d(-1, 0, 0);

    double angle1 = (180 / Math.PI) * (Vector3d.VectorAngle(normal, northAngle));
    double angle2 = (180 / Math.PI) * (Vector3d.VectorAngle(normal, westAngle));

    //Print("{0}:{1}", normal, angle1);

    if (angle1 < 45){
      return "N";
    }else if(angle1 == 45 && angle2 == 45){
      return "N";
    }else if (angle1 > 135){
      return "S";
    }else if(angle1 == 135 && angle2 == 135){
      return "S";
    }else if(angle2 <= 45){
      return "W";
    }else{
      return "E";
    }
  }

  private Point3d getMinCoord(BrepVertexList vertices){
    Point3d origin = new Point3d(0, 0, 0);
    int i = 0;
    int minId = 0;
    double minValue = 1000;
    foreach(BrepVertex vertex in vertices){

      Point3d checkPt = vertex.Location;
      double distance = origin.DistanceTo(checkPt);
      //Print("{0}:{1}", i, distance);
      if (distance < minValue){
        minId = i;
        minValue = distance;
      }
      i += 1;
    }
    //Print("{0}:{1}", minId, minValue);

    return vertices[minId].Location;
  }

  private Point3d getMaxCoord(BrepVertexList vertices){
    Point3d origin = new Point3d(0, 0, 0);
    int i = 0;
    int maxId = 0;
    double maxValue = -1000;
    foreach(BrepVertex vertex in vertices){

      Point3d checkPt = vertex.Location;
      double distance = origin.DistanceTo(checkPt);
      //Print("{0}:{1}", i, distance);
      if (distance > maxValue){
        maxId = i;
        maxValue = distance;
      }
      i += 1;
    }
    //Print("{0}:{1}", minId, minValue);

    return vertices[maxId].Location;
  }
# ---------- end assignclass ----------
assignclass_2 = CSharpScript(geos=flatten(rooms), tol=number_slider, windows=windows)  # -> out, Room, Faces, Windows, zones; inputs geos: list of Brep, tol: Double, windows: list of Surface
# ---------- assignclass_2: C# ----------
    List<Room> roomList = new List<Room>();
    List<Face> faceList = new List<Face>();
    //Brep同士をsplitする
    //TODO:思ったような動きをしてくれない
    List<Brep> splitGeos = new List<Brep>();

    /*
    for (int i = 0; i < geos.Count; i = i + 1){
      List<Brep> cutterBreps = geos.FindAll(geo => geo != geos[i]);
      Print("{0}", cutterBreps.Count);
      foreach(Brep cutterBrep in cutterBreps){
        Brep[] splitGeo = geos[i].Split(cutterBrep, 0.1);
        bool test1 = splitGeo[0].Join(splitGeo[1], 0.1, false);
        Print("{0}", test1);
        //for (int j = 1; j < splitGeo.Count; j = j + 1){
        //  splitGeo[0].Join(geos[j], 0.1, false);
        //}
        //foreach(Brep geo in splitGeo){
        //splitGeos.Add(geo);
        //}
        splitGeos.Add(splitGeo[0]);
      }
    }
    Print("{0}", splitGeos);
    test = splitGeos;
    */

    //BAUES用のデータをこの時点で作ってみる
    var zoneList = new List<Zone>();
    //Roomに対する処理
    foreach(Brep geo in geos){
      Room temp = new Room(geo);

      //var surfaceDetailedList = new List<object>();
      //TODO: SurfaceとFaceの違い理解
      //BrepSurfaceList srfs = geo.Surfaces;
      BrepFaceList srfs = geo.Faces;
      foreach(Surface srf in srfs){
        Vector3d normal = srf.NormalAt(0.5, 0.5);
        Vector3d tempNormal = reviseNormal(srf, temp);
        Face face = new Face(temp, srf, normal, tempNormal);
        //Print("{0}", face.centerPt);
        faceList.Add(face);
        temp.addFace(face);
        //var surfaceDetailed = new Dictionary<string, object>();
        //surfaceDetailed.Add("name", "room"+temp.id.ToString()+"_"+face.elementType);
        //surfaceDetailed.Add("surfaceType", face.face);
        //surfaceDetailed.Add("vertices", face.bauesVertices);
        //SurfaceDetailed surfaceDetailed = new SurfaceDetailed("room" + temp.id.ToString());
        //surfaceDetailedList.Add(surfaceDetailed);
      }
      roomList.Add(temp);
      /*
      var zone = new Dictionary<string, object>();
      zone.Add("name", "room" + temp.id.ToString());
      zone.Add("multiplier", 1);
      zone.Add("surfaces", surfaceDetailedList);
      */
      Zone zone = new Zone("room" + temp.id.ToString());
      zoneList.Add(zone);
    }
    //FaceのboundaryConditionを計算する処理
    List<Face> faceListBC = new List<Face>();
    //理解が進んだらboundary conditionは違うコンポーネントにうつす
    for (int i = 0; i < faceList.Count; i++){
      //テストするsurfaceを選択する
      var testFace = faceList[i];

      //違うparentを持つfaceを取得する
      List<Face> targetFaces = faceList
        .FindAll(face => face.parent != testFace.parent);
      //.Select(face => face.geometry);

      //TODO: Selectメソッドにmigrateする
      List<Surface> targetSurfaces = new List<Surface>();

      foreach(Face face in targetFaces){
        targetSurfaces.Add(face.geometry);
      }
      //Print("{0}", targetSurfaces);

      //testFacesに対して、normal directionのテストを行う
      Point3d testPt = new Point3d(testFace.centerPt);
      testPt += testFace.normal * -tol / 2;
      Ray3d testRay = new Ray3d(testPt, testFace.normal);

      if (shootIt(testRay, targetSurfaces, tol, 2)){
        testFace.bc = "interior";
        testFace.bauesBC = BoundaryCondition.Surface;
        //どのfaceにtouchしているのかをチェック
        //testFace.centerPtから一番近いtargetSurfacesが隣接しているsurfaceだと判断する
        Face adjacentFace = getClosestFaceFromFace(testFace, targetFaces);
        testFace.adjacencyRoomId = adjacentFace.parentId;
        testFace.adjacencyFaceId = adjacentFace.partId;
        //Print("{0}", testFace.id);
        //Print("{0}", adjacentFace.id);

      }else{
        //z座標<=0であれば、bc=groundとする
        //testFace.bc = boundaryCondition.outdoor;
        if(testFace.centerPt.Z <= tol){
          testFace.bc = "ground";
          testFace.bauesBC = BoundaryCondition.Ground;
        }else{
          testFace.bc = "outdoor";
          testFace.bauesBC = BoundaryCondition.Outdoors;
        }
        testFace.adjacencyRoomId = 0;
      }
      testFace.setElementType();
      testFace.setConstructionId();
      faceListBC.Add(testFace);
      Print("{0}", testFace.parent.id);
      //Print("{0}", zoneList[testFace.parent.id - 1].surfaces);
      //ここでsurfaceをzoneに追加していく
      SurfaceDetailed srfDetail = new SurfaceDetailed("room" + testFace.id.ToString(), testFace);
      zoneList[testFace.parent.id - 1].addSurface(srfDetail);
    }

    //Roomに属するfaceの属性(wall,ceiling,roof)を集計するロジック
    foreach(Room room in roomList){
      List<Face> faces = room.getFaces();
      Print("{0}", faces.Count);
      foreach(Face face in faces){
        room.groupChildFaces(face);
      }
    }
    //Print("{0}", roomList[0].roofs.Count);

    Room = roomList;

    //windowがどのwallの上にあるかどうかを判断するロジック
    List<Face> externalFaces = faceListBC
      .FindAll(face => face.bc == "outdoor");
    //Print("{0}", externalFaces.Count);

    List<Window> windowList = new List<Window>();
    foreach (Surface windowGeo in windows){
      //それぞれのwindowに対して一番近いexternalFacesをwindowが属するfaceとする
      int parentId = 0;
      double tiltAngle = 0;
      double closestDistance = 10000;
      Window window = new Window(windowGeo);
      foreach(Face exFace in externalFaces){
        double distance = window.centerPt.DistanceTo(exFace.centerPt);
        //Print("{0}", distance);
        if (distance < closestDistance){
          parentId = exFace.id;
          tiltAngle = exFace.tiltAngle;
          closestDistance = distance;
        }
      }

      if (closestDistance < 10000){
        window.parentId = parentId;
        window.tiltAngle = tiltAngle;
        //Print("{0}", window.parent);
      }else{
        //エラー処理を加える
      }
      windowList.Add(window);
      //FenestrationDetailed fenDetailed = new FenestrationDetailed(window);
      //zoneList[faceList[parentId].parentId - 1].surfaces[parentId].addWindow(fenDetailed);
      //Print("{0}", zoneList[faceList[parentId].parentId - 1].surfaces[parentId]);
    }
    //BAUESデータ書き出し用の処理を加える

    //WindowをfaceにAddする
    List<Face> faceListWindow = new List<Face>();
    foreach(Face face in faceListBC){
      foreach(Window window in windowList){
        if(window.parentId == face.id){
          face.addWindows(window);
        }
      }
      faceListWindow.Add(face);
    }

    Faces = faceListBC;
    Windows = windowList;
# ---------- assignclass_2: C# additional code ----------
  private Vector3d reviseNormal(Surface srf, Room parent){
    //モデルによってはsurfaceのvectorの方向が意図と逆に向いている場合があるのでそれを修正
    Point3d centroid = parent.centroid;
    AreaMassProperties areaMp = AreaMassProperties.Compute(srf);
    Point3d centerPt = areaMp.Centroid;
    Vector3d normal = srf.NormalAt(0.5, 0.5);
    //Point3d testPt = new Point(centerPt.X + normal.X, centerPt.Y + normal.Y, centerPt.Z + normal.Z);
    Point3d testPt = centerPt + normal;
    //Print("{0}", centerPt);
    //Print("{0}", testPt);
    double baseDistance = centroid.DistanceTo(centerPt);
    double testDistance = centroid.DistanceTo(testPt);
    if (baseDistance > testDistance){
      Vector3d revNormal = new Vector3d(-normal.X, -normal.Y, -normal.Z);
      //Print("{0}", normal);
      //Print("{0}", revNormal);
      return revNormal;
    }else{
      return normal;
    }

  }
  private Face getClosestFaceFromFace(Face originFace, List<Face> Faces){
    //TはFaceかWindowとしたい。ジェネリクスがよくわかっていないので

    Face closestFace = null;
    double closestDistance = 10000;
    foreach(Face face in Faces){
      //faceがwallであればwallのみでテストする
      double distance = 10000;
      if (originFace.face == "wall" && face.face == "wall"){
        distance = originFace.centerPt.DistanceTo(face.centerPt);
        //Print("{0}", distance);
      }else if (originFace.face != "wall" && face.face != "wall"){
        distance = originFace.centerPt.DistanceTo(face.centerPt);
      }
      if (distance < closestDistance){
        closestFace = face;
        closestDistance = distance;
      }
    }
    Print("{0}", closestDistance);
    return closestFace;
  }
  private bool shootIt(Ray3d ray, List<Surface> srfs, double tol, int bounce){
    Point3d[] intersectPts = Intersection.RayShoot(ray, srfs, 1);
    //Print("{0}", intersectPts.Length);
    if (intersectPts.Length > 0){
      //Print("{0}", ray.Position.DistanceTo(intersectPts[0]));
      if (ray.Position.DistanceTo(intersectPts[0]) <= tol){
        return true;
      }else{
        return false;
      }
    }else{
      return false;
    }

  }

  //基底クラスを作成する
  public class baseGeo{
    public Guid guid;
    public int id;
    public int displayName;

    //staticコンストラクタをどう継承すべきか理解必要

  }
  //BAUES Analysis用の構造体(struct)
  /*
  struct Baues{
  public List<Zone> zones;
  }
  */

  public class Zone{
    public string name;
    public int multiplier;
    public List<SurfaceDetailed> surfaces;

    public Zone(string name){
      this.name = name;
      this.multiplier = 1;
      this.surfaces = new List<SurfaceDetailed>();
    }

    public void addSurface(SurfaceDetailed surface){
      this.surfaces.Add(surface);
    }
  }

  public class SurfaceDetailed{
    public string name;
    public SurfaceType surfaceType;
    public int surfaceTypeId; //そのsurface typeのid
    public string constructionName;
    public string boundaryCondition;
    public string boundaryConditionObject;
    public List<double> vertices;
    public List<FenestrationDetailed> windows;
    public static int _totalWalls;
    public static int _totalRoofs;
    public static int _totalCeilings;
    public static int _totalFloors;

    static SurfaceDetailed(){
      _totalWalls = 0;
      _totalRoofs = 0;
      _totalCeilings = 0;
      _totalFloors = 0;
    }

    public SurfaceDetailed(string name, Face face){

      //this.surfaceType = (SurfaceType)face.face;
      //this.boundaryCondition = face.
      this.vertices = face.bauesVertices;
      switch(face.face){
        case "wall":
          this.surfaceType = SurfaceType.Wall;
          _totalWalls += 1;
          surfaceTypeId = _totalWalls;
          break;
        case "floor":
          this.surfaceType = SurfaceType.Floor;
          _totalFloors += 1;
          surfaceTypeId = _totalFloors;
          break;
        case "roof":
          if (face.elementType == "exteriorroof"){
            this.surfaceType = SurfaceType.Roof;
            _totalRoofs += 1;
            surfaceTypeId = _totalRoofs;
            break;
          }else{
            this.surfaceType = SurfaceType.Ceiling;
            _totalCeilings += 1;
            surfaceTypeId = _totalCeilings;
            break;
          }
      }
      this.name = "room" + face.parent.id + "_" + this.surfaceType.ToString() + surfaceTypeId.ToString();
    }
  }

  public class FenestrationDetailed{
    public string name;
    public string constructionName;
    public List<double> vertices;

  }

  public enum SurfaceType{
    Wall,
    Roof,
    Ceiling,
    Floor
  }

  public enum BoundaryCondition{
    Outdoors,
    Surface,
    Ground
  }


  public class Room{
    public Guid guid;
    public int id;
    public string displayName;
    public Brep geometry;
    public Point3d centroid;
    private List<Face> _faceList;
    public static int _totalRooms;
    public BrepVertexList vertices;
    public Point3d minPt;
    public Point3d maxPt;
    public List<Face> sWalls;
    public List<Face> wWalls;
    public List<Face> nWalls;
    public List<Face> eWalls;
    public List<Face> floors;
    public List<Face> roofs;
    public double area; //new hasp用のデータ
    public double floorHeight;//階高
    public double ceilingHeight;//天井高
    public double height;//地上高

    static Room(){
      _totalRooms = 0;
    }

    public Room(Brep geometry){
      this.guid = Guid.NewGuid();
      _totalRooms += 1;
      this.id = _totalRooms;
      //this.displayName = _totalRooms;
      this._faceList = new List<Face>();
      this.geometry = geometry;
      BrepVertexList vertices = geometry.Vertices;
      this.vertices = vertices;
      this.minPt = getMinCoord(vertices);
      this.maxPt = getMaxCoord(vertices);
      this.sWalls = new List<Face>();
      this.wWalls = new List<Face>();
      this.nWalls = new List<Face>();
      this.eWalls = new List<Face>();
      this.floors = new List<Face>();
      this.roofs = new List<Face>();
      VolumeMassProperties vmp = VolumeMassProperties.Compute(geometry);
      this.centroid = vmp.Centroid;
      //BAUES Analysisへの接続用データ

    }

    public void addFace(Face face){
      _faceList.Add(face);
      //TODO: this logic should be elaborated
      if (face.face == "floor"){
        this.area = face.area;
        this.height = face.centerPt.Z;
      }else if(face.face == "wall"){
        double maxZ = 0;
        double minZ = 100;
        foreach(BrepVertex vertex in face.vertices){
          Point3d pt = vertex.Location;
          if (pt.Z > maxZ){
            maxZ = pt.Z;
          }
          if (pt.Z < minZ){
            minZ = pt.Z;
          }
        }
        this.floorHeight = maxZ - minZ;
        this.ceilingHeight = this.floorHeight - 0.1;//とりあえず
      }

    }

    public void groupChildFaces(Face face){
      if (face.face == "wall"){
        switch(face.direction){
          case "S":
            this.sWalls.Add(face);
            break;
          case "N":
            this.nWalls.Add(face);
            break;
          case "W":
            this.wWalls.Add(face);
            break;
          case "E":
            this.eWalls.Add(face);
            break;
        }
      }else if(face.face == "roof"){
        this.roofs.Add(face);
      }else if(face.face == "floor"){
        this.floors.Add(face);
      }
    }

    public List<int> getDirectionList(){
      List<int> directionList = new List<int>();
      directionList.Add(this.sWalls.Count);
      directionList.Add(this.wWalls.Count);
      directionList.Add(this.nWalls.Count);
      directionList.Add(this.eWalls.Count);
      directionList.Add(this.floors.Count);
      directionList.Add(this.roofs.Count);
      int total = this.sWalls.Count + this.wWalls.Count + this.nWalls.Count + this.eWalls.Count + this.floors.Count + this.roofs.Count;
      directionList.Add(total);

      return directionList;//[S,W,N,E,F,CR,total]
    }

    public List<Face> getFaces(){
      return _faceList;
    }

    //public static string generateDisplayName{
    //}
    private Point3d getMinCoord(BrepVertexList vertices){
      Point3d origin = new Point3d(0, 0, 0);
      int i = 0;
      int minId = 0;
      double minValue = 1000;
      foreach(BrepVertex vertex in vertices){

        Point3d checkPt = vertex.Location;
        double distance = origin.DistanceTo(checkPt);
        //Print("{0}:{1}", i, distance);
        if (distance < minValue){
          minId = i;
          minValue = distance;
        }
        i += 1;
      }
      //Print("{0}:{1}", minId, minValue);

      return vertices[minId].Location;
    }

    private Point3d getMaxCoord(BrepVertexList vertices){
      Point3d origin = new Point3d(0, 0, 0);
      int i = 0;
      int maxId = 0;
      double maxValue = -1000;
      foreach(BrepVertex vertex in vertices){

        Point3d checkPt = vertex.Location;
        double distance = origin.DistanceTo(checkPt);
        //Print("{0}:{1}", i, distance);
        if (distance > maxValue){
          maxId = i;
          maxValue = distance;
        }
        i += 1;
      }
      //Print("{0}:{1}", minId, minValue);

      return vertices[maxId].Location;
    }
  }

  public class Window{
    public Guid guid;
    public int id;
    public string displayName;
    public int parentId {get; set;}
    public Surface geometry { get; private set; }
    public Vector3d normal {get; private set;}
    public Point3d centerPt;
    public double tiltAngle;
    public int constructionId; //とりあえず外壁1,内壁2,床(室内）3,屋根4,床（地面）5, 窓6　THERBのelement Idに相当
    public double area;
    public static int _totalWindows;

    static Window(){
      _totalWindows = 0;
    }

    public Window(Surface geometry){
      this.guid = Guid.NewGuid();
      _totalWindows += 1;
      this.id = _totalWindows;
      this.geometry = geometry;
      AreaMassProperties areaMp = AreaMassProperties.Compute(geometry);
      this.centerPt = areaMp.Centroid;
      this.area = areaMp.Area;
      this.constructionId = 6;
    }
  }

  public class Face{
    public Guid guid;
    public int id;
    public int partId;
    public string displayName;
    //public faceType face{get; private set;}
    public string face{get; private set;}
    //public boundaryCondition bc{get; set;}
    public string bc{get; set;} //boundary conditionのこと
    public string elementType{get; set;}
    public int constructionId; //とりあえず外壁1,内壁2,床(室内）5,屋根4,床（地面）5, 窓6　THERBのelement Idに相当/鈴木君からもらったデータにとりあえずそろえる
    //parentとparentIdをわける
    public Room parent;
    public int parentId;
    public Surface geometry { get; private set; }
    public BrepVertexList vertices;
    public Vector3d normal {get; private set;}
    public Vector3d tempNormal;
    public Point3d centerPt;
    public double tiltAngle;
    public double area;
    public string direction;
    public double dirAngle;//新しい属性
    public int adjacencyRoomId; //隣接しているRoomのId 外気に接している場合には0
    public List<Window> windows {get; private set;}
    public List<int> windowIds;
    public static int _totalFaces;
    public static int _totalExWalls;
    public static int _totalInWalls;
    public static int _totalFlrCeilings;
    public static int _totalRoofs;
    public static int _totalGrounds;
    //BAUES Analysis用の属性
    public BoundaryCondition bauesBC;
    public int adjacencyFaceId;
    public List<double> bauesVertices;

    static Face(){
      _totalFaces = 0;
      _totalExWalls = 0;
      _totalInWalls = 0;
      _totalFlrCeilings = 0;
      _totalRoofs = 0;
      _totalGrounds = 0;
    }

    public Face(Room parent, Surface geometry, Vector3d normal, Vector3d tempNormal){
      this.guid = Guid.NewGuid();
      _totalFaces += 1;
      this.id = _totalFaces;
      //全体を通してのidとelementごとのidをつける
      this.geometry = geometry;
      this.parent = parent;
      this.parentId = parent.id;
      AreaMassProperties areaMp = AreaMassProperties.Compute(geometry);
      this.centerPt = areaMp.Centroid;
      this.area = areaMp.Area;
      this.normal = tempNormal;
      BrepVertexList vertices = geometry.ToBrep().Vertices;
      this.vertices = vertices;
      this.bauesVertices = getBauesVertices();

      //方角、床、天井を判別するためにはtempNormalを使う
      this.face = getFaceType(tempNormal);
      this.dirAngle = calcDirAngle(tempNormal);
      this.direction = defineDirection(tempNormal);

      //TODO: this logic has to be elaborated
      if (this.face == "wall"){
        this.tiltAngle = 90;
      }else{
        this.tiltAngle = 0;
      }
      this.windows = new List<Window>();
      this.windowIds = new List<int>();
    }

    private double calcDirAngle(Vector3d normal){

      Vector3d northAngle = new Vector3d(0, 1, 0);
      Vector3d westAngle = new Vector3d(-1, 0, 0);

      double angle1 = (180 / Math.PI) * (Vector3d.VectorAngle(normal, northAngle));
      double angle2 = (180 / Math.PI) * (Vector3d.VectorAngle(normal, westAngle));

      if(angle2 < 90){
        return 360 - angle1;
      }else{
        return angle1;
      }
    }

    private string defineDirection(Vector3d normal){
      if (this.face == "floor"){
        return "F";
      }else if (this.face == "roof"){
        return "CR";
      }

      Vector3d northAngle = new Vector3d(0, 1, 0);
      Vector3d westAngle = new Vector3d(-1, 0, 0);

      double angle1 = (180 / Math.PI) * (Vector3d.VectorAngle(normal, northAngle));
      double angle2 = (180 / Math.PI) * (Vector3d.VectorAngle(normal, westAngle));

      //Print("{0}:{1}", normal, angle1);

      if (angle1 < 45){
        return "N";
      }else if(angle1 == 45 && angle2 == 45){
        return "N";
      }else if (angle1 > 135){
        return "S";
      }else if(angle1 == 135 && angle2 == 135){
        return "S";
      }else if(angle2 <= 45){
        return "W";
      }else{
        return "E";
      }
    }

    public List<double> getBauesVertices(){
      List<double> bauesVertices = new List<double>();
      foreach(BrepVertex vertex in this.vertices){
        Point3d pt = vertex.Location;
        bauesVertices.Add(pt.X);
        bauesVertices.Add(pt.Y);
        bauesVertices.Add(pt.Z);
      }
      return bauesVertices;
    }

    public string getFaceType(Vector3d normal){

      //better to add filter logic for internal wall
      double Z = normal.Z;
      int roofAngle = 10;
      if (Z > Math.Cos((Math.PI / 180) * roofAngle)){
        //return faceType.roof;
        return "roof";
      }else if(Z < -Math.Cos((Math.PI / 180) * 85)){
        //return faceType.floor;
        return "floor";
      }else{
        //string direction = defineDirection(normal);
        //Print("{0}:{1}", normal, direction);
        //return faceType.wall;
        return "wall";
      }
    }

    public void addWindows(Window window){
      this.windows.Add(window);
      this.windowIds.Add(window.id);
    }

    public void setElementType(){
      string firstPhrase = "";
      if (this.bc == "outdoor"){
        firstPhrase = "exterior";
      }else{
        firstPhrase = this.bc;
      }
      this.elementType = firstPhrase + this.face;
      //partIdをアサインする
      switch(this.elementType){
        case "exteriorwall":
          _totalExWalls += 1;
          this.partId = _totalExWalls;
          break;
        case "interiorwall":
          _totalInWalls += 1;
          this.partId = _totalInWalls;
          break;
        case "interiorroof":
          _totalFlrCeilings += 1;
          this.partId = _totalFlrCeilings;
          break;
        case "interiorfloor":
          _totalFlrCeilings += 1;
          this.partId = _totalFlrCeilings;
          break;
        case "exteriorroof":
          _totalRoofs += 1;
          this.partId = _totalRoofs;
          break;
        case "groundfloor":
          _totalGrounds += 1;
          this.partId = _totalGrounds;
          break;
      }
    }

    public void setConstructionId(){
      //Print("{0}", this.elementType);
      switch(this.elementType){
        case "exteriorwall":
          this.constructionId = 1;
          break;
        case "interiorwall":
          this.constructionId = 2;
          break;
        case "interiorroof":
          this.constructionId = 3;
          break;
        case "interiorfloor":
          this.constructionId = 3;
          break;
        case "exteriorroof":
          this.constructionId = 4;
          break;
        case "groundroof":
          this.constructionId = 5;
          break;
        case "groundfloor":
          this.constructionId = 5;
          break;
      }
    }
  }

  public enum faceType{
    wall,
    roof,
    floor
  }

  public enum elementType{
    exteriorWall,
    interiorWall,
    roof,
    floor,
    groundWall,
    groundFloor
  }

  private string defineDirection(Vector3d normal){
    Vector3d northAngle = new Vector3d(0, 1, 0);
    Vector3d westAngle = new Vector3d(-1, 0, 0);

    double angle1 = (180 / Math.PI) * (Vector3d.VectorAngle(normal, northAngle));
    double angle2 = (180 / Math.PI) * (Vector3d.VectorAngle(normal, westAngle));

    //Print("{0}:{1}", normal, angle1);

    if (angle1 < 45){
      return "N";
    }else if(angle1 == 45 && angle2 == 45){
      return "N";
    }else if (angle1 > 135){
      return "S";
    }else if(angle1 == 135 && angle2 == 135){
      return "S";
    }else if(angle2 <= 45){
      return "W";
    }else{
      return "E";
    }
  }

  private Point3d getMinCoord(BrepVertexList vertices){
    Point3d origin = new Point3d(0, 0, 0);
    int i = 0;
    int minId = 0;
    double minValue = 1000;
    foreach(BrepVertex vertex in vertices){

      Point3d checkPt = vertex.Location;
      double distance = origin.DistanceTo(checkPt);
      //Print("{0}:{1}", i, distance);
      if (distance < minValue){
        minId = i;
        minValue = distance;
      }
      i += 1;
    }
    //Print("{0}:{1}", minId, minValue);

    return vertices[minId].Location;
  }

  private Point3d getMaxCoord(BrepVertexList vertices){
    Point3d origin = new Point3d(0, 0, 0);
    int i = 0;
    int maxId = 0;
    double maxValue = -1000;
    foreach(BrepVertex vertex in vertices){

      Point3d checkPt = vertex.Location;
      double distance = origin.DistanceTo(checkPt);
      //Print("{0}:{1}", i, distance);
      if (distance > maxValue){
        maxId = i;
        maxValue = distance;
      }
      i += 1;
    }
    //Print("{0}:{1}", minId, minValue);

    return vertices[maxId].Location;
  }
# ---------- end assignclass_2 ----------

python = GhPythonScript(x="5")  # -> a; same code as python
concat = Concatenate(FragmentA="INFL", FragmentB=python, FragmentD="    0      0.0               0")  # disabled
panel = Panel(concat)

list_2 = ValueList({"蛍光灯　埋め込み": 1, "蛍光灯　直付け": 2, "蛍光灯　吊り下げ": 3, "白熱灯　埋め込み": 4, "白熱灯　直付け": 5, "白熱灯　吊り下げ": 6}, selected="白熱灯　吊り下げ")
list_3 = ValueList({"W/㎡": 1, "ｋW": 2}, selected="ｋW")
python_2 = GhPythonScript(x="6")  # -> a; same code as python
python_3 = GhPythonScript(x="1")  # -> a; same code as python
python_4 = GhPythonScript(x="5")  # -> a; same code as python
python_5 = GhPythonScript(x=list_2)  # -> a
# ---------- python_5: Python ----------
__author__ = "81803"
__version__ = "2021.06.22"

import rhinoscriptsyntax as rs
x = str(x)
y = len(x)
z = " "
q = 3 - y
a = z*q+x
# ---------- end python_5 ----------
python_6 = GhPythonScript(x="20")  # -> a
# ---------- python_6: Python ----------
__author__ = "81803"
__version__ = "2021.06.22"

import rhinoscriptsyntax as rs
x = str(x)
y = len(x)
z = " "
q = 6 - y
a = z*q+x
# ---------- end python_6 ----------
python_7 = GhPythonScript(x=list_3)  # -> a; same code as python_5
concat_2 = Concatenate(
    FragmentA="LIGH",
    FragmentB=python_3,
    FragmentC="MtoF",
    FragmentD=python_4,
    FragmentE=python_5,
    FragmentF=python_6,
    FragmentG=python_7,
    FragmentH=python_2,
    FragmentI="   400")
panel_2 = Panel(concat_2)

list_4 = ValueList({"家": 0, "学校": 1, "オフィス": 2, "劇場": 3, "店": 4}, selected="オフィス")
python_8 = GhPythonScript(x=list_4)  # -> a
# ---------- python_8: Python ----------
__author__ = "81803"
__version__ = "2021.07.22"

import rhinoscriptsyntax as rs
x = str(x)
if x =="2":
    a1 = "    40    80"
else:
    a1 = "ごめんなさい、まだ対応してません"
a = a1
# ---------- end python_8 ----------
python_9 = GhPythonScript(x="10")  # -> a; same code as python
concat_3 = Concatenate(FragmentA="FURN", FragmentB=python_9, FragmentC=python_8)

list_5 = ValueList({"構造を選択": 0, "木造": 1, "RC": 2}, selected="RC")
list_6 = ValueList({"家": 0.3, "学校": 0.2, "オフィス": 0.6, "劇場": 0.05, "店": 0.4}, selected="家")

list_7 = ValueList({"自然冷却": 1, "強制冷却": 2}, selected="自然冷却")
list_8 = ValueList({"白熱灯": 100, "蛍光灯": 90, "LED": 40}, selected="LED")
パソコン何台使うか = Panel("4")
python_10 = GhPythonScript(x="5")  # -> a; same code as python
python_11 = GhPythonScript(x="1")  # -> a; same code as python
int = Integer(パソコン何台使うか)
division = Division(A=list_8, B="100")
python_12 = GhPythonScript(x=list_7)  # -> a; same code as python_5
multiplication = Multiplication(A=int, B=200, C=list_6)
division_2 = Division(A=multiplication)
ma = MassAddition(Input=[division, division_2])  # -> Result, PartialResults
小数点変更 = GhPythonScript(x=ma.Result)  # -> a
# ---------- 小数点変更: Python ----------
__author__ = "81803"
__version__ = "2021.07.04"

import rhinoscriptsyntax as rs
x = float(x)
a = ('{:.1f}'.format(x))
# ---------- end 小数点変更 ----------
python_13 = GhPythonScript(x=小数点変更)  # -> a; same code as python_6
concat_4 = Concatenate(
    FragmentA="HEAT",
    FragmentB=python_11,
    FragmentC="MtoF",
    FragmentD=python_10,
    FragmentE=python_12,
    FragmentF=python_13,
    FragmentG="     0",
    FragmentH="  1")

fin = Data(0)
panel_3 = Panel(python)
ジョブ名_テスト名を入れてください = Panel("     Ventilation test 001")
getwindowproperties = CSharpScript(Windows=assignclass_2.Windows)  # -> out, ids, geometries, areas, tiltAngles, constructionIds
# ---------- getwindowproperties: C# usings ----------
using System.Reflection;
using Rhino.Geometry.Intersect;
using System.Linq;
# ---------- getwindowproperties: C# ----------
    if (Windows == null) return;
    MethodInfo geometryGetter = Windows.GetType().GetProperty("geometry").GetGetMethod();
    Surface geometry = geometryGetter.Invoke(Windows, null) as Surface;
    double area = (double) Windows.GetType().GetField("area").GetValue(Windows);
    double angle = (double) Windows.GetType().GetField("tiltAngle").GetValue(Windows);
    int constructionId = (int) Windows.GetType().GetField("constructionId").GetValue(Windows);
    int id = (int) Windows.GetType().GetField("id").GetValue(Windows);
    
    ids = id;
    geometries = geometry;
    areas = Math.Round(area, 2);
    tiltAngles = angle;
    constructionIds = constructionId;
# ---------- end getwindowproperties ----------
# 室用データ
getroomproperties = CSharpScript(Rooms=assignclass_2.Room)  # -> out, ids, minPts, maxPts, sCount, wCount, nCount, eCount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
# ---------- getroomproperties: C# ----------
    if (Rooms == null) return;
    FieldInfo idField = Rooms.GetType().GetField("id");
    int id = (int) idField.GetValue(Rooms);

    FieldInfo minPtField = Rooms.GetType().GetField("minPt");
    Point3d minPoint = (Point3d) minPtField.GetValue(Rooms);

    var type = Type.GetType("ExternalType");
    // Lookup the method
    var directionsGetter = Rooms.GetType().GetMethod("getDirectionList");
    Print("{0}", directionsGetter);

    //TODO:Listで返す方法がうまくいかない
    List<int> directions = (List<int>) directionsGetter.Invoke(Rooms, null);
    //Print("{0}", directions[0]);
    //MethodInfo sWallGetter = Rooms.GetType().GetProperty("sWalls").GetGetMethod();
    //List<Face> sWall = (List<Face>) sWallGetter.Invoke(Rooms, null);

    ids = id;
    minPts = minPoint;
    sCount = directions[0];
    wCount = directions[1];
    nCount = directions[2];
    eCount = directions[3];
    fCount = directions[4];
    crCount = directions[5];
    totalCount = directions[6];
    //sWalls = swall;
    //direcitonList = direcitons;
# ---------- end getroomproperties ----------
# areas:面積
# height: 地上高
# floorHeight:階高
# ceilingHeight:天井高
getroomproperties_2 = CSharpScript(Rooms=assignclass_2.Room)  # -> out, ids, minPts, maxPts, sCount, wCount, nCount, eCount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
# ---------- getroomproperties_2: C# ----------
    if (Rooms == null) return;
    FieldInfo idField = Rooms.GetType().GetField("id");
    int id = (int) idField.GetValue(Rooms);

    FieldInfo minPtField = Rooms.GetType().GetField("minPt");
    Point3d minPoint = (Point3d) minPtField.GetValue(Rooms);

    var type = Type.GetType("ExternalType");
    // Lookup the method
    var directionsGetter = Rooms.GetType().GetMethod("getDirectionList");
    Print("{0}", directionsGetter);

    double area = (double) Rooms.GetType().GetField("area").GetValue(Rooms);
    double height = (double) Rooms.GetType().GetField("height").GetValue(Rooms);
    double floorHeight = (double) Rooms.GetType().GetField("floorHeight").GetValue(Rooms);
    double ceilingHeight = (double) Rooms.GetType().GetField("ceilingHeight").GetValue(Rooms);

    //TODO:Listで返す方法がうまくいかない
    List<int> directions = (List<int>) directionsGetter.Invoke(Rooms, null);
    //Print("{0}", directions[0]);
    //MethodInfo sWallGetter = Rooms.GetType().GetProperty("sWalls").GetGetMethod();
    //List<Face> sWall = (List<Face>) sWallGetter.Invoke(Rooms, null);

    ids = id;
    minPts = minPoint;
    sCount = directions[0];
    wCount = directions[1];
    nCount = directions[2];
    eCount = directions[3];
    fCount = directions[4];
    crCount = directions[5];
    totalCount = directions[6];
    areas = area;
    heights = Math.Round(height,3);
    floorHeights = Math.Round(floorHeight,3);
    ceilingHeights = Math.Round(ceilingHeight,3);
    //sWalls = swall;
    //direcitonList = direcitons;
# ---------- end getroomproperties_2 ----------

# ----
# dirAngles:方角情報
# adjacencyRoomIds:接している室id
getfaceproperties = CSharpScript(Faces=assignclass_2.Faces)  # -> out, Face, geometries, simplify(ids), simplify(windowIds), centerPts, tiltAngles, areas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
# ---------- getfaceproperties: C# ----------
    if (Faces == null) return;
    MethodInfo elementTypeGetter = Faces.GetType().GetProperty("elementType").GetGetMethod();
    string elementType = elementTypeGetter.Invoke(Faces, null) as string;
    FieldInfo idField = Faces.GetType().GetField("id");
    int id = (int) idField.GetValue(Faces);
    FieldInfo windowIdField = Faces.GetType().GetField("windowIds");
    List<int> windowId = (List<int>) windowIdField.GetValue(Faces);
    FieldInfo centerPtField = Faces.GetType().GetField("centerPt");
    Point3d centerPt = (Point3d) centerPtField.GetValue(Faces);
    double tiltAngle = (double) Faces.GetType().GetField("tiltAngle").GetValue(Faces);
    double area = (double) Faces.GetType().GetField("area").GetValue(Faces);
    MethodInfo geoGetter = Faces.GetType().GetProperty("geometry").GetGetMethod();
    Surface geo = geoGetter.Invoke(Faces, null) as Surface;
    int partId = (int) Faces.GetType().GetField("partId").GetValue(Faces);
    string direction = (string) Faces.GetType().GetField("direction").GetValue(Faces);
    double dirAngle = (double) Faces.GetType().GetField("dirAngle").GetValue(Faces);
    int adjacencyRoomId = (int) Faces.GetType().GetField("adjacencyRoomId").GetValue(Faces);

    geometries = geo;
    ids = id;
    windowIds = windowId;
    centerPts = centerPt;
    tiltAngles = tiltAngle;
    areas = area;
    Face = Faces;
    partIds = partId;
    elementTypes = elementType;
    directions = direction;
    dirAngles = dirAngle;
    adjacencyRoomIds = adjacencyRoomId;
# ---------- end getfaceproperties ----------

getfaceproperties_2 = CSharpScript(Faces=assignclass.Faces, element="groundfloor")  # -> out, Face, geometries, simplify(ids), simplify(windowIds), centerPts, tiltAngles, areas, directions; inputs element: String
# ---------- getfaceproperties_2: C# ----------
    if (Faces == null) return;
    MethodInfo elementTypeGetter = Faces.GetType().GetProperty("elementType").GetGetMethod();
    string elementType = elementTypeGetter.Invoke(Faces, null) as string;
    //Print("{0}", elementType);
    if (elementType == element){
      FieldInfo idField = Faces.GetType().GetField("id");
      int id = (int) idField.GetValue(Faces);
      FieldInfo windowIdField = Faces.GetType().GetField("windowIds");
      List<int> windowId = (List<int>) windowIdField.GetValue(Faces);
      FieldInfo centerPtField = Faces.GetType().GetField("centerPt");
      Point3d centerPt = (Point3d) centerPtField.GetValue(Faces);
      double tiltAngle = (double) Faces.GetType().GetField("tiltAngle").GetValue(Faces);
      double area = (double) Faces.GetType().GetField("area").GetValue(Faces);
      string direction = (string) Faces.GetType().GetField("direction").GetValue(Faces);
      MethodInfo geoGetter = Faces.GetType().GetProperty("geometry").GetGetMethod();
      Surface geo = geoGetter.Invoke(Faces, null) as Surface;

      geometries = geo;
      ids = id;
      windowIds = windowId;
      centerPts = centerPt;
      directions = direction;
      tiltAngles = tiltAngle;
      areas = area;
      Face = Faces;
    }
# ---------- end getfaceproperties_2 ----------
# EXPS_完成(要検討)
getwindowproperties_2 = CSharpScript(Windows=assignclass.Windows)  # -> out, geometries, areas, tiltAngles, constructionIds
# ---------- getwindowproperties_2: C# ----------
    if (Windows == null) return;
    MethodInfo geometryGetter = Windows.GetType().GetProperty("geometry").GetGetMethod();
    Surface geometry = geometryGetter.Invoke(Windows, null) as Surface;
    double area = (double) Windows.GetType().GetField("area").GetValue(Windows);
    double angle = (double) Windows.GetType().GetField("tiltAngle").GetValue(Windows);
    int constructionId = (int) Windows.GetType().GetField("constructionId").GetValue(Windows);

    geometries = geometry;
    areas = Math.Round(area, 2);
    tiltAngles = angle;
    constructionIds = constructionId;
# ---------- end getwindowproperties_2 ----------
getfaceproperties_3 = CSharpScript(Faces=assignclass.Faces, element="exteriorwall")  # -> out, Face, geometries, simplify(ids), simplify(windowIds), centerPts, tiltAngles, areas, directions; inputs element: String; same code as getfaceproperties_2
getfaceproperties_4 = CSharpScript(Faces=assignclass.Faces, element="interiorwall")  # -> out, Face, geometries, simplify(ids), simplify(windowIds), centerPts, tiltAngles, areas, directions; inputs element: String; same code as getfaceproperties_2
getfaceproperties_5 = CSharpScript(Faces=assignclass.Faces, element="interiorroof")  # -> out, Face, geometries, simplify(ids), simplify(windowIds), centerPts, tiltAngles, areas, directions; inputs element: String; same code as getfaceproperties_2
getfaceproperties_6 = CSharpScript(Faces=assignclass.Faces, element="exteriorroof")  # -> out, Face, geometries, simplify(ids), simplify(windowIds), centerPts, tiltAngles, areas, directions; inputs element: String; same code as getfaceproperties_2
getfaceproperties_7 = CSharpScript(Faces=assignclass.Faces, element="interiorfloor")  # -> out, Face, geometries, simplify(ids), simplify(windowIds), centerPts, tiltAngles, areas, directions; inputs element: String; same code as getfaceproperties_2
exps_other = EXPS_other(
    geometory_ids=getfaceproperties_2.ids,
    tiltangle=getfaceproperties.tiltAngles,
    geo=getfaceproperties_2.geometries,
    dirangle=getfaceproperties.dirAngles,
    element="groundfloor")  # -> result, area
exps_window = EXPS_Window(
    exwall_geo=getfaceproperties_3.geometries,
    window_id=getfaceproperties_3.windowIds,
    tiltangle=getfaceproperties.tiltAngles,
    dirangle=getfaceproperties.dirAngles,
    window_geo=getwindowproperties_2.geometries)  # -> result, y2, x1_x3, 面積
exps_other_2 = EXPS_other(
    geometory_ids=getfaceproperties_3.ids,
    tiltangle=getfaceproperties.tiltAngles,
    geo=getfaceproperties_3.geometries,
    dirangle=getfaceproperties.dirAngles,
    element="exteriorwall")  # -> result, area
exps_other_3 = EXPS_other(
    geometory_ids=getfaceproperties_4.ids,
    tiltangle=getfaceproperties.tiltAngles,
    geo=getfaceproperties_4.geometries,
    dirangle=getfaceproperties.dirAngles,
    element="interiorwall")  # -> result, area
exps_other_4 = EXPS_other(
    geometory_ids=getfaceproperties_5.ids,
    tiltangle=getfaceproperties.tiltAngles,
    geo=getfaceproperties_5.geometries,
    dirangle=getfaceproperties.dirAngles,
    element="interiorroof")  # -> result, area
exps_other_5 = EXPS_other(
    geometory_ids=getfaceproperties_6.ids,
    tiltangle=getfaceproperties_6.tiltAngles,
    geo=getfaceproperties_6.geometries,
    dirangle=getfaceproperties.dirAngles,
    element="exteriorroof")  # -> result, area
exps_other_6 = EXPS_other(
    geometory_ids=getfaceproperties_7.ids,
    tiltangle=getfaceproperties.tiltAngles,
    geo=getfaceproperties_7.geometries,
    dirangle=getfaceproperties.dirAngles,
    element="interiorfloor")  # -> result, area
panel_4 = Panel(exps_window.result)
panel_5 = Panel(exps_other_2.result)
panel_6 = Panel(exps_other_3.result)
panel_7 = Panel(exps_other_4.result)
panel_8 = Panel(exps_other_5.result)
panel_9 = Panel(exps_other_6.result)
panel_10 = Panel(exps_other.result)

debrep = DeconstructBrep(Brep=getfaceproperties_3.geometries)  # -> Faces, Edges, Vertices
cluster = Cluster_9(観測点=debrep.Vertices)  # -> flatten(X_2), flatten(Y_2), flatten(Z_2), flatten(X), flatten(Y), flatten(Z)
sort = SortList(Keys=cluster.Z)  # -> Keys, ValuesA
item = ListItem(List=sort.Keys, Index=0, Wrap=True)  # -> Item1, Item
list_9 = ValueList({"北海道": 0, "東京": 1, "名古屋": 2, "大阪": 3, "広島": 4, "福岡": 5, "鹿児島": 6}, selected="北海道")
敷地の地面 = ValueList({"草": 9, "裸の地面": 15, "黒土": 11, "雪": 82, "アスファルト": 9}, selected="草")
python_14 = GhPythonScript(x=list_9)  # -> a
# ---------- python_14: Python ----------
__author__ = "moritayuutarou"

import rhinoscriptsyntax as rs

x = str(x)
if x == "0":
    a1 = "43.081"
elif x == "1":
    a1 = "35.680"
elif x == "2":
    a1 = "35.171"
elif x == "3":
    a1 = "34.702"
elif x == "4":
    a1 = "33.602"
elif x == "5":
    a1 = "34.396"
else:
    a1 = "aaaaa"
a = a1
# ---------- end python_14 ----------
python_15 = GhPythonScript(x=python_14)  # -> a
# ---------- python_15: Python ----------
__author__ = "moritayuutarou"

import rhinoscriptsyntax as rs

x = str(x)
if x == "43.081":
    a1 = "141.34"
elif x == "35.680":
    a1 = "139.76"
elif x == "35.171":
    a1 = "136.88"
elif x == "34.702":
    a1 = "135.49"
elif x == "33.602":
    a1 = "130.26"
elif x == "34.396":
    a1 = "132.47"
else:
    a1 = "aaaaa"
a = a1
# ---------- end python_15 ----------
限界日射取得_w_６桁以内 = Panel("0")
軒高_m_６桁以内 = Panel(item.Item1)
設定温湿度_25度_50 = Panel("1")
緯度_6桁以内 = Panel(python_14)
緯度_６桁以内 = Panel(python_15)
python_16 = GhPythonScript(x=緯度_6桁以内)  # -> a; same code as python_2
python_17 = GhPythonScript(x=緯度_６桁以内)  # -> a; same code as python_2
python_18 = GhPythonScript(x=軒高_m_６桁以内)  # -> a; same code as python_2
python_19 = GhPythonScript(x=設定温湿度_25度_50)  # -> a, b
# ---------- python_19: Python ----------
__author__ = "81803"
__version__ = "2021.06.22"

import rhinoscriptsyntax as rs
x1 = int(x)
if x1 == 1:
    xx = "24"
    xy = "50"
else:
    xx = "22.5"
    xy = "50"

y0 = len(xx)
y1 = len(xy)
z = " "
q = 6 - y0
r = 6 - y1
a = z*q+xx
b = z*r+xy
# ---------- end python_19 ----------
python_20 = GhPythonScript(x=敷地の地面)  # -> a; same code as python
python_21 = GhPythonScript(x=限界日射取得_w_６桁以内)  # -> a; same code as python_2
python_22 = GhPythonScript(x="7")  # -> a; same code as python
python_23 = GhPythonScript(x="27")  # -> a; same code as python
concat_5 = Concatenate(
    FragmentA="BUIL",
    FragmentB=python_22,
    FragmentC=python_16,
    FragmentD=python_17,
    FragmentE=python_18,
    FragmentF=python_20,
    FragmentG=python_19.a,
    FragmentH=python_19.b,
    限界日射取得量W=python_21,
    FragmentJ=python_23)
panel_11 = Panel(concat_5)

txt = Text(flatten(getroomproperties_2.areas))
lng = ListLength(List=txt)
人 = Slider(4, range=0..10)
txt_2 = Text(simplify(flatten(getroomproperties_2.areas)))
txt_3 = Text(人)
series = Series(Start="1", Step="1", Count=lng)
cluster_2 = Cluster_13(人数=txt_3, 床面積=txt_2)
concat_6 = Concatenate(
    B="OPCO ",
    C="opc",
    A=series,
    OPCO導入="   10 20 20   ",
    夏季冬季中間期="  8 26 26 50 50  0  8 22 22 40 40  0  8 24 24 50 50",
    外気量=cluster_2)  # -> flatten(Result)
panel_12 = Panel(concat_6)

list_10 = ValueList({"静座": 1, "軽作業": 2, "軽い走行": 3, "立つ座る歩く": 4, "座学": 5, "着席作業": 6, "ダンス": 7}, selected="静座")
python_24 = GhPythonScript(x="5")  # -> a; same code as python
python_25 = GhPythonScript(x="1")  # -> a; same code as python
python_26 = GhPythonScript(x=list_10)  # -> a; same code as python_5
txt_4 = Text(txt_3)
python_27 = GhPythonScript(x=txt_4)  # -> a; same code as python_6
concat_7 = Concatenate(
    FragmentA="OCUP",
    FragmentB=python_25,
    FragmentC="MtoF",
    FragmentD=python_24,
    FragmentE=python_26,
    FragmentF=python_27,
    FragmentG="  2")

txt_5 = Text("    ")
dup = DuplicateData(Data=txt_5, Number=lng, Order="False")  # -> simplify(graft(Data))
panel_13 = Panel(dup)

concat_8 = Concatenate(FragmentA="opc", FragmentB=series)
python_28 = GhPythonScript()  # -> a, b
# ---------- python_28: Python ----------
__author__ = "81803"
__version__ = "2021.07.22"

import rhinoscriptsyntax as rs

a = "SOPC "
b = "     100   100   100   100      "
# ---------- end python_28 ----------
concat_9 = Concatenate(FragmentA=python_28.a, FragmentC=concat_8, FragmentB=python_28.b)  # -> simplify(graft(Result))
panel_14 = Panel(concat_9)

内壁の厚さ = Panel("100")
外壁の厚さ_柱含む_mm = Panel("250")
柱太さ_mm = Panel("160")
list_11 = ValueList({"外壁を選択": 0, "窯業": 31, "金属": 6, "モルタル": 27, "木質系": 52}, selected="外壁を選択")
cluster_3 = Cluster_14(外表面=list_11, 構造決定=list_5, 外壁厚さ=外壁の厚さ_柱含む_mm, 内壁=内壁の厚さ, 柱=柱太さ_mm)
panel_15 = Panel(cluster_3)

python_29 = GhPythonScript(x="7")  # -> a; same code as python
concat_10 = Concatenate(FragmentA="HRAT", FragmentB=python_29, FragmentC="100100100100100100100100100")
panel_16 = Panel(concat_10)

data = Data(flatten([panel_4, panel_5, panel_6, panel_7, panel_8, panel_9, panel_10]))

計算目的を選択 = ValueList({"計算目的を選択": "計算目的", "ノーマル": 0, "熱負荷計算": 1}, selected="ノーマル")
計算量 = ValueList({"簡易": 0, "詳細": 1}, selected="簡易")
日 = Slider(1, range=1..31)
日_2 = Slider(31, range=1..31)
月 = Slider(12, range=1..12)
日_3 = Slider(15, range=1..31)
月_2 = Slider(1, range=1..12)
月_3 = Slider(12, range=1..12)
list_12 = ValueList({"×0.01MJ/㎡h": 0, "kcal/㎡h": 1}, selected="×0.01MJ/㎡h")
cluster_4 = Cluster_12(txt=月_3, txt_2=日_2)
cluster_5 = Cluster_12(txt=月, txt_2=日_3)
cluster_6 = Cluster_12(txt=月_2, txt_2=日)
cluster_7 = Cluster_15(x=list_12, x_2=計算目的を選択, x_3=計算量, 助走開始=cluster_5, 計算開始=cluster_6, 計算終了=cluster_4)
panel_17 = Panel(cluster_7)

panel_18 = Panel(data)
dup_2 = DuplicateData(Data=concat_3, Number=lng, Order="False")  # -> simplify(graft(Data))
dup_3 = DuplicateData(Data=panel, Number=lng, Order="False")  # -> simplify(graft(Data))
panel_19 = Panel("   10 20 20            ")
dup_4 = DuplicateData(Data=panel_2, Number=lng, Order="False")  # -> simplify(graft(Data))
dup_5 = DuplicateData(Data=concat_7, Number=lng, Order="False")  # -> simplify(graft(Data))
lng_2 = ListLength()
panel_20 = Panel(dup_3)

# ---- group: ここが大事
data_2 = Data(simplify(graft(getroomproperties_2.ids)))
groupfacepropertiesbyroom = CSharpScript(Faces=assignclass.Faces, parentId=data_2)  # -> out, Face, geometries, simplify(ids), simplify(windowIds), centerPts, tiltAngles, areas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; inputs parentId: Int32
# ---------- groupfacepropertiesbyroom: C# ----------
    if (Faces == null) return;
    int parent = (int) Faces.GetType().GetField("parent").GetValue(Faces);
    if (parent == parentId){
      FieldInfo idField = Faces.GetType().GetField("id");
      int id = (int) idField.GetValue(Faces);
      FieldInfo windowIdField = Faces.GetType().GetField("windowIds");
      List<int> windowId = (List<int>) windowIdField.GetValue(Faces);
      FieldInfo centerPtField = Faces.GetType().GetField("centerPt");
      Point3d centerPt = (Point3d) centerPtField.GetValue(Faces);
      double tiltAngle = (double) Faces.GetType().GetField("tiltAngle").GetValue(Faces);
      double area = (double) Faces.GetType().GetField("area").GetValue(Faces);
      MethodInfo geoGetter = Faces.GetType().GetProperty("geometry").GetGetMethod();
      Surface geo = geoGetter.Invoke(Faces, null) as Surface;
      string direction = (string) Faces.GetType().GetField("direction").GetValue(Faces);
      int elementId = (int) Faces.GetType().GetField("constructionId").GetValue(Faces);
      int adjacencyId = (int) Faces.GetType().GetField("adjacencyId").GetValue(Faces);
      MethodInfo elementTypeGetter = Faces.GetType().GetProperty("elementType").GetGetMethod();
      string elementType = elementTypeGetter.Invoke(Faces, null) as string;
      Print("{0}", elementType);

      geometries = geo;
      ids = id;
      windowIds = windowId;
      centerPts = centerPt;
      tiltAngles = tiltAngle;
      areas = area;
      Face = Faces;
      directions = direction;
      elementIds = elementId;
      adjacencyIds = adjacencyId;
      elementTypes = elementType;
    }
# ---------- end groupfacepropertiesbyroom ----------
getfaceproperties_8 = CSharpScript(Faces=groupfacepropertiesbyroom.Face, element="exteriorwall")  # -> out, Face, simplify(geometries), simplify(ids), simplify(windowIds), centerPts, tiltAngles, areas, directions; inputs element: String; same code as getfaceproperties_2
getfaceproperties_9 = CSharpScript(Faces=groupfacepropertiesbyroom.Face, element="exteriorroof")  # -> out, Face, simplify(geometries), simplify(ids), simplify(windowIds), centerPts, tiltAngles, areas, directions; inputs element: String; same code as getfaceproperties_2

# ----
panel_21 = Panel(dup_4)
panel_22 = Panel(dup_2)
panel_23 = Panel(dup_5)
dup_6 = DuplicateData(Data=concat_4, Number=lng, Order="False")  # -> simplify(graft(Data))
panel_24 = Panel(dup_6)
panel_25 = Panel(getwindowproperties.geometries)
panel_26 = Panel(getwindowproperties.ids)
getfaceproperties_10 = CSharpScript(Faces=groupfacepropertiesbyroom.Face, element="interiorfloor")  # -> out, Face, geometries, simplify(ids), simplify(windowIds), centerPts, tiltAngles, areas, directions; inputs element: String; same code as getfaceproperties_2
getfaceproperties_11 = CSharpScript(Faces=groupfacepropertiesbyroom.Face, element="groundfloor")  # -> out, Face, geometries, simplify(ids), simplify(windowIds), centerPts, tiltAngles, areas, directions; inputs element: String; same code as getfaceproperties_2
getfaceproperties_12 = CSharpScript(Faces=groupfacepropertiesbyroom.Face, element="interiorwall")  # -> out, Face, geometries, simplify(ids), simplify(windowIds), centerPts, tiltAngles, areas, directions; inputs element: String; same code as getfaceproperties_2
getfaceproperties_13 = CSharpScript(Faces=groupfacepropertiesbyroom.Face, element="interiorroof")  # -> out, Face, geometries, simplify(ids), simplify(windowIds), centerPts, tiltAngles, areas, directions; inputs element: String; same code as getfaceproperties_2

list_13 = ValueList({"内装仕上げの色を選択してください": 0, "明色": 1, "中等色": 2, "暗色": 3}, selected="中等色")
cluster_8 = Cluster_24(exps_result=panel_5, Element_ids=getfaceproperties_8.ids)  # -> owal_exps, number
lng_3 = ListLength(List=getroomproperties_2.ids)
series_2 = Series(Start="1", Step="1", Count=lng_3)  # -> simplify(Series)
python_30 = GhPythonScript(x=getroomproperties_2.heights)  # -> a; same code as python
python_31 = GhPythonScript(x=getroomproperties_2.floorHeights)  # -> a; same code as python
python_32 = GhPythonScript(x=getroomproperties_2.ceilingHeights)  # -> a; same code as python
python_33 = GhPythonScript(x=getroomproperties_2.areas)  # -> a; same code as python
python_34 = GhPythonScript(x=list_13)  # -> a; same code as python_5
python_35 = GhPythonScript(x=series_2)  # -> a; inputs x: Int32
# ---------- python_35: Python ----------
__author__ = "81803"
__version__ = "2022.03.04"

import rhinoscriptsyntax as rs
"""Provides a scripting component.
    Inputs:
        x: The x script variable
        y: The y script variable
    Output:
        a: The a output variable"""

__author__ = "81803"
__version__ = "2022.03.04"

import rhinoscriptsyntax as rs
x=str(x)
x1=len(x)
print 
x2=3-x1
x3="_"*x2
#y=str(y)
#y1=y[0]
#y2=y1.upper()
#print y2
#x4=y2+x3+str(x)
#a=x4
#    a=()
#else:
#    a=x4
#    a=x4+"  "
a="S"+x3+x
# ---------- end python_35 ----------
python_36 = GhPythonScript(x=python_30)  # -> a; same code as python_2
python_37 = GhPythonScript(x=python_31)  # -> a; same code as python_2
python_38 = GhPythonScript(x=python_32)  # -> a; same code as python_2
python_39 = GhPythonScript(x=python_33)  # -> a; same code as python_2
panel_27 = Panel("aaaaaa")
concat_11 = Concatenate(
    FragmentA="SPAC ",
    FragmentB=simplify(graft(python_35)),
    FragmentA_2="WS01 ",
    FragmentA_3=simplify(graft(python_36)),
    FragmentA_4=simplify(graft(python_37)),
    FragmentA_5=simplify(graft(python_38)),
    FragmentA_6=python_34,
    FragmentA_7="        ",
    FragmentA_8=simplify(graft(python_39)))

panel_28 = Panel(concat_11)
cluster_9 = Cluster_24(exps_result=exps_other.result, Element_ids=getfaceproperties_11.ids)  # -> owal_exps, number

data_3 = Data(flatten([exps_other_3.area, exps_other_2.area, exps_other_4.area, exps_other_5.area, exps_other_6.area, exps_other.area]))
data_4 = Data(cluster_9.number)
python_40 = GhPythonScript(x="32")  # -> a; same code as python
item_2 = ListItem(List=data_3, Index=data_4, Wrap=True)
concat_12 = Concatenate(FragmentA="GWAL ", FragmentB=" GWA", FragmentA_2=python_40, FragmentE=item_2)  # -> flatten(Result)
panel_29 = Panel(concat_12)

cluster_10 = Cluster_24(exps_result=exps_other_6.result, Element_ids=getfaceproperties_10.ids)  # -> owal_exps, number
cluster_11 = Cluster_24(exps_result=exps_other_3.result, Element_ids=getfaceproperties_12.ids)  # -> owal_exps, number
cluster_12 = Cluster_24(exps_result=exps_other_4.result, Element_ids=getfaceproperties_13.ids)  # -> owal_exps, number

toggle = BooleanToggle(True)
data_5 = Data(groupfacepropertiesbyroom.adjacencyIds)
clean = CleanTree(RemoveNulls=toggle, RemoveInvalid=toggle, RemoveEmpty=toggle, Tree=data_5)  # -> flatten(Tree)
data_6 = Data(flatten([exps_other_3.area, exps_other_2.area, exps_other_4.area, exps_other_5.area, exps_other_6.area, exps_other.area]))
data_7 = Data([cluster_11.number, cluster_12.number, cluster_10.number])
item_3 = ListItem(List=data_6, Index=data_7, Wrap=True)
item_4 = ListItem(List=clean, Index=data_7, Wrap=True)
python_41 = GhPythonScript(x=item_4)  # -> a; inputs x: Int32; same code as python_35
python_42 = GhPythonScript(x="17")  # -> a; same code as python
panel_30 = Panel(item_3)
concat_13 = Concatenate(
    FragmentA="IWAL ",
    FragmentB=" IWA",
    FragmentC="    3      ",
    FragmentB_2=python_41,
    FragmentD=python_42,
    FragmentE=panel_30)
panel_31 = Panel(concat_13)

cluster_13 = Cluster_24(exps_result=exps_other_5.result, Element_ids=getfaceproperties_9.ids)  # -> owal_exps, number
cluster_14 = Cluster_24(exps_result=exps_other_2.result, Element_ids=getfaceproperties_8.ids)  # -> owal_exps, number
panel_32 = Panel(cluster_11.owal_exps)
panel_33 = Panel(cluster_9.owal_exps)
panel_34 = Panel(cluster_10.owal_exps)
panel_35 = Panel(cluster_14.owal_exps)
panel_36 = Panel(cluster_13.owal_exps)
panel_37 = Panel(cluster_12.owal_exps)
concat_14 = Concatenate(FragmentB=" OWA", FragmentA=panel_36)
merge = Merge(Data1=panel_32, Data2=panel_37, Data3=panel_34)
concat_15 = Concatenate(FragmentC=" OWA", FragmentA=panel_35)
merge_2 = Merge(Data1=concat_15, Data2=concat_14)

# ----
# Room0には、この壁があることはHASPで認識可能
data_8 = Data(flatten([exps_other_3.area, exps_other_2.area, exps_other_4.area, exps_other_5.area, exps_other_6.area, exps_other.area]))
owal_exps = Panel(merge_2)
item_5 = ListItem(List=data_8, Index=[cluster_14.number, cluster_13.number], Wrap=True)
panel_38 = Panel(item_5)
list_14 = ValueList({"明色": 0, "黒": 1, "コンクリート": 3, "中等色": 4, "白タイル": 5, "光沢　アルミ": 6, "白ペイント": 7}, selected="明色")
txt_6 = Text(list_14)
python_43 = GhPythonScript(x=txt_6)  # -> a
# ---------- python_43: Python ----------
__author__ = "81803"
__version__ = "2021.07.19"

import rhinoscriptsyntax as rs

x = str(x)
if x =="0":
    q = " 72 90"
elif x =="1":
    q = " 90 95"
elif x =="3":
    q = " 90 95"
elif x =="4":
    q = " 60 90"
elif x =="5":
    q = " 40 90"
elif x =="6":
    q = " 40 50"
elif x =="7":
    q = " 35 92"
else:
    q = ""
a = q
# ---------- end python_43 ----------
cluster_15 = Cluster_16()
concat_16 = Concatenate(
    FragmentA="OWAL",
    FragmentA_2=" ",
    FragmentC=owal_exps,
    FragmentD=" ",
    FragmentE=python_43,
    FragmentF="  0",
    FragmentG=cluster_15,
    FragmentH=panel_38)
panel_39 = Panel(concat_16)

iwal_exps = Panel(merge)
data_9 = Data(flatten([exps_other_3.area, exps_other_2.area, exps_other_4.area, exps_other_5.area, exps_other_6.area, exps_other.area]))
item_6 = ListItem(List=data_9, Index=0, Wrap=True)
panel_40 = Panel(item_6)
cluster_16 = Cluster_19(
    job名=ジョブ名_テスト名を入れてください,
    buil=panel_11,
    cntl=panel_17,
    hrat=panel_16,
    exps=panel_18,
    wcon=cluster_3,
    seas="SEAS         2  2  2  3  3  1  1  1  1  3  3  2",
    wsch="WSCH WS01    1  1  1  1  1  2  2  2  2",
    dsch="DSCH MtoF    9100 18 50 21 10 23",
    dsch1="+      StoS  9100 16 80 22 30 23",
    opco=flatten(panel_12),
    fin=fin)
# ファイルの書き込みとデータのuploadを一つにまとめたコンポーネントを作成する
ファイル名 = Panel("220322test")
拡張子 = Panel("txt")
ファイル保存先 = Panel("C:\Users\katsu\Documents\development\THERB-GH\example")
panel_41 = Panel("http://localhost:5000")
panel_42 = Panel("test8")
path = FilePath("C:\Users\katsu\Documents\development\THERB-GH\example\input001.txt")
uploadtherb = UploadTherb()
python_44 = GhPythonScript()  # -> a; same code as python_2

窓_東面 = Brep([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])
窓_東面_2 = Brep([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])
entwine = Entwine(Branch00=窓_東面, Branch01=窓_東面_2, FlattenInputs=True)  # -> simplify(Result)

壁_西面 = Brep([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])
壁_東面 = Brep([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])
壁_北面 = Brep([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])
壁_南面 = Brep([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])
entwine_2 = Entwine(Branch00=壁_西面, Branch01=壁_東面, Branch02=壁_北面, Branch03=壁_南面, FlattenInputs=True)  # -> simplify(Result)

# ---- group: 方位角で決定
panel_43 = Panel("""90
270
180
0""")

# ----
Z = UnitZ(Factor="1")
pt = Point(Point(0, 0, 0))
line = LineSDL(Start=pt, Direction=Z, Length="1")

# ----
# dirAngles:方角情報
# adjacencyRoomIds:接している室id
getfaceproperties_14 = CSharpScript(Faces=assignclass_2.Faces)  # -> out, Face, geometries, simplify(ids), simplify(windowIds), centerPts, tiltAngles, areas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; disabled; same code as getfaceproperties

list_15 = ValueList({"単板ガラス・ブラインド室内側": 0, "複層ガラス(中間層6mm)・ブラインド室内側": 1, "複層ガラス(中間層12mm)・ブラインド室内側": 2, "複層ガラス・ブラインド内蔵": 3}, selected="複層ガラス(中間層6mm)・ブラインド室内側")
panel_44 = Panel(getfaceproperties_8.windowIds)
pshift = ShiftPaths(Data=panel_44, Offset=-1)
list_16 = ValueList({"ブラインドなし": 0, "明色ブラインド": 1, "中間色ブラインド": 2, "暗色ブラインド": 3}, selected="ブラインドなし")
list_17 = ValueList({"窓を選択": 12, "No1": 0, "No2": 1, "No3": 2, "No4": 3, "No5": 4}, selected="No2")
list_18 = ValueList({"一般窓": 0, "AFW": 1, "PPW": 2}, selected="一般窓")
cluster_17 = Cluster_24(exps_result=exps_window.result, Element_ids=pshift)  # -> owal_exps, number
python_45 = GhPythonScript(x=list_15)  # -> a
# ---------- python_45: Python ----------
__author__ = "81803"
__version__ = "2021.07.20"

import rhinoscriptsyntax as rs
x = str(x)
if x == "0":
    q = "No1透明フロートガラス&No2透明網入りガラス&No3熱反クリア&No4高性能夏反シルバー系(SS20)"
    s = "&"
    a1 = q.split(s)
elif x =="1":
    q = "No1透明フロート二層&No2透明フロート三重&No3透明クリア+透明&No4low-εクリア(CVD)+透明&No5透明+low-εクリア(CVD)&No6low-εクリア(CVD)+透明(アルゴン封入)"
    s = "&"
    a1 = q.split(s)
elif x =="2":
    q = "No1透明フロート二層&No2透明フロート三重&No3透明網入り+透明フロート&No4low-εクリア(CVD)+透明&No5透明+low-εクリア(CVD)"
    s = "&"
    a1 = q.split(s)
elif x =="3":
    q = "No1透明フロート二層&No2透明網入り+透明フロート"
    s = "&"
    a1 = q.split(s)
else:
    a1 = ""
a = a1
# ---------- end python_45 ----------
該当窓種類 = Panel(python_45)
python_46 = GhPythonScript(x=list_16)  # -> a; same code as python_5
python_47 = GhPythonScript(x=exps_window.y2)  # -> a; same code as python
python_48 = GhPythonScript(x=list_15, y=list_17)  # -> a
# ---------- python_48: Python ----------
__author__ = "81803"
__version__ = "2021.07.20"

import rhinoscriptsyntax as rs
x = str(x)
y = str(y)
if x =="0" and y == "0":
    a1 = "  1"
elif x =="0" and y == "1":
    a1 = "  9"
elif x =="0" and y == "2":
    a1 = " 39"
elif x =="0" and y == "3":
    a1 = " 87"
elif x =="1" and y == "0":
    a1 = "  1"
elif x =="1" and y == "1":
    a1 = "  9"
elif x =="1" and y == "2":
    a1 = " 47"
elif x =="1" and y == "3":
    a1 = "115"
elif x =="1" and y == "4":
    a1 = "167"
elif x =="2" and y == "0":
    a1 = "  1"
elif x =="2" and y == "1":
    a1 = "  9"
elif x =="2" and y == "2":
    a1 = " 17"
elif x =="2" and y == "3":
    a1 = "115"
elif x =="2" and y == "4":
    a1 = "141"
elif x =="3" and y == "0":
    a1 = "  1"
elif x =="3" and y == "1":
    a1 = "  9"
elif x =="3" and y == "2":
    a1 = " 87"
else:
    a1 = "該当するものがありません"
a = a1
# ---------- end python_48 ----------
python_49 = GhPythonScript(x=list_15, y=list_18)  # -> a
# ---------- python_49: Python ----------
__author__ = "81803"
__version__ = "2021.07.20"

import rhinoscriptsyntax as rs

x = str(x)
y = str(y)
if x =="0" and y =="0":
    q = "SNGL"
elif x =="1" and y =="0":
    q = "DL06"
elif x =="2" and y =="0":
    q = "DL12"
elif x =="3" and y =="0":
    q = "DLBT"
elif x =="3" and y =="1":
    q = "AFWN"
elif x =="1" and y =="2":
    q = "PP06"
elif x =="2" and y =="2":
    q = "PP12"
else:
    q = "WNDOが指定できません。再調整してください"
a = q
# ---------- end python_49 ----------
python_50 = GhPythonScript(x=exps_window.面積)  # -> a; same code as python
python_51 = GhPythonScript(x=exps_window.x1_x3)  # -> a; same code as python
要確認 = Panel(python_49)
panel_45 = Panel(cluster_17.owal_exps)

tstat = TreeStatistics(Tree=cluster_17.owal_exps)  # -> Paths, Length, Count
tstat_2 = TreeStatistics(Tree=python_47)  # -> Paths, Length, Count
replace = ReplacePaths(Data=python_47, Search=tstat_2.Paths, Replace=tstat.Paths)
tstat_3 = TreeStatistics(Tree=python_51)  # -> Paths, Length, Count
tstat_4 = TreeStatistics(Tree=python_50)  # -> Paths, Length, Count
replace_2 = ReplacePaths(Data=python_51, Search=tstat_3.Paths, Replace=tstat.Paths)
replace_3 = ReplacePaths(Data=python_50, Search=tstat_4.Paths, Replace=tstat.Paths)

concat_17 = Concatenate(
    FragmentA="WNDW ",
    FragmentB=python_49,
    FragmentC=panel_45,
    FragmentA_2=" ",
    FragmentD=python_48,
    FragmentE=python_46,
    FragmentF="     0",
    FragmentA_3=" 40",
    FragmentG=replace,
    FragmentH=replace_2,
    FragmentI=replace_3)
panel_46 = Panel(concat_17)

panel_47 = Panel(python_50)
cluster_18 = Cluster_18(
    spac=panel_28,
    owal=concat_16,
    iwal=concat_13,
    gwal=concat_12,
    wndw=concat_17,
    infl=dup_3,
    ligh=dup_4,
    ocup=dup_5,
    heat=dup_6,
    furn=dup_2,
    sopc=concat_9,
    data=panel_13)  # -> flatten(R)
panel_48 = Panel(cluster_18)
cluster_19 = Cluster_17(d1=cluster_16, d2=cluster_18)
panel_49 = Panel(cluster_19)
python_52 = FileCreator(name=ファイル名, ext=拡張子, save=ファイル保存先, lines=panel_49, write=Toggle(False))  # inputs lines: list, write: Boolean
# ---------- python_52: Python ----------
"""
Creates a file with a given ndame and extension.
    Inputs:
        name: Desired file name.
        ext: Desired file extension.
        lines: Text to write.
        write: Set to True to write.
"""

# Stephen P. Maher /  2015

ghenv.Component.Name = "File Creator"

import Grasshopper as gh
import os

gh_path = save # Get GH file path
print(gh_path)
#file = os.path.dirname(os.path.realpath(gh_path)) # Get GH file directory to save to
#print(file)
#file=gh_path
#print('file',file)
if "." not in ext: ext = "." + ext
else: pass

if os.path.exists(gh_path) == False: # Test if file already exists; if it doesn't, proceed
    file = name  # Set file name and extension
print(file)
if os.path.exists(gh_path) == True: # If it does exists, follow the next steps
    file = gh_path+"/"+name + ext 
print('file',file)
if write:
    filePath = open(file, "w") # Open the file
    for line in lines: # Iterate through lines
        filePath.write(line + "\n") # Write separate lines
    filePath.close() # Close the file
else:
    msg = "Set 'write' to True."
    ghenv.Component.AddRuntimeMessage(gh.Kernel.GH_RuntimeMessageLevel.Warning, msg)
# ---------- end python_52 ----------

# ----
# 2.データ書き出し
# 3.データアップロード
# 面構成データ用(b.dat)
# 1.データ抽出
# 2-1.部屋数、窓数、ドア数、オーバーハング数、ウイング数をカウント
# 守田君に相談
# 入力条件を変更してほしい
# 2-2.以下の各行に、0 0を追加（熱容量はとりあえず0)
# room,wall idとwindow idの組み合わせ
# (ppt参照）
# {部屋;壁番号}
# 　　窓番号
# 2-4.窓の座標情報を抽出
# 守田君に聞く
# 小原担当
# 2-5.内壁の情報を抽出
# 注) ジオメトリはsplitしたものを入れる必要あり(今後要改善）
# ToDo
# 0.windowにも傾斜角を割り当てるロジックを組み込む
# 1.傾斜角を計算するロジックを組み込む（今はwallだったら90みたいな単純なロジック）
# 2.Shading,Doorも組み込む
# 3.idをRhinoのジオメトリ上に表示できるようにする
# 5.北がどっちの方向を向いているのかを設定できるようにする
# doorのロジックはupdate必要
# 2-6.床、天井の情報を抽出
# 2-7.屋根の情報を抽出
# 屋根の方位角のロジックはupdate必要
# 2-8.地面の情報を抽出
# 室構成データ用(r.bat)
# 2-8.部屋ごとの面数を抽出
# 動的にparentIdごとにグルーピングするようにしたい
# 2-9.部屋を構成している面のidを抽出する
# 部位Noをどう計算するかを考える必要あり
windows_2 = Surface([<surface referenced from the Rhino model> x2])
rooms_2 = Brep([<brep referenced from the Rhino model> x3])
windows_split = Surface(windows_2)
rooms_split = Brep(rooms_2)
room = Brep([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])
window = Brep([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])
庇 = Brep([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])
cluster_20 = Cluster(brep=room)
assignclass_3 = CSharpScript(geos=flatten(rooms_split), tol=Slider(0.1, range=0..0.1), windows=windows_split)  # -> out, Room, Faces, Windows, test; inputs geos: list of Brep, tol: Double, windows: list of Surface; disabled; same code as assignclass
showboundarycondition = CSharpScript(Faces=flatten(assignclass_3.Faces))  # -> out, A, interior, exterior; inputs Faces: list
# ---------- showboundarycondition: C# ----------
    if (Faces == null || Faces.Count == 0) return;
    List<Surface> interiorList = new List<Surface>();
    List<Surface> exteriorList = new List<Surface>();

    foreach(var face in Faces){
      //Print("{0}", face.bc);
      Type type = face.GetType();
      PropertyInfo property = type.GetProperty("bc");
      MethodInfo bcGetter = property.GetGetMethod();
      string bc = bcGetter.Invoke(face, null) as string;
      //Print("{0}", bc);
      PropertyInfo geoProperty = type.GetProperty("geometry");
      //Print("{0}", geoProperty);
      MethodInfo geoGetter = geoProperty.GetGetMethod();
      Surface geo = geoGetter.Invoke(face, null) as Surface;
      if (bc == "interior"){
        interiorList.Add(geo);
      }else{
        exteriorList.Add(geo);
      }
    }
    interior = interiorList;
    exterior = exteriorList;
# ---------- showboundarycondition: C# additional code ----------
  private bool shootIt(Ray3d ray, List<Surface> srfs, double tol, int bounce){
    Point3d[] intersectPts = Intersection.RayShoot(ray, srfs, 1);
    Print("{0}", intersectPts.Length);
    if (intersectPts.Length > 0){
      if (ray.Position.DistanceTo(intersectPts[0]) <= tol){
        return true;
      }else{
        return false;
      }
    }else{
      return false;
    }

  }

  public class Room{
    public Guid id;
    public Guid displayName {get; private set;}
    public Brep geometry;
    private static List<Face> _faceList;
    //public List<Face> faceList {get;}
    //private static int totalRooms;

    static Room(){
      _faceList = new List<Face>();
    }

    public Room(Brep geometry){
      Guid g = Guid.NewGuid();
      this.id = g;
      this.displayName = g;
      this.geometry = geometry;
    }

    public void addFace(Face face){
      _faceList.Add(face);
      //faceList.Add(face);
    }

    public List<Face> getFaces(){
      return _faceList;
    }
  }

  public class Face{
    public Guid id;
    public Guid displayName;
    public faceType face;
    //public boundaryCondition bc {get; private set;}
    public string bc {get; private set;}
    public Guid parent {get; private set;}
    public Surface geometry {get; private set;}
    public List<Point3d> vertices;
    public Vector3d normal;

    public Face(faceType face, Guid parent, Surface geometry, Vector3d normal){
      Guid g = Guid.NewGuid();
      this.id = g;
      this.displayName = g;
      this.geometry = geometry;
      this.normal = normal;
    }
  }

  public enum faceType{
    wall,
    roof,
    floor
  }

  public enum boundaryCondition{
    outdoor,
    ground,
    interiorWall
  }
# ---------- end showboundarycondition ----------
showfacetype = CSharpScript(Faces=flatten(assignclass_3.Faces))  # -> out, A, walls, roofs, floors; inputs Faces: list
# ---------- showfacetype: C# ----------
    if (Faces == null || Faces.Count == 0) return;
    List<Surface> wallList = new List<Surface>();
    List<Surface> roofList = new List<Surface>();
    List<Surface> floorList = new List<Surface>();

    foreach(var face in Faces){
      //Print("{0}", face.bc);
      Type type = face.GetType();
      PropertyInfo property = type.GetProperty("face");
      MethodInfo faceGetter = property.GetGetMethod();
      string faceType = faceGetter.Invoke(face, null) as string;
      Print("{0}", faceType);
      PropertyInfo geoProperty = type.GetProperty("geometry");
      //Print("{0}", geoProperty);
      MethodInfo geoGetter = geoProperty.GetGetMethod();
      Surface geo = geoGetter.Invoke(face, null) as Surface;
      if (faceType == "wall"){
        wallList.Add(geo);
      }else if(faceType == "roof") {
        roofList.Add(geo);
      }else{
        floorList.Add(geo);
      }
    }
    walls = wallList;
    roofs = roofList;
    floors = floorList;
# ---------- showfacetype: C# additional code ----------
  private bool shootIt(Ray3d ray, List<Surface> srfs, double tol, int bounce){
    Point3d[] intersectPts = Intersection.RayShoot(ray, srfs, 1);
    Print("{0}", intersectPts.Length);
    if (intersectPts.Length > 0){
      if (ray.Position.DistanceTo(intersectPts[0]) <= tol){
        return true;
      }else{
        return false;
      }
    }else{
      return false;
    }

  }

  public class Room{
    public Guid id;
    public Guid displayName {get; private set;}
    public Brep geometry;
    private static List<Face> _faceList;
    //public List<Face> faceList {get;}
    //private static int totalRooms;

    static Room(){
      _faceList = new List<Face>();
    }

    public Room(Brep geometry){
      Guid g = Guid.NewGuid();
      this.id = g;
      this.displayName = g;
      this.geometry = geometry;
    }

    public void addFace(Face face){
      _faceList.Add(face);
      //faceList.Add(face);
    }

    public List<Face> getFaces(){
      return _faceList;
    }
  }

  public class Face{
    public Guid id;
    public Guid displayName;
    public faceType face;
    //public boundaryCondition bc {get; private set;}
    public string bc {get; private set;}
    public Guid parent {get; private set;}
    public Surface geometry {get; private set;}
    public List<Point3d> vertices;
    public Vector3d normal;

    public Face(faceType face, Guid parent, Surface geometry, Vector3d normal){
      Guid g = Guid.NewGuid();
      this.id = g;
      this.displayName = g;
      this.geometry = geometry;
      this.normal = normal;
    }
  }

  public enum faceType{
    wall,
    roof,
    floor
  }

  public enum boundaryCondition{
    outdoor,
    ground,
    interiorWall
  }
# ---------- end showfacetype ----------
srf = Surface(showfacetype.walls)
srf_2 = Surface(showboundarycondition.interior)
cluster_21 = Cluster_8(brep=cluster_20, window=window)  # -> I, 壁pt, 窓pt
getfaceproperties_15 = CSharpScript(Faces=assignclass_3.Faces)  # -> out, Face, geometries, simplify(ids), simplify(windowIds), centerPts, tiltAngles, areas, directions; inputs element: String
# ---------- getfaceproperties_15: C# ----------
    if (Faces == null) return;
    FieldInfo idField = Faces.GetType().GetField("id");
    int id = (int) idField.GetValue(Faces);
    FieldInfo windowIdField = Faces.GetType().GetField("windowIds");
    List<int> windowId = (List<int>) windowIdField.GetValue(Faces);
    FieldInfo centerPtField = Faces.GetType().GetField("centerPt");
    Point3d centerPt = (Point3d) centerPtField.GetValue(Faces);
    double tiltAngle = (double) Faces.GetType().GetField("tiltAngle").GetValue(Faces);
    double area = (double) Faces.GetType().GetField("area").GetValue(Faces);
    string direction = (string) Faces.GetType().GetField("direction").GetValue(Faces);
    MethodInfo geoGetter = Faces.GetType().GetProperty("geometry").GetGetMethod();
    Surface geo = geoGetter.Invoke(Faces, null) as Surface;

    geometries = geo;
    ids = id;
    windowIds = windowId;
    centerPts = centerPt;
    directions = direction;
    tiltAngles = tiltAngle;
    areas = area;
    Face = Faces;
# ---------- end getfaceproperties_15 ----------
panel_50 = Panel(getfaceproperties_15.ids)
number_slider_2 = Slider(1, range=1..10)
対象物 = Brep(cluster_20)
number_slider_3 = Slider(2, range=1..10)
number_slider_4 = Slider(3, range=1..10)
panel_51 = Panel(assignclass_3.out)
area = Area(Geometry=flatten(対象物))  # -> Area, Centroid
brep = Brep(assignclass_3.test)
panel_52 = Panel(対象物)
窓番号 = PointList(Points=cluster_21.窓pt, Size=Slider(2, range=0..2))
部屋番号 = PointList(Points=area.Centroid, Size=Slider(2, range=0..2))
getwindowproperties_3 = CSharpScript(Windows=assignclass_3.Windows)  # -> out, geometries, areas, tiltAngles, constructionIds; same code as getwindowproperties_2
壁番号 = PointList(Points=cluster_21.壁pt, Size=Slider(1, range=0..2))
item_7 = ListItem(List=brep, Index=Slider(0, range=0..5), Wrap=True)
groupfacepropertiesbyroom_2 = CSharpScript(Faces=assignclass_3.Faces, parentId=number_slider_2)  # -> out, Face, geometries, simplify(ids), simplify(windowIds), centerPts, tiltAngles, areas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; inputs parentId: Int32; same code as groupfacepropertiesbyroom
groupfacepropertiesbyroom_3 = CSharpScript(Faces=assignclass_3.Faces, parentId=number_slider_3)  # -> out, Face, geometries, simplify(ids), simplify(windowIds), centerPts, tiltAngles, areas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; inputs parentId: Int32; same code as groupfacepropertiesbyroom
groupfacepropertiesbyroom_4 = CSharpScript(Faces=assignclass_3.Faces, parentId=number_slider_4)  # -> out, Face, geometries, simplify(ids), simplify(windowIds), centerPts, tiltAngles, areas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; inputs parentId: Int32; same code as groupfacepropertiesbyroom
getfaceproperties_16 = CSharpScript(Faces=assignclass_3.Faces, element="exteriorwall")  # -> out, Face, geometries, simplify(ids), simplify(windowIds), centerPts, tiltAngles, areas, directions; inputs element: String; same code as getfaceproperties_2
getfaceproperties_17 = CSharpScript(Faces=assignclass_3.Faces, element="groundfloor")  # -> out, Face, geometries, simplify(ids), simplify(windowIds), centerPts, tiltAngles, areas; inputs element: String
# ---------- getfaceproperties_17: C# ----------
    if (Faces == null) return;
    MethodInfo elementTypeGetter = Faces.GetType().GetProperty("elementType").GetGetMethod();
    string elementType = elementTypeGetter.Invoke(Faces, null) as string;
    //Print("{0}", elementType);
    if (elementType == element){
      FieldInfo idField = Faces.GetType().GetField("id");
      int id = (int) idField.GetValue(Faces);
      FieldInfo windowIdField = Faces.GetType().GetField("windowIds");
      List<int> windowId = (List<int>) windowIdField.GetValue(Faces);
      FieldInfo centerPtField = Faces.GetType().GetField("centerPt");
      Point3d centerPt = (Point3d) centerPtField.GetValue(Faces);
      double tiltAngle = (double) Faces.GetType().GetField("tiltAngle").GetValue(Faces);
      double area = (double) Faces.GetType().GetField("area").GetValue(Faces);
      MethodInfo geoGetter = Faces.GetType().GetProperty("geometry").GetGetMethod();
      Surface geo = geoGetter.Invoke(Faces, null) as Surface;

      geometries = geo;
      ids = id;
      windowIds = windowId;
      centerPts = centerPt;
      tiltAngles = tiltAngle;
      areas = area;
      Face = Faces;
    }
# ---------- end getfaceproperties_17 ----------
cluster_22 = Cluster_3(brep=対象物)
cluster_23 = Cluster_2(G=rooms_2)
getfaceproperties_18 = CSharpScript(Faces=assignclass_3.Faces, element="interiorfloor")  # -> out, Face, geometries, simplify(ids), simplify(windowIds), centerPts, tiltAngles, areas; inputs element: String; same code as getfaceproperties_17
getfaceproperties_19 = CSharpScript(Faces=assignclass_3.Faces, element="interiorroof")  # -> out, Face, geometries, simplify(ids), simplify(windowIds), centerPts, tiltAngles, areas; inputs element: String; same code as getfaceproperties_17
getfaceproperties_20 = CSharpScript(Faces=assignclass_3.Faces, element="exteriorroof")  # -> out, Face, geometries, simplify(ids), simplify(windowIds), centerPts, tiltAngles, areas; inputs element: String; same code as getfaceproperties_17
getfaceproperties_21 = CSharpScript(Faces=assignclass_3.Faces, element="interiorwall")  # -> out, Face, geometries, simplify(ids), simplify(windowIds), centerPts, tiltAngles, areas; inputs element: String; same code as getfaceproperties_17
getroomproperties_3 = CSharpScript(Rooms=assignclass_3.Room)  # -> out, ids, minPts, maxPts, sCount, wCount, nCount, eCount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; same code as getroomproperties
panel_53 = Panel(cluster_21.壁pt)
data_10 = Data(flatten(cluster_21.I))
lng_4 = ListLength(List=getwindowproperties_3.geometries)
panel_54 = Panel(getwindowproperties_3.geometries)
lng_5 = ListLength(List=getroomproperties_3.ids)
cluster_24 = Cluster_5(P=cluster_22, 容積=cluster_23)
tstat_5 = TreeStatistics(Tree=panel_53)  # -> Paths, Length, Count
panel_55 = Panel(getwindowproperties_3.out)
debrep_2 = DeconstructBrep(Brep=getwindowproperties_3.geometries)  # -> Faces, Edges, simplify(Vertices)
chars = Characters(Text=tstat_5.Paths)  # -> Result, Unicode
panel_56 = Panel(tstat_5.Paths)
cluster_25 = Cluster_10(point=cluster_22, 容積=cluster_23)
item_8 = ListItem(List=chars.Result, Index=0, Wrap=True)  # -> flatten(Item), flatten(Item1), Item2, flatten(Item3)
cluster_26 = Cluster_9(観測点=debrep_2.Vertices)  # -> flatten(X_2), flatten(Y_2), flatten(Z_2), flatten(X), flatten(Y), flatten(Z)
number_slider_5 = Slider(1, range=0..10)
points = PointList(Points=getfaceproperties_15.centerPts, Size=number_slider_5)
points_2 = PointList(Points=getroomproperties_3.minPts, Size=number_slider_5)
panel_57 = Panel(cluster_25)
concat_18 = Concatenate(FragmentA=item_8.Item1, FragmentC=item_8.Item3, FragmentB=data_10)
panel_58 = Panel(concat_18)
panel_59 = Panel("""1
2
3""")
panel_60 = Panel("""1
2
3
4""")
panel_61 = Panel(getfaceproperties_19.ids)
窓の座標情報 = Panel(debrep_2.Vertices)
s壁の数 = Panel(getroomproperties_3.sCount)
部屋数 = Panel(lng_5)
部屋ごとに設定 = Panel(cluster_25)
窓数 = Panel(lng_4)
窓の面積 = Panel(getwindowproperties_3.areas)
窓の傾斜角 = Panel(getwindowproperties_3.tiltAngles)
ドア数 = Panel("0")
surfacecount = CSharpScript(
    sCount=getroomproperties_3.sCount,
    wCount=getroomproperties_3.wCount,
    nCount=getroomproperties_3.nCount,
    eCount=getroomproperties_3.eCount,
    fCount=getroomproperties_3.fCount,
    crCount=getroomproperties_3.crCount,
    totalCount=getroomproperties_3.totalCount)  # -> out, therbData; inputs sCount: list of String, wCount: list, nCount: list, eCount: list, fCount: list, crCount: list, totalCount: list
# ---------- surfacecount: C# ----------
    string data = "";
    int id = 1;
    //Print("{0}", windowIds[0]);
    for(int i = 0; i < sCount.Count;i = i + 1){
      //TODO:string interpolationを使いたい
      data += id.ToString() + " " + sCount[i] + " " + wCount[i] + " " + nCount[i] + " " + eCount[i] + " " + fCount[i] + " " + crCount[i] + " " + totalCount[i] + " \r\n ";
      id += 1;
    }

    therbData = data;
# ---------- end surfacecount ----------
exporttherb = CSharpScript(input2=部屋ごとに設定)  # -> out, output2; inputs input2: list of String
# ---------- exporttherb: C# ----------
    string data = "";
    int id = 1;
    foreach(string row in input2){
      Print("{0}", row);
      //TODO:string interpolationを使いたい
      data += "Room " + id.ToString() + " " + row + "18.8 16.7 \r\n";
      id += 1;
    }

    //test = "Room {name}";
    output2 = data;
# ---------- end exporttherb ----------
ひさし数 = Panel("0")
ウイング数 = Panel("0")
panel_62 = Panel(exporttherb.output2)

panel_63 = Panel(getfaceproperties_16.windowIds)

null = NullItem(Item=getfaceproperties_16.Face)  # -> NullFlags, InvalidFlags, Description
not = GateNot(A=null.NullFlags)
cull = CullPattern(List=getfaceproperties_16.Face, CullPattern=not)
lng_6 = ListLength(List=cull)

panel_64 = Panel(getfaceproperties_16.geometries)

null_2 = NullItem(Item=getfaceproperties_16.geometries)  # -> NullFlags, InvalidFlags, Description
not_2 = GateNot(A=null_2.NullFlags)
cull_2 = CullPattern(List=getfaceproperties_16.geometries, CullPattern=not_2)
lng_7 = ListLength(List=cull_2)

null_3 = NullItem(Item=getfaceproperties_16.ids)  # -> NullFlags, InvalidFlags, Description
not_3 = GateNot(A=null_3.NullFlags)
cull_3 = CullPattern(List=getfaceproperties_16.ids, CullPattern=not_3)
lng_8 = ListLength(List=cull_3)

null_4 = NullItem(Item=getfaceproperties_21.Face)  # -> NullFlags, InvalidFlags, Description
not_4 = GateNot(A=null_4.NullFlags)
cull_4 = CullPattern(List=getfaceproperties_21.Face, CullPattern=not_4)
lng_9 = ListLength(List=cull_4)

null_5 = NullItem(Item=getfaceproperties_20.Face)  # -> NullFlags, InvalidFlags, Description
not_5 = GateNot(A=null_5.NullFlags)
cull_5 = CullPattern(List=getfaceproperties_20.Face, CullPattern=not_5)
lng_10 = ListLength(List=cull_5)

null_6 = NullItem(Item=getfaceproperties_19.Face)  # -> NullFlags, InvalidFlags, Description
not_6 = GateNot(A=null_6.NullFlags)
cull_6 = CullPattern(List=getfaceproperties_19.Face, CullPattern=not_6)
lng_11 = ListLength(List=cull_6)

null_7 = NullItem(Item=getfaceproperties_17.Face)  # -> NullFlags, InvalidFlags, Description
not_7 = GateNot(A=null_7.NullFlags)
cull_7 = CullPattern(List=getfaceproperties_17.Face, CullPattern=not_7)
lng_12 = ListLength(List=cull_7)

null_8 = NullItem(Item=getfaceproperties_18.Face)  # -> NullFlags, InvalidFlags, Description
not_8 = GateNot(A=null_8.NullFlags)
cull_8 = CullPattern(List=getfaceproperties_18.Face, CullPattern=not_8)
lng_13 = ListLength(List=cull_8)

panel_65 = Panel(getfaceproperties_16.tiltAngles)

null_9 = NullItem(Item=groupfacepropertiesbyroom_2.directions)  # -> NullFlags, InvalidFlags, Description
not_9 = GateNot(A=null_9.NullFlags)
cull_9 = CullPattern(List=groupfacepropertiesbyroom_2.directions, CullPattern=not_9)

null_10 = NullItem(Item=groupfacepropertiesbyroom_2.elementIds)  # -> NullFlags, InvalidFlags, Description
not_10 = GateNot(A=null_10.NullFlags)
cull_10 = CullPattern(List=groupfacepropertiesbyroom_2.elementIds, CullPattern=not_10)

null_11 = NullItem(Item=groupfacepropertiesbyroom_3.directions)  # -> NullFlags, InvalidFlags, Description
not_11 = GateNot(A=null_11.NullFlags)
cull_11 = CullPattern(List=groupfacepropertiesbyroom_3.directions, CullPattern=not_11)

null_12 = NullItem(Item=groupfacepropertiesbyroom_2.ids)  # -> NullFlags, InvalidFlags, Description
not_12 = GateNot(A=null_12.NullFlags)
cull_12 = CullPattern(List=groupfacepropertiesbyroom_2.ids, CullPattern=not_12)

null_13 = NullItem(Item=groupfacepropertiesbyroom_2.adjacencyIds)  # -> NullFlags, InvalidFlags, Description
not_13 = GateNot(A=null_13.NullFlags)
cull_13 = CullPattern(List=groupfacepropertiesbyroom_2.adjacencyIds, CullPattern=not_13)

null_14 = NullItem(Item=groupfacepropertiesbyroom_3.elementIds)  # -> NullFlags, InvalidFlags, Description
not_14 = GateNot(A=null_14.NullFlags)
cull_14 = CullPattern(List=groupfacepropertiesbyroom_3.elementIds, CullPattern=not_14)

null_15 = NullItem(Item=groupfacepropertiesbyroom_2.elementTypes)  # -> NullFlags, InvalidFlags, Description
not_15 = GateNot(A=null_15.NullFlags)
cull_15 = CullPattern(List=groupfacepropertiesbyroom_2.elementTypes, CullPattern=not_15)

null_16 = NullItem(Item=groupfacepropertiesbyroom_3.ids)  # -> NullFlags, InvalidFlags, Description
not_16 = GateNot(A=null_16.NullFlags)
cull_16 = CullPattern(List=groupfacepropertiesbyroom_3.ids, CullPattern=not_16)

null_17 = NullItem(Item=groupfacepropertiesbyroom_3.adjacencyIds)  # -> NullFlags, InvalidFlags, Description
not_17 = GateNot(A=null_17.NullFlags)
cull_17 = CullPattern(List=groupfacepropertiesbyroom_3.adjacencyIds, CullPattern=not_17)

null_18 = NullItem(Item=groupfacepropertiesbyroom_3.elementTypes)  # -> NullFlags, InvalidFlags, Description
not_18 = GateNot(A=null_18.NullFlags)
cull_18 = CullPattern(List=groupfacepropertiesbyroom_3.elementTypes, CullPattern=not_18)

null_19 = NullItem(Item=groupfacepropertiesbyroom_4.directions)  # -> NullFlags, InvalidFlags, Description
not_19 = GateNot(A=null_19.NullFlags)
cull_19 = CullPattern(List=groupfacepropertiesbyroom_4.directions, CullPattern=not_19)

null_20 = NullItem(Item=groupfacepropertiesbyroom_4.elementIds)  # -> NullFlags, InvalidFlags, Description
not_20 = GateNot(A=null_20.NullFlags)
cull_20 = CullPattern(List=groupfacepropertiesbyroom_4.elementIds, CullPattern=not_20)

null_21 = NullItem(Item=groupfacepropertiesbyroom_4.ids)  # -> NullFlags, InvalidFlags, Description
not_21 = GateNot(A=null_21.NullFlags)
cull_21 = CullPattern(List=groupfacepropertiesbyroom_4.ids, CullPattern=not_21)

null_22 = NullItem(Item=groupfacepropertiesbyroom_4.adjacencyIds)  # -> NullFlags, InvalidFlags, Description
not_22 = GateNot(A=null_22.NullFlags)
cull_22 = CullPattern(List=groupfacepropertiesbyroom_4.adjacencyIds, CullPattern=not_22)

null_23 = NullItem(Item=groupfacepropertiesbyroom_4.elementTypes)  # -> NullFlags, InvalidFlags, Description
not_23 = GateNot(A=null_23.NullFlags)
cull_23 = CullPattern(List=groupfacepropertiesbyroom_4.elementTypes, CullPattern=not_23)

tmatch = MatchText(Text=getfaceproperties_16.directions, Pattern="N", Case=True)
cull_24 = CullPattern(List=getfaceproperties_16.geometries, CullPattern=tmatch)

getfaceproperties_22 = CSharpScript(Faces=cull_4, element="interiorwall")  # -> out, geometries, simplify(ids), simplify(windowIds), centerPts, tiltAngles, areas, constructionIds; inputs element: String
# ---------- getfaceproperties_22: C# ----------
    if (Faces == null) return;
    MethodInfo elementTypeGetter = Faces.GetType().GetProperty("elementType").GetGetMethod();
    string elementType = elementTypeGetter.Invoke(Faces, null) as string;
    //Print("{0}", elementType);
    if (elementType == element){
      FieldInfo idField = Faces.GetType().GetField("id");
      int id = (int) idField.GetValue(Faces);
      FieldInfo windowIdField = Faces.GetType().GetField("windowIds");
      List<int> windowId = (List<int>) windowIdField.GetValue(Faces);
      FieldInfo centerPtField = Faces.GetType().GetField("centerPt");
      Point3d centerPt = (Point3d) centerPtField.GetValue(Faces);
      FieldInfo tiltAngleField = Faces.GetType().GetField("tiltAngle");
      int constructionId = (int) Faces.GetType().GetField("constructionId").GetValue(Faces);
      double tiltAngle = (double) tiltAngleField.GetValue(Faces);
      double area = (double) Faces.GetType().GetField("area").GetValue(Faces);
      MethodInfo geoGetter = Faces.GetType().GetProperty("geometry").GetGetMethod();
      Surface geo = geoGetter.Invoke(Faces, null) as Surface;

      geometries = geo;
      ids = id;
      windowIds = windowId;
      centerPts = centerPt;
      tiltAngles = tiltAngle;
      areas = Math.Round(area, 2);
      constructionIds = constructionId;
    }
# ---------- end getfaceproperties_22 ----------
getfaceproperties_23 = CSharpScript(Faces=cull_6, element="interiorroof")  # -> out, Face, geometries, simplify(ids), simplify(windowIds), centerPts, tiltAngles, areas, constructionIds; inputs element: String
# ---------- getfaceproperties_23: C# ----------
    if (Faces == null) return;
    MethodInfo elementTypeGetter = Faces.GetType().GetProperty("elementType").GetGetMethod();
    string elementType = elementTypeGetter.Invoke(Faces, null) as string;
    //Print("{0}", elementType);
    if (elementType == element){
      FieldInfo idField = Faces.GetType().GetField("id");
      int id = (int) idField.GetValue(Faces);
      FieldInfo windowIdField = Faces.GetType().GetField("windowIds");
      List<int> windowId = (List<int>) windowIdField.GetValue(Faces);
      FieldInfo centerPtField = Faces.GetType().GetField("centerPt");
      Point3d centerPt = (Point3d) centerPtField.GetValue(Faces);
      double tiltAngle = (double) Faces.GetType().GetField("tiltAngle").GetValue(Faces);
      double area = (double) Faces.GetType().GetField("area").GetValue(Faces);
      int constructionId = (int) Faces.GetType().GetField("constructionId").GetValue(Faces);
      MethodInfo geoGetter = Faces.GetType().GetProperty("geometry").GetGetMethod();
      Surface geo = geoGetter.Invoke(Faces, null) as Surface;

      geometries = geo;
      ids = id;
      windowIds = windowId;
      centerPts = centerPt;
      tiltAngles = tiltAngle;
      areas = Math.Round(area, 2);
      Face = Faces;
      constructionIds = constructionId;
    }
# ---------- end getfaceproperties_23 ----------
getfaceproperties_24 = CSharpScript(Faces=cull, element="exteriorwall")  # -> out, geometries, simplify(ids), simplify(windowIds), centerPts, tiltAngles, areas, directions, constructionIds; inputs element: String
# ---------- getfaceproperties_24: C# ----------
    if (Faces == null) return;
    MethodInfo elementTypeGetter = Faces.GetType().GetProperty("elementType").GetGetMethod();
    string elementType = elementTypeGetter.Invoke(Faces, null) as string;
    //Print("{0}", elementType);
    if (elementType == element){
      FieldInfo idField = Faces.GetType().GetField("id");
      int id = (int) idField.GetValue(Faces);
      FieldInfo windowIdField = Faces.GetType().GetField("windowIds");
      List<int> windowId = (List<int>) windowIdField.GetValue(Faces);
      FieldInfo centerPtField = Faces.GetType().GetField("centerPt");
      Point3d centerPt = (Point3d) centerPtField.GetValue(Faces);
      FieldInfo tiltAngleField = Faces.GetType().GetField("tiltAngle");
      double tiltAngle = (double) tiltAngleField.GetValue(Faces);
      string direction = (string) Faces.GetType().GetField("direction").GetValue(Faces);
      int constructionId = (int) Faces.GetType().GetField("constructionId").GetValue(Faces);
      double area = (double) Faces.GetType().GetField("area").GetValue(Faces);
      MethodInfo geoGetter = Faces.GetType().GetProperty("geometry").GetGetMethod();
      Surface geo = geoGetter.Invoke(Faces, null) as Surface;

      geometries = geo;
      ids = id;
      windowIds = windowId;
      centerPts = centerPt;
      tiltAngles = tiltAngle;
      directions = direction;
      areas = Math.Round(area, 2);
      constructionIds = constructionId;
    }
# ---------- end getfaceproperties_24 ----------
getfaceproperties_25 = CSharpScript(Faces=cull_5, element="exteriorroof")  # -> out, Face, geometries, simplify(ids), simplify(windowIds), centerPts, tiltAngles, areas, constructionIds; inputs element: String; same code as getfaceproperties_23
getfaceproperties_26 = CSharpScript(Faces=cull_8, element="interiorfloor")  # -> out, Face, geometries, simplify(ids), simplify(windowIds), centerPts, tiltAngles, areas, constructionIds; inputs element: String; same code as getfaceproperties_23
getfaceproperties_27 = CSharpScript(Faces=cull_7, element="groundfloor")  # -> out, Face, geometries, simplify(ids), simplify(windowIds), centerPts, tiltAngles, areas, constructionIds; inputs element: String; same code as getfaceproperties_23
addition = Addition(A=lng_11, B=lng_13)
debrep_3 = DeconstructBrep(Brep=getfaceproperties_22.geometries)  # -> Faces, Edges, simplify(Vertices)
debrep_4 = DeconstructBrep(Brep=getfaceproperties_25.geometries)  # -> Faces, Edges, simplify(Vertices)
debrep_5 = DeconstructBrep(Brep=getfaceproperties_27.geometries)  # -> Faces, Edges, simplify(Vertices)
merge_3 = Merge(Data1=getfaceproperties_23.geometries, Data2=getfaceproperties_26.geometries)
points_3 = PointList(Points=getfaceproperties_24.centerPts, Size=number_slider_5)
debrep_6 = DeconstructBrep(Brep=getfaceproperties_24.geometries)  # -> Faces, Edges, simplify(Vertices)
debrep_7 = DeconstructBrep(Brep=merge_3)  # -> Faces, Edges, simplify(Vertices)
cluster_27 = Cluster_9(観測点=debrep_5.Vertices)  # -> flatten(X_2), flatten(Y_2), flatten(Z_2), flatten(X), flatten(Y), flatten(Z)
cluster_28 = Cluster_9(観測点=debrep_3.Vertices)  # -> flatten(X_2), flatten(Y_2), flatten(Z_2), flatten(X), flatten(Y), flatten(Z)
merge_4 = Merge(Data1=getfaceproperties_23.tiltAngles, Data2=getfaceproperties_26.tiltAngles)
merge_5 = Merge(Data1=getfaceproperties_23.areas, Data2=getfaceproperties_26.areas)
merge_6 = Merge(Data1=getfaceproperties_23.constructionIds, Data2=getfaceproperties_26.constructionIds)
cluster_29 = Cluster_9(観測点=debrep_6.Vertices)  # -> flatten(X_2), flatten(Y_2), flatten(Z_2), flatten(X), flatten(Y), flatten(Z)
cluster_30 = Cluster_9(観測点=debrep_7.Vertices)  # -> flatten(X_2), flatten(Y_2), flatten(Z_2), flatten(X), flatten(Y), flatten(Z)
cluster_31 = Cluster_9(観測点=debrep_4.Vertices)  # -> flatten(X_2), flatten(Y_2), flatten(Z_2), flatten(X), flatten(Y), flatten(Z)
item_9 = ListItem(List=getfaceproperties_22.geometries, Index=Slider(1, range=0..1), Wrap=True)
部屋id1の構成面の方角 = Panel(cull_9)
床_天井の座標情報 = Panel(debrep_7.Vertices)
内壁の座標情報 = Panel(debrep_3.Vertices)
屋根の座標情報 = Panel(debrep_4.Vertices)
地面の座標情報 = Panel(debrep_5.Vertices)
cluster_32 = Cluster_11(input=getfaceproperties_24.windowIds)
外壁数 = Panel(lng_7)
部屋id1の構成面のelement_no = Panel(cull_10)
内壁の面積 = Panel(getfaceproperties_22.areas)
床_天井の面積 = Panel(getfaceproperties_23.areas)
屋根の面積 = Panel(getfaceproperties_25.areas)
地面の面積 = Panel(getfaceproperties_27.areas)
地面の傾斜角 = Panel(getfaceproperties_27.tiltAngles)
内壁数 = Panel(lng_9)
部屋id1の構成面の部位no = Panel(cull_12)
床数 = Panel(addition)
exportinternalwall = CSharpScript(
    x1=cluster_28.X_2,
    y1=cluster_28.Y_2,
    z1=cluster_28.Z_2,
    x2=cluster_28.X,
    y2=cluster_28.Y,
    z2=cluster_28.Z,
    tiltAngles=getfaceproperties_22.tiltAngles,
    areas=getfaceproperties_22.areas,
    structureNo=getfaceproperties_22.constructionIds,
    doorIds="0 0 0 0 0 0 0 0")  # -> out, therbData; inputs x1: list of String, y1: list, z1: list, x2: list, y2: list, z2: list, tiltAngles: list, areas: list, structureNo: list
# ---------- exportinternalwall: C# ----------
    string data = "";
    int id = 1;
    //Print("{0}", windowIds[0]);
    for(int i = 0; i < x1.Count;i = i + 1){
      //TODO:string interpolationを使いたい
      data += "In-wall " + id.ToString() + " " + x1[i] + " " + y1[i] + " " + z1[i] + " " + x2[i] + " " + y2[i] + " " + z2[i]+ " " + tiltAngles[i] + " \r\n structure No. " + structureNo[i] + " \r\n in-door No. " + doorIds + " \r\n";

      id += 1;

    }
    therbData = data;
# ---------- end exportinternalwall ----------
部屋id1の構成面の隣室条件 = Panel(cull_13)
exportwindowceilingfloor = CSharpScript(
    element="Roof",
    x1=cluster_31.X_2,
    y1=cluster_31.Y_2,
    z1=cluster_31.Z_2,
    x2=cluster_31.X,
    y2=cluster_31.Y,
    z2=cluster_31.Z,
    direction="0",
    tiltAngles=getfaceproperties_25.tiltAngles,
    areas=getfaceproperties_25.areas,
    structureNo=getfaceproperties_25.constructionIds)  # -> out, therbData; inputs element: String, x1: list of String, y1: list, z1: list, x2: list, y2: list, z2: list, tiltAngles: list, areas: list, structureNo: list
# ---------- exportwindowceilingfloor: C# ----------
    string data = "";
    int id = 1;
    //Print("{0}", windowIds[0]);
    for(int i = 0; i < x1.Count;i = i + 1){
      //TODO:string interpolationを使いたい
      data += element + id.ToString() + " " + x1[i] + " " + y1[i] + " " + x2[i] + " " + y2[i] + " " + direction + " " + tiltAngles[i] + " " + areas[i] + " 0 \r\n structure No. " + structureNo[i] + " \r\n ";
      id += 1;
    }

    therbData = data;
# ---------- end exportwindowceilingfloor ----------
exportwindowceilingfloor_2 = CSharpScript(
    element="Ground",
    x1=cluster_27.X_2,
    y1=cluster_27.Y_2,
    z1=cluster_27.Z_2,
    x2=cluster_27.X,
    y2=cluster_27.Y,
    z2=cluster_27.Z,
    tiltAngles=getfaceproperties_27.tiltAngles,
    areas=getfaceproperties_27.areas,
    structureNo=getfaceproperties_27.constructionIds)  # -> out, therbData; inputs element: String, x1: list of String, y1: list, z1: list, x2: list, y2: list, z2: list, tiltAngles: list, areas: list, structureNo: list
# ---------- exportwindowceilingfloor_2: C# ----------
    string data = "";
    int id = 1;
    //Print("{0}", windowIds[0]);
    for(int i = 0; i < x1.Count;i = i + 1){
      //TODO:string interpolationを使いたい
      data += element + id.ToString() + " " + x1[i] + " " + y1[i] + " " + z1[i] + " " + x2[i] + " " + y2[i] + " " + z2[i] + " " + tiltAngles[i] + " " + areas[i] + " \r\n structure No. " + structureNo[i] + " \r\n ";
      id += 1;
    }

    therbData = data;
# ---------- end exportwindowceilingfloor_2 ----------
屋根数 = Panel(lng_10)
exportwindowceilingfloor_3 = CSharpScript(
    element="flr&cling",
    x1=cluster_30.X_2,
    y1=cluster_30.Y_2,
    z1=cluster_30.Z_2,
    x2=cluster_30.X,
    y2=cluster_30.Y,
    z2=cluster_30.Z,
    tiltAngles=merge_4,
    areas=merge_5,
    structureNo=merge_6)  # -> out, therbData; inputs element: String, x1: list of String, y1: list, z1: list, x2: list, y2: list, z2: list, tiltAngles: list, areas: list, structureNo: list
# ---------- exportwindowceilingfloor_3: C# ----------
    string data = "";
    int id = 1;
    //Print("{0}", windowIds[0]);
    for(int i = 0; i < x1.Count;i = i + 1){
      //TODO:string interpolationを使いたい
      data += element + id.ToString() + " " + x1[i] + " " + y1[i] + " " + z1[i] + " " + x2[i] + " " + y2[i] + " " + z2[i] + " " + tiltAngles[i] + " " + areas[i] + " 0 \r\n structure No. " + structureNo[i] + " overhang No. 0 wing1 No. 0 wing2 No. 0 \r\n";
      id += 1;
    }

    therbData = data;
# ---------- end exportwindowceilingfloor_3 ----------
exportwindowceilingfloor_4 = CSharpScript(
    element="Window",
    x1=cluster_26.X_2,
    y1=cluster_26.Y_2,
    z1=cluster_26.Z_2,
    x2=cluster_28.X,
    y2=cluster_26.X,
    z2=cluster_26.Z,
    tiltAngles=窓の傾斜角,
    areas=窓の面積,
    structureNo=getwindowproperties_3.constructionIds)  # -> out, therbData; inputs element: String, x1: list of String, y1: list, z1: list, x2: list, y2: list, z2: list, tiltAngles: list, areas: list, structureNo: list
# ---------- exportwindowceilingfloor_4: C# ----------
    string data = "";
    int id = 1;
    //Print("{0}", windowIds[0]);
    for(int i = 0; i < x1.Count;i = i + 1){
      //TODO:string interpolationを使いたい
      data += element + id.ToString() + " " + x1[i] + " " + y1[i] + " " + z1[i] + " " + x2[i] + " " + y2[i] + " " + z2[i] + " " + tiltAngles[i] + " " + areas[i] + " \r\n structure No. " + structureNo[i] + " overhang No. 0 wing1 No. 0 wing2 No. 0 \r\n";
      id += 1;
    }

    therbData = data;
# ---------- end exportwindowceilingfloor_4 ----------
地面数 = Panel(lng_12)
surfacecount_2 = CSharpScript(
    roomId=number_slider_2,
    direction=部屋id1の構成面の方角,
    elementNo=部屋id1の構成面のelement_no,
    elementType=cull_15,
    adjacency=部屋id1の構成面の隣室条件)  # -> out, therbData; inputs direction: list of String, elementNo: list of String, elementType: list of String, adjacency: list
# ---------- surfacecount_2: C# ----------
    string data = "";
    int id = 1;
    //Print("{0}", windowIds[0]);
    var directionDict = new Dictionary<string, string>(){
        {"S","1"},
        {"W","2"},
        {"N","3"},
        {"E","4"},
        {"F","5"},
        {"CR","6"},
        };

    var directionCount = new Dictionary<string, int>(){
        {"S",1},
        {"W",1},
        {"N",1},
        {"E",1},
        {"F",1},
        {"CR",1},
        };
    /*
    var elementCount = new Dictionary<string, int>(){
        {"exteriorwall",1},
        {"interiorwall",1},
        {"interiorfloor",1},
        {"exteriorroof",1},
        {"groundfloor",1},
        };
    */
    var elementCount = new Dictionary<string, int>(){
        {"1",1},
        {"2",1},
        {"3",1},
        {"4",1},
        {"5",1},
        };
    for(int i = 0; i < direction.Count;i = i + 1){
      //TODO:string interpolationを使いたい
      data += roomId + " " + id.ToString() + " " + directionDict[direction[i]] + " " + directionCount[direction[i]] + " " + elementNo[i] + " " + elementCount[elementNo[i]] + " " + adjacency[i] + " \r\n ";
      directionCount[direction[i]] += 1;
      elementCount[elementNo[i]] += 1;
      id += 1;
    }

    therbData = data;
# ---------- end surfacecount_2 ----------
surfacecount_3 = CSharpScript(roomId=number_slider_3, direction=cull_11, elementNo=cull_14, elementType=cull_18, adjacency=cull_17)  # -> out, therbData; inputs direction: list of String, elementNo: list of String, elementType: list of String, adjacency: list; same code as surfacecount_2
surfacecount_4 = CSharpScript(roomId=number_slider_4, direction=cull_19, elementNo=cull_20, elementType=cull_23, adjacency=cull_22)  # -> out, therbData; inputs direction: list of String, elementNo: list of String, elementType: list of String, adjacency: list; same code as surfacecount_2
panel_66 = Panel(exportwindowceilingfloor_3.therbData)
panel_67 = Panel(exportinternalwall.therbData)
panel_68 = Panel(exportinternalwall.out)
panel_69 = Panel(exportwindowceilingfloor_2.therbData)
python_53 = GhPythonScript(x=部屋数, y=外壁数, z=窓数, u=内壁数, v=ドア数, w=床数, s=屋根数, t=地面数, xx=ひさし数, xy=ウイング数)  # -> a
# ---------- python_53: Python ----------
__author__ = "81803"
__version__ = "2022.02.02"

import rhinoscriptsyntax as rs
if x == "":
    x1 == ""
elif y == "":
    x1 == ""
else :
    x1 = " "
a = x + x1 + y + x1 + z + x1 + u + x1 + v + x1 + w + x1 + s + x1 + t + x1 + xx + x1 + xy + x1 + "[kJ/m3 K]    [kg/m3(kg/kg')]"
# ---------- end python_53 ----------
merge_7 = Merge(
    Data1=surfacecount.therbData,
    Data2=surfacecount_2.therbData,
    Data3=surfacecount_3.therbData,
    Data4=surfacecount_4.therbData)
_1行目 = Panel(python_53)
panel_70 = Panel(merge_7)
exporttherb_2 = CSharpScript(surfaceCount=surfacecount.therbData, roomData=flatten(merge_7))  # -> out, rDat; inputs surfaceCount: String, roomData: String
# ---------- exporttherb_2: C# ----------
    rDat = surfaceCount + "\r\n" + roomData + "\r\n";
# ---------- end exporttherb_2 ----------
r_datファイル書き出し = Panel(exporttherb_2.rDat)

# ----
# 2-3-1.外壁の座標情報を抽出
# overhangとwingは未実装
# 2-3-2.外壁に属している窓、shadingのidを抽出
# Ex-wall 5に対して、window No.1という意味
structure_no = Panel(getfaceproperties_24.constructionIds)
外壁の座標情報 = Panel(cluster_29.X_2)
panel_71 = Panel(getfaceproperties_24.windowIds)
外壁の傾斜角 = Panel(getfaceproperties_24.tiltAngles)
外壁の面積 = Panel(getfaceproperties_24.areas)

exportexternalwall = CSharpScript(
    x1=cluster_29.X_2,
    y1=cluster_29.Y_2,
    z1=cluster_29.Z_2,
    x2=cluster_29.X,
    y2=cluster_29.Y,
    z2=cluster_29.Z,
    tiltAngles=外壁の傾斜角,
    areas=外壁の面積,
    structureNo=structure_no,
    windowIds=simplify(cluster_32))  # -> out, output3; inputs x1: list of String, y1: list, z1: list, x2: list, y2: list, z2: list, tiltAngles: list, areas: list, structureNo: list, windowIds: list
# ---------- exportexternalwall: C# ----------
    string data = "";
    int id = 1;
    //Print("{0}", windowIds[0]);
    for(int i = 0; i < x1.Count;i = i + 1){
      //TODO:string interpolationを使いたい
      data += "Ex-wall " + id.ToString() + " " + x1[i] + " " + y1[i] + " " + z1[i] + " " + x2[i] + " " + y2[i] + " " + z2[i] + " " + " " + tiltAngles[i] + " " + areas[i] + " 0 \r\n structure No. " + structureNo[i] + " overhang No. 0 wing1 No. 0 wing2 No. 0 \r\n window No. " + windowIds[i] + " \r\n";

      id += 1;

    }
    output3 = data;
# ---------- end exportexternalwall ----------
panel_72 = Panel(exportexternalwall.output3)
exporttherb_3 = CSharpScript(
    overallData=python_53,
    roomData=exporttherb.output2,
    exteriorWallData=exportexternalwall.output3,
    interiorWallData=exportinternalwall.therbData,
    windowData=exportwindowceilingfloor_4.therbData,
    flrCeilingData=exportwindowceilingfloor_3.therbData,
    roofData=exportwindowceilingfloor.therbData,
    groundData=exportwindowceilingfloor_2.therbData)  # -> out, bDat; inputs overallData: String, roomData: String, exteriorWallData: String
# ---------- exporttherb_3: C# ----------
    bDat = overallData + "\r\n" + roomData + "\r\n" + exteriorWallData + "\r\n" + windowData + "\r\n" + interiorWallData + "\r\n" + flrCeilingData + "\r\n" + roofData + "\r\n" + groundData + "\r\n";
# ---------- end exporttherb_3 ----------
b_datファイル書き出し = Panel(exporttherb_3.bDat)

# ----
# 前回の成果
# Step3_壁4_窓2
# インプット→
# インプット→
# インプット→
南 = Panel("""0
6""")
北 = Panel("""2
14""")
東 = Panel("""1
7
13""")
西 = Panel("""3
9
15""")
explode = Explode(Curve=entwine_2, Recursive=True)  # -> Segments, Vertices
neg = Negative(Value=panel_43)
pshift_2 = ShiftPaths(Data=explode.Vertices, Offset=-1)
panel_73 = Panel(entwine_2)
xz = XZPlane(Origin=Point(0, 0, 0))
sunion = SetUnion(SetA=pshift_2)
rotax = RotateAxis(Geometry=xz, Angle=graft(degrees(neg)), Axis=line)  # -> simplify(Geometry), Transform
vec2pt = Vector2Pt(PointA=pt, PointB=sunion, Unitize=False)  # -> Vector, Length
group = Group(Objects=sunion)  # -> flatten(Group)
move = Move(Geometry=rotax.Geometry, Motion=vec2pt.Vector)  # -> simplify(graft(Geometry)), Transform
xy = XYPlane(Origin=Point(0, 0, 0))
xy_2 = XYPlane(Origin=Point(0, 0, 0))
xy_3 = XYPlane(Origin=Point(0, 0, 0))
toggle_2 = BooleanToggle(True)

# ---- group: OK
pdecon = Deconstruct(Point=move.Geometry)  # -> XComponent, YComponent, ZComponent
python_54 = GhPythonScript(x=pdecon.ZComponent)  # -> a
# ---------- python_54: Python ----------
__author__ = "81803"
__version__ = "2022.02.28"

import rhinoscriptsyntax as rs
if x < 0.000001:
    a = "False"
else:
    a = "true"
# ---------- end python_54 ----------
data_11 = Data(flatten(python_54))
tstat_6 = TreeStatistics(Tree=python_54)  # -> Paths, Length, Count
mindex = MemberIndex(Set=data_11, Member="False")  # -> Index, Count
item_10 = ListItem(List=tstat_6.Paths, Index=mindex.Index, Wrap=True)
split = SplitTree(Data=move.Geometry, Masks=flatten(item_10))  # -> Positive, Negative

# ----
orient = Orient(Geometry=group, Source=split.Positive, Target=xy)  # -> graft(Geometry), Transform
ungroup = Ungroup(Group=orient.Geometry)  # -> simplify(Objects)
pdecon_2 = Deconstruct(Point=ungroup)  # -> XComponent, YComponent, ZComponent

sunion_2 = SetUnion(SetA=pdecon_2.ZComponent)
python_55 = GhPythonScript(x=sunion_2)  # -> a
# ---------- python_55: Python ----------
__author__ = "81803"
__version__ = "2022.02.28"

import rhinoscriptsyntax as rs
if x == 0:
    a = "false"
else:
    a = "true"
# ---------- end python_55 ----------
sunion_3 = SetUnion(SetA=python_55)  # -> simplify(Union)
lng_14 = ListLength(List=sunion_3)
python_56 = GhPythonScript(x=lng_14)  # -> a
# ---------- python_56: Python ----------
__author__ = "81803"
__version__ = "2022.03.01"

import rhinoscriptsyntax as rs
if x >= 2:
    a = "out"
else:
    a = "safe(first)"
# ---------- end python_56 ----------
data_12 = Data(flatten(python_56))
subset = SubSet(SetA=python_56, SetB="safe(first)")
data_13 = Data(flatten(subset))
mindex_2 = MemberIndex(Set=data_13, Member=Toggle(True))  # -> Index, Count
tstat_7 = TreeStatistics(Tree=subset)  # -> Paths, Length, Count
item_11 = ListItem(List=tstat_7.Paths, Index=mindex_2.Index, Wrap=True)
split_2 = SplitTree(Data=sunion_3, Masks=flatten(item_11))  # -> Positive, Negative
subset_2 = SubSet(SetA=split_2.Positive, SetB="false")
data_14 = Data(flatten(subset_2))
mindex_3 = MemberIndex(Set=data_14, Member=Toggle(True))  # -> Index, Count
tstat_8 = TreeStatistics(Tree=subset_2)  # -> Paths, Length, Count
item_12 = ListItem(List=tstat_8.Paths, Index=mindex_3.Index, Wrap=True)
split_3 = SplitTree(Data=ungroup, Masks=flatten(item_12))  # -> Positive, Negative
pdecon_3 = Deconstruct(Point=split_3.Positive)  # -> XComponent, YComponent, ZComponent

sunion_4 = SetUnion(SetA=pdecon_3.XComponent, SetB=pdecon_3.YComponent)  # -> simplify(Union)
python_57 = GhPythonScript(x=sunion_4)  # -> a
# ---------- python_57: Python ----------
__author__ = "81803"
__version__ = "2022.02.28"

import rhinoscriptsyntax as rs
if x < 0:
    a = "false"
else:
    a = "true"
# ---------- end python_57 ----------
sunion_5 = SetUnion(SetA=python_57)  # -> simplify(Union)
lng_15 = ListLength(List=sunion_5)
python_58 = GhPythonScript(x=lng_15)  # -> a; same code as python_56
subset_3 = SubSet(SetA=python_58, SetB="safe(first)")
data_15 = Data(flatten(subset_3))
mindex_4 = MemberIndex(Set=data_15, Member=Toggle(True))  # -> Index, Count
tstat_9 = TreeStatistics(Tree=subset_3)  # -> Paths, Length, Count
item_13 = ListItem(List=tstat_9.Paths, Index=mindex_4.Index, Wrap=True)
split_4 = SplitTree(Data=sunion_5, Masks=flatten(item_13))  # -> Positive, Negative
subset_4 = SubSet(SetA=split_4.Positive, SetB="true")
data_16 = Data(flatten(subset_4))
mindex_5 = MemberIndex(Set=data_16, Member=Toggle(True))  # -> Index, Count
tstat_10 = TreeStatistics(Tree=subset_4)  # -> Paths, Length, Count
item_14 = ListItem(List=tstat_10.Paths, Index=mindex_5.Index, Wrap=True)

# ----
# EWAL,IWAL用データ
panel_74 = Panel("exteriorwall")  # disabled
panel_75 = Panel("interiorwall")  # disabled
panel_76 = Panel("exteriorroof")  # disabled
getfaceproperties_28 = CSharpScript(Faces=assignclass.Faces, element=panel_74)  # -> out, Face, geometries, simplify(ids), simplify(windowIds), centerPts, tiltAngles, areas, directions; inputs element: String; disabled; same code as getfaceproperties_2
getwindowproperties_4 = CSharpScript(Windows=assignclass.Windows)  # -> out, geometries, areas, tiltAngles, constructionIds; disabled; same code as getwindowproperties_2
getfaceproperties_29 = CSharpScript(Faces=assignclass.Faces, element=panel_75)  # -> out, Face, geometries, simplify(ids), simplify(windowIds), centerPts, tiltAngles, areas; inputs element: String; disabled; same code as getfaceproperties_17
getfaceproperties_30 = CSharpScript(Faces=assignclass.Faces, element=panel_76)  # -> out, Face, geometries, simplify(ids), simplify(windowIds), centerPts, tiltAngles, areas; inputs element: String; disabled; same code as getfaceproperties_17
geo = Geometry(getfaceproperties_29.geometries)  # disabled
input_exteriorwall = Brep(graft(getfaceproperties_28.geometries))  # disabled
input_exteriorwall_2 = Brep(getfaceproperties_28.geometries)  # disabled
panel_77 = Panel(getfaceproperties_14.out)  # disabled
tstat_11 = TreeStatistics(Tree=input_exteriorwall)  # -> Paths, Length, Count; disabled

# ----
# IDとリスト番号が違うための処理
panel_78 = Panel(getfaceproperties_28.windowIds)  # disabled
addition_2 = Addition(A=panel_78, C=-1)  # disabled
python_59 = GhPythonScript(x=addition_2)  # -> a; disabled; same code as python

# ----
# 外屋根_Plane生成
md_slider = MDSlider(SliderMode=0, slider_value=Point(0, 0, 0.5), x_domain=Domain(0, 1), y_domain=Domain(0, 1), z_domain=Domain(0, 1))  # disabled
evalsrf = EvaluateSurface(Surface=reparameterize(getfaceproperties_30.geometries), Point=md_slider)  # -> Point, Normal, UDirection, VDirection, Frame; disabled

# ----
# 内壁_Plane生成
md_slider_2 = MDSlider(SliderMode=0, slider_value=Point(0, 0, 0.5), x_domain=Domain(0, 1), y_domain=Domain(0, 1), z_domain=Domain(0, 1))  # disabled
evalsrf_2 = EvaluateSurface(Surface=reparameterize(getfaceproperties_29.geometries), Point=md_slider_2)  # -> Point, Normal, UDirection, VDirection, Frame; disabled

item_15 = ListItem(List=getwindowproperties_4.geometries, Index=python_59, Wrap=True)  # disabled

# ---- group: 基盤となるデータ構造
tstat_12 = TreeStatistics(Tree=item_15)  # -> Paths, Length, Count; disabled

# ----
# 外壁_Plane生成
md_slider_3 = MDSlider(SliderMode=0, slider_value=Point(0, 0, 0.5), x_domain=Domain(0, 1), y_domain=Domain(0, 1), z_domain=Domain(0, 1))  # disabled
evalsrf_3 = EvaluateSurface(Surface=reparameterize(input_exteriorwall_2), Point=md_slider_3)  # -> Point, Normal, UDirection, VDirection, Frame; disabled
data_17 = Data(graft(evalsrf_3.Frame))  # disabled
tstat_13 = TreeStatistics(Tree=data_17)  # -> Paths, Length, Count; disabled
replace_4 = ReplacePaths(Data=data_17, Search=tstat_13.Paths, Replace=tstat_12.Paths)  # disabled

# ----
# 外壁_処理
xy_4 = XYPlane(Origin=Point(0, 0, 0))  # disabled
orient_2 = Orient(Geometry=input_exteriorwall_2, Source=evalsrf_3.Frame, Target=xy_4)  # -> graft(Geometry), Transform; disabled
tstat_14 = TreeStatistics(Tree=orient_2.Geometry)  # -> Paths, Length, Count; disabled
replace_5 = ReplacePaths(Data=orient_2.Geometry, Search=tstat_14.Paths, Replace=tstat_12.Paths)  # disabled
toggle_3 = BooleanToggle(True)  # disabled
clean_2 = CleanTree(RemoveNulls=toggle_3, RemoveInvalid=toggle_3, RemoveEmpty=toggle_3, Tree=replace_5)  # disabled
roomc_1wall = Brep(clean_2)  # disabled
crv = Curve(roomc_1wall)  # disabled
explode_2 = Explode(Curve=crv, Recursive=True)  # -> Segments, Vertices; disabled
sunion_6 = SetUnion(SetA=explode_2.Vertices)  # disabled
pdecon_4 = Deconstruct(Point=sunion_6)  # -> XComponent, YComponent, ZComponent; disabled
cluster_33 = Cluster_20(input_expswall=pdecon_4.XComponent)  # disabled
cluster_34 = Cluster_20(input_expswall=pdecon_4.YComponent)  # disabled
panel_79 = Panel("     0     0")  # disabled
concat_19 = Concatenate(FragmentD=panel_79, FragmentA=cluster_33, FragmentC=panel_79, FragmentB=cluster_34)  # disabled
pshift_3 = ShiftPaths(Data=concat_19, Offset=-1)  # disabled

# ----
# 外屋根_処理
xy_5 = XYPlane(Origin=Point(0, 0, 0))  # disabled
orient_3 = Orient(Geometry=getfaceproperties_30.geometries, Source=evalsrf.Frame, Target=xy_5)  # -> graft(Geometry), Transform; disabled
tstat_15 = TreeStatistics(Tree=orient_3.Geometry)  # -> Paths, Length, Count; disabled
replace_6 = ReplacePaths(Data=orient_3.Geometry, Search=tstat_15.Paths, Replace=tstat_12.Paths)  # disabled
toggle_4 = BooleanToggle(True)  # disabled
clean_3 = CleanTree(RemoveNulls=toggle_4, RemoveInvalid=toggle_4, RemoveEmpty=toggle_4, Tree=replace_6)  # disabled
roomc_1wall_2 = Brep(clean_3)  # disabled
crv_2 = Curve(roomc_1wall_2)  # disabled
explode_3 = Explode(Curve=crv_2, Recursive=True)  # -> Segments, Vertices; disabled
sunion_7 = SetUnion(SetA=explode_3.Vertices)  # disabled
pdecon_5 = Deconstruct(Point=sunion_7)  # -> XComponent, YComponent, ZComponent; disabled
cluster_35 = Cluster_20(input_expswall=pdecon_5.XComponent)  # disabled
cluster_36 = Cluster_20(input_expswall=pdecon_5.YComponent)  # disabled
panel_80 = Panel("     0     0")  # disabled
concat_20 = Concatenate(FragmentD=panel_80, FragmentA=cluster_35, FragmentC=panel_80, FragmentB=cluster_36)  # disabled
pshift_4 = ShiftPaths(Data=concat_20, Offset=-1)  # disabled

# ----
# 内壁_処理
xy_6 = XYPlane(Origin=Point(0, 0, 0))  # disabled
orient_4 = Orient(Geometry=getfaceproperties_29.geometries, Source=evalsrf_2.Frame, Target=xy_6)  # -> graft(Geometry), Transform; disabled
tstat_16 = TreeStatistics(Tree=orient_4.Geometry)  # -> Paths, Length, Count; disabled
replace_7 = ReplacePaths(Data=orient_4.Geometry, Search=tstat_16.Paths, Replace=tstat_12.Paths)  # disabled
toggle_5 = BooleanToggle(True)  # disabled
clean_4 = CleanTree(RemoveNulls=toggle_5, RemoveInvalid=toggle_5, RemoveEmpty=toggle_5, Tree=replace_7)  # disabled
roomc_1wall_3 = Brep(clean_4)  # disabled
crv_3 = Curve(roomc_1wall_3)  # disabled
explode_4 = Explode(Curve=crv_3, Recursive=True)  # -> Segments, Vertices; disabled
sunion_8 = SetUnion(SetA=explode_4.Vertices)  # disabled
pdecon_6 = Deconstruct(Point=sunion_8)  # -> XComponent, YComponent, ZComponent; disabled
cluster_37 = Cluster_20(input_expswall=pdecon_6.XComponent)  # disabled
cluster_38 = Cluster_20(input_expswall=pdecon_6.YComponent)  # disabled
panel_81 = Panel("     0     0")  # disabled
concat_21 = Concatenate(FragmentD=panel_81, FragmentA=cluster_37, FragmentC=panel_81, FragmentB=cluster_38)  # disabled
pshift_5 = ShiftPaths(Data=concat_21, Offset=-1)  # disabled

# ----
# 窓付き_処理
replace_8 = ReplacePaths(Data=input_exteriorwall, Search=tstat_11.Paths, Replace=tstat_12.Paths)  # disabled
toggle_6 = BooleanToggle(True)  # disabled
merge_8 = Merge(Data1=item_15, Data2=replace_8)  # disabled
clean_5 = CleanTree(RemoveNulls=toggle_6, RemoveInvalid=toggle_6, RemoveEmpty=toggle_6, Tree=merge_8)  # disabled
lng_16 = ListLength(List=clean_5)  # disabled
python_60 = GhPythonScript(x=lng_16)  # -> a; disabled; same code as python_2
panel_82 = Panel("true")  # disabled
mindex_6 = MemberIndex(Set=python_60, Member=panel_82)  # -> Index, Count; disabled
xy_7 = XYPlane(Origin=Point(0, 0, 0))  # disabled

# ---- group: ちょっと怖い
pshift_6 = ShiftPaths(Data=mindex_6.Index, Offset=-1)  # disabled

# ----
clean_6 = CleanTree(RemoveNulls=toggle_6, RemoveInvalid=toggle_6, RemoveEmpty=toggle_6, Tree=pshift_6)  # disabled
tstat_17 = TreeStatistics(Tree=clean_6)  # -> Paths, Length, Count; disabled

# ---- group: Plane
split_5 = SplitTree(Data=replace_4, Masks=flatten(tstat_17.Paths))  # -> Positive, Negative; disabled

# ---- group: オブジェクト
split_6 = SplitTree(Data=merge_8, Masks=flatten(tstat_17.Paths))  # -> Positive, Negative; disabled

# ----
orient_5 = Orient(Geometry=split_6.Positive, Source=split_5.Positive, Target=xy_7)  # -> Geometry, Transform; disabled

# ----
# 窓と壁の分離
area_2 = Area(Geometry=orient_5.Geometry)  # -> Area, Centroid; disabled
tstat_18 = TreeStatistics(Tree=orient_5.Geometry)  # -> Paths, Length, Count; disabled
sort_2 = SortList(Keys=area_2.Area)  # -> Keys, ValuesA; disabled
item_16 = ListItem(List=sort_2.Keys, Index=0, Wrap=True)  # -> Item1, Item; disabled
mindex_7 = MemberIndex(Set=area_2.Area, Member=item_16.Item1)  # -> Index, Count; disabled

# ---- group: 窓
cull_i = CullIndex(List=orient_5.Geometry, Indices=mindex_7.Index, Wrap=True)  # disabled

# ---- group: 壁
item_17 = ListItem(List=orient_5.Geometry, Index=mindex_7.Index, Wrap=True)  # disabled

# ----
tstat_19 = TreeStatistics(Tree=cull_i)  # -> Paths, Length, Count; disabled
tstat_20 = TreeStatistics(Tree=item_17)  # -> Paths, Length, Count; disabled
replace_9 = ReplacePaths(Data=cull_i, Search=tstat_19.Paths, Replace=tstat_18.Paths)  # disabled
replace_10 = ReplacePaths(Data=item_17, Search=tstat_20.Paths, Replace=tstat_18.Paths)  # disabled

roomc_1window = Brep(replace_9)  # disabled
roomc_1wall_4 = Brep(replace_10)  # disabled
cluster_39 = Cluster_22(roomc_1window=roomc_1window, roomc_1wall=roomc_1wall_4)  # -> output_exps_x2_2, output_exps_y2_2, output_exps_x3_2, output_exps_x1_2, output_exps_y3_2, output_exps_y1_2; disabled
python_61 = GhPythonScript(x=cluster_39.output_exps_y1_2)  # -> a; disabled; same code as python_2
python_62 = GhPythonScript(x=cluster_39.output_exps_y2_2)  # -> a; disabled; same code as python_2
python_63 = GhPythonScript(x=cluster_39.output_exps_y3_2)  # -> a; disabled; same code as python_2
python_64 = GhPythonScript(x=cluster_39.output_exps_x1_2)  # -> a; disabled; same code as python_2
python_65 = GhPythonScript(x=cluster_39.output_exps_x2_2)  # -> a; disabled; same code as python_2
python_66 = GhPythonScript(x=cluster_39.output_exps_x3_2)  # -> a; disabled; same code as python_2
concat_22 = Concatenate(
    FragmentF=python_61,
    FragmentE=python_62,
    FragmentD=python_63,
    FragmentC=python_64,
    FragmentA=python_65,
    FragmentB=python_66)  # disabled

wall_y1_y3_x1_x3_zvを除く = Panel(pshift_3)  # disabled
wall_y1_y3_x1_x3_zvを除く_2 = Panel(pshift_4)  # disabled
wall_y1_y3_x1_x3_zvを除く_3 = Panel(pshift_5)  # disabled
wall_y1_y3_x1_x3_zvを除く_4 = Panel(concat_22)  # disabled

split_7 = SplitTree(Data=ungroup, Masks=flatten(item_14))  # -> Positive, Negative
pshift_7 = ShiftPaths(Data=split_7.Positive, Offset=-1)
tstat_21 = TreeStatistics(Tree=pshift_7)  # -> Paths, Length, Count
panel_83 = Panel(tstat_21.Paths)
split_8 = SplitTree(Data=split.Positive, Masks=flatten(tstat_21.Paths))  # -> Positive, Negative
pdecon_7 = Deconstruct(Point=split_7.Positive)  # -> XComponent, YComponent, ZComponent
sunion_9 = SetUnion(SetA=pdecon_7.XComponent)
sunion_10 = SetUnion(SetA=pdecon_7.YComponent)
sort_3 = SortList(Keys=sunion_9)  # -> Keys, ValuesA
sort_4 = SortList(Keys=sunion_10)  # -> Keys, ValuesA
item_18 = ListItem(List=sort_3.Keys, Index=0, Wrap=True)  # -> Item1, Item
item_19 = ListItem(List=sort_4.Keys, Index=0, Wrap=True)  # -> Item1, Item

# ---- group: Point
orient_6 = Orient(Geometry=sunion, Source=split_8.Positive, Target=xy_2)  # -> Geometry, Transform

# ---- group: x1,y1
pt_2 = ConstructPoint(XCoordinate=item_18.Item, YCoordinate=item_19.Item, ZCoordinate=0)

# ---- group: x2,y1
pt_3 = ConstructPoint(XCoordinate=item_18.Item1, YCoordinate=item_19.Item, ZCoordinate=0)

# ---- group: x1,y2
pt_4 = ConstructPoint(XCoordinate=item_18.Item, YCoordinate=item_19.Item1, ZCoordinate=0)

# ---- group: x2,y2
pt_5 = ConstructPoint(XCoordinate=item_18.Item1, YCoordinate=item_19.Item1, ZCoordinate=0)

# ---- group: Window
orient_7 = Orient(Geometry=entwine, Source=split_8.Positive, Target=xy_3)  # -> Geometry, Transform

# ----
merge_9 = Merge(Data1=pt_2, Data2=pt_3, Data3=pt_5, Data4=pt_4)
pline = PolyLine(Vertices=merge_9, Closed=Toggle(True))
pshift_8 = ShiftPaths(Data=pline, Offset=-1)
srf_3 = Surface(pshift_8)
tstat_22 = TreeStatistics(Tree=orient_7.Geometry)  # -> Paths, Length, Count
panel_84 = Panel(pline)
tstat_23 = TreeStatistics(Tree=srf_3)  # -> Paths, Length, Count
replace_11 = ReplacePaths(Data=orient_7.Geometry, Search=tstat_22.Paths, Replace=tstat_23.Paths)
panel_85 = Panel(srf_3)
clean_7 = CleanTree(RemoveNulls=toggle_2, RemoveInvalid=toggle_2, RemoveEmpty=toggle_2, Tree=replace_11)
roomc_1window_2 = Brep(clean_7)
roomc_1wall_5 = Brep(srf_3)
crv_4 = Curve(roomc_1wall_5)
explode_5 = Explode(Curve=crv_4, Recursive=True)  # -> Segments, Vertices
sunion_11 = SetUnion(SetA=explode_5.Vertices)
cluster_40 = Cluster_21(roomc_1wall=roomc_1wall_5, roomc_1window=roomc_1window_2)  # -> exps_x3, exps_y3, exps_x2, exps_x1, exps_y2, exps_y1
pdecon_8 = Deconstruct(Point=sunion_11)  # -> XComponent, YComponent, ZComponent
cluster_41 = Cluster_20(input_expswall=pdecon_8.XComponent)
cluster_42 = Cluster_20(input_expswall=pdecon_8.YComponent)
output_exps_x1ory1 = Data(cluster_40.exps_y3)
output_exps_x2ory2 = Data(cluster_40.exps_y1)
output_exps_x2ory2_2 = Data(cluster_40.exps_y2)
output_exps_x1ory1_2 = Data(cluster_40.exps_x1)
output_exps_x2ory2_3 = Data(cluster_40.exps_x3)
output_exps_x2ory2_4 = Data(cluster_40.exps_x2)
python_67 = GhPythonScript(x=output_exps_x2ory2)  # -> a; same code as python_2
python_68 = GhPythonScript(x=output_exps_x2ory2_2)  # -> a; same code as python_2
python_69 = GhPythonScript(x=output_exps_x1ory1)  # -> a; same code as python_2
python_70 = GhPythonScript(x=output_exps_x2ory2_3)  # -> a; same code as python_2
python_71 = GhPythonScript(x=output_exps_x2ory2_4)  # -> a; same code as python_2
python_72 = GhPythonScript(x=output_exps_x1ory1_2)  # -> a; same code as python_2
concat_23 = Concatenate(FragmentD="     0     0", FragmentA=cluster_41, FragmentC="     0     0", FragmentB=cluster_42)
concat_24 = Concatenate(
    FragmentF=python_67,
    FragmentE=python_68,
    FragmentD=python_69,
    FragmentC=python_70,
    FragmentA=python_71,
    FragmentB=python_72)
wall_y1_y3_x1_x3_zvを除く_5 = Panel(concat_23)
window_2 = Panel(concat_24)

# ==== cluster Cluster
brep = ClusterInput()
brep_2 = Brep(brep)

# ----
# 全オブジェクトから最も体積の大きいオブジェクトの選択
volume = Volume(Geometry=brep_2)  # -> Volume, Centroid
sort_list = SortList(Keys=volume.Volume)  # -> Keys, ValuesValuesA
list_item = ListItem(List=sort_list.Keys, Index="-1", Wrap=True)

panel = Panel(volume.Volume)

member_index = MemberIndex(Set=list_item, Member=volume.Volume)  # -> flatten(Index), Count
# 選択したオブジェクトからのリスト番号を抽出し
# その他オブジェクトで分断
addition = Addition(A=member_index.Index, B=1)
split_list = SplitList(List=brep_2, Index=addition)  # -> ListA, ListB
split_brep_multiple = SplitBrepMultiple(Brep=split_list.ListA, Cutters=split_list.ListB)  # -> graft(Result)

# ----
# 切断した体積を修復
cap_holes_ex = CapHolesEx(Brep=split_brep_multiple)  # -> simplify(Brep), Caps, Solid
brep_3 = ClusterOutput(cap_holes_ex.Brep)

# ==== cluster Cluster_2
G = ClusterInput()
volume = Volume(Geometry=G)  # -> simplify(Volume), Centroid
python = GhPythonScript(x=volume.Volume)  # -> a
# ---------- python: Python ----------
__author__ = "81803"
__version__ = "2021.09.09"

import rhinoscriptsyntax as rs
x = str(x)
w = x.find('.')
w2 = w+2
if w == -1:
    a = x
else:
    a = x[0:w2]
# ---------- end python ----------
容積計算 = ClusterOutput(python)

# ==== cluster Cluster_3
brep = ClusterInput()
wires = BrepWireframe(Brep=brep, Density=-1)
# 各部屋のポイント
explode = Explode(Curve=wires, Recursive=True)  # -> Segments, Vertices
end = EndPoints(Curve=explode.Segments)  # -> simplify(Start), End
trim = TrimTree(Tree=end.Start, Depth=1)
cullpt = CullDuplicates(Points=trim, Tolerance=0.1, CullMode=3)  # -> Points, Indices, Valence
point = ClusterOutput(cullpt.Points)

# ==== cluster Cluster_5
P = ClusterInput()
pdecon = Deconstruct(Point=P)  # -> XComponent, YComponent, ZComponent
cluster = Cluster_4(input=pdecon.XComponent)  # -> 最大_2, 最小_2
cluster_2 = Cluster_4(input=pdecon.YComponent)  # -> 最大_2, 最小_2
cluster_3 = Cluster_4(input=pdecon.ZComponent)  # -> 最大_2, 最小_2
data = Data(simplify(cluster_2.最大_2))
data_2 = Data(simplify(cluster_3.最大_2))
data_3 = Data(simplify(cluster.最大_2))
data_4 = Data(simplify(cluster.最小_2))
data_5 = Data(simplify(cluster_2.最小_2))
data_6 = Data(simplify(cluster_3.最小_2))
容積 = ClusterInput()
concat = Concatenate(
    FragmentA=data_3,
    FragmentH=" ",
    FragmentB=data_4,
    FragmentI=" ",
    FragmentC=data,
    FragmentJ=" ",
    FragmentD=data_5,
    FragmentK=" ",
    FragmentE=data_2,
    FragmentL=" ",
    FragmentF=data_6,
    FragmentM=" ",
    FragmentG=容積)
部屋ごとに設定1_8 = ClusterOutput(concat)

# ==== cluster Cluster_8
brep = ClusterInput()
window = ClusterInput()
cluster = Cluster_7(brep=brep, window=window)  # -> I, 壁pt_2, 窓pt_2
窓pt = ClusterOutput(cluster.窓pt_2)
壁pt = ClusterOutput(cluster.壁pt_2)
mindex = MemberIndex(Set=cluster.I, Member=Toggle(True))  # -> simplify(Index), Count
I = ClusterOutput(mindex.Index)

# ==== cluster Cluster_9
観測点 = ClusterInput()
観測点_2 = Point(観測点)
原点 = Point(Point(0, 0, 0))
ln = Line(StartPoint=原点, EndPoint=観測点_2)

# ---- group: 長さを計測して、最大、最小の順番を抽出
len = Length(Curve=ln)
sort = SortList(Keys=len)  # -> Keys, ValuesA
item = ListItem(List=sort.Keys, Index="-1", Wrap=True)  # -> Item, Item1
最大 = Data(item.Item)
最小 = Data(item.Item1)
mindex = MemberIndex(Set=len, Member=最大)  # -> Index, Count
mindex_2 = MemberIndex(Set=len, Member=最小)  # -> Index, Count

# ---- group: 最小の点
item_2 = ListItem(List=観測点_2, Index=mindex_2.Index, Wrap=True)

# ---- group: 最大の点
item_3 = ListItem(List=観測点_2, Index=mindex.Index, Wrap=True)

# ----
format = Format(Format="{0:0.00}", Culture=127, Data0=item_2)
format_2 = Format(Format="{0:0.00}", Culture=127, Data0=item_3)
pdecon = Deconstruct(Point=format_2)  # -> XComponent, YComponent, ZComponent
pdecon_2 = Deconstruct(Point=format)  # -> XComponent, YComponent, ZComponent
X = ClusterOutput(pdecon.XComponent)
Y = ClusterOutput(pdecon.YComponent)
Z = ClusterOutput(pdecon.ZComponent)
X_2 = ClusterOutput(pdecon_2.XComponent)
Y_2 = ClusterOutput(pdecon_2.YComponent)
Z_2 = ClusterOutput(pdecon_2.ZComponent)

# ==== cluster Cluster_10
point = ClusterInput()
容積 = ClusterInput()
point_2 = Data(point)
容積_2 = Data(容積)
pdecon = Deconstruct(Point=point_2)  # -> XComponent, YComponent, ZComponent
graft = GraftTree(Tree=容積_2, IncludeEmptyLists=True, IncludeNullItems=True)  # -> simplify(Tree)
cluster = Cluster_4(input=pdecon.XComponent)  # -> simplify(最大_2), simplify(最小_2)
cluster_2 = Cluster_4(input=pdecon.YComponent)  # -> simplify(最大_2), simplify(最小_2)
cluster_3 = Cluster_4(input=pdecon.ZComponent)  # -> simplify(最大_2), simplify(最小_2)
concat = Concatenate(
    A=" ",
    x1=cluster.最小_2,
    B=" ",
    y1=cluster_2.最小_2,
    C=" ",
    z1=cluster_3.最小_2,
    D=" ",
    x2=cluster.最大_2,
    E=" ",
    y2=cluster_2.最大_2,
    F=" ",
    z2=cluster_3.最大_2,
    G=" ",
    容積=graft,
    H=" ",
    I=" ")  # -> flatten(部屋ごとに設定)
部屋ごとに設定 = ClusterOutput(concat)

# ==== cluster Cluster_11
input = ClusterInput()
input_2 = Data(input)
tstat = TreeStatistics(Tree=input_2)  # -> Paths, Length, Count
join = TextJoin(Text=input_2, Join=" ")  # -> flatten(Result)
data = Data(flatten(tstat.Length))
python = GhPythonScript(x=data)  # -> a
# ---------- python: Python ----------
__author__ = "81803"
__version__ = "2022.02.04"

import rhinoscriptsyntax as rs
x1 = 6-x
x2 = " 0"*x1
if x2 == " 0 0 0 0 0 0":
    x2 = "0 0 0 0 0 0"
a = x2
# ---------- end python ----------
concat = Concatenate(FragmentA=join, FragmentB=python)
window_id = Data(concat)
window_id_2 = ClusterOutput(window_id)

# ==== cluster Cluster_12
txt = ClusterInput()
txt_2 = ClusterInput()
panel = Panel("2000")
txt_3 = Text(" ")
txt_4 = Text(txt)
txt_5 = Text(txt_2)
python = GhPythonScript(x=txt_3)  # -> a
# ---------- python: Python ----------
__author__ = "81803"
__version__ = "2021.06.22"

import rhinoscriptsyntax as rs
xx = str(x)
y = len(xx)
z = " "
q = 3 - y
a = z*q+xx
# ---------- end python ----------
python_2 = GhPythonScript(x=txt_4)  # -> a; same code as python
python_3 = GhPythonScript(x=txt_5)  # -> a; same code as python
concat = Concatenate(FragmentA=python, FragmentB=python_2, FragmentC=python_3)
R = ClusterOutput(concat)

# ==== cluster Cluster_13
人数 = ClusterInput()
床面積 = ClusterInput()
人数_2 = Data(人数)
床面積_2 = Data(床面積)
multiplication = Multiplication(A=人数_2, B="20")
division = Division(A=multiplication, B=床面積_2)
num = Number(division)
小数点変更 = GhPythonScript(x=num)  # -> a
# ---------- 小数点変更: Python ----------
__author__ = "81803"
__version__ = "2021.07.04"

import rhinoscriptsyntax as rs
x
a = ('{:.1f}'.format(x))
# ---------- end 小数点変更 ----------
python = GhPythonScript(x=小数点変更)  # -> a
# ---------- python: Python ----------
__author__ = "81803"
__version__ = "2021.06.22"

import rhinoscriptsyntax as rs
xx = str(x)
y = len(xx)
z = " "
q = 6 - y
a = z*q+xx
# ---------- end python ----------
a = ClusterOutput(python)

# ==== cluster Cluster_14
内壁 = ClusterInput()
柱 = ClusterInput()
外表面 = ClusterInput()
外壁厚さ = ClusterInput()
内壁_2 = Data(内壁)
構造決定 = ClusterInput()
柱_2 = Data(柱)
外表面_2 = Data(外表面)
外壁厚さ_2 = Data(外壁厚さ)
構造決定_2 = Data(構造決定)
構造 = Data(構造決定_2)
kouzo = GhPythonScript(x=構造決定_2)  # -> a, b, c
# ---------- kouzo: Python ----------
__author__ = "81803"
__version__ = "2021.07.11"

import rhinoscriptsyntax as rs
x0 = int(x)
if x0 == 0:
    x1 = "構造を選択してください"
elif x0 == 1:
    x1 = " 27  1 32  7"
else :
    x1 = " 32 31"
if x1 == " 27  1 32  7":
    x2 = 16
elif x1 == " 32 31":
    x2 = 62
else:
    x2 = "構造を選択してください"
if x2 == 16:
    x3 = " 32  7 27  1"
elif x2 == 62:
    x3 = " 31 32"
else:
    x3 = ""
a = x1
b = x2
c = x3
# ---------- end kouzo ----------
python = GhPythonScript(x=外表面_2)  # -> a
# ---------- python: Python ----------
__author__ = "81803"
__version__ = "2021.06.22"

import rhinoscriptsyntax as rs
x0 = int(x)
if x0 == 0:
    x1 = "外壁を選択してください"
else:
    x1 = x0
a = x1
# ---------- end python ----------
python_2 = GhPythonScript(x=構造決定_2)  # -> a, b, c; same code as kouzo
txt = Text(構造)
subtraction = Subtraction(A=柱_2, B=kouzo.b)
subtraction_2 = Subtraction(A=内壁_2, B=python_2.b)
python_3 = GhPythonScript(x=txt)  # -> a
# ---------- python_3: Python ----------
__author__ = "81803"
__version__ = "2021.06.22"

import rhinoscriptsyntax as rs
x0 = int(x)
if x0 == 0:
    x1 = "構造を選択してください"
elif x0 == 1:
    x1 = " 52 28"
else :
    x1 = " 86 10"
a = x1
# ---------- end python_3 ----------
python_4 = GhPythonScript(x=python)  # -> a
# ---------- python_4: Python ----------
__author__ = "81803"
__version__ = "2021.06.22"

import rhinoscriptsyntax as rs
x = str(x)
y = len(x)
z = " "
qa = " 20"
q = 3 - y
a = z*q+x+qa
# ---------- end python_4 ----------
python_5 = GhPythonScript(x=python_3)  # -> a
# ---------- python_5: Python ----------
__author__ = "81803"
__version__ = "2021.06.22"

import rhinoscriptsyntax as rs
x0 = str(x)
if x0 == " 52 28":
    x1 = 28
elif x0 == 1:
    x1 = " 86 10"
else :
    x1 = 10
a = x1
# ---------- end python_5 ----------
python_6 = GhPythonScript(y=構造決定_2, x=subtraction)  # -> a
# ---------- python_6: Python ----------
__author__ = "81803"
__version__ = "2021.06.22"

import rhinoscriptsyntax as rs
y = str(y)
if y == "1":
    qa = " 52"
else:
    qa = " 72"

w = str(x)
e = len(w)
z = " "
q = 3 - e
a = qa+z*q+w
# ---------- end python_6 ----------
python_7 = GhPythonScript(y=構造決定_2, x=subtraction_2)  # -> a; same code as python_6
python_8 = GhPythonScript(x=python_5)  # -> a
# ---------- python_8: Python ----------
__author__ = "81803"
__version__ = "2021.06.22"

import rhinoscriptsyntax as rs
x0 = str(x)
if x0 == "10":
    x1 = 20
else :
    x1 = x0
a = x1
# ---------- end python_8 ----------
panel = Panel(python_4)
python_9 = GhPythonScript(x=python_8)  # -> a
# ---------- python_9: Python ----------
__author__ = "81803"
__version__ = "2021.07.11"

import rhinoscriptsyntax as rs
x = str(x)
if x == "28":
    x1 = "20"
else:
    x1 = ""
a = x1
# ---------- end python_9 ----------
subtraction_3 = Subtraction(A=外壁厚さ_2, B=python_9, C=python_8)
python_10 = GhPythonScript(y=python_8, x=subtraction_3)  # -> a
# ---------- python_10: Python ----------
__author__ = "81803"
__version__ = "2021.06.22"

import rhinoscriptsyntax as rs
y = str(y)
if y == "20":
    qa = " 22"
    qb = " 86 10"
else:
    qa = " 71"
    qb = ""

w = str(x)
e = len(w)
z = " "
q = 3 - e
a = qa+z*q+w+qb
# ---------- end python_10 ----------
concat = Concatenate(FragmentD="WCON  BEC  ", FragmentA=kouzo.a, FragmentB=python_6, FragmentC=kouzo.c)
concat_2 = Concatenate(FragmentD="WCON  IWA  ", FragmentA=python_2.a, FragmentB=python_7, FragmentC=python_2.c)
bec = Data(concat)
iwa = Data(concat_2)
python_11 = GhPythonScript(y=python_3, x=python_4, z=python_10)  # -> a
# ---------- python_11: Python ----------
__author__ = "81803"
__version__ = "2021.06.22"

import rhinoscriptsyntax as rs
x = str(x)
y = str(y)
z = str(z)
if y ==" 52 28":
    x1 = x
    z1 = z
else:
    x1 = ""
    z1 = z

a1 = x1 + y +z1
a = a1
# ---------- end python_11 ----------
panel_2 = Panel(python_11)
concat_3 = Concatenate(FragmentA="WCON  GWA  ", FragmentB=python_11)
concat_4 = Concatenate(FragmentA="WCON  OWA  ", FragmentB=python_11)
gwa = Data(concat_3)
owa = Data(concat_4)
merge = Merge(Data1=owa, Data2=iwa, Data3=gwa, Data4=bec)
wcon = ClusterOutput(merge)

# ==== cluster Cluster_15

python = GhPythonScript(x="7")  # -> a
# ---------- python: Python ----------
__author__ = "81803"
__version__ = "2021.06.22"

import rhinoscriptsyntax as rs
x = int(x)
z = " "
a = z * x
# ---------- end python ----------

x = ClusterInput()
x_2 = ClusterInput()

python_2 = GhPythonScript(x="24")  # -> a; same code as python

x_3 = ClusterInput()
python_3 = GhPythonScript(x=x)  # -> a; same code as python
python_4 = GhPythonScript(x=x_2)  # -> a, b
# ---------- python_4: Python ----------
__author__ = "81803"
__version__ = "2021.06.22"

import rhinoscriptsyntax as rs
xx = str(x)
y = len(xx)
z = " "
q = 3 - y
a = z*q+xx
if x == 0:
    bb = 0
else:
    bb = 0
r = 3 - bb
b = z*q+str(bb)
# ---------- end python_4 ----------
python_5 = GhPythonScript(x=x_3)  # -> a; same code as python
助走開始 = ClusterInput()
計算開始 = ClusterInput()
計算終了 = ClusterInput()
concat = Concatenate(
    FragmentA="CNTL",
    FragmentB=python,
    FragmentC=python_4.a,
    FragmentD=python_5,
    FragmentE="  0",
    FragmentF=python_3,
    FragmentG=python_4.b,
    FragmentH=助走開始,
    FragmentA_2=計算開始,
    FragmentB_2=計算終了,
    FragmentC_2="  1",
    FragmentA_3=python_2)
R = ClusterOutput(concat)

# ==== cluster Cluster_16
python = GhPythonScript(x="18")  # -> a; same code as python
a = ClusterOutput(python)

# ==== cluster Cluster_17
d1 = ClusterInput()
d2 = ClusterInput()
txt = Text("CMPL")
merge = Merge(Data1=d1, Data2=d2)  # -> flatten(Result)
cmpl = Text(txt)
merge_2 = Merge(Data1=merge, Data2=cmpl)
R = ClusterOutput(merge_2)

# ==== cluster Cluster_18
infl = ClusterInput()
ligh = ClusterInput()
ocup = ClusterInput()
heat = ClusterInput()
furn = ClusterInput()
sopc = ClusterInput()
spac = ClusterInput()
owal = ClusterInput()
iwal = ClusterInput()
gwal = ClusterInput()
beco = ClusterInput()
wndw = ClusterInput()
data = ClusterInput()
infl_2 = Data(infl)
ligh_2 = Text(ligh)
ocup_2 = Text(ocup)
heat_2 = Text(heat)
furn_2 = Text(furn)
sopc_2 = Text(sopc)
spac_2 = Data(spac)
owal_2 = Data(owal)
iwal_2 = Data(iwal)
gwal_2 = Data(gwal)
beco_2 = Data(beco)
wndw_2 = Data(wndw)
data_2 = Data(data)
階層データ = Merge(
    Data1=spac_2,
    Data2=owal_2,
    Data3=iwal_2,
    Data4=gwal_2,
    Data5=beco_2,
    Data6=wndw_2,
    Data7=infl_2,
    Data8=ligh_2,
    Data9=ocup_2,
    Data10=heat_2,
    Data11=furn_2,
    Data12=sopc_2,
    Data13=data_2)
R = ClusterOutput(階層データ)

# ==== cluster Cluster_19
fin = ClusterInput()
fin_2 = Data(fin)
panel = Panel(fin_2)
python = GhPythonScript(x=panel)  # -> out, a; same code as python
job名 = ClusterInput()
buil = ClusterInput()
cntl = ClusterInput()
hrat = ClusterInput()
exps = ClusterInput()
wcon = ClusterInput()
seas = ClusterInput()
wsch = ClusterInput()
dsch = ClusterInput()
dsch1 = ClusterInput()
opco = ClusterInput()
job名_2 = Text(job名)
buil_2 = Text(buil)
cntl_2 = Text(cntl)
hrat_2 = Text(hrat)
exps_2 = Text(exps)
wcon_2 = Text(wcon)
seas_2 = Text(seas)
wsch_2 = Text(wsch)
dsch_2 = Text(dsch)
dsch1_2 = Text(dsch1)
opco_2 = Text(opco)
fin_3 = Text(python.a)
merge = Merge(
    Data1=job名_2,
    Data2=buil_2,
    Data3=cntl_2,
    Data4=hrat_2,
    Data5=exps_2,
    Data6=wcon_2,
    Data7=seas_2,
    Data8=wsch_2,
    Data9=dsch_2,
    Data10=dsch1_2,
    Data11=opco_2,
    Data12=fin_3)
R = ClusterOutput(merge)

# ==== cluster Cluster_20
input_expswall = ClusterInput()
input_expswall_2 = Data(input_expswall)
sunion = SetUnion(SetA=input_expswall_2)
sort = SortList(Keys=sunion)  # -> Keys, ValuesA
item = ListItem(List=sort.Keys, Index=0, Wrap=True)  # -> Item1, Item
max = Data(item.Item1)
min = Data(item.Item)
subtraction = Subtraction(A=max, B=min)
python = GhPythonScript(x=subtraction)  # -> a
# ---------- python: Python ----------
__author__ = "81803"
__version__ = "2021.09.09"

import rhinoscriptsyntax as rs
x = str(x)
w = x.find('.')
w2 = w+3
if w == -1:
    a = x
else:
    a = x[0:w2]
# ---------- end python ----------
python_2 = GhPythonScript(x=python)  # -> a
# ---------- python_2: Python ----------
__author__ = "81803"
__version__ = "2021.06.22"

import rhinoscriptsyntax as rs
y = len(x)
z = " "
q = 6 - y
a = z*q+x
# ---------- end python_2 ----------
output = Data(python_2)
output_2 = ClusterOutput(output)

# ==== cluster Cluster_21
roomc_1window = ClusterInput()
roomc_1wall = ClusterInput()
roomc_1window_2 = Brep(roomc_1window)
roomc_1wall_2 = Brep(roomc_1wall)

# ---- group: 窓用壁
tstat = TreeStatistics(Tree=roomc_1window_2)  # -> Paths, graft(Length), Count
split = SplitTree(Data=roomc_1wall_2, Masks=flatten(tstat.Paths))  # -> Positive, Negative
dup = DuplicateData(Data=split.Positive, Number=tstat.Length, Order=True)

# ----
crv = Curve(roomc_1window_2)
tstat_2 = TreeStatistics(Tree=crv)  # -> Paths, Length, Count
crv_2 = Curve(dup)
tstat_3 = TreeStatistics(Tree=crv_2)  # -> Paths, Length, Count
replace = ReplacePaths(Data=crv_2, Search=tstat_3.Paths, Replace=tstat_2.Paths)
explode = Explode(Curve=crv, Recursive=True)  # -> Segments, Vertices
explode_2 = Explode(Curve=replace, Recursive=True)  # -> Segments, Vertices
sunion = SetUnion(SetA=explode.Vertices)
sunion_2 = SetUnion(SetA=explode_2.Vertices)
pdecon = Deconstruct(Point=sunion)  # -> XComponent, YComponent, ZComponent
pdecon_2 = Deconstruct(Point=sunion_2)  # -> XComponent, YComponent, ZComponent

input_expwindow = Data(pdecon.XComponent)
input_expwindow_2 = Data(input_expwindow)
sunion_3 = SetUnion(SetA=input_expwindow_2)
sort = SortList(Keys=sunion_3)  # -> Keys, ValuesA
item = ListItem(List=sort.Keys, Index=0, Wrap=True)  # -> Item1, Item
max = Data(item.Item1)
min = Data(item.Item)
subtraction = Subtraction(A=max, B=min)
python = GhPythonScript(x=subtraction)  # -> a; same code as python
output_exps_x2ory2 = Data(python)
exps_x2 = ClusterOutput(output_exps_x2ory2)  # EXPS_X2

input_exps_wall_window用 = Data(pdecon_2.XComponent)
input_exps_wall_window用_2 = Data(input_exps_wall_window用)
sunion_4 = SetUnion(SetA=input_exps_wall_window用_2)
sort_2 = SortList(Keys=sunion_4)  # -> Keys, ValuesA
item_2 = ListItem(List=sort_2.Keys, Index=0, Wrap=True)  # -> Item1, Item
max_2 = Data(item_2.Item1)
min_2 = Data(item_2.Item)
subtraction_2 = Subtraction(A=max_2, B=max)
python_2 = GhPythonScript(x=subtraction_2)  # -> a; same code as python
output_exps_x3ory3 = Data(python_2)
exps_x3 = ClusterOutput(output_exps_x3ory3)  # EX{S_X3

subtraction_3 = Subtraction(A=min, B=min_2)
python_3 = GhPythonScript(x=subtraction_3)  # -> a; same code as python
output_exps_x1ory1 = Data(python_3)
exps_x1 = ClusterOutput(output_exps_x1ory1)  # EXPS_X1

input_expwindow_3 = Data(pdecon.YComponent)
input_expwindow_4 = Data(input_expwindow_3)
sunion_5 = SetUnion(SetA=input_expwindow_4)
sort_3 = SortList(Keys=sunion_5)  # -> Keys, ValuesA
item_3 = ListItem(List=sort_3.Keys, Index=0, Wrap=True)  # -> Item1, Item
max_3 = Data(item_3.Item1)
min_3 = Data(item_3.Item)
subtraction_4 = Subtraction(A=max_3, B=min_3)
python_4 = GhPythonScript(x=subtraction_4)  # -> a; same code as python
output_exps_x2ory2_2 = Data(python_4)
exps_y2 = ClusterOutput(output_exps_x2ory2_2)  # EXPS_Y2

input_exps_wall_window用_3 = Data(pdecon_2.YComponent)
input_exps_wall_window用_4 = Data(input_exps_wall_window用_3)
sunion_6 = SetUnion(SetA=input_exps_wall_window用_4)
sort_4 = SortList(Keys=sunion_6)  # -> Keys, ValuesA
item_4 = ListItem(List=sort_4.Keys, Index=0, Wrap=True)  # -> Item1, Item
max_4 = Data(item_4.Item1)
min_4 = Data(item_4.Item)
subtraction_5 = Subtraction(A=max_4, B=max_3)
python_5 = GhPythonScript(x=subtraction_5)  # -> a; same code as python
output_exps_x3ory3_2 = Data(python_5)
exps_y3 = ClusterOutput(output_exps_x3ory3_2)  # EXPS_Y3

subtraction_6 = Subtraction(A=min_3, B=min_4)
python_6 = GhPythonScript(x=subtraction_6)  # -> a; same code as python
output_exps_x1ory1_2 = Data(python_6)
exps_y1 = ClusterOutput(output_exps_x1ory1_2)  # EXPS_Y1

# ==== cluster Cluster_22
roomc_1window = ClusterInput()
roomc_1wall = ClusterInput()
roomc_1window_2 = Brep(roomc_1window)
roomc_1wall_2 = Brep(roomc_1wall)
explode = Explode(Curve=roomc_1wall_2, Recursive=True)  # -> Segments, Vertices
explode_2 = Explode(Curve=roomc_1window_2, Recursive=True)  # -> Segments, Vertices
sunion = SetUnion(SetA=explode.Vertices)
sunion_2 = SetUnion(SetA=explode_2.Vertices)
pdecon = Deconstruct(Point=sunion)  # -> XComponent, YComponent, ZComponent
pdecon_2 = Deconstruct(Point=sunion_2)  # -> XComponent, YComponent, ZComponent

input_exps_wall_window用 = Data(pdecon_2.XComponent)
input_exps_wall_window用_2 = Data(input_exps_wall_window用)
sunion_3 = SetUnion(SetA=input_exps_wall_window用_2)
sort = SortList(Keys=sunion_3)  # -> Keys, ValuesA
item = ListItem(List=sort.Keys, Index=0, Wrap=True)  # -> Item1, Item
min = Data(item.Item)
max = Data(item.Item1)
subtraction = Subtraction(A=max, B=min)
python = GhPythonScript(x=subtraction)  # -> a; same code as python
output_exps_x2 = Data(python)

input_expwindow = Data(pdecon.XComponent)
input_expwindow_2 = Data(input_expwindow)
sunion_4 = SetUnion(SetA=input_expwindow_2)
sort_2 = SortList(Keys=sunion_4)  # -> Keys, ValuesA
item_2 = ListItem(List=sort_2.Keys, Index=0, Wrap=True)  # -> Item1, Item
max_2 = Data(item_2.Item1)
min_2 = Data(item_2.Item)
subtraction_2 = Subtraction(A=max_2, B=max)
subtraction_3 = Subtraction(A=min, B=min_2)
python_2 = GhPythonScript(x=subtraction_3)  # -> a; same code as python
python_3 = GhPythonScript(x=subtraction_2)  # -> a; same code as python
output_exps_x1 = Data(python_2)
output_exps_x3 = Data(python_3)

input_exps_wall_window用_3 = Data(pdecon_2.YComponent)
input_exps_wall_window用_4 = Data(input_exps_wall_window用_3)
sunion_5 = SetUnion(SetA=input_exps_wall_window用_4)
sort_3 = SortList(Keys=sunion_5)  # -> Keys, ValuesA
item_3 = ListItem(List=sort_3.Keys, Index=0, Wrap=True)  # -> Item1, Item
max_3 = Data(item_3.Item1)
min_3 = Data(item_3.Item)
subtraction_4 = Subtraction(A=max_3, B=min_3)
python_4 = GhPythonScript(x=subtraction_4)  # -> a; same code as python
output_exps_y2 = Data(python_4)

input_expwindow_3 = Data(pdecon.YComponent)
input_expwindow_4 = Data(input_expwindow_3)
sunion_6 = SetUnion(SetA=input_expwindow_4)
sort_4 = SortList(Keys=sunion_6)  # -> Keys, ValuesA
item_4 = ListItem(List=sort_4.Keys, Index=0, Wrap=True)  # -> Item1, Item
max_4 = Data(item_4.Item1)
min_4 = Data(item_4.Item)
subtraction_5 = Subtraction(A=max_4, B=max_3)
subtraction_6 = Subtraction(A=min_3, B=min_4)
python_5 = GhPythonScript(x=subtraction_6)  # -> a; same code as python
python_6 = GhPythonScript(x=subtraction_5)  # -> a; same code as python
output_exps_y1 = Data(python_5)
output_exps_y3 = Data(python_6)

output_exps_x1_2 = ClusterOutput(output_exps_x1)
output_exps_y1_2 = ClusterOutput(output_exps_y1)
output_exps_x2_2 = ClusterOutput(output_exps_x2)
output_exps_y2_2 = ClusterOutput(output_exps_y2)
output_exps_x3_2 = ClusterOutput(output_exps_x3)
output_exps_y3_2 = ClusterOutput(output_exps_y3)

# ==== cluster EXPS_other
element = ClusterInput()
element_2 = Data(element)
geometory_ids = ClusterInput()
geo = ClusterInput()
geo_2 = Geometry(geo)

# ----
# 内壁_Plane生成
md_slider = MDSlider(SliderMode=0, slider_value=Point(0, 0, 0.5), x_domain=Domain(0, 1), y_domain=Domain(0, 1), z_domain=Domain(0, 1))
evalsrf = EvaluateSurface(Surface=reparameterize(geo_2), Point=md_slider)  # -> Point, Normal, UDirection, VDirection, Frame

# ----
# 内壁_処理
xy = XYPlane(Origin=Point(0, 0, 0))
orient = Orient(Geometry=geo_2, Source=evalsrf.Frame, Target=xy)  # -> simplify(graft(Geometry)), Transform
toggle = BooleanToggle(True)
clean = CleanTree(RemoveNulls=toggle, RemoveInvalid=toggle, RemoveEmpty=toggle, Tree=orient.Geometry)
roomc_1wall = Brep(clean)
crv = Curve(roomc_1wall)
explode = Explode(Curve=crv, Recursive=True)  # -> Segments, Vertices
sunion = SetUnion(SetA=explode.Vertices)
pdecon = Deconstruct(Point=sunion)  # -> XComponent, YComponent, ZComponent
cluster = Cluster_23(input_expswall=pdecon.XComponent)  # -> simplify(D)
cluster_2 = Cluster_23(input_expswall=pdecon.YComponent)  # -> simplify(D)

multiplication = Multiplication(A=cluster, B=cluster_2)
tstat = TreeStatistics(Tree=cluster)  # -> simplify(Paths), Length, Count
area = ClusterOutput(multiplication)  # Area
addition = Addition(A=geometory_ids)
dirangle = ClusterInput()  # dirAngle
tiltangle = ClusterInput()  # tiltAngle
python = GhPythonScript(x=addition, y=element_2)  # -> simplify(a)
# ---------- python: Python ----------
__author__ = "81803"
__version__ = "2022.03.04"

import rhinoscriptsyntax as rs
"""Provides a scripting component.
    Inputs:
        x: The x script variable
        y: The y script variable
    Output:
        a: The a output variable"""

__author__ = "81803"
__version__ = "2022.03.04"

import rhinoscriptsyntax as rs
x=str(x)
x1=len(x)
x2=3-x1
x3="_"*x2
y=str(y)
y1=y[0]
print y1
y2=y1.upper()
#print y2
x4=y2+x3+str(x)
a=x4
if a ==y2+"None":
    a=()
else:
    a=x4
    a=x4+"  "
# ---------- end python ----------
toggle_2 = BooleanToggle(True)
split = SplitTree(Data=simplify(graft(tiltangle)), Masks=flatten(tstat.Paths))  # -> Positive, Negative
split_2 = SplitTree(Data=simplify(graft(dirangle)), Masks=flatten(tstat.Paths))  # -> Positive, Negative
clean_2 = CleanTree(RemoveNulls=toggle_2, RemoveInvalid=toggle_2, RemoveEmpty=toggle_2, Tree=python)  # -> simplify(Tree)
python_2 = GhPythonScript(x=split.Positive)  # -> simplify(a); same code as python_2
python_3 = GhPythonScript(x=split_2.Positive)  # -> simplify(a); same code as python_2
panel = Panel(clean_2)
concat = Concatenate(
    EXPS="EXPS ",
    EXPS名=clean_2,
    傾斜角=python_2,
    方位角=python_3,
    隣棟距離="  0",
    隣棟高さ="  0",
    Zy="     0",
    y1="     0",
    y2="     0",
    y3=cluster_2,
    Zx="     0",
    x1="     0",
    x2="     0",
    x3=cluster)
result = ClusterOutput(concat)

# ==== cluster EXPS_Window
exwall_geo = ClusterInput()
exwall_geo_2 = Brep(exwall_geo)
window_id = ClusterInput()
window_geo = ClusterInput()
tiltangle = ClusterInput()
dirangle = ClusterInput()

exterior_geo = Brep(graft(exwall_geo_2))
window_id_2 = Data(window_id)
window_geo_2 = Data(window_geo)
input_exteriorwall = Brep(exwall_geo_2)
tstat = TreeStatistics(Tree=exterior_geo)  # -> Paths, Length, Count

tstat_2 = TreeStatistics(Tree=simplify(exterior_geo))  # -> Paths, Length, Count
rep = ReplaceText(Text=tstat_2.Paths, Find="{", RecursiveReplace=False)
rep_2 = ReplaceText(Text=rep, Find="}", RecursiveReplace=False)
path = ConstructPath(Indices=graft(rep_2))  # -> simplify(Branch)
cull_i = CullIndex(List=path, Indices="0", Wrap=True)  # -> simplify(List)
panel = Panel(cull_i)
window_id_3 = Data(window_id_2)
merge = Merge(Data1=cull_i, Data2=window_id_2)

# ----
# IDとリスト番号が違うための処理
addition = Addition(A=merge, B=-1)
addition_2 = Addition(A=merge)
python = GhPythonScript(x=addition)  # -> a
# ---------- python: Python ----------
__author__ = "81803"
__version__ = "2022.03.03"

import rhinoscriptsyntax as rs
if x == -1:
    a= ()
else:
    a=x
# ---------- end python ----------

item = ListItem(List=window_geo_2, Index=python, Wrap=True)

panel_2 = Panel(item)

# ---- group: 基盤となるデータ構造
tstat_3 = TreeStatistics(Tree=item)  # -> Paths, Length, Count

# ----
# 外壁_Plane生成
md_slider = MDSlider(SliderMode=0, slider_value=Point(0, 0, 0.5), x_domain=Domain(0, 1), y_domain=Domain(0, 1), z_domain=Domain(0, 1))
evalsrf = EvaluateSurface(Surface=reparameterize(input_exteriorwall), Point=md_slider)  # -> Point, Normal, UDirection, VDirection, Frame
data = Data(graft(evalsrf.Frame))
tstat_4 = TreeStatistics(Tree=data)  # -> Paths, Length, Count
replace = ReplacePaths(Data=data, Search=tstat_4.Paths, Replace=tstat_3.Paths)

# ----
# 窓付き_処理
replace_2 = ReplacePaths(Data=exterior_geo, Search=tstat.Paths, Replace=tstat_3.Paths)
toggle = BooleanToggle(True)
merge_2 = Merge(Data1=item, Data2=replace_2)
clean = CleanTree(RemoveNulls=toggle, RemoveInvalid=toggle, RemoveEmpty=toggle, Tree=merge_2)
lng = ListLength(List=clean)
python_2 = GhPythonScript(x=lng)  # -> a
# ---------- python_2: Python ----------
__author__ = "81803"
__version__ = "2022.03.02"

import rhinoscriptsyntax as rs
if x <= 1:
    a = "false"
else:
    a = "true"
# ---------- end python_2 ----------
mindex = MemberIndex(Set=python_2, Member="true")  # -> Index, Count
xy = XYPlane(Origin=Point(0, 0, 0))

# ---- group: ちょっと怖い
pshift = ShiftPaths(Data=mindex.Index, Offset=-1)

# ----
clean_2 = CleanTree(RemoveNulls=toggle, RemoveInvalid=toggle, RemoveEmpty=toggle, Tree=pshift)
tstat_5 = TreeStatistics(Tree=clean_2)  # -> Paths, Length, Count

# ---- group: Plane
split = SplitTree(Data=replace, Masks=flatten(tstat_5.Paths))  # -> Positive, Negative

# ---- group: オブジェクト
split_2 = SplitTree(Data=merge_2, Masks=flatten(tstat_5.Paths))  # -> Positive, Negative

# ----
orient = Orient(Geometry=split_2.Positive, Source=split.Positive, Target=xy)  # -> Geometry, Transform

# ----
# 窓と壁の分離
area = Area(Geometry=orient.Geometry)  # -> Area, Centroid
tstat_6 = TreeStatistics(Tree=orient.Geometry)  # -> Paths, Length, Count
sort = SortList(Keys=area.Area)  # -> Keys, ValuesA
item_2 = ListItem(List=sort.Keys, Index=0, Wrap=True)  # -> Item1, Item
mindex_2 = MemberIndex(Set=area.Area, Member=item_2.Item1)  # -> Index, Count

# ---- group: 窓
cull_i_2 = CullIndex(List=orient.Geometry, Indices=mindex_2.Index, Wrap=True)

# ---- group: 壁
item_3 = ListItem(List=orient.Geometry, Index=mindex_2.Index, Wrap=True)

# ----
tstat_7 = TreeStatistics(Tree=cull_i_2)  # -> Paths, Length, Count
tstat_8 = TreeStatistics(Tree=item_3)  # -> Paths, Length, Count
replace_3 = ReplacePaths(Data=cull_i_2, Search=tstat_7.Paths, Replace=tstat_6.Paths)
replace_4 = ReplacePaths(Data=item_3, Search=tstat_8.Paths, Replace=tstat_6.Paths)

roomc_1window = Brep(replace_3)
roomc_1wall = Brep(replace_4)
tstat_9 = TreeStatistics(Tree=roomc_1window)  # -> Paths, Length, Count
cluster = Cluster_22(roomc_1window=roomc_1window, roomc_1wall=roomc_1wall)  # -> output_exps_x2_2, output_exps_y2_2, output_exps_x3_2, output_exps_x1_2, output_exps_y3_2, output_exps_y1_2
split_3 = SplitTree(Data=simplify(graft(tiltangle)), Masks=flatten(tstat_9.Paths))  # -> Positive, Negative
split_4 = SplitTree(Data=simplify(graft(dirangle)), Masks=flatten(tstat_9.Paths))  # -> Positive, Negative
python_3 = GhPythonScript(x=addition_2)  # -> a
# ---------- python_3: Python ----------
__author__ = "81803"
__version__ = "2022.03.04"

import rhinoscriptsyntax as rs
x=str(x)
x1=len(x)
x2=3-x1
x3="_"*x2
x4="D"+x3+str(x)
a=x4
if a =="DNone":
    a=()
else:
    a=x4
    a=x4+"  "
# ---------- end python_3 ----------
toggle_2 = BooleanToggle(True)
python_4 = GhPythonScript(x=split_3.Positive)  # -> simplify(a); same code as python_2
python_5 = GhPythonScript(x=split_4.Positive)  # -> simplify(a); same code as python_2
clean_3 = CleanTree(RemoveNulls=toggle_2, RemoveInvalid=toggle_2, RemoveEmpty=toggle_2, Tree=python_3)
python_6 = GhPythonScript(x=cluster.output_exps_y1_2)  # -> simplify(a); same code as python_2
python_7 = GhPythonScript(x=cluster.output_exps_y2_2)  # -> simplify(a); same code as python_2
python_8 = GhPythonScript(x=cluster.output_exps_y3_2)  # -> simplify(a); same code as python_2
python_9 = GhPythonScript(x=cluster.output_exps_x1_2)  # -> simplify(a); same code as python_2
python_10 = GhPythonScript(x=cluster.output_exps_x2_2)  # -> simplify(a); same code as python_2
python_11 = GhPythonScript(x=cluster.output_exps_x3_2)  # -> simplify(a); same code as python_2
concat = Concatenate(
    EXPS="EXPS ",
    EXPS名=clean_3,
    傾斜角=python_4,
    方位角=python_5,
    隣棟距離="  0",
    隣棟高さ="  0",
    Zy="     0",
    y1=python_6,
    y2=python_7,
    y3=python_8,
    Zx="     0",
    x1=python_9,
    x2=python_10,
    x3=python_11)

addition_3 = Addition(A=cluster.output_exps_x2_2, B=cluster.output_exps_x3_2, C=cluster.output_exps_x1_2)
addition_4 = Addition(A=cluster.output_exps_y2_2)
multiplication = Multiplication(A=cluster.output_exps_y2_2, B=cluster.output_exps_x2_2)
python_12 = GhPythonScript(x=addition_3)  # -> a; same code as python
python_13 = GhPythonScript(x=multiplication)  # -> a; same code as python
python_14 = GhPythonScript(x=addition_4)  # -> a; same code as python
y2 = ClusterOutput(python_14)  # Y2
面積 = ClusterOutput(python_13)  # 面積
x1_x3 = ClusterOutput(python_12)  # X1~X3
result = ClusterOutput(concat)

# ==== cluster Cluster_24
exps_result = ClusterInput()
panel = Panel(ClusterInput())
exps_number = GhPythonScript(x=exps_result)  # -> flatten(a)
# ---------- exps_number: Python ----------
__author__ = "81803"
__version__ = "2022.03.07"

import rhinoscriptsyntax as rs
a=x[5:9]
# ---------- end exps_number ----------
toggle = BooleanToggle(True)
panel_2 = Panel(exps_number)
clean = CleanTree(RemoveNulls=toggle, RemoveInvalid=toggle, RemoveEmpty=toggle, Tree=panel)
tstat = TreeStatistics(Tree=clean)  # -> Paths, Length, Count
toggle_2 = BooleanToggle(False)
lng = ListLength(List=tstat.Length)
dup = DuplicateData(Data="A", Number=lng, Order=toggle_2)  # -> simplify(Data)
split = TextSplit(Text=exps_number, Separators="_")
panel_3 = Panel(dup)
dup_2 = DuplicateData(Data=simplify(graft(dup)), Number=simplify(graft(tstat.Length)), Order=toggle_2)  # -> simplify(Data)
item = ListItem(List=split, Index=0, Wrap=True)  # -> flatten(Item1), Item
keysearch = KeyValueSearch(Keys=clean, Values=dup_2, Search=item.Item1)
mindex = MemberIndex(Set=keysearch, Member="A")  # -> simplify(Index), Count
item_2 = ListItem(List=exps_number, Index=mindex.Index, Wrap=True)  # -> simplify(Item)
panel_4 = Panel(item_2)
tstat_2 = TreeStatistics(Tree=item_2)  # -> Paths, Length, Count
split_2 = TextSplit(Text=item_2, Separators="_")
replace = ReplacePaths(Data=item_2, Search=tstat_2.Paths, Replace=tstat.Paths)
item_3 = ListItem(List=split_2, Index=0, Wrap=True)  # -> Item1, Item
pshift = ShiftPaths(Data=item_3.Item1, Offset=-1)
tstat_3 = TreeStatistics(Tree=pshift)  # -> Paths, Length, Count
owal_exps = ClusterOutput(replace)
replace_2 = ReplacePaths(Data=pshift, Search=tstat_3.Paths, Replace=tstat.Paths)
subtraction = Subtraction(A=replace_2, B=1)
number = ClusterOutput(subtraction)  # number

# ==== cluster Cluster_4
input = ClusterInput()
input_2 = Data(input)
python = GhPythonScript(x=input_2)  # -> a; same code as python
sort_list = SortList(Keys=python)  # -> Keys, ValuesValuesA
list_item = ListItem(List=sort_list.Keys, Index="-1", Wrap=True)  # -> Item, Item1
最大 = Data(list_item.Item)
最小 = Data(list_item.Item1)
最大_2 = ClusterOutput(最大)
最小_2 = ClusterOutput(最小)

# ==== cluster Cluster_7
window = ClusterInput()
brep = ClusterInput()

# ----
# 窓と部屋を一体化
window_2 = Brep(window)
brep_2 = Brep(brep)
panel = Panel(brep_2)
area = Area(Geometry=window_2)  # -> Area, Centroid
debrep = DeconstructBrep(Brep=brep_2)  # -> Faces, Edges, Vertices
窓pt = Point(area.Centroid)
area_2 = Area(Geometry=debrep.Faces)  # -> Area, Centroid
窓pt_2 = ClusterOutput(窓pt)
cluster = Cluster_6(G=window_2, C=area.Centroid)
壁pt = Data(area_2.Centroid)
sdiff = SolidDifference(BrepsA=debrep.Faces, BrepsB=cluster)
壁pt_2 = ClusterOutput(壁pt)
join = BrepJoin(Breps=sdiff)  # -> Breps, Closed
unrollbrep = UnrollBrep(brep=join.Breps, explodeBoolean=Toggle(True))  # -> out, unrolledBrep, unrolledGeometry; inputs brep: Brep, geometry: list of GeometryBase, explodeBoolean: Boolean
# ---------- unrollbrep: Python ----------
"""
UnrollBreps

UnrollPolysurfaces and or Surfaces at once with or without any extra geometry
such as points, curves, etc.

by - Tudor Cosmatu
2014

ALTU - http://all-2.blogspot.de
ScoopIt - http://www.scoop.it/t/al-tu-research
FB: https://www.facebook.com/ALTU.cdrl

"""

print "UnrollBreps"+'\n'+"UnrollPolysurfaces and or Surfaces at once"+'\n'+"with or without any extra geometry "+'\n'+"such as points, curves, etc. "+'\n'+'\n'+" brep - takes any number of breps and or surfaces "+'\n'+" geometry - takes any number of geometries (which are either on the brep,"+'\n'+"or have been projected onto it"+'\n'+"explodeBoolean - explode the unrolled surfaces, if left empty - set to False"+'\n'+'\n'+"by - Tudor Cosmatu"+'\n'+"ALTU - http://all-2.blogspot.de"+'\n'+"ScoopIt - http://www.scoop.it/t/al-tu-research"+'\n'+"FB: https://www.facebook.com/ALTU.cdrl"

import rhinoscriptsyntax as rs

if (brep is not None):
    
    if (explodeBoolean is None):
        explodeBoolean = 0
    
    if (len(geometry)>0):
        geometryBool = True
    else:
        geometryBool = False
    
    if (geometryBool == False):
        unrolledBrep = rs.UnrollSurface(brep, explodeBoolean)
    elif (geometryBool == True):
        unroll = rs.UnrollSurface(brep, explodeBoolean, geometry)
        unrolledBrep = unroll[0]
        unrolledGeometry = unroll[1]
# ---------- end unrollbrep ----------

# ----
# 窓のリスト番号を抽出
wires = BrepWireframe(Brep=unrollbrep.unrolledBrep, Density=-1)
join_2 = JoinCurves(Curves=wires, Preserve=False)  # -> simplify(Curves)
area_3 = Area(Geometry=join_2)  # -> Area, Centroid
sort = SortList(Keys=area_3.Area)  # -> Keys, ValuesA
item = ListItem(List=sort.Keys, Index="-1", Wrap=True)
mindex = MemberIndex(Set=area_3.Area, Member=item)  # -> Index, Count
cull_i = CullIndex(List=area_3.Area, Indices=mindex.Index, Wrap=True)
mindex_2 = MemberIndex(Set=area_3.Area, Member=cull_i)  # -> simplify(Index), Count

失敗作 = 失敗作(B=unrollbrep.unrolledBrep)

# ----
# 窓の中心座標を抽出
# (UnrollBrep上での変換)
item_2 = ListItem(List=join_2, Index=mindex_2.Index, Wrap=True)
area_4 = Area(Geometry=item_2)  # -> Area, Centroid
panel_2 = Panel(area_4.Centroid)

pt = Point(area.Centroid)

# ----
# Point in Brep で認識できるようなモデルを生成
toggle = BooleanToggle(True)
debrep_2 = DeconstructBrep(Brep=brep_2)  # -> simplify(graft(Faces)), Edges, Vertices
clean = CleanTree(RemoveNulls=toggle, RemoveInvalid=toggle, RemoveEmpty=toggle, Tree=area_4.Centroid)
tstat = TreeStatistics(Tree=clean)  # -> Paths, Length, Count
split = SplitTree(Data=debrep_2.Faces, Masks=flatten(tstat.Paths))  # -> Positive, Negative
area_5 = Area(Geometry=split.Positive)  # -> Area, Centroid
md_slider = MDSlider(SliderMode=0, slider_value=Point(0.5, 0.5, 0.5), x_domain=Domain(0, 1), y_domain=Domain(0, 1), z_domain=Domain(0, 1))
evalsrf = EvaluateSurface(Surface=split.Positive, Point=md_slider)  # -> Point, Normal, UDirection, VDirection, Frame
line = LineSDL(Start=area_5.Centroid, Direction=evalsrf.Normal, Length="100")
extr = Extrude(Base=split.Positive, Direction=line)
capex = CapHolesEx(Brep=extr)  # -> Brep, Caps, Solid
brepinc = PointInBrep(Brep=capex.Brep, Point=pt, Strict=False)
I = ClusterOutput(brepinc)
data = Data(brepinc)

# ----
# 判定的に壊滅的に使えない
incurve = PointInCurve(Point=pt, Curve=split.Positive)  # -> Relationship, Point; disabled

saishuu = Panel(data)

# ==== cluster Cluster_23
input_expswall = ClusterInput()
input_expswall_2 = Data(input_expswall)
sunion = SetUnion(SetA=input_expswall_2)
sort = SortList(Keys=sunion)  # -> Keys, ValuesA
item = ListItem(List=sort.Keys, Index=0, Wrap=True)  # -> Item1, Item
max = Data(item.Item1)
min = Data(item.Item)
subtraction = Subtraction(A=max, B=min)
python = GhPythonScript(x=subtraction)  # -> a; same code as python
python_2 = GhPythonScript(x=python)  # -> a; same code as python_2
output = Data(python_2)
pshift = ShiftPaths(Data=output, Offset=-1)
D = ClusterOutput(pshift)

# ==== cluster Cluster_6
# 地面に直接接しているオブジェクトの影響をなくす
G = ClusterInput()
C = ClusterInput()

scale = Scale(Geometry=G, Center=C, Factor="0.01")  # -> Geometry, Transform

G_2 = ClusterOutput(scale.Geometry)

# ==== cluster 失敗作
B = ClusterInput()

# ----
# どこの壁面に窓が何個あるのか抽出
wire_point = WirePoint(B=B)
trim = TrimTree(Tree=wire_point, Depth=1)
lng = ListLength(List=trim)
ma = MassAddition(Input=lng)  # -> Result, PartialResults
trim_2 = TrimTree(Tree=ma.Result, Depth=1)
subtraction = Subtraction(A=trim_2, B=4)
division = Division(A=subtraction, B=4)  # -> graft(Result)

窓の項数 = Panel(division)

# ==== cluster WirePoint
B = ClusterInput()
wires = BrepWireframe(Brep=B, Density=-1)
join = JoinCurves(Curves=wires, Preserve=False)  # -> simplify(Curves)
explode = Explode(Curve=join, Recursive=True)  # -> simplify(Segments), Vertices
end = EndPoints(Curve=explode.Segments)  # -> Start, End
S = ClusterOutput(end.Start)
