# Grasshopper definition development.gh (Grasshopper 1.0.7)
# plug-ins: baues-toolbox Info, THERB-GH

# ----
# 成功ケース
brep = Brep([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])
srf = Surface(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)

brep_2 = Brep([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])
srf_2 = Surface([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])

brep_3 = Brep([<brep referenced from the Rhino model> x5])
srf_3 = Surface(<surface referenced from the Rhino model>)

srf_4 = Surface([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])
brep_4 = Brep([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])

brep_5 = Brep([<brep referenced from the Rhino model> x15])
srf_5 = Surface([<surface referenced from the Rhino model> x3])

brep_6 = Brep([<brep referenced from the Rhino model> x3])
srf_6 = Surface(<surface referenced from the Rhino model>)

srf_7 = Surface(<surface referenced from the Rhino model>)
# 失敗ケース
brep_7 = Brep([<brep referenced from the Rhino model> x4])

brep_8 = Brep([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])
srf_8 = Surface([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])

srf_9 = Surface(<surface referenced from the Rhino model>)
readconstruction = ReadConstruction(Run=Toggle(True))
therb = THERB(Boxes=brep_8, Windows=srf_8, Overhangs=srf_9, Tolerance=0.1)  # -> Therb, Test
panel = Panel(readconstruction)
decompose = Decompose(Therb=therb.Therb)  # -> Rooms, Faces, Windows, Overhangs

number_slider = Slider(0.1, range=0..0.1)
windows_split = Surface([<surface referenced from the Rhino model> x3])
# step1. ジオメトリ、条件入力
rooms_split = Brep([<brep referenced from the Rhino model> x20])

# ----
# 北の方角を指定
vec = Vector(Vector(11.35901027, 6.301332919, 5))
brep_9 = Brep([<brep referenced from the Rhino model> x3])
exportt = ExportT(Start_month=Slider(1, range=0..1), End_month=Slider(12, range=0..100))
filterfacebyproperty = FilterFaceByProperty(Faces=decompose.Faces, Bc=0, SurfT=0, Direction=-1)  # -> TrueFace, FalseFace
item = ListItem(List=readconstruction, Index=Slider(4, range=0..15), Wrap=True)
panel_2 = Panel(item)
readproperty = ReadProperty()
updateconstruction = UpdateConstruction(Face=filterfacebyproperty.TrueFace, Construction=item)
merge = Merge(Data1=updateconstruction, Data2=filterfacebyproperty.FalseFace)  # -> flatten(Result)
compose = Compose(Rooms=decompose.Rooms, Faces=merge, Windows=decompose.Windows, Overhangs=decompose.Overhangs)
item_2 = ListItem(List=filterfacebyproperty.TrueFace, Index=Slider(0, range=0..15), Wrap=True)
exporta = ExportA(Therb=therb.Therb)
exporta_2 = ExportA(Therb=therb.Therb)
exportb = ExportB(Therb=compose)
exportr = ExportR(Therb=therb.Therb)
readfaceproperty = ReadFaceProperty()  # -> RoomId, PartId, Surface, ElementType, Normal, CenterPt, Direction, ConstructionId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
run_simulation = RunSimulation(Therb=therb.Therb, Name="TEST", Run=Toggle(False))
exportw = ExportW(Construction=readconstruction)

# ----
# step2. 出力をチェック
b_datファイル書き出し = Panel(exportb)
w_datファイル書き出し = Panel(exportw)
t_datデータ = Panel(exportt)
r_datファイル書き出し = Panel(exportr)

panel_3 = Panel(exporta)

# ----
# step03.
# サーバーにuploadする
# ための情報を入力
# step03-1. サーバーのドメイン入力
# (今のところ、ここは変える必要ないです）
# step03-2. プロジェクト名を入力
# step03-3. Trueにするとuploadして計算開始
panel_4 = Panel("http://localhost:5000/run")

uploadtherb = UploadTherb(Url=panel_4, ProjectName="demo2", Upload=Toggle(True))
# step04.
# サーバーからのresponseが表示されます。
# successとなっていれば、以下のurlをchrome
# で表示してください
# step05.
# 計算結果をPythonを利用してさらに分析することができます。
# 以下に分析例をまとめたJupyter Notebookを置いています。
# https://github.com/becat-oss/therb-notebook
panel_5 = Panel(uploadtherb)
