# Grasshopper definition example.gh (Grasshopper 1.0.7)

# ----
# 注) ジオメトリはsplitしたものを入れる必要あり(今後要改善）
number_slider = Slider(0.1, range=0..0.1)
# ToDo
# 0. tilt angle
# 1.roomの床面積情報
# ToDo
# 0.windowにも傾斜角を割り当てるロジックを組み込む
# 1.傾斜角を計算するロジックを組み込む（今はwallだったら90みたいな単純なロジック）
# 2.Shading,Doorも組み込む
# 3.idをRhinoのジオメトリ上に表示できるようにする
# 5.北がどっちの方向を向いているのかを設定できるようにする
windows_split = Surface([<surface referenced from the Rhino model> x2])
# 1. ジオメトリ、条件入力
rooms_split = Brep([<brep referenced from the Rhino model> x3])
assignclass = CSharpScript(geos=flatten(rooms_split), tol=number_slider, windows=windows_split)  # -> out, Room, Faces, Windows, zones; inputs geos: list of Brep, tol: Double, windows: list of Surface
# ---------- assignclass: C# usings ----------
using Rhino.Geometry.Collections;
using Rhino.Geometry.Intersect;
using System.Threading.Tasks;
# ---------- assignclass: C# ----------
    List<Room> roomList = new List<Room>();
    List<Face> faceList = new List<Face>();
    //Brep同士をsplitする
    //TODO:思ったような動きをしてくれない
    List<Brep> splitGeos = new List<Brep>();

    /*
    for (int i = 0; i < geos.Count; i = i + 1){
      List<Brep> cutterBreps = geos.FindAll(geo => geo != geos[i]);
      Print("{0}", cutterBreps.Count);
      foreach(Brep cutterBrep in cutterBreps){
        Brep[] splitGeo = geos[i].Split(cutterBrep, 0.1);
        bool test1 = splitGeo[0].Join(splitGeo[1], 0.1, false);
        Print("{0}", test1);
        //for (int j = 1; j < splitGeo.Count; j = j + 1){
        //  splitGeo[0].Join(geos[j], 0.1, false);
        //}
        //foreach(Brep geo in splitGeo){
        //splitGeos.Add(geo);
        //}
        splitGeos.Add(splitGeo[0]);
      }
    }
    Print("{0}", splitGeos);
    test = splitGeos;
    */

    //BAUES用のデータをこの時点で作ってみる
    var zoneList = new List<Zone>();
    //Roomに対する処理
    foreach(Brep geo in geos){
      Room temp = new Room(geo);

      //var surfaceDetailedList = new List<object>();
      //TODO: SurfaceとFaceの違い理解
      //BrepSurfaceList srfs = geo.Surfaces;
      BrepFaceList srfs = geo.Faces;
      foreach(Surface srf in srfs){
        Vector3d normal = srf.NormalAt(0.5, 0.5);
        Vector3d tempNormal = reviseNormal(srf, temp);
        Face face = new Face(temp, srf, normal, tempNormal);
        //Print("{0}", face.centerPt);
        faceList.Add(face);
        temp.addFace(face);
        //var surfaceDetailed = new Dictionary<string, object>();
        //surfaceDetailed.Add("name", "room"+temp.id.ToString()+"_"+face.elementType);
        //surfaceDetailed.Add("surfaceType", face.face);
        //surfaceDetailed.Add("vertices", face.bauesVertices);
        //SurfaceDetailed surfaceDetailed = new SurfaceDetailed("room" + temp.id.ToString());
        //surfaceDetailedList.Add(surfaceDetailed);
      }
      roomList.Add(temp);
      /*
      var zone = new Dictionary<string, object>();
      zone.Add("name", "room" + temp.id.ToString());
      zone.Add("multiplier", 1);
      zone.Add("surfaces", surfaceDetailedList);
      */
      Zone zone = new Zone("room" + temp.id.ToString());
      zoneList.Add(zone);
    }
    //FaceのboundaryConditionを計算する処理
    List<Face> faceListBC = new List<Face>();
    //理解が進んだらboundary conditionは違うコンポーネントにうつす
    for (int i = 0; i < faceList.Count; i++){
      //テストするsurfaceを選択する
      var testFace = faceList[i];

      //違うparentを持つfaceを取得する
      List<Face> targetFaces = faceList
        .FindAll(face => face.parent != testFace.parent);
      //.Select(face => face.geometry);

      //TODO: Selectメソッドにmigrateする
      List<Surface> targetSurfaces = new List<Surface>();

      foreach(Face face in targetFaces){
        targetSurfaces.Add(face.geometry);
      }
      //Print("{0}", targetSurfaces);

      //testFacesに対して、normal directionのテストを行う
      Point3d testPt = new Point3d(testFace.centerPt);
      testPt += testFace.normal * -tol / 2;
      Ray3d testRay = new Ray3d(testPt, testFace.normal);

      if (shootIt(testRay, targetSurfaces, tol, 2)){
        testFace.bc = "interior";
        testFace.bauesBC = BoundaryCondition.Surface;
        //どのfaceにtouchしているのかをチェック
        //testFace.centerPtから一番近いtargetSurfacesが隣接しているsurfaceだと判断する
        Face adjacentFace = getClosestFaceFromFace(testFace, targetFaces);
        testFace.adjacencyRoomId = adjacentFace.parentId;
        testFace.adjacencyFaceId = adjacentFace.partId;
        //Print("{0}", testFace.id);
        //Print("{0}", adjacentFace.id);

      }else{
        //z座標<=0であれば、bc=groundとする
        //testFace.bc = boundaryCondition.outdoor;
        if(testFace.centerPt.Z <= tol){
          testFace.bc = "ground";
          testFace.bauesBC = BoundaryCondition.Ground;
        }else{
          testFace.bc = "outdoor";
          testFace.bauesBC = BoundaryCondition.Outdoors;
        }
        testFace.adjacencyRoomId = 0;
      }
      testFace.setElementType();
      testFace.setConstructionId();
      faceListBC.Add(testFace);
      Print("{0}", testFace.parent.id);
      //Print("{0}", zoneList[testFace.parent.id - 1].surfaces);
      //ここでsurfaceをzoneに追加していく
      SurfaceDetailed srfDetail = new SurfaceDetailed("room" + testFace.id.ToString(), testFace);
      //zoneList[testFace.parent.id - 1].addSurface(srfDetail);
    }

    //Roomに属するfaceの属性(wall,ceiling,roof)を集計するロジック
    foreach(Room room in roomList){
      List<Face> faces = room.getFaces();
      Print("{0}", faces.Count);
      foreach(Face face in faces){
        room.groupChildFaces(face);
      }
    }
    //Print("{0}", roomList[0].roofs.Count);

    Room = roomList;

    //windowがどのwallの上にあるかどうかを判断するロジック
    List<Face> externalFaces = faceListBC
      .FindAll(face => face.bc == "outdoor");
    //Print("{0}", externalFaces.Count);

    List<Window> windowList = new List<Window>();
    foreach (Surface windowGeo in windows){
      //それぞれのwindowに対して一番近いexternalFacesをwindowが属するfaceとする
      int parentId = 0;
      double tiltAngle = 0;
      double closestDistance = 10000;
      Window window = new Window(windowGeo);
      foreach(Face exFace in externalFaces){
        double distance = window.centerPt.DistanceTo(exFace.centerPt);
        //Print("{0}", distance);
        if (distance < closestDistance){
          parentId = exFace.id;
          tiltAngle = exFace.tiltAngle;
          closestDistance = distance;
        }
      }

      if (closestDistance < 10000){
        window.parentId = parentId;
        window.tiltAngle = tiltAngle;
        //Print("{0}", window.parent);
      }else{
        //エラー処理を加える
      }
      windowList.Add(window);
      //FenestrationDetailed fenDetailed = new FenestrationDetailed(window);
      //zoneList[faceList[parentId].parentId - 1].surfaces[parentId].addWindow(fenDetailed);
      //Print("{0}", zoneList[faceList[parentId].parentId - 1].surfaces[parentId]);
    }
    //BAUESデータ書き出し用の処理を加える

    //WindowをfaceにAddする
    List<Face> faceListWindow = new List<Face>();
    foreach(Face face in faceListBC){
      foreach(Window window in windowList){
        if(window.parentId == face.id){
          face.addWindows(window);
        }
      }
      faceListWindow.Add(face);
    }

    Faces = faceListBC;
    Windows = windowList;
# ---------- assignclass: C# additional code ----------
  private Vector3d reviseNormal(Surface srf, Room parent){
    //モデルによってはsurfaceのvectorの方向が意図と逆に向いている場合があるのでそれを修正
    Point3d centroid = parent.centroid;
    AreaMassProperties areaMp = AreaMassProperties.Compute(srf);
    Point3d centerPt = areaMp.Centroid;
    Vector3d normal = srf.NormalAt(0.5, 0.5);
    //Point3d testPt = new Point(centerPt.X + normal.X, centerPt.Y + normal.Y, centerPt.Z + normal.Z);
    Point3d testPt = centerPt + normal;
    //Print("{0}", centerPt);
    //Print("{0}", testPt);
    double baseDistance = centroid.DistanceTo(centerPt);
    double testDistance = centroid.DistanceTo(testPt);
    if (baseDistance > testDistance){
      Vector3d revNormal = new Vector3d(-normal.X, -normal.Y, -normal.Z);
      //Print("{0}", normal);
      //Print("{0}", revNormal);
      return revNormal;
    }else{
      return normal;
    }

  }
  private Face getClosestFaceFromFace(Face originFace, List<Face> Faces){
    //TはFaceかWindowとしたい。ジェネリクスがよくわかっていないので

    Face closestFace = null;
    double closestDistance = 10000;
    foreach(Face face in Faces){
      //faceがwallであればwallのみでテストする
      double distance = 10000;
      if (originFace.face == "wall" && face.face == "wall"){
        distance = originFace.centerPt.DistanceTo(face.centerPt);
        //Print("{0}", distance);
      }else if (originFace.face != "wall" && face.face != "wall"){
        distance = originFace.centerPt.DistanceTo(face.centerPt);
      }
      if (distance < closestDistance){
        closestFace = face;
        closestDistance = distance;
      }
    }
    Print("{0}", closestDistance);
    return closestFace;
  }
  private bool shootIt(Ray3d ray, List<Surface> srfs, double tol, int bounce){
    Point3d[] intersectPts = Intersection.RayShoot(ray, srfs, 1);
    //Print("{0}", intersectPts.Length);
    if (intersectPts.Length > 0){
      //Print("{0}", ray.Position.DistanceTo(intersectPts[0]));
      if (ray.Position.DistanceTo(intersectPts[0]) <= tol){
        return true;
      }else{
        return false;
      }
    }else{
      return false;
    }

  }

  //基底クラスを作成する
  public class baseGeo{
    public Guid guid;
    public int id;
    public int displayName;

    //staticコンストラクタをどう継承すべきか理解必要

  }
  //BAUES Analysis用の構造体(struct)
  /*
  struct Baues{
  public List<Zone> zones;
  }
  */

  public class Zone{
    public string name;
    public int multiplier;
    public List<SurfaceDetailed> surfaces;

    public Zone(string name){
      this.name = name;
      this.multiplier = 1;
      this.surfaces = new List<SurfaceDetailed>();
    }

    public void addSurface(SurfaceDetailed surface){
      this.surfaces.Add(surface);
    }
  }

  public class SurfaceDetailed{
    public string name;
    public SurfaceType surfaceType;
    public int surfaceTypeId; //そのsurface typeのid
    public string constructionName;
    public string boundaryCondition;
    public string boundaryConditionObject;
    public List<double> vertices;
    public List<FenestrationDetailed> windows;
    public static int _totalWalls;
    public static int _totalRoofs;
    public static int _totalCeilings;
    public static int _totalFloors;

    static SurfaceDetailed(){
      _totalWalls = 0;
      _totalRoofs = 0;
      _totalCeilings = 0;
      _totalFloors = 0;
    }

    public SurfaceDetailed(string name, Face face){

      //this.surfaceType = (SurfaceType)face.face;
      //this.boundaryCondition = face.
      this.vertices = face.bauesVertices;
      switch(face.face){
        case "wall":
          this.surfaceType = SurfaceType.Wall;
          _totalWalls += 1;
          surfaceTypeId = _totalWalls;
          break;
        case "floor":
          this.surfaceType = SurfaceType.Floor;
          _totalFloors += 1;
          surfaceTypeId = _totalFloors;
          break;
        case "roof":
          if (face.elementType == "exteriorroof"){
            this.surfaceType = SurfaceType.Roof;
            _totalRoofs += 1;
            surfaceTypeId = _totalRoofs;
            break;
          }else{
            this.surfaceType = SurfaceType.Ceiling;
            _totalCeilings += 1;
            surfaceTypeId = _totalCeilings;
            break;
          }
      }
      this.name = "room" + face.parent.id + "_" + this.surfaceType.ToString() + surfaceTypeId.ToString();
    }
  }

  public class FenestrationDetailed{
    public string name;
    public string constructionName;
    public List<double> vertices;

  }

  public enum SurfaceType{
    Wall,
    Roof,
    Ceiling,
    Floor
  }

  public enum BoundaryCondition{
    Outdoors,
    Surface,
    Ground
  }


  public class Room{
    public Guid guid;
    public int id;
    public string displayName;
    public Brep geometry;
    public Point3d centroid;
    private List<Face> _faceList;
    public static int _totalRooms;
    public BrepVertexList vertices;
    public Point3d minPt;
    public Point3d maxPt;
    public List<Face> sWalls;
    public List<Face> wWalls;
    public List<Face> nWalls;
    public List<Face> eWalls;
    public List<Face> floors;
    public List<Face> roofs;
    public double area; //new hasp用のデータ
    public double floorHeight;//階高
    public double ceilingHeight;//天井高
    public double height;//地上高

    static Room(){
      _totalRooms = 0;
    }

    public Room(Brep geometry){
      this.guid = Guid.NewGuid();
      _totalRooms += 1;
      this.id = _totalRooms;
      //this.displayName = _totalRooms;
      this._faceList = new List<Face>();
      this.geometry = geometry;
      BrepVertexList vertices = geometry.Vertices;
      this.vertices = vertices;
      this.minPt = getMinCoord(vertices);
      this.maxPt = getMaxCoord(vertices);
      this.sWalls = new List<Face>();
      this.wWalls = new List<Face>();
      this.nWalls = new List<Face>();
      this.eWalls = new List<Face>();
      this.floors = new List<Face>();
      this.roofs = new List<Face>();
      VolumeMassProperties vmp = VolumeMassProperties.Compute(geometry);
      this.centroid = vmp.Centroid;
      //BAUES Analysisへの接続用データ

    }

    public void addFace(Face face){
      _faceList.Add(face);
      //TODO: this logic should be elaborated
      if (face.face == "floor"){
        this.area = face.area;
        this.height = face.centerPt.Z;
      }else if(face.face == "wall"){
        double maxZ = 0;
        double minZ = 100;
        foreach(BrepVertex vertex in face.vertices){
          Point3d pt = vertex.Location;
          if (pt.Z > maxZ){
            maxZ = pt.Z;
          }
          if (pt.Z < minZ){
            minZ = pt.Z;
          }
        }
        this.floorHeight = maxZ - minZ;
        this.ceilingHeight = this.floorHeight - 0.1;//とりあえず
      }

    }

    public void groupChildFaces(Face face){
      if (face.face == "wall"){
        switch(face.direction){
          case "S":
            this.sWalls.Add(face);
            break;
          case "N":
            this.nWalls.Add(face);
            break;
          case "W":
            this.wWalls.Add(face);
            break;
          case "E":
            this.eWalls.Add(face);
            break;
        }
      }else if(face.face == "roof"){
        this.roofs.Add(face);
      }else if(face.face == "floor"){
        this.floors.Add(face);
      }
    }

    public List<int> getDirectionList(){
      List<int> directionList = new List<int>();
      directionList.Add(this.sWalls.Count);
      directionList.Add(this.wWalls.Count);
      directionList.Add(this.nWalls.Count);
      directionList.Add(this.eWalls.Count);
      directionList.Add(this.floors.Count);
      directionList.Add(this.roofs.Count);
      int total = this.sWalls.Count + this.wWalls.Count + this.nWalls.Count + this.eWalls.Count + this.floors.Count + this.roofs.Count;
      directionList.Add(total);

      return directionList;//[S,W,N,E,F,CR,total]
    }

    public List<Face> getFaces(){
      return _faceList;
    }

    //public static string generateDisplayName{
    //}
    private Point3d getMinCoord(BrepVertexList vertices){
      Point3d origin = new Point3d(0, 0, 0);
      int i = 0;
      int minId = 0;
      double minValue = 1000;
      foreach(BrepVertex vertex in vertices){

        Point3d checkPt = vertex.Location;
        double distance = origin.DistanceTo(checkPt);
        //Print("{0}:{1}", i, distance);
        if (distance < minValue){
          minId = i;
          minValue = distance;
        }
        i += 1;
      }
      //Print("{0}:{1}", minId, minValue);

      return vertices[minId].Location;
    }

    private Point3d getMaxCoord(BrepVertexList vertices){
      Point3d origin = new Point3d(0, 0, 0);
      int i = 0;
      int maxId = 0;
      double maxValue = -1000;
      foreach(BrepVertex vertex in vertices){

        Point3d checkPt = vertex.Location;
        double distance = origin.DistanceTo(checkPt);
        //Print("{0}:{1}", i, distance);
        if (distance > maxValue){
          maxId = i;
          maxValue = distance;
        }
        i += 1;
      }
      //Print("{0}:{1}", minId, minValue);

      return vertices[maxId].Location;
    }
  }

  public class Window{
    public Guid guid;
    public int id;
    public string displayName;
    public int parentId {get; set;}
    public Surface geometry { get; private set; }
    public Vector3d normal {get; private set;}
    public Point3d centerPt;
    public double tiltAngle;
    public int constructionId; //とりあえず外壁1,内壁2,床(室内）3,屋根4,床（地面）5, 窓6　THERBのelement Idに相当
    public double area;
    public static int _totalWindows;

    static Window(){
      _totalWindows = 0;
    }

    public Window(Surface geometry){
      this.guid = Guid.NewGuid();
      _totalWindows += 1;
      this.id = _totalWindows;
      this.geometry = geometry;
      AreaMassProperties areaMp = AreaMassProperties.Compute(geometry);
      this.centerPt = areaMp.Centroid;
      this.area = areaMp.Area;
      this.constructionId = 6;
    }
  }

  public class Face{
    public Guid guid;
    public int id;
    public int partId;
    public string displayName;
    //public faceType face{get; private set;}
    public string face{get; private set;}
    //public boundaryCondition bc{get; set;}
    public string bc{get; set;} //boundary conditionのこと
    public string elementType{get; set;}
    public int constructionId; //とりあえず外壁1,内壁2,床(室内）5,屋根4,床（地面）5, 窓6　THERBのelement Idに相当/鈴木君からもらったデータにとりあえずそろえる
    //parentとparentIdをわける
    public Room parent;
    public int parentId;
    public Surface geometry { get; private set; }
    public BrepVertexList vertices;
    public Vector3d normal {get; private set;}
    public Vector3d tempNormal;
    public Point3d centerPt;
    public double tiltAngle;
    public double area;
    public string direction;
    public double dirAngle;//新しい属性
    public int adjacencyRoomId; //隣接しているRoomのId 外気に接している場合には0
    public List<Window> windows {get; private set;}
    public List<int> windowIds;
    public static int _totalFaces;
    public static int _totalExWalls;
    public static int _totalInWalls;
    public static int _totalFlrCeilings;
    public static int _totalRoofs;
    public static int _totalGrounds;
    //BAUES Analysis用の属性
    public BoundaryCondition bauesBC;
    public int adjacencyFaceId;
    public List<double> bauesVertices;

    static Face(){
      _totalFaces = 0;
      _totalExWalls = 0;
      _totalInWalls = 0;
      _totalFlrCeilings = 0;
      _totalRoofs = 0;
      _totalGrounds = 0;
    }

    public Face(Room parent, Surface geometry, Vector3d normal, Vector3d tempNormal){
      this.guid = Guid.NewGuid();
      _totalFaces += 1;
      this.id = _totalFaces;
      //全体を通してのidとelementごとのidをつける
      this.geometry = geometry;
      this.parent = parent;
      this.parentId = parent.id;
      AreaMassProperties areaMp = AreaMassProperties.Compute(geometry);
      this.centerPt = areaMp.Centroid;
      this.area = areaMp.Area;
      this.normal = tempNormal;
      BrepVertexList vertices = geometry.ToBrep().Vertices;
      this.vertices = vertices;
      this.bauesVertices = getBauesVertices();

      //方角、床、天井を判別するためにはtempNormalを使う
      this.face = getFaceType(tempNormal);
      this.dirAngle = calcDirAngle(tempNormal);
      this.direction = defineDirection(tempNormal);

      //TODO: this logic has to be elaborated
      if (this.face == "wall"){
        this.tiltAngle = 90;
      }else{
        this.tiltAngle = 0;
      }
      this.windows = new List<Window>();
      this.windowIds = new List<int>();
    }

    private double calcDirAngle(Vector3d normal){

      Vector3d northAngle = new Vector3d(0, 1, 0);
      Vector3d westAngle = new Vector3d(-1, 0, 0);

      double angle1 = (180 / Math.PI) * (Vector3d.VectorAngle(normal, northAngle));
      double angle2 = (180 / Math.PI) * (Vector3d.VectorAngle(normal, westAngle));

      if(angle2 < 90){
        return 360 - angle1;
      }else{
        return angle1;
      }
    }

    private string defineDirection(Vector3d normal){
      if (this.face == "floor"){
        return "F";
      }else if (this.face == "roof"){
        return "CR";
      }

      Vector3d northAngle = new Vector3d(0, 1, 0);
      Vector3d westAngle = new Vector3d(-1, 0, 0);

      double angle1 = (180 / Math.PI) * (Vector3d.VectorAngle(normal, northAngle));
      double angle2 = (180 / Math.PI) * (Vector3d.VectorAngle(normal, westAngle));

      //Print("{0}:{1}", normal, angle1);

      if (angle1 < 45){
        return "N";
      }else if(angle1 == 45 && angle2 == 45){
        return "N";
      }else if (angle1 > 135){
        return "S";
      }else if(angle1 == 135 && angle2 == 135){
        return "S";
      }else if(angle2 <= 45){
        return "W";
      }else{
        return "E";
      }
    }

    public List<double> getBauesVertices(){
      List<double> bauesVertices = new List<double>();
      foreach(BrepVertex vertex in this.vertices){
        Point3d pt = vertex.Location;
        bauesVertices.Add(pt.X);
        bauesVertices.Add(pt.Y);
        bauesVertices.Add(pt.Z);
      }
      return bauesVertices;
    }

    public string getFaceType(Vector3d normal){

      //better to add filter logic for internal wall
      double Z = normal.Z;
      int roofAngle = 10;
      if (Z > Math.Cos((Math.PI / 180) * roofAngle)){
        //return faceType.roof;
        return "roof";
      }else if(Z < -Math.Cos((Math.PI / 180) * 85)){
        //return faceType.floor;
        return "floor";
      }else{
        //string direction = defineDirection(normal);
        //Print("{0}:{1}", normal, direction);
        //return faceType.wall;
        return "wall";
      }
    }

    public void addWindows(Window window){
      this.windows.Add(window);
      this.windowIds.Add(window.id);
    }

    public void setElementType(){
      string firstPhrase = "";
      if (this.bc == "outdoor"){
        firstPhrase = "exterior";
      }else{
        firstPhrase = this.bc;
      }
      this.elementType = firstPhrase + this.face;
      //partIdをアサインする
      switch(this.elementType){
        case "exteriorwall":
          _totalExWalls += 1;
          this.partId = _totalExWalls;
          break;
        case "interiorwall":
          _totalInWalls += 1;
          this.partId = _totalInWalls;
          break;
        case "interiorroof":
          _totalFlrCeilings += 1;
          this.partId = _totalFlrCeilings;
          break;
        case "interiorfloor":
          _totalFlrCeilings += 1;
          this.partId = _totalFlrCeilings;
          break;
        case "exteriorroof":
          _totalRoofs += 1;
          this.partId = _totalRoofs;
          break;
        case "groundfloor":
          _totalGrounds += 1;
          this.partId = _totalGrounds;
          break;
      }
    }

    public void setConstructionId(){
      //Print("{0}", this.elementType);
      switch(this.elementType){
        case "exteriorwall":
          this.constructionId = 1;
          break;
        case "interiorwall":
          this.constructionId = 2;
          break;
        case "interiorroof":
          this.constructionId = 3;
          break;
        case "interiorfloor":
          this.constructionId = 3;
          break;
        case "exteriorroof":
          this.constructionId = 4;
          break;
        case "groundroof":
          this.constructionId = 5;
          break;
        case "groundfloor":
          this.constructionId = 5;
          break;
      }
    }
  }

  public enum faceType{
    wall,
    roof,
    floor
  }

  public enum elementType{
    exteriorWall,
    interiorWall,
    roof,
    floor,
    groundWall,
    groundFloor
  }

  private string defineDirection(Vector3d normal){
    Vector3d northAngle = new Vector3d(0, 1, 0);
    Vector3d westAngle = new Vector3d(-1, 0, 0);

    double angle1 = (180 / Math.PI) * (Vector3d.VectorAngle(normal, northAngle));
    double angle2 = (180 / Math.PI) * (Vector3d.VectorAngle(normal, westAngle));

    //Print("{0}:{1}", normal, angle1);

    if (angle1 < 45){
      return "N";
    }else if(angle1 == 45 && angle2 == 45){
      return "N";
    }else if (angle1 > 135){
      return "S";
    }else if(angle1 == 135 && angle2 == 135){
      return "S";
    }else if(angle2 <= 45){
      return "W";
    }else{
      return "E";
    }
  }

  private Point3d getMinCoord(BrepVertexList vertices){
    Point3d origin = new Point3d(0, 0, 0);
    int i = 0;
    int minId = 0;
    double minValue = 1000;
    foreach(BrepVertex vertex in vertices){

      Point3d checkPt = vertex.Location;
      double distance = origin.DistanceTo(checkPt);
      //Print("{0}:{1}", i, distance);
      if (distance < minValue){
        minId = i;
        minValue = distance;
      }
      i += 1;
    }
    //Print("{0}:{1}", minId, minValue);

    return vertices[minId].Location;
  }

  private Point3d getMaxCoord(BrepVertexList vertices){
    Point3d origin = new Point3d(0, 0, 0);
    int i = 0;
    int maxId = 0;
    double maxValue = -1000;
    foreach(BrepVertex vertex in vertices){

      Point3d checkPt = vertex.Location;
      double distance = origin.DistanceTo(checkPt);
      //Print("{0}:{1}", i, distance);
      if (distance > maxValue){
        maxId = i;
        maxValue = distance;
      }
      i += 1;
    }
    //Print("{0}:{1}", minId, minValue);

    return vertices[maxId].Location;
  }
# ---------- end assignclass ----------

# ----
# 2.パラメータ抽出
cluster = Cluster(brep=rooms_split)
対象物 = Brep(cluster)
cluster_2 = Cluster_3(brep=対象物)
cluster_3 = Cluster_2(G=rooms_split)
# 守田君に質問する
# 空白行を調整する方法
cluster_4 = Cluster_5(point=cluster_2, 容積=cluster_3)

number_slider_2 = Slider(1, range=1..10)
number_slider_3 = Slider(3, range=1..10)
number_slider_4 = Slider(2, range=1..10)
cluster_5 = Cluster_10(faces=assignclass.Faces, parentid=number_slider_2)  # -> L_6, L, L_2, L_3, L_4, L_5
cluster_6 = Cluster_12(faces=assignclass.Faces, parentid=number_slider_3)  # -> L, L_2, L_3, L_4, L_5
cluster_7 = Cluster_11(faces=assignclass.Faces, parentid=number_slider_4)  # -> L, L_2, L_3, L_5, L_4

# ----
# 2-3.windowデータから情報を抽出
cluster_8 = Cluster_20(windows=assignclass.Windows)  # -> x1, L, y1, areas, z1, V, x2, tiltangles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

# ----
# 守田君にY2をoutputに出してもらう
panel = Panel("{0:0.000}")
format = Format(Format="{0:0.0000}", Culture=127, Data0=cluster_8.areas)
format_2 = Format(Format=panel, Culture=127, Data0=cluster_8.tiltangles)
flatten = FlattenTree(Tree=cluster_8.L, Path="{0}")
surfacecount = CSharpScript(
    roomId=number_slider_4,
    direction=cluster_7.L,
    elementNo=cluster_7.L_2,
    partId=cluster_7.L_4,
    elementType=cluster_7.L_5,
    adjacency=cluster_7.L_3)  # -> out, therbData; inputs roomId: Int32, direction: list of String, elementNo: list of String, partId: list of Int32, elementType: list of String, adjacency: list of Int32
# ---------- surfacecount: C# ----------
    string data = "";
    int id = 1;
    //Print("{0}", windowIds[0]);
    var directionDict = new Dictionary<string, int>(){
        {"S",1},
        {"W",2},
        {"N",3},
        {"E",4},
        {"F",5},
        {"CR",6},
        };

    var directionCount = new Dictionary<string, int>(){
        {"S",1},
        {"W",1},
        {"N",1},
        {"E",1},
        {"F",1},
        {"CR",1},
        };
    /*
    var elementCount = new Dictionary<string, int>(){
        {"exteriorwall",1},
        {"interiorwall",1},
        {"interiorfloor",1},
        {"exteriorroof",1},
        {"groundfloor",1},
        };
    */
    var elementCount = new Dictionary<string, int>(){
        {"1",1},
        {"2",1},
        {"3",1},
        {"4",1},
        {"5",1},
        };
    for(int i = 0; i < direction.Count;i = i + 1){
      //TODO:string interpolationを使いたい
      data += cF(roomId, 5) + cF(id, 5) + cF(directionDict[direction[i]], 5) + cF(directionCount[direction[i]], 5) + cF(elementNo[i], 5) + cF(partId[i], 5) + cF(adjacency[i], 5) + " \r\n";
      directionCount[direction[i]] += 1;
      elementCount[elementNo[i]] += 1;
      id += 1;
    }

    therbData = data;
# ---------- surfacecount: C# additional code ----------
  private string cF(int input, int totalLength)
  {
    string inputStr = input.ToString();
    int inputLength = inputStr.Length;
    string emptyString = new string(' ', totalLength - inputLength);

    return emptyString + inputStr;
  }

  private string cF(string input, int totalLength)
  {
    int inputLength = input.Length;
    string emptyString = new string(' ', totalLength - inputLength);

    return emptyString + input;
  }
# ---------- end surfacecount ----------
surfacecount_2 = CSharpScript(
    roomId=number_slider_3,
    direction=cluster_6.L,
    elementNo=cluster_6.L_2,
    partId=cluster_6.L_5,
    elementType=cluster_6.L_4,
    adjacency=cluster_6.L_3)  # -> out, therbData; inputs roomId: Int32, direction: list of String, elementNo: list of String, partId: list of Int32, elementType: list of String, adjacency: list of Int32; same code as surfacecount
panel_2 = Panel(surfacecount.therbData)

# ----
# 2-1.roomデータから情報を抽出
# 2-2.faceデータから情報を抽出
# 2-4.roomに紐づくface属性を抽出
panel_3 = Panel("groundfloor")
getroomproperties = CSharpScript(Rooms=assignclass.Room)  # -> out, ids, minPts, maxPts, sCount, wCount, nCount, eCount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
# ---------- getroomproperties: C# ----------
    if (Rooms == null) return;
    FieldInfo idField = Rooms.GetType().GetField("id");
    int id = (int) idField.GetValue(Rooms);

    FieldInfo minPtField = Rooms.GetType().GetField("minPt");
    Point3d minPoint = (Point3d) minPtField.GetValue(Rooms);

    var type = Type.GetType("ExternalType");
    // Lookup the method
    var directionsGetter = Rooms.GetType().GetMethod("getDirectionList");
    Print("{0}", directionsGetter);

    double area = (double) Rooms.GetType().GetField("area").GetValue(Rooms);
    double height = (double) Rooms.GetType().GetField("height").GetValue(Rooms);
    double floorHeight = (double) Rooms.GetType().GetField("floorHeight").GetValue(Rooms);
    double ceilingHeight = (double) Rooms.GetType().GetField("ceilingHeight").GetValue(Rooms);

    //TODO:Listで返す方法がうまくいかない
    List<int> directions = (List<int>) directionsGetter.Invoke(Rooms, null);
    //Print("{0}", directions[0]);
    //MethodInfo sWallGetter = Rooms.GetType().GetProperty("sWalls").GetGetMethod();
    //List<Face> sWall = (List<Face>) sWallGetter.Invoke(Rooms, null);

    ids = id;
    minPts = minPoint;
    sCount = directions[0];
    wCount = directions[1];
    nCount = directions[2];
    eCount = directions[3];
    fCount = directions[4];
    crCount = directions[5];
    totalCount = directions[6];
    areas = area;
    heights = Math.Round(height, 3);
    floorHeights = Math.Round(floorHeight, 3);
    ceilingHeights = Math.Round(ceilingHeight, 3);
    //sWalls = swall;
    //direcitonList = direcitons;
# ---------- end getroomproperties ----------
lng = ListLength(List=getroomproperties.ids)

cluster_9 = Cluster_15(faces=assignclass.Faces, element="exteriorwall", element_2="exteriorwall")  # -> x1, y1, z1, x2, windowids, y2, z2, tiltangles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
cluster_10 = Cluster_8(faces=assignclass.Faces, element_2="interiorroof", element="interiorroof")  # -> geometries, L, centerpts, tiltangles, areas, constructionids
cluster_11 = Cluster_9(faces=assignclass.Faces, element="exteriorroof", element_2="exteriorroof")  # -> L, geometries, tiltangles, areas, constructionids
cluster_12 = Cluster_8(faces=assignclass.Faces, element="interiorfloor", element_2="interiorfloor")  # -> L, geometries, centerpts, tiltangles, areas, constructionids
cluster_13 = Cluster_18(faces=assignclass.Faces, element=panel_3, element_2=panel_3)  # -> L, x1, tiltangles, y1, areas, z1, constructionids, V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
cluster_14 = Cluster_17(faces=assignclass.Faces, element="interiorwall", element_2="interiorwall")  # -> x1, L, y1, z1, V, x2, tiltangles, y2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

format_3 = Format(Format="{0:0.000}", Culture=127, Data0=cluster_14.x2)
format_4 = Format(Format="{0:0.0000}", Culture=127, Data0=cluster_14.areas)
format_5 = Format(Format="{0:0.000}", Culture=127, Data0=cluster_14.y2)
format_6 = Format(Format="{0:0.000}", Culture=127, Data0=cluster_14.x1)
format_7 = Format(Format="{0:0.000}", Culture=127, Data0=cluster_14.y1)
format_8 = Format(Format="{0:0.000}", Culture=127, Data0=cluster_14.z1)

flatten_2 = FlattenTree(Tree=cluster_9.L, Path="{0}")

merge = Merge(Data1=cluster_10.geometries, Data2=cluster_12.geometries)
debrep = DeconstructBrep(Brep=cluster_11.geometries)  # -> Faces, Edges, simplify(Vertices)
addition = Addition(A=cluster_10.L, B=cluster_12.L)
debrep_2 = DeconstructBrep(Brep=merge)  # -> Faces, Edges, simplify(Vertices)
cluster_15 = Cluster_6(観測点=debrep_2.Vertices)  # -> flatten(X_2), flatten(Y_2), flatten(Z_2), flatten(X), flatten(Y), flatten(Z)
cluster_16 = Cluster_6(観測点=debrep.Vertices)  # -> flatten(X_2), flatten(Y_2), flatten(Z_2), flatten(X), flatten(Y), flatten(Z)
merge_2 = Merge(Data1=cluster_10.tiltangles, Data2=cluster_12.tiltangles)
merge_3 = Merge(Data1=cluster_10.areas, Data2=cluster_12.areas)
merge_4 = Merge(Data1=cluster_10.constructionids, Data2=cluster_12.constructionids)

flatten_3 = FlattenTree(Tree=lng, Path="{0}")

format_9 = Format(Format="{0:0.000}", Culture=127, Data0=cluster_14.tiltangles)
format_10 = Format(Format="{0:0.000}", Culture=127, Data0=cluster_14.z2)

format_11 = Format(Format="{0:0.000}", Culture=127, Data0=cluster_9.z2)
format_12 = Format(Format="{0:0.0000}", Culture=127, Data0=cluster_9.areas)
format_13 = Format(Format="{0:0.000}", Culture=127, Data0=cluster_9.tiltangles)
format_14 = Format(Format="{0:0.000}", Culture=127, Data0=cluster_9.y1)
format_15 = Format(Format="{0:0.000}", Culture=127, Data0=cluster_9.z1)
format_16 = Format(Format="{0:0.000}", Culture=127, Data0=cluster_9.y2)

format_17 = Format(Format="{0:0.000}", Culture=127, Data0=cluster_13.tiltangles)
format_18 = Format(Format="{0:0.000}", Culture=127, Data0=cluster_13.z1)
format_19 = Format(Format="{0:0.000}", Culture=127, Data0=cluster_13.x2)
format_20 = Format(Format="{0:0.0000}", Culture=127, Data0=cluster_13.areas)
format_21 = Format(Format="{0:0.000}", Culture=127, Data0=cluster_13.x1)
format_22 = Format(Format="{0:0.000}", Culture=127, Data0=cluster_13.y1)
format_23 = Format(Format="{0:0.000}", Culture=127, Data0=cluster_13.y2)
format_24 = Format(Format="{0:0.000}", Culture=127, Data0=cluster_13.z2)

format_25 = Format(Format="{0:0.000}", Culture=127, Data0=merge_2)
format_26 = Format(Format="{0:0.000}", Culture=127, Data0=cluster_15.Z_2)
format_27 = Format(Format="{0:0.000}", Culture=127, Data0=cluster_15.X)
format_28 = Format(Format="{0:0.0000}", Culture=127, Data0=merge_3)
format_29 = Format(Format="{0:0.000}", Culture=127, Data0=cluster_15.X_2)
format_30 = Format(Format="{0:0.000}", Culture=127, Data0=cluster_15.Y_2)
format_31 = Format(Format="{0:0.000}", Culture=127, Data0=cluster_15.Y)
format_32 = Format(Format="{0:0.000}", Culture=127, Data0=cluster_15.Z)

# ----
# 室構成データ用(r.bat)
# 2-8.部屋ごとの面数を抽出
# 2-9.部屋を構成している面のidを抽出する
# 部位Noをどう計算するかを考える必要あり
surfacecount_3 = CSharpScript(
    roomId=number_slider_3,
    direction=cluster_6.L,
    elementNo=cluster_6.L_2,
    partId=cluster_6.L_5,
    elementType=cluster_6.L_4,
    adjacency=cluster_6.L_3)  # -> out, therbData; inputs direction: list of String, elementNo: list of String, partId: list, elementType: list of String, adjacency: list
# ---------- surfacecount_3: C# ----------
    string data = "";
    int id = 1;
    //Print("{0}", windowIds[0]);
    var directionDict = new Dictionary<string, string>(){
        {"S","1"},
        {"W","2"},
        {"N","3"},
        {"E","4"},
        {"F","5"},
        {"CR","6"},
        };

    var directionCount = new Dictionary<string, int>(){
        {"S",1},
        {"W",1},
        {"N",1},
        {"E",1},
        {"F",1},
        {"CR",1},
        };
    /*
    var elementCount = new Dictionary<string, int>(){
        {"exteriorwall",1},
        {"interiorwall",1},
        {"interiorfloor",1},
        {"exteriorroof",1},
        {"groundfloor",1},
        };
    */
    var elementCount = new Dictionary<string, int>(){
        {"1",1},
        {"2",1},
        {"3",1},
        {"4",1},
        {"5",1},
        };
    for(int i = 0; i < direction.Count;i = i + 1){
      //TODO:string interpolationを使いたい
      data += roomId + " " + id.ToString() + " " + directionDict[direction[i]] + " " + directionCount[direction[i]] + " " + elementNo[i] + " " + partId[i] + " " + adjacency[i] + " \r\n";
      directionCount[direction[i]] += 1;
      elementCount[elementNo[i]] += 1;
      id += 1;
    }

    therbData = data;
# ---------- end surfacecount_3 ----------
部屋id1の構成面の方角 = Panel(cluster_5.L)
s壁の数 = Panel(getroomproperties.sCount)
部屋id1の構成面のelement_no = Panel(cluster_5.L_2)
部屋id1の構成面の部位no = Panel(cluster_5.L_6)
部屋id1の構成面の隣室条件 = Panel(cluster_5.L_3)
surfacecount_4 = CSharpScript(
    sCount=getroomproperties.sCount,
    wCount=getroomproperties.wCount,
    nCount=getroomproperties.nCount,
    eCount=getroomproperties.eCount,
    fCount=getroomproperties.fCount,
    crCount=getroomproperties.crCount,
    totalCount=getroomproperties.totalCount)  # -> out, therbData; inputs sCount: list of Int32, wCount: list of Int32, nCount: list of Int32, eCount: list of Int32, fCount: list of Int32, crCount: list of Int32, totalCount: list of Int32
# ---------- surfacecount_4: C# ----------
    string data = "";
    int id = 1;
    //Print("{0}", windowIds[0]);
    for(int i = 0; i < sCount.Count;i = i + 1){
      //TODO:string interpolationを使いたい
      data += cF(id, 5) + cF(sCount[i], 5) + cF(wCount[i], 5) + cF(nCount[i], 5) + cF(eCount[i], 5) + cF(fCount[i], 5) + cF(crCount[i], 5) + cF(totalCount[i], 5) + " \r\n";
      id += 1;
    }

    therbData = data;
# ---------- surfacecount_4: C# additional code ----------
  private string cF(int input, int totalLength)
  {
    string inputStr = input.ToString();
    int inputLength = inputStr.Length;
    string emptyString = new string(' ', totalLength - inputLength);

    return emptyString + inputStr;
  }
# ---------- end surfacecount_4 ----------
surfacecount_5 = CSharpScript(
    roomId=number_slider_2,
    direction=部屋id1の構成面の方角,
    elementNo=部屋id1の構成面のelement_no,
    partId=cluster_5.L_5,
    elementType=cluster_5.L_4,
    adjacency=部屋id1の構成面の隣室条件)  # -> out, therbData; inputs roomId: Int32, direction: list of String, elementNo: list of String, partId: list of Int32, elementType: list of String, adjacency: list of Int32; same code as surfacecount
merge_5 = Merge(
    Data1=surfacecount_4.therbData,
    Data2=surfacecount_5.therbData,
    Data3=surfacecount.therbData,
    Data4=surfacecount_2.therbData)

flatten_4 = FlattenTree(Tree=addition, Path="{0}")
flatten_5 = FlattenTree(Tree=cluster_14.L, Path="{0}")
flatten_6 = FlattenTree(Tree=cluster_13.L, Path="{0}")
flatten_7 = FlattenTree(Tree=cluster_11.L, Path="{0}")

# ----
# スペースの数を調整する
# 3-1.面構成データ用(b.dat)
# 3-1-1.部屋数、窓数、ドア数、オーバーハング数、ウイング数をカウント
# 2-2.以下の各行に、0 0を追加（熱容量はとりあえず0)
# 2-3-1.外壁の座標情報を抽出
# overhangとwingは未実装
# 守田君に聞く
# 2-3-2.外壁に属している窓、shadingのidを抽出
# 2-4.窓の座標情報を抽出
# 2-5.内壁の情報を抽出
# doorのロジックはupdate必要
# 2-6.床、天井の情報を抽出
# 2-7.屋根の情報を抽出
# 屋根の方位角のロジックはupdate必要
# 2-8.地面の情報を抽出
部屋数 = Panel(flatten_3)
外壁の座標情報 = Panel(cluster_9.x1)
部屋ごとに設定 = Panel(cluster_4)
structure_no = Panel(cluster_9.constructionids)
# 守田君に質問する
cluster_17 = Cluster_7(input=cluster_9.windowids)
床_天井の座標情報 = Panel(debrep_2.Vertices)
内壁の座標情報 = Panel(cluster_14.V)
屋根の座標情報 = Panel(debrep.Vertices)
窓の座標情報 = Panel(cluster_8.V)
地面の座標情報 = Panel(cluster_13.V)
# 3. THERBにデータ書き出し
外壁数 = Panel(flatten_2)
窓数 = Panel(flatten)
内壁の面積 = Panel(cluster_14.areas)
床_天井の面積 = Panel(cluster_10.areas)
屋根の面積 = Panel(cluster_11.areas)
地面の面積 = Panel(cluster_13.areas)
窓の面積 = Panel(cluster_8.areas)
外壁の傾斜角 = Panel(cluster_9.tiltangles)
内壁数 = Panel(flatten_5)
地面の傾斜角 = Panel(cluster_13.tiltangles)
窓の傾斜角 = Panel(cluster_8.tiltangles)
外壁の面積 = Panel(cluster_9.areas)
ドア数 = Panel("0")
exporttherb = CSharpScript(input2=部屋ごとに設定)  # -> out, output2; inputs input2: list of String
# ---------- exporttherb: C# ----------
    string data = "";
    int id = 1;
    foreach(string row in input2){
      Print("{0}", row);
      //TODO:string interpolationを使いたい
      data += cF("Room " + id.ToString(),13) + " " + row + "18.8 16.7 \r\n";
      id += 1;
    }

    //test = "Room {name}";
    output2 = data;
# ---------- exporttherb: C# additional code ----------
  private string cF(string input, int totalLength)
  {
    int inputLength = input.Length;
    string emptyString = new string(' ', totalLength - inputLength);

    return emptyString + input;
  }
# ---------- end exporttherb ----------
床数 = Panel(flatten_4)
exportwindowceilingfloor = CSharpScript(
    element="Window",
    x1=cluster_8.x1,
    y1=cluster_8.y1,
    z1=cluster_8.z1,
    x2=cluster_8.x2,
    y2=cluster_8.x2,
    z2=cluster_8.z2,
    tiltAngles=format_2,
    areas=format,
    structureNo=cluster_8.constructionids)  # -> out, therbData; inputs element: String, x1: list of String, y1: list of String, z1: list of String, x2: list of String, y2: list of String, z2: list of String, tiltAngles: list of String, areas: list of String, structureNo: list of String
# ---------- exportwindowceilingfloor: C# ----------
    string data = "";
    int id = 1;
    //Print("{0}", windowIds[0]);
    for(int i = 0; i < x1.Count;i = i + 1){
      //TODO:string interpolationを使いたい
      data += cF(element + id.ToString(), 13) + cF(x1[i], 8) + cF(y1[i], 8) + cF(z1[i], 8) + cF(x2[i], 8) + cF(y2[i], 8) + cF(z2[i], 8) + cF(tiltAngles[i], 10) + cF(areas[i], 12)
        + "\r\n  structure No. " + cF(structureNo[i], 5) + "  overhang No.     0      wing1 No.    0   wing2 No.    0\r\n";
      id += 1;
    }

    therbData = data;
# ---------- exportwindowceilingfloor: C# additional code ----------
  private string cF(string input, int totalLength)
  {
    int inputLength = input.Length;
    string emptyString = new string(' ', totalLength - inputLength);

    return emptyString + input;
  }
# ---------- end exportwindowceilingfloor ----------
exportinternalwall = CSharpScript(
    x1=format_6,
    y1=format_7,
    z1=format_8,
    x2=format_3,
    y2=format_5,
    z2=format_10,
    tiltAngles=format_9,
    areas=format_4,
    structureNo=cluster_14.constructionids,
    doorIds="   0   0   0   0   0   0   0   0   0   0   0")  # -> out, therbData; inputs x1: list of String, y1: list of String, z1: list of String, x2: list of String, y2: list of String, z2: list of String, tiltAngles: list of String, areas: list of String, structureNo: list of String, doorIds: String
# ---------- exportinternalwall: C# ----------
    string data = "";
    int id = 1;
    //Print("{0}", windowIds[0]);
    for(int i = 0; i < x1.Count;i = i + 1){
      //TODO:string interpolationを使いたい
      data += cF("In-wall" + id.ToString(), 13) + cF(x1[i], 8) + cF(y1[i], 8) + cF(z1[i], 8) + cF(x2[i], 8) + cF(y2[i], 8) + cF(z2[i], 8) + cF(tiltAngles[i], 10) + cF(areas[i], 12)
        + "    0\r\n  structure No. " + cF(structureNo[i], 5) + " \r\n in-door No. " + doorIds + " \r\n";

      id += 1;

    }
    therbData = data;
# ---------- exportinternalwall: C# additional code ----------
  private string cF(string input, int totalLength)
  {
    int inputLength = input.Length;
    string emptyString = new string(' ', totalLength - inputLength);

    return emptyString + input;
  }
# ---------- end exportinternalwall ----------
exportexternalwall = CSharpScript(
    x1=cluster_9.x1,
    y1=format_14,
    z1=format_15,
    x2=cluster_9.x2,
    y2=format_16,
    z2=format_11,
    tiltAngles=format_13,
    areas=format_12,
    structureNo=structure_no,
    windowIds=simplify(cluster_17))  # -> out, output3; inputs x1: list of String, y1: list of String, z1: list of String, x2: list of String, y2: list of String, z2: list of String, tiltAngles: list of String, areas: list of String, structureNo: list of String, windowIds: list
# ---------- exportexternalwall: C# ----------
    string data = "";
    int id = 1;
    //Print("{0}", windowIds[0]);
    for(int i = 0; i < x1.Count;i = i + 1){
      //TODO:string interpolationを使いたい
      Print("{0}", y1[i]);
      data += cF("Ex-wall " + id.ToString(), 13) + cF(x1[i], 8) + cF(y1[i], 8) + cF(z1[i], 8) + cF(x2[i], 8) + cF(y2[i], 8) + cF(z2[i], 8) + cF(tiltAngles[i], 10) + cF(areas[i], 12) + "    0\r\n  structure No. " + cF(structureNo[i], 5) + "  overhang No.     0      wing1 No.    0   wing2 No.    0 \r\n      window No. " + windowIds[i] + "\r\n";
      //data += cF("Ex-wall " + id.ToString(), 13) + cF(x1[i], 8) + cF(y1[i], 8) + " " + z1[i] + " " + x2[i] + " " + y2[i] + " " + z2[i] + " " + " " + tiltAngles[i] + " " + areas[i] + " 0 \r\n structure No. " + structureNo[i] + " overhang No. 0 wing1 No. 0 wing2 No. 0 \r\n window No. " + windowIds[i] + " \r\n";

      id += 1;

    }
    output3 = data;
# ---------- exportexternalwall: C# additional code ----------
  private string cF(string input, int totalLength)
  {
    int inputLength = input.Length;
    string emptyString = new string(' ', totalLength - inputLength);

    return emptyString + input;
  }

  private string cNF(double input, int totalLength, int digit){
    string inputValue = string.Format("{0:0.000}", input);
    string emptyString = new string(' ', totalLength - inputValue.Length);

    return emptyString + inputValue;
  }
# ---------- end exportexternalwall ----------
exportwindowceilingfloor_2 = CSharpScript(
    element="flr&cling",
    x1=format_29,
    y1=format_30,
    z1=format_26,
    x2=format_27,
    y2=format_31,
    z2=format_32,
    tiltAngles=format_25,
    areas=format_28,
    structureNo=merge_4)  # -> out, therbData; inputs element: String, x1: list of String, y1: list of String, z1: list of String, x2: list of String, y2: list of String, z2: list of String, tiltAngles: list of String, areas: list of String, structureNo: list of String
# ---------- exportwindowceilingfloor_2: C# ----------
    string data = "";
    int id = 1;
    //Print("{0}", windowIds[0]);
    for(int i = 0; i < x1.Count;i = i + 1){
      //TODO:string interpolationを使いたい
      data += cF(element + id.ToString(), 13) + cF(x1[i], 8) + cF(y1[i], 8) + cF(z1[i], 8) + cF(x2[i], 8) + cF(y2[i], 8) + cF(z2[i], 8) + cF(tiltAngles[i], 10) + cF(areas[i], 12)
        + "    0\r\n  structure No. " + cF(structureNo[i], 5) + "\r\n";
      id += 1;
    }

    therbData = data;
# ---------- exportwindowceilingfloor_2: C# additional code ----------
  private string cF(string input, int totalLength)
  {
    int inputLength = input.Length;
    string emptyString = new string(' ', totalLength - inputLength);

    return emptyString + input;
  }
# ---------- end exportwindowceilingfloor_2 ----------
exportroof = CSharpScript(
    element="Roof",
    x1=cluster_16.X_2,
    y1=cluster_16.Y_2,
    x2=cluster_16.X,
    y2=cluster_16.Y,
    direction="0",
    tiltAngles=cluster_11.tiltangles,
    areas=cluster_11.areas,
    structureNo=cluster_11.constructionids)  # -> out, therbData; inputs element: String, x1: list of Double, y1: list of Double, x2: list of Double, y2: list of Double, direction: Double, tiltAngles: list of Double, areas: list of Double, structureNo: list of String
# ---------- exportroof: C# ----------
    string data = "";
    int id = 1;
    //Print("{0}", windowIds[0]);
    for(int i = 0; i < x1.Count;i = i + 1){
      //TODO:string interpolationを使いたい
      data += cF(element + id.ToString(), 13) + cNF(x1[i], 8, 3) + cNF(y1[i], 8, 3) + "        " + cNF(x2[i], 8, 3) + cNF(y2[i], 8, 3) + cNF(direction, 8, 3) + cNF(tiltAngles[i], 10, 3) + cNF(areas[i], 12, 4) + "    0\r\n structure No. " + cF(structureNo[i], 5) + " \r\n";
      id += 1;
    }

    therbData = data;
# ---------- exportroof: C# additional code ----------
  private string cF(string input, int totalLength)
  {
    int inputLength = input.Length;
    string emptyString = new string(' ', totalLength - inputLength);

    return emptyString + input;
  }

  private string cNF(double input, int totalLength, int digit){
    string zeros = new String('0', digit);
    string format = "{0:0." + zeros + "}";
    string inputValue = string.Format(format, input);
    string emptyString = new string(' ', totalLength - inputValue.Length);

    return emptyString + inputValue;
  }
# ---------- end exportroof ----------
屋根数 = Panel(flatten_7)
地面数 = Panel(flatten_6)
panel_4 = Panel(exporttherb.output2)
ひさし数 = Panel("0")
ウイング数 = Panel("0")
python = GhPythonScript(x=部屋数, y=外壁数, z=窓数, u=内壁数, v=ドア数, w=床数, s=屋根数, t=地面数, xx=ひさし数, xy=ウイング数)  # -> a
# ---------- python: Python ----------
__author__ = "81803"
__version__ = "2022.02.02"

import rhinoscriptsyntax as rs
if x == "":
    x1 == ""
elif y == "":
    x1 == ""
else :
    x1 = " "
a = x + x1 + y + x1 + z + x1 + u + x1 + v + x1 + w + x1 + s + x1 + t + x1 + xx + x1 + xy + x1 + "[kJ/m3 K]    [kg/m3(kg/kg')]"
# ---------- end python ----------
exporttherb_2 = CSharpScript(
    overallData=python,
    roomData=exporttherb.output2,
    exteriorWallData=exportexternalwall.output3,
    interiorWallData=exportinternalwall.therbData,
    windowData=exportwindowceilingfloor.therbData,
    flrCeilingData=exportwindowceilingfloor_2.therbData,
    roofData=exportroof.therbData)  # -> out, bDat; inputs overallData: String, roomData: String, exteriorWallData: String
# ---------- exporttherb_2: C# ----------
    bDat = overallData + "\r\n" + roomData + "\r\n" + exteriorWallData + "\r\n" + windowData + "\r\n" + interiorWallData + "\r\n" + flrCeilingData + "\r\n" + roofData + "\r\n" + groundData + "\r\n";
# ---------- end exporttherb_2 ----------

panel_5 = Panel(cluster_17)
exportwindowceilingfloor_3 = CSharpScript(
    element="Ground",
    x1=format_21,
    y1=format_22,
    z1=format_18,
    x2=format_19,
    y2=format_23,
    z2=format_24,
    tiltAngles=format_17,
    areas=format_20,
    structureNo=merge_4)  # -> out, therbData; inputs element: String, x1: list of String, y1: list of String, z1: list of String, x2: list of String, y2: list of String, z2: list of String, tiltAngles: list of String, areas: list of String, structureNo: list of String; same code as exportwindowceilingfloor_2
merge_6 = Merge(Data1=部屋数, Data2=外壁数, Data3=窓数, Data4=内壁数, Data5=ドア数, Data6=床数, Data7=屋根数, Data8=地面数, Data9=ひさし数, Data10=ウイング数)  # -> flatten(Result)
panel_6 = Panel(exportexternalwall.output3)
exporttherb_3 = CSharpScript(input2=merge_6)  # -> out, output2; inputs input2: list of String
# ---------- exporttherb_3: C# ----------
    string data = "";
    foreach(string row in input2){
      Print("{0}", row);
      //TODO:string interpolationを使いたい
      data += convertFormat(row, 4);
    }
    output2 = data;
# ---------- exporttherb_3: C# additional code ----------
  private string convertFormat(string input, int totalLength)
  {
    int inputLength = input.Length;
    string emptyString = new string(' ', totalLength - inputLength);

    return emptyString + input;
  }
# ---------- end exporttherb_3 ----------
panel_7 = Panel(exportwindowceilingfloor.therbData)
panel_8 = Panel(exportinternalwall.therbData)
panel_9 = Panel(exportroof.therbData)
panel_10 = Panel(exportwindowceilingfloor_2.therbData)
panel_11 = Panel(exportwindowceilingfloor_3.therbData)
panel_12 = Panel(surfacecount_5.therbData)
panel_13 = Panel(surfacecount_4.therbData)
panel_14 = Panel(merge_5)
panel_15 = Panel(exporttherb_3.output2)
panel_16 = Panel(python)

# ----
# 4. データをサーバーにupload
b_datファイル書き出し = Panel(exporttherb_2.bDat)

# ==== cluster Cluster
brep = ClusterInput()
brep_2 = Brep(brep)

# ----
# 全オブジェクトから最も体積の大きいオブジェクトの選択
volume = Volume(Geometry=brep_2)  # -> Volume, Centroid
sort_list = SortList(Keys=volume.Volume)  # -> Keys, ValuesValuesA
list_item = ListItem(List=sort_list.Keys, Index="-1", Wrap=True)

panel = Panel(volume.Volume)

member_index = MemberIndex(Set=list_item, Member=volume.Volume)  # -> flatten(Index), Count
# 選択したオブジェクトからのリスト番号を抽出し
# その他オブジェクトで分断
addition = Addition(A=member_index.Index, B=1)
split_list = SplitList(List=brep_2, Index=addition)  # -> ListA, ListB
split_brep_multiple = SplitBrepMultiple(Brep=split_list.ListA, Cutters=split_list.ListB)  # -> graft(Result)

# ----
# 切断した体積を修復
cap_holes_ex = CapHolesEx(Brep=split_brep_multiple)  # -> simplify(Brep), Caps, Solid
brep_3 = ClusterOutput(cap_holes_ex.Brep)

# ==== cluster Cluster_2
G = ClusterInput()
volume = Volume(Geometry=G)  # -> simplify(Volume), Centroid
python = GhPythonScript(x=volume.Volume)  # -> a
# ---------- python: Python ----------
__author__ = "81803"
__version__ = "2021.09.09"

import rhinoscriptsyntax as rs
x = str(x)
w = x.find('.')
w2 = w+2
if w == -1:
    a = x
else:
    a = x[0:w2]
# ---------- end python ----------
容積計算 = ClusterOutput(python)

# ==== cluster Cluster_3
brep = ClusterInput()
wires = BrepWireframe(Brep=brep, Density=-1)
# 各部屋のポイント
explode = Explode(Curve=wires, Recursive=True)  # -> Segments, Vertices
end = EndPoints(Curve=explode.Segments)  # -> simplify(Start), End
trim = TrimTree(Tree=end.Start, Depth=1)
cullpt = CullDuplicates(Points=trim, Tolerance=0.1, CullMode=3)  # -> Points, Indices, Valence
point = ClusterOutput(cullpt.Points)

# ==== cluster Cluster_5
point = ClusterInput()
容積 = ClusterInput()
point_2 = Data(point)
容積_2 = Data(容積)
pdecon = Deconstruct(Point=point_2)  # -> XComponent, YComponent, ZComponent
# ここで空白のスペースを規定している
graft = GraftTree(Tree=容積_2, IncludeEmptyLists=True, IncludeNullItems=True)  # -> simplify(Tree)
cluster = Cluster_4(input=pdecon.XComponent)  # -> simplify(最大_2), simplify(最小_2)
cluster_2 = Cluster_4(input=pdecon.YComponent)  # -> simplify(最大_2), simplify(最小_2)
cluster_3 = Cluster_4(input=pdecon.ZComponent)  # -> simplify(最大_2), simplify(最小_2)
# ここで小数点の操作をしている
concat = Concatenate(
    A=" ",
    x1=cluster.最小_2,
    B=" ",
    y1=cluster_2.最小_2,
    C=" ",
    z1=cluster_3.最小_2,
    D=" ",
    x2=cluster.最大_2,
    E=" ",
    y2=cluster_2.最大_2,
    F=" ",
    z2=cluster_3.最大_2,
    G=" ",
    容積=graft,
    H=" ",
    I=" ")  # -> flatten(部屋ごとに設定)
部屋ごとに設定 = ClusterOutput(concat)

# ==== cluster Cluster_6
観測点 = ClusterInput()
観測点_2 = Point(観測点)
原点 = Point(Point(0, 0, 0))
ln = Line(StartPoint=原点, EndPoint=観測点_2)

# ---- group: 長さを計測して、最大、最小の順番を抽出
len = Length(Curve=ln)
sort = SortList(Keys=len)  # -> Keys, ValuesA
item = ListItem(List=sort.Keys, Index="-1", Wrap=True)  # -> Item, Item1
最大 = Data(item.Item)
最小 = Data(item.Item1)
mindex = MemberIndex(Set=len, Member=最大)  # -> Index, Count
mindex_2 = MemberIndex(Set=len, Member=最小)  # -> Index, Count

# ---- group: 最小の点
item_2 = ListItem(List=観測点_2, Index=mindex_2.Index, Wrap=True)

# ---- group: 最大の点
item_3 = ListItem(List=観測点_2, Index=mindex.Index, Wrap=True)

# ----
format = Format(Format="{0:0.00}", Culture=127, Data0=item_2)
format_2 = Format(Format="{0:0.00}", Culture=127, Data0=item_3)
pdecon = Deconstruct(Point=format_2)  # -> XComponent, YComponent, ZComponent
pdecon_2 = Deconstruct(Point=format)  # -> XComponent, YComponent, ZComponent
X = ClusterOutput(pdecon.XComponent)
Y = ClusterOutput(pdecon.YComponent)
Z = ClusterOutput(pdecon.ZComponent)
X_2 = ClusterOutput(pdecon_2.XComponent)
Y_2 = ClusterOutput(pdecon_2.YComponent)
Z_2 = ClusterOutput(pdecon_2.ZComponent)

# ==== cluster Cluster_7
input = ClusterInput()
input_2 = Data(input)
panel = Panel(input_2)
tstat = TreeStatistics(Tree=input_2)  # -> Paths, Length, Count
join = TextJoin(Text=input_2, Join=" ")  # -> flatten(Result)
data = Data(flatten(tstat.Length))
python = GhPythonScript(id=join, idLength=data)  # -> a
# ---------- python: Python ----------
__author__ = "81803"
__version__ = "2022.02.04"

import rhinoscriptsyntax as rs
x1 = 11-idLength
x2 = "   0"*x1
#if x2 == " 0 0 0 0 0 0 0 0 0 0 0":
#    x2 = "0 0 0 0 0 0 0 0 0 0 0"
#TODO:より汎用性のある書き方に直す
a ="   "+id+ x2


def cF(input,totalLength):
    emptyLength =totalLength-input.length
    return " "*emptyLength
# ---------- end python ----------
python_2 = GhPythonScript(x=data)  # -> a
# ---------- python_2: Python ----------
__author__ = "81803"
__version__ = "2022.02.04"

import rhinoscriptsyntax as rs
x1 = 11-x
x2 = " 0"*x1
if x2 == " 0 0 0 0 0 0 0 0 0 0 0":
    x2 = "0 0 0 0 0 0 0 0 0 0 0"
a = x2
# ---------- end python_2 ----------
concat = Concatenate(FragmentA=join, FragmentB=python_2)
window_id = Data(concat)
window_id_2 = ClusterOutput(window_id)

# ==== cluster Cluster_8
faces = ClusterInput()
element = ClusterInput()
getfaceproperties = CSharpScript(Faces=faces, element=element)  # -> out, Face, geometries, simplify(ids), simplify(windowIds), centerPts, tiltAngles, areas; inputs element: String
# ---------- getfaceproperties: C# usings ----------
using System.Reflection;
using Rhino.Geometry.Intersect;
using System.Linq;
# ---------- getfaceproperties: C# ----------
    if (Faces == null) return;
    MethodInfo elementTypeGetter = Faces.GetType().GetProperty("elementType").GetGetMethod();
    string elementType = elementTypeGetter.Invoke(Faces, null) as string;
    //Print("{0}", elementType);
    if (elementType == element){
      FieldInfo idField = Faces.GetType().GetField("id");
      int id = (int) idField.GetValue(Faces);
      FieldInfo windowIdField = Faces.GetType().GetField("windowIds");
      List<int> windowId = (List<int>) windowIdField.GetValue(Faces);
      FieldInfo centerPtField = Faces.GetType().GetField("centerPt");
      Point3d centerPt = (Point3d) centerPtField.GetValue(Faces);
      double tiltAngle = (double) Faces.GetType().GetField("tiltAngle").GetValue(Faces);
      double area = (double) Faces.GetType().GetField("area").GetValue(Faces);
      MethodInfo geoGetter = Faces.GetType().GetProperty("geometry").GetGetMethod();
      Surface geo = geoGetter.Invoke(Faces, null) as Surface;

      geometries = geo;
      ids = id;
      windowIds = windowId;
      centerPts = centerPt;
      tiltAngles = tiltAngle;
      areas = area;
      Face = Faces;
    }
# ---------- end getfaceproperties ----------

null = NullItem(Item=getfaceproperties.Face)  # -> NullFlags, InvalidFlags, Description
not = GateNot(A=null.NullFlags)
cull = CullPattern(List=getfaceproperties.Face, CullPattern=not)
lng = ListLength(List=cull)

element_2 = ClusterInput()
getfaceproperties_2 = CSharpScript(Faces=cull, element=element_2)  # -> out, Face, geometries, simplify(ids), simplify(windowIds), centerPts, tiltAngles, areas, constructionIds; inputs element: String
# ---------- getfaceproperties_2: C# ----------
    if (Faces == null) return;
    MethodInfo elementTypeGetter = Faces.GetType().GetProperty("elementType").GetGetMethod();
    string elementType = elementTypeGetter.Invoke(Faces, null) as string;
    //Print("{0}", elementType);
    if (elementType == element){
      FieldInfo idField = Faces.GetType().GetField("id");
      int id = (int) idField.GetValue(Faces);
      FieldInfo windowIdField = Faces.GetType().GetField("windowIds");
      List<int> windowId = (List<int>) windowIdField.GetValue(Faces);
      FieldInfo centerPtField = Faces.GetType().GetField("centerPt");
      Point3d centerPt = (Point3d) centerPtField.GetValue(Faces);
      double tiltAngle = (double) Faces.GetType().GetField("tiltAngle").GetValue(Faces);
      double area = (double) Faces.GetType().GetField("area").GetValue(Faces);
      int constructionId = (int) Faces.GetType().GetField("constructionId").GetValue(Faces);
      MethodInfo geoGetter = Faces.GetType().GetProperty("geometry").GetGetMethod();
      Surface geo = geoGetter.Invoke(Faces, null) as Surface;

      geometries = geo;
      ids = id;
      windowIds = windowId;
      centerPts = centerPt;
      tiltAngles = tiltAngle;
      areas = Math.Round(area, 2);
      Face = Faces;
      constructionIds = constructionId;
    }
# ---------- end getfaceproperties_2 ----------
L = ClusterOutput(lng)
geometries = ClusterOutput(getfaceproperties_2.geometries)
centerpts = ClusterOutput(getfaceproperties_2.centerPts)
tiltangles = ClusterOutput(getfaceproperties_2.tiltAngles)
areas = ClusterOutput(getfaceproperties_2.areas)
constructionids = ClusterOutput(getfaceproperties_2.constructionIds)

# ==== cluster Cluster_9
faces = ClusterInput()
element = ClusterInput()
getfaceproperties = CSharpScript(Faces=faces, element=element)  # -> out, Face, geometries, simplify(ids), simplify(windowIds), centerPts, tiltAngles, areas; inputs element: String; same code as getfaceproperties

null = NullItem(Item=getfaceproperties.Face)  # -> NullFlags, InvalidFlags, Description
not = GateNot(A=null.NullFlags)
cull = CullPattern(List=getfaceproperties.Face, CullPattern=not)
lng = ListLength(List=cull)

element_2 = ClusterInput()
getfaceproperties_2 = CSharpScript(Faces=cull, element=element_2)  # -> out, Face, geometries, simplify(ids), simplify(windowIds), centerPts, tiltAngles, areas, constructionIds; inputs element: String; same code as getfaceproperties_2
L = ClusterOutput(lng)
geometries = ClusterOutput(getfaceproperties_2.geometries)
tiltangles = ClusterOutput(getfaceproperties_2.tiltAngles)
areas = ClusterOutput(getfaceproperties_2.areas)
constructionids = ClusterOutput(getfaceproperties_2.constructionIds)

# ==== cluster Cluster_10
faces = ClusterInput()
parentid = ClusterInput()
groupfacepropertiesbyroom = CSharpScript(Faces=faces, parentId=parentid)  # -> out, Face, geometries, simplify(ids), simplify(windowIds), centerPts, tiltAngles, areas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; inputs parentId: Int32
# ---------- groupfacepropertiesbyroom: C# ----------
    if (Faces == null) return;
    int parent = (int) Faces.GetType().GetField("parentId").GetValue(Faces);
    Print("{0}", parent);
    if (parent == parentId){
      FieldInfo idField = Faces.GetType().GetField("id");
      int id = (int) idField.GetValue(Faces);
      FieldInfo windowIdField = Faces.GetType().GetField("windowIds");
      List<int> windowId = (List<int>) windowIdField.GetValue(Faces);
      FieldInfo centerPtField = Faces.GetType().GetField("centerPt");
      Point3d centerPt = (Point3d) centerPtField.GetValue(Faces);
      double tiltAngle = (double) Faces.GetType().GetField("tiltAngle").GetValue(Faces);
      double area = (double) Faces.GetType().GetField("area").GetValue(Faces);
      MethodInfo geoGetter = Faces.GetType().GetProperty("geometry").GetGetMethod();
      Surface geo = geoGetter.Invoke(Faces, null) as Surface;
      string direction = (string) Faces.GetType().GetField("direction").GetValue(Faces);
      int elementId = (int) Faces.GetType().GetField("constructionId").GetValue(Faces);
      int adjacencyId = (int) Faces.GetType().GetField("adjacencyRoomId").GetValue(Faces);
      int partId = (int) Faces.GetType().GetField("partId").GetValue(Faces);
      MethodInfo elementTypeGetter = Faces.GetType().GetProperty("elementType").GetGetMethod();
      string elementType = elementTypeGetter.Invoke(Faces, null) as string;
      Print("{0}", elementType);

      geometries = geo;
      ids = id;
      windowIds = windowId;
      centerPts = centerPt;
      tiltAngles = tiltAngle;
      areas = area;
      Face = Faces;
      directions = direction;
      elementIds = elementId;
      adjacencyRoomIds = adjacencyId;
      elementTypes = elementType;
      partIds = partId;
    }
# ---------- end groupfacepropertiesbyroom ----------

null = NullItem(Item=groupfacepropertiesbyroom.directions)  # -> NullFlags, InvalidFlags, Description
not = GateNot(A=null.NullFlags)
cull = CullPattern(List=groupfacepropertiesbyroom.directions, CullPattern=not)

null_2 = NullItem(Item=groupfacepropertiesbyroom.elementIds)  # -> NullFlags, InvalidFlags, Description
not_2 = GateNot(A=null_2.NullFlags)
cull_2 = CullPattern(List=groupfacepropertiesbyroom.elementIds, CullPattern=not_2)

null_3 = NullItem(Item=groupfacepropertiesbyroom.ids)  # -> NullFlags, InvalidFlags, Description
not_3 = GateNot(A=null_3.NullFlags)
cull_3 = CullPattern(List=groupfacepropertiesbyroom.ids, CullPattern=not_3)

null_4 = NullItem(Item=groupfacepropertiesbyroom.adjacencyRoomIds)  # -> NullFlags, InvalidFlags, Description
not_4 = GateNot(A=null_4.NullFlags)
cull_4 = CullPattern(List=groupfacepropertiesbyroom.adjacencyRoomIds, CullPattern=not_4)

null_5 = NullItem(Item=groupfacepropertiesbyroom.elementTypes)  # -> NullFlags, InvalidFlags, Description
not_5 = GateNot(A=null_5.NullFlags)
cull_5 = CullPattern(List=groupfacepropertiesbyroom.elementTypes, CullPattern=not_5)

null_6 = NullItem(Item=groupfacepropertiesbyroom.partIds)  # -> NullFlags, InvalidFlags, Description
not_6 = GateNot(A=null_6.NullFlags)
cull_6 = CullPattern(List=groupfacepropertiesbyroom.partIds, CullPattern=not_6)

L = ClusterOutput(cull)
L_2 = ClusterOutput(cull_2)
L_3 = ClusterOutput(cull_4)
L_4 = ClusterOutput(cull_5)
L_5 = ClusterOutput(cull_6)
L_6 = ClusterOutput(cull_3)

# ==== cluster Cluster_11
faces = ClusterInput()
parentid = ClusterInput()
groupfacepropertiesbyroom = CSharpScript(Faces=faces, parentId=parentid)  # -> out, Face, geometries, simplify(ids), simplify(windowIds), centerPts, tiltAngles, areas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; inputs parentId: Int32
# ---------- groupfacepropertiesbyroom: C# ----------
    if (Faces == null) return;
    int parent = (int) Faces.GetType().GetField("parentId").GetValue(Faces);
    if (parent == parentId){
      FieldInfo idField = Faces.GetType().GetField("id");
      int id = (int) idField.GetValue(Faces);
      FieldInfo windowIdField = Faces.GetType().GetField("windowIds");
      List<int> windowId = (List<int>) windowIdField.GetValue(Faces);
      FieldInfo centerPtField = Faces.GetType().GetField("centerPt");
      Point3d centerPt = (Point3d) centerPtField.GetValue(Faces);
      double tiltAngle = (double) Faces.GetType().GetField("tiltAngle").GetValue(Faces);
      double area = (double) Faces.GetType().GetField("area").GetValue(Faces);
      MethodInfo geoGetter = Faces.GetType().GetProperty("geometry").GetGetMethod();
      Surface geo = geoGetter.Invoke(Faces, null) as Surface;
      string direction = (string) Faces.GetType().GetField("direction").GetValue(Faces);
      int elementId = (int) Faces.GetType().GetField("constructionId").GetValue(Faces);
      int adjacencyId = (int) Faces.GetType().GetField("adjacencyRoomId").GetValue(Faces);
      MethodInfo elementTypeGetter = Faces.GetType().GetProperty("elementType").GetGetMethod();
      string elementType = elementTypeGetter.Invoke(Faces, null) as string;
      int partId = (int) Faces.GetType().GetField("partId").GetValue(Faces);

      geometries = geo;
      ids = id;
      windowIds = windowId;
      centerPts = centerPt;
      tiltAngles = tiltAngle;
      areas = area;
      Face = Faces;
      directions = direction;
      elementIds = elementId;
      adjacencyRoomIds = adjacencyId;
      elementTypes = elementType;
      partIds = partId;
    }
# ---------- end groupfacepropertiesbyroom ----------

null = NullItem(Item=groupfacepropertiesbyroom.directions)  # -> NullFlags, InvalidFlags, Description
not = GateNot(A=null.NullFlags)
cull = CullPattern(List=groupfacepropertiesbyroom.directions, CullPattern=not)

null_2 = NullItem(Item=groupfacepropertiesbyroom.elementIds)  # -> NullFlags, InvalidFlags, Description
not_2 = GateNot(A=null_2.NullFlags)
cull_2 = CullPattern(List=groupfacepropertiesbyroom.elementIds, CullPattern=not_2)

null_3 = NullItem(Item=groupfacepropertiesbyroom.adjacencyRoomIds)  # -> NullFlags, InvalidFlags, Description
not_3 = GateNot(A=null_3.NullFlags)
cull_3 = CullPattern(List=groupfacepropertiesbyroom.adjacencyRoomIds, CullPattern=not_3)

null_4 = NullItem(Item=groupfacepropertiesbyroom.partIds)  # -> NullFlags, InvalidFlags, Description
not_4 = GateNot(A=null_4.NullFlags)
cull_4 = CullPattern(List=groupfacepropertiesbyroom.partIds, CullPattern=not_4)

null_5 = NullItem(Item=groupfacepropertiesbyroom.elementTypes)  # -> NullFlags, InvalidFlags, Description
not_5 = GateNot(A=null_5.NullFlags)
cull_5 = CullPattern(List=groupfacepropertiesbyroom.elementTypes, CullPattern=not_5)

L = ClusterOutput(cull)
L_2 = ClusterOutput(cull_2)
L_3 = ClusterOutput(cull_3)
L_4 = ClusterOutput(cull_4)
L_5 = ClusterOutput(cull_5)

# ==== cluster Cluster_12
faces = ClusterInput()
parentid = ClusterInput()
groupfacepropertiesbyroom = CSharpScript(Faces=faces, parentId=parentid)  # -> out, Face, geometries, simplify(ids), simplify(windowIds), centerPts, tiltAngles, areas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; inputs parentId: Int32; same code as groupfacepropertiesbyroom

null = NullItem(Item=groupfacepropertiesbyroom.directions)  # -> NullFlags, InvalidFlags, Description
not = GateNot(A=null.NullFlags)
cull = CullPattern(List=groupfacepropertiesbyroom.directions, CullPattern=not)

null_2 = NullItem(Item=groupfacepropertiesbyroom.elementIds)  # -> NullFlags, InvalidFlags, Description
not_2 = GateNot(A=null_2.NullFlags)
cull_2 = CullPattern(List=groupfacepropertiesbyroom.elementIds, CullPattern=not_2)

null_3 = NullItem(Item=groupfacepropertiesbyroom.adjacencyRoomIds)  # -> NullFlags, InvalidFlags, Description
not_3 = GateNot(A=null_3.NullFlags)
cull_3 = CullPattern(List=groupfacepropertiesbyroom.adjacencyRoomIds, CullPattern=not_3)

null_4 = NullItem(Item=groupfacepropertiesbyroom.elementTypes)  # -> NullFlags, InvalidFlags, Description
not_4 = GateNot(A=null_4.NullFlags)
cull_4 = CullPattern(List=groupfacepropertiesbyroom.elementTypes, CullPattern=not_4)

null_5 = NullItem(Item=groupfacepropertiesbyroom.partIds)  # -> NullFlags, InvalidFlags, Description
not_5 = GateNot(A=null_5.NullFlags)
cull_5 = CullPattern(List=groupfacepropertiesbyroom.partIds, CullPattern=not_5)
L = ClusterOutput(cull)
L_2 = ClusterOutput(cull_2)
L_3 = ClusterOutput(cull_3)
L_4 = ClusterOutput(cull_4)
L_5 = ClusterOutput(cull_5)

# ==== cluster Cluster_15
faces = ClusterInput()
element = ClusterInput()
element_2 = ClusterInput()
cluster = Cluster_14(faces=faces, element_2=element, element=element_2)  # -> geometries, ids, windowids, centerpts, tiltangles, areas, L, constructionids
windowids = ClusterOutput(cluster.windowids)
tiltangles = ClusterOutput(cluster.tiltangles)
areas = ClusterOutput(cluster.areas)
L = ClusterOutput(cluster.L)
constructionids = ClusterOutput(cluster.constructionids)
debrep = DeconstructBrep(Brep=cluster.geometries)  # -> Faces, Edges, simplify(Vertices)
cluster_2 = Cluster_13(観測点=debrep.Vertices)  # -> flatten(X_2), flatten(Y_2), flatten(Z_2), flatten(X), flatten(Y), flatten(Z)
panel = Panel(debrep.Vertices)
x1 = ClusterOutput(cluster_2.X_2)
y1 = ClusterOutput(cluster_2.Y_2)
z1 = ClusterOutput(cluster_2.Z_2)
x2 = ClusterOutput(cluster_2.X)
y2 = ClusterOutput(cluster_2.Y)
z2 = ClusterOutput(cluster_2.Z)

# ==== cluster Cluster_17
faces = ClusterInput()
element = ClusterInput()
element_2 = ClusterInput()
cluster = Cluster_16(faces=faces, element_2=element, element=element_2)  # -> L, geometries, centerpts, tiltangles, areas, constructionids
debrep = DeconstructBrep(Brep=cluster.geometries)  # -> Faces, Edges, simplify(Vertices)
L = ClusterOutput(cluster.L)
tiltangles = ClusterOutput(cluster.tiltangles)
areas = ClusterOutput(cluster.areas)
constructionids = ClusterOutput(cluster.constructionids)
cluster_2 = Cluster_6(観測点=debrep.Vertices)  # -> flatten(X_2), flatten(Y_2), flatten(Z_2), flatten(X), flatten(Y), flatten(Z)
V = ClusterOutput(debrep.Vertices)
x1 = ClusterOutput(cluster_2.X_2)
y1 = ClusterOutput(cluster_2.Y_2)
z1 = ClusterOutput(cluster_2.Z_2)
x2 = ClusterOutput(cluster_2.X)
y2 = ClusterOutput(cluster_2.Y)
z2 = ClusterOutput(cluster_2.Z)

# ==== cluster Cluster_18
faces = ClusterInput()
element = ClusterInput()
element_2 = ClusterInput()
cluster = Cluster_9(faces=faces, element=element, element_2=element_2)  # -> L, geometries, tiltangles, areas, constructionids
L = ClusterOutput(cluster.L)
tiltangles = ClusterOutput(cluster.tiltangles)
areas = ClusterOutput(cluster.areas)
constructionids = ClusterOutput(cluster.constructionids)
debrep = DeconstructBrep(Brep=cluster.geometries)  # -> Faces, Edges, simplify(Vertices)
cluster_2 = Cluster_6(観測点=debrep.Vertices)  # -> flatten(X_2), flatten(Y_2), flatten(Z_2), flatten(X), flatten(Y), flatten(Z)
V = ClusterOutput(debrep.Vertices)
x1 = ClusterOutput(cluster_2.X_2)
y1 = ClusterOutput(cluster_2.Y_2)
z1 = ClusterOutput(cluster_2.Z_2)
x2 = ClusterOutput(cluster_2.X)
y2 = ClusterOutput(cluster_2.Y)
z2 = ClusterOutput(cluster_2.Z)

# ==== cluster Cluster_20
windows = ClusterInput()
getwindowproperties = CSharpScript(Windows=windows)  # -> out, geometries, areas, tiltAngles, constructionIds
# ---------- getwindowproperties: C# ----------
    if (Windows == null) return;
    MethodInfo geometryGetter = Windows.GetType().GetProperty("geometry").GetGetMethod();
    Surface geometry = geometryGetter.Invoke(Windows, null) as Surface;
    double area = (double) Windows.GetType().GetField("area").GetValue(Windows);
    double angle = (double) Windows.GetType().GetField("tiltAngle").GetValue(Windows);
    int constructionId = (int) Windows.GetType().GetField("constructionId").GetValue(Windows);

    geometries = geometry;
    areas = Math.Round(area, 2);
    tiltAngles = angle;
    constructionIds = constructionId;
# ---------- end getwindowproperties ----------
lng = ListLength(List=getwindowproperties.geometries)
areas = ClusterOutput(getwindowproperties.areas)
tiltangles = ClusterOutput(getwindowproperties.tiltAngles)
constructionids = ClusterOutput(getwindowproperties.constructionIds)
L = ClusterOutput(lng)
debrep = DeconstructBrep(Brep=getwindowproperties.geometries)  # -> Faces, Edges, simplify(Vertices)
V = ClusterOutput(debrep.Vertices)
cluster = Cluster_19(観測点=debrep.Vertices)  # -> flatten(X_2), flatten(Y_2), flatten(Z_2), flatten(X), flatten(Y), flatten(Z)
z2 = ClusterOutput(cluster.Z)
x1 = ClusterOutput(cluster.X_2)
y1 = ClusterOutput(cluster.Y_2)
z1 = ClusterOutput(cluster.Z_2)
x2 = ClusterOutput(cluster.X)
y2 = ClusterOutput(cluster.Y)

# ==== cluster Cluster_4
input = ClusterInput()
input_2 = Data(input)
# ここで小数点の操作をしている
python = GhPythonScript(x=input_2)  # -> a
# ---------- python: Python ----------
__author__ = "81803"
__version__ = "2021.09.09"

import rhinoscriptsyntax as rs
x = str(x)
w = x.find('.')
w2 = w+4
if w == -1:
    a = x
else:
    a = x[0:w2]
# ---------- end python ----------
sort_list = SortList(Keys=python)  # -> Keys, ValuesValuesA
list_item = ListItem(List=sort_list.Keys, Index="-1", Wrap=True)  # -> Item, Item1
最大 = Data(list_item.Item)
最小 = Data(list_item.Item1)
最大_2 = ClusterOutput(最大)
最小_2 = ClusterOutput(最小)

# ==== cluster Cluster_13
観測点 = ClusterInput()
観測点_2 = Point(観測点)
原点 = Point(Point(0, 0, 0))
ln = Line(StartPoint=原点, EndPoint=観測点_2)

# ---- group: 長さを計測して、最大、最小の順番を抽出
len = Length(Curve=ln)
sort = SortList(Keys=len)  # -> Keys, ValuesA
item = ListItem(List=sort.Keys, Index="-1", Wrap=True)  # -> Item, Item1
最大 = Data(item.Item)
最小 = Data(item.Item1)
mindex = MemberIndex(Set=len, Member=最大)  # -> Index, Count
mindex_2 = MemberIndex(Set=len, Member=最小)  # -> Index, Count

# ---- group: 最小の点
item_2 = ListItem(List=観測点_2, Index=mindex_2.Index, Wrap=True)

# ---- group: 最大の点
item_3 = ListItem(List=観測点_2, Index=mindex.Index, Wrap=True)

# ----
format = Format(Format="{0:0.000}", Culture=127, Data0=item_2)
format_2 = Format(Format="{0:0.000}", Culture=127, Data0=item_3)
pdecon = Deconstruct(Point=format_2)  # -> XComponent, YComponent, ZComponent
pdecon_2 = Deconstruct(Point=format)  # -> XComponent, YComponent, ZComponent
X = ClusterOutput(pdecon.XComponent)
Y = ClusterOutput(pdecon.YComponent)
Z = ClusterOutput(pdecon.ZComponent)
X_2 = ClusterOutput(pdecon_2.XComponent)
Z_2 = ClusterOutput(pdecon_2.ZComponent)
Y_2 = ClusterOutput(pdecon_2.YComponent)

# ==== cluster Cluster_14
faces = ClusterInput()
element = ClusterInput()
getfaceproperties = CSharpScript(Faces=faces, element=element)  # -> out, Face, geometries, simplify(ids), simplify(windowIds), centerPts, tiltAngles, areas, directions, partIds; inputs element: String
# ---------- getfaceproperties: C# usings ----------
using System.Reflection;
using Rhino.Geometry.Intersect;
using System.Linq;
# ---------- getfaceproperties: C# ----------
    if (Faces == null) return;
    MethodInfo elementTypeGetter = Faces.GetType().GetProperty("elementType").GetGetMethod();
    string elementType = elementTypeGetter.Invoke(Faces, null) as string;
    //Print("{0}", elementType);
    if (elementType == element){
      FieldInfo idField = Faces.GetType().GetField("id");
      int id = (int) idField.GetValue(Faces);
      FieldInfo windowIdField = Faces.GetType().GetField("windowIds");
      List<int> windowId = (List<int>) windowIdField.GetValue(Faces);
      FieldInfo centerPtField = Faces.GetType().GetField("centerPt");
      Point3d centerPt = (Point3d) centerPtField.GetValue(Faces);
      double tiltAngle = (double) Faces.GetType().GetField("tiltAngle").GetValue(Faces);
      double area = (double) Faces.GetType().GetField("area").GetValue(Faces);
      string direction = (string) Faces.GetType().GetField("direction").GetValue(Faces);
      int partId = (int) Faces.GetType().GetField("partId").GetValue(Faces);
      MethodInfo geoGetter = Faces.GetType().GetProperty("geometry").GetGetMethod();
      Surface geo = geoGetter.Invoke(Faces, null) as Surface;

      geometries = geo;
      ids = id;
      windowIds = windowId;
      centerPts = centerPt;
      directions = direction;
      tiltAngles = tiltAngle;
      partIds = partId;
      areas = area;
      Face = Faces;
    }
# ---------- end getfaceproperties ----------

null = NullItem(Item=getfaceproperties.Face)  # -> NullFlags, InvalidFlags, Description
not = GateNot(A=null.NullFlags)
cull = CullPattern(List=getfaceproperties.Face, CullPattern=not)
lng = ListLength(List=cull)

ids = ClusterOutput(getfaceproperties.ids)

null_2 = NullItem(Item=getfaceproperties.geometries)  # -> NullFlags, InvalidFlags, Description
not_2 = GateNot(A=null_2.NullFlags)
cull_2 = CullPattern(List=getfaceproperties.geometries, CullPattern=not_2)
lng_2 = ListLength(List=cull_2)

element_2 = ClusterInput()
getfaceproperties_2 = CSharpScript(Faces=cull, element=element_2)  # -> out, geometries, simplify(ids), simplify(windowIds), centerPts, tiltAngles, areas, directions, constructionIds; inputs element: String
# ---------- getfaceproperties_2: C# ----------
    if (Faces == null) return;
    MethodInfo elementTypeGetter = Faces.GetType().GetProperty("elementType").GetGetMethod();
    string elementType = elementTypeGetter.Invoke(Faces, null) as string;
    //Print("{0}", elementType);
    if (elementType == element){
      FieldInfo idField = Faces.GetType().GetField("id");
      int id = (int) idField.GetValue(Faces);
      FieldInfo windowIdField = Faces.GetType().GetField("windowIds");
      List<int> windowId = (List<int>) windowIdField.GetValue(Faces);
      FieldInfo centerPtField = Faces.GetType().GetField("centerPt");
      Point3d centerPt = (Point3d) centerPtField.GetValue(Faces);
      FieldInfo tiltAngleField = Faces.GetType().GetField("tiltAngle");
      double tiltAngle = (double) tiltAngleField.GetValue(Faces);
      string direction = (string) Faces.GetType().GetField("direction").GetValue(Faces);
      int constructionId = (int) Faces.GetType().GetField("constructionId").GetValue(Faces);
      double area = (double) Faces.GetType().GetField("area").GetValue(Faces);
      MethodInfo geoGetter = Faces.GetType().GetProperty("geometry").GetGetMethod();
      Surface geo = geoGetter.Invoke(Faces, null) as Surface;

      geometries = geo;
      ids = id;
      windowIds = windowId;
      centerPts = centerPt;
      tiltAngles = tiltAngle;
      directions = direction;
      areas = Math.Round(area, 2);
      constructionIds = constructionId;
    }
# ---------- end getfaceproperties_2 ----------
L = ClusterOutput(lng_2)
geometries = ClusterOutput(getfaceproperties_2.geometries)
windowids = ClusterOutput(getfaceproperties_2.windowIds)
centerpts = ClusterOutput(getfaceproperties_2.centerPts)
tiltangles = ClusterOutput(getfaceproperties_2.tiltAngles)
areas = ClusterOutput(getfaceproperties_2.areas)
constructionids = ClusterOutput(getfaceproperties_2.constructionIds)

# ==== cluster Cluster_16
faces = ClusterInput()
element = ClusterInput()
getfaceproperties = CSharpScript(Faces=faces, element=element)  # -> out, Face, geometries, simplify(ids), simplify(windowIds), centerPts, tiltAngles, areas, partIds; inputs element: String
# ---------- getfaceproperties: C# usings ----------
using System.Reflection;
using Rhino.Geometry.Intersect;
using System.Linq;
# ---------- getfaceproperties: C# ----------
    if (Faces == null) return;
    MethodInfo elementTypeGetter = Faces.GetType().GetProperty("elementType").GetGetMethod();
    string elementType = elementTypeGetter.Invoke(Faces, null) as string;
    //Print("{0}", elementType);
    if (elementType == element){
      FieldInfo idField = Faces.GetType().GetField("id");
      int id = (int) idField.GetValue(Faces);
      FieldInfo windowIdField = Faces.GetType().GetField("windowIds");
      List<int> windowId = (List<int>) windowIdField.GetValue(Faces);
      FieldInfo centerPtField = Faces.GetType().GetField("centerPt");
      Point3d centerPt = (Point3d) centerPtField.GetValue(Faces);
      double tiltAngle = (double) Faces.GetType().GetField("tiltAngle").GetValue(Faces);
      double area = (double) Faces.GetType().GetField("area").GetValue(Faces);
      MethodInfo geoGetter = Faces.GetType().GetProperty("geometry").GetGetMethod();
      Surface geo = geoGetter.Invoke(Faces, null) as Surface;
      int partId = (int) Faces.GetType().GetField("partId").GetValue(Faces);

      geometries = geo;
      ids = id;
      windowIds = windowId;
      centerPts = centerPt;
      tiltAngles = tiltAngle;
      areas = area;
      Face = Faces;
      partIds = partId;
    }
# ---------- end getfaceproperties ----------

null = NullItem(Item=getfaceproperties.Face)  # -> NullFlags, InvalidFlags, Description
not = GateNot(A=null.NullFlags)
cull = CullPattern(List=getfaceproperties.Face, CullPattern=not)
lng = ListLength(List=cull)

element_2 = ClusterInput()
getfaceproperties_2 = CSharpScript(Faces=cull, element=element_2)  # -> out, geometries, simplify(ids), simplify(windowIds), centerPts, tiltAngles, areas, constructionIds; inputs element: String
# ---------- getfaceproperties_2: C# ----------
    if (Faces == null) return;
    MethodInfo elementTypeGetter = Faces.GetType().GetProperty("elementType").GetGetMethod();
    string elementType = elementTypeGetter.Invoke(Faces, null) as string;
    //Print("{0}", elementType);
    if (elementType == element){
      FieldInfo idField = Faces.GetType().GetField("id");
      int id = (int) idField.GetValue(Faces);
      FieldInfo windowIdField = Faces.GetType().GetField("windowIds");
      List<int> windowId = (List<int>) windowIdField.GetValue(Faces);
      FieldInfo centerPtField = Faces.GetType().GetField("centerPt");
      Point3d centerPt = (Point3d) centerPtField.GetValue(Faces);
      FieldInfo tiltAngleField = Faces.GetType().GetField("tiltAngle");
      int constructionId = (int) Faces.GetType().GetField("constructionId").GetValue(Faces);
      double tiltAngle = (double) tiltAngleField.GetValue(Faces);
      double area = (double) Faces.GetType().GetField("area").GetValue(Faces);
      MethodInfo geoGetter = Faces.GetType().GetProperty("geometry").GetGetMethod();
      Surface geo = geoGetter.Invoke(Faces, null) as Surface;

      geometries = geo;
      ids = id;
      windowIds = windowId;
      centerPts = centerPt;
      tiltAngles = tiltAngle;
      areas = Math.Round(area, 2);
      constructionIds = constructionId;
    }
# ---------- end getfaceproperties_2 ----------
L = ClusterOutput(lng)
geometries = ClusterOutput(getfaceproperties_2.geometries)
centerpts = ClusterOutput(getfaceproperties_2.centerPts)
tiltangles = ClusterOutput(getfaceproperties_2.tiltAngles)
areas = ClusterOutput(getfaceproperties_2.areas)
constructionids = ClusterOutput(getfaceproperties_2.constructionIds)

# ==== cluster Cluster_19
観測点 = ClusterInput()
観測点_2 = Point(観測点)
原点 = Point(Point(0, 0, 0))
ln = Line(StartPoint=原点, EndPoint=観測点_2)

# ---- group: 長さを計測して、最大、最小の順番を抽出
len = Length(Curve=ln)
sort = SortList(Keys=len)  # -> Keys, ValuesA
item = ListItem(List=sort.Keys, Index="-1", Wrap=True)  # -> Item, Item1
最大 = Data(item.Item)
最小 = Data(item.Item1)
mindex = MemberIndex(Set=len, Member=最大)  # -> Index, Count
mindex_2 = MemberIndex(Set=len, Member=最小)  # -> Index, Count

# ---- group: 最小の点
item_2 = ListItem(List=観測点_2, Index=mindex_2.Index, Wrap=True)

# ---- group: 最大の点
item_3 = ListItem(List=観測点_2, Index=mindex.Index, Wrap=True)

# ----
format = Format(Format="{0:0.000}", Culture=127, Data0=item_2)
format_2 = Format(Format="{0:0.000}", Culture=127, Data0=item_3)
pdecon = Deconstruct(Point=format_2)  # -> XComponent, YComponent, ZComponent
pdecon_2 = Deconstruct(Point=format)  # -> XComponent, YComponent, ZComponent
X = ClusterOutput(pdecon.XComponent)
Y = ClusterOutput(pdecon.YComponent)
Z = ClusterOutput(pdecon.ZComponent)
X_2 = ClusterOutput(pdecon_2.XComponent)
Y_2 = ClusterOutput(pdecon_2.YComponent)
Z_2 = ClusterOutput(pdecon_2.ZComponent)
