# Grasshopper definition example2.gh (Grasshopper 1.0.7)
# plug-ins: THERB-GH

vec = Vector(Vector(11.35901027, 6.301332919, 5))
exportt = ExportT(Start_month=Slider(1, range=0..1), End_month=Slider(12, range=0..100))

# ----
# 1-2.計算に必要な諸条件（北の方角、計算期間）を指定
number_slider = Slider(0.1, range=0..0.1)
# step1. ジオメトリ、条件入力
# 1-1. ジオメトリ情報を入力
brep = Brep([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])
srf = Surface([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])
srf_2 = Surface(<surface referenced from the Rhino model>)
therb = THERB(Boxes=brep, Windows=srf, Overhangs=srf_2, Tolerance=number_slider)  # -> Therb, Test

# ----
# step2. 壁体構成を編集する
# 2-1. 編集するFaceを選択
# 2-2. 壁体構成データを取得
# 2-3. 更新する壁体構成データを選択
decompose = Decompose(Therb=therb.Therb)  # -> Rooms, Faces, Windows, Overhangs
filterfacebyproperty = FilterFaceByProperty(Faces=decompose.Faces, Bc=0, SurfT=0, Direction=-1)  # -> TrueFace, FalseFace
readconstruction = ReadConstruction(Run=Toggle(True))
item = ListItem(List=readconstruction, Index=Slider(4, range=0..15), Wrap=True)
panel = Panel(readconstruction)
updateconstruction = UpdateConstruction(Face=filterfacebyproperty.TrueFace, Construction=item)
merge = Merge(Data1=updateconstruction, Data2=filterfacebyproperty.FalseFace)  # -> flatten(Result)
panel_2 = Panel(item)
compose = Compose(Rooms=decompose.Rooms, Faces=merge, Windows=decompose.Windows, Overhangs=decompose.Overhangs)

# ----
# step3. 出力をチェック
exportw = ExportW(Construction=readconstruction)
exporta = ExportA(Therb=therb.Therb)
exportb = ExportB(Therb=compose)
exportr = ExportR(Therb=therb.Therb)
panel_3 = Panel(exporta)

b_datファイル書き出し = Panel(exportb)
w_datファイル書き出し = Panel(exportw)
t_datデータ = Panel(exportt)
r_datファイル書き出し = Panel(exportr)

# ----
# step4. 計算開始
run_simulation = RunSimulation(Therb=therb.Therb, Name="TEST", Run=Toggle(False))
