# Grasshopper definition example_完成イメージ.gh (Grasshopper 1.0.7)
# plug-ins: baues-toolbox Info, THERB-GH

digit_scroller = DigitScroller(Scroller_Digits=12, Scroller_Prefix="Index", Scroller_Radix=11, Scroller_Value=13)

windows_split = Surface([<surface referenced from the Rhino model> x3])
# step1. ジオメトリ、条件入力
rooms_split = Brep([<brep referenced from the Rhino model> x20])

brep = Brep([<brep referenced from the Rhino model> x3])
box = Box({Plane=PlaneXY(41.37666819, 10.43952063, 0), X=Domain(0, 16.74319471), Y=Domain(0, 9.045752188), Z=Domain(0, 9.187566884)})
# タスク13.fiterFaceByPropertyを実装
panel = Panel("exterior")
number_slider = Slider(0.1, range=0.1..10)
debrep = DeconstructBrep(Brep=box)  # -> Faces, Edges, Vertices
brep_2 = Brep([<brep referenced from the Rhino model> x2])
brep_3 = Brep(brep_2)
c_script = CSharpScript(geometries=brep_3)  # -> out, A; inputs geometries: list of Brep
# ---------- c_script: C# usings ----------
using System.Linq;
# ---------- c_script: C# ----------
    double tol = 10;
    List<Brep> splitGeos;
    try
    {
      splitGeos = SplitGeometry(geometries, tol);
    }
    catch(Exception e)
    {
      Component.AddRuntimeMessage(GH_RuntimeMessageLevel.Error, e.Message);
      return;
    }
    A = splitGeos;
# ---------- c_script: C# additional code ----------
  private List<Brep> SplitGeometry(List<Brep> breps, double tol)
  {
    if (breps.Count == 1)
    {
      if (!breps[0].IsSolid) throw new Exception();
      return breps;
    }
    List<Brep> splitGeos = new List<Brep>();
    for (int i = 0; i < breps.Count; i = i + 1)
    {
      if (!breps[i].IsSolid) throw new Exception("開かれたBrepが入れられました");

      List<Brep> cutterBreps = breps.FindAll(geo => geo != breps[i]);
      Brep[] splitGeo = breps[i].Split(cutterBreps, tol);
      Brep jointedBrep = Brep.JoinBreps(splitGeo, tol)[0];

      if (!jointedBrep.IsSolid) throw new Exception("BrepのJointが失敗しました。");

      splitGeos.Add(jointedBrep);
    }
    return splitGeos;
  }
# ---------- end c_script ----------
brep_4 = Brep(brep_3)
brep_5 = Brep([<brep referenced from the Rhino model> x3])
brep_6 = Brep([<brep referenced from the Rhino model> x2])
brep_7 = Brep(brep_6)
c_script_2 = CSharpScript(geometries=brep_7)  # -> out, A; inputs geometries: list of Brep
# ---------- c_script_2: C# usings ----------
using System.Linq;
using Rhino.Geometry.Collections;
# ---------- c_script_2: C# ----------
    double tol = 0.1;
    List<Brep> splitGeos;
    try
    {
      splitGeos = SplitGeometry(geometries, tol);
      //splitGeos = SplitGeometry2(geometries, tol);
    }
    catch(Exception e)
    {
      Component.AddRuntimeMessage(GH_RuntimeMessageLevel.Error, e.Message);
      return;
    }
    List<Surface> resultSrf = new List<Surface>();
    //List<Brep> resultSrf = new List<Brep>();
    foreach (Brep geo in splitGeos)
    {

      //BrepFaceList srfs = geo.Faces;
      foreach (var brepface in geo.Faces)
      {

        //resultSrf.Add(brepface.Brep);
        resultSrf.Add(Brep.CreateEdgeSurface(brepface.ToBrep().Edges).Faces[0].ToNurbsSurface());
        //Print("" + brepface.IsSurface);
        //Print("" + brepface.Brep.IsSurface);
        //Print("" + brepface.Brep.Edges.Count);
        Print("" + brepface.ToBrep().Edges.Count);

        //BrepEdgeList edges;
        /*
        if(2 < brepface.Brep.Edges.Count & brepface.Brep.Edges.Count < 5){
        edges = brepface.Brep.Edges;
        }
        else{
        edges = brepface.ToBrep().Edges;
        }*//*
        Surface srf;
        if(brepface.IsSurface){
        srf = brepface.ToNurbsSurface();
        }
        else{
        edges = brepface.Brep.Edges;
        Print("" + edges.Count);
        if(edges.Count < 2 | 4 < edges.Count) {
        A = resultSrf;
        return; //throw new Exception("Edgeの分割に失敗しました。");
        }
        srf = Brep.CreateEdgeSurface(edges).Faces[0].ToNurbsSurface();
        }

        resultSrf.Add(srf);*/

      }
    }
    A = resultSrf;
# ---------- c_script_2: C# additional code ----------
  private List<Brep> SplitGeometry(List<Brep> breps, double tol)
  {
    if (breps.Count == 1)
    {
      if (!breps[0].IsSolid) throw new Exception();
      return breps;
    }
    List<Brep> splitGeos = new List<Brep>();
    for (int i = 0; i < breps.Count; i = i + 1)
    {
      if (!breps[i].IsSolid) throw new Exception("開かれたBrepが入れられました");

      List<Brep> cutterBreps = breps.FindAll(geo => geo != breps[i]);
      Brep[] splitGeo = breps[i].Split(cutterBreps, tol);
      Brep jointedBrep = Brep.JoinBreps(splitGeo, tol)[0];

      if (!jointedBrep.IsSolid) throw new Exception("BrepのJointが失敗しました。");

      splitGeos.Add(jointedBrep);
    }
    return splitGeos;
  }

  private List<Brep> SplitGeometry2(List<Brep> breps, double tol)
  {
    if (breps.Count == 1)
    {
      if (!breps[0].IsSolid) throw new Exception();
      return breps;
    }
    List<Brep> splitGeos = new List<Brep>();
    for (int i = 0; i < breps.Count; i = i + 1)
    {
      if (!breps[i].IsSolid) throw new Exception("開かれたBrepが入れられました");

      List<Brep> cutterBreps = breps.FindAll(geo => geo != breps[i]);
      Brep[] splitGeo = breps[i].Split(cutterBreps, tol);/*
      Brep jointedBrep = Brep.JoinBreps(splitGeo, tol)[0];

      if (!jointedBrep.IsSolid) throw new Exception("BrepのJointが失敗しました。");*/

      splitGeos.AddRange(splitGeo.ToList());
    }
    return splitGeos;
  }
# ---------- end c_script_2 ----------
c_script_3 = CSharpScript(geometries=brep_7)  # -> out, A; inputs geometries: list of Brep
# ---------- c_script_3: C# ----------
    double tol = 0.1;
    List<Brep> splitGeos;
    try
    {
      splitGeos = SplitGeometry(geometries, tol);
      //splitGeos = SplitGeometry2(geometries, tol);
    }
    catch(Exception e)
    {
      Component.AddRuntimeMessage(GH_RuntimeMessageLevel.Error, e.Message);
      return;
    }
    List<Surface> resultSrf = new List<Surface>();
    //List<Brep> resultSrf = new List<Brep>();
    foreach (Brep geo in splitGeos)
    {

      //BrepFaceList srfs = geo.Faces;
      foreach (var brepface in geo.Faces)
      {

        //resultSrf.Add(brepface.Brep);
        Print("" + brepface.IsSurface);
        if(brepface.IsSurface){
          resultSrf.Add(brepface);
        }
        else{
          BrepEdgeList edges = brepface.Brep.Edges;/*
          Print("" + edges.Count);
          Print("" + brepface.Brep.Edges.Count);
          Print("" + brepface.ToBrep().Edges.Count);*/
          if(edges.Count < 2 | 4 < edges.Count) {
            A = resultSrf;
            return; //throw new Exception("Edgeの分割に失敗しました。");
          }
          Surface srf = Brep.CreateEdgeSurface(edges).Faces[0].ToNurbsSurface();
          resultSrf.Add(srf);
        }
        //Print("" + brepface.Brep.IsSurface);
        //Print("" + brepface.Brep.Edges.Count);
        //Print("" + brepface.ToBrep().Edges.Count);
        /*
        BrepEdgeList edges;
        if(2 < brepface.Brep.Edges.Count & brepface.Brep.Edges.Count < 5){
        edges = brepface.Brep.Edges;
        }
        else{
        edges = brepface.ToBrep().Edges;
        }
        Surface srf;
        if(brepface.IsSurface){
        srf = brepface.ToNurbsSurface();
        }
        else{
        edges = brepface.Brep.Edges;
        Print("" + edges.Count);
        if(edges.Count < 2 | 4 < edges.Count) {
        A = resultSrf;
        return; //throw new Exception("Edgeの分割に失敗しました。");
        }
        srf = Brep.CreateEdgeSurface(edges).Faces[0].ToNurbsSurface();
        }

        resultSrf.Add(srf);*/

      }
    }
    A = resultSrf;
# ---------- c_script_3: C# additional code ----------
  private List<Brep> SplitGeometry(List<Brep> breps, double tol)
  {
    if (breps.Count == 1)
    {
      if (!breps[0].IsSolid) throw new Exception();
      return breps;
    }
    List<Brep> splitGeos = new List<Brep>();
    for (int i = 0; i < breps.Count; i = i + 1)
    {
      if (!breps[i].IsSolid) throw new Exception("開かれたBrepが入れられました");

      List<Brep> cutterBreps = breps.FindAll(geo => geo != breps[i]);
      Brep[] splitGeo = breps[i].Split(cutterBreps, tol);
      Brep jointedBrep = Brep.JoinBreps(splitGeo, tol)[0];

      if (!jointedBrep.IsSolid) throw new Exception("BrepのJointが失敗しました。");

      splitGeos.Add(jointedBrep);
    }
    return splitGeos;
  }

  private List<Brep> SplitGeometry2(List<Brep> breps, double tol)
  {
    if (breps.Count == 1)
    {
      if (!breps[0].IsSolid) throw new Exception();
      return breps;
    }
    List<Brep> splitGeos = new List<Brep>();
    for (int i = 0; i < breps.Count; i = i + 1)
    {
      if (!breps[i].IsSolid) throw new Exception("開かれたBrepが入れられました");

      List<Brep> cutterBreps = breps.FindAll(geo => geo != breps[i]);
      Brep[] splitGeo = breps[i].Split(cutterBreps, tol);/*
      Brep jointedBrep = Brep.JoinBreps(splitGeo, tol)[0];

      if (!jointedBrep.IsSolid) throw new Exception("BrepのJointが失敗しました。");*/

      splitGeos.AddRange(splitGeo.ToList());
    }
    return splitGeos;
  }
# ---------- end c_script_3 ----------
c_script_4 = CSharpScript(geometries=brep_7)  # -> out, A; inputs geometries: list of Brep
# ---------- c_script_4: C# ----------
    double tol = 0.1;
    List<Brep> splitGeos;
    try
    {
      splitGeos = SplitGeometry(geometries, tol);
      //splitGeos = SplitGeometry2(geometries, tol);
    }
    catch(Exception e)
    {
      Component.AddRuntimeMessage(GH_RuntimeMessageLevel.Error, e.Message);
      return;
    }
    List<Surface> resultSrf = new List<Surface>();
    //List<Brep> resultSrf = new List<Brep>();
    A = splitGeos;
# ---------- c_script_4: C# additional code ----------
  private List<Brep> SplitGeometry(List<Brep> breps, double tol)
  {
    if (breps.Count == 1)
    {
      if (!breps[0].IsSolid) throw new Exception();
      return breps;
    }
    List<Brep> splitGeos = new List<Brep>();
    for (int i = 0; i < breps.Count; i = i + 1)
    {
      if (!breps[i].IsSolid) throw new Exception("開かれたBrepが入れられました");

      List<Brep> cutterBreps = breps.FindAll(geo => geo != breps[i]);
      Brep[] splitGeo = breps[i].Split(cutterBreps, tol);
      Brep jointedBrep = Brep.JoinBreps(splitGeo, tol)[0];

      if (!jointedBrep.IsSolid) throw new Exception("BrepのJointが失敗しました。");

      splitGeos.Add(jointedBrep);
    }
    return splitGeos;
  }

  private List<Brep> SplitGeometry2(List<Brep> breps, double tol)
  {
    if (breps.Count == 1)
    {
      if (!breps[0].IsSolid) throw new Exception();
      return breps;
    }
    List<Brep> splitGeos = new List<Brep>();
    for (int i = 0; i < breps.Count; i = i + 1)
    {
      if (!breps[i].IsSolid) throw new Exception("開かれたBrepが入れられました");

      List<Brep> cutterBreps = breps.FindAll(geo => geo != breps[i]);
      Brep[] splitGeo = breps[i].Split(cutterBreps, tol);/*
      Brep jointedBrep = Brep.JoinBreps(splitGeo, tol)[0];

      if (!jointedBrep.IsSolid) throw new Exception("BrepのJointが失敗しました。");*/

      splitGeos.AddRange(splitGeo.ToList());
    }
    return splitGeos;
  }
# ---------- end c_script_4 ----------
brep_8 = Brep(c_script_2.A)
panel_2 = Panel(brep_8)
item = ListItem(List=brep_8, Index=digit_scroller, Wrap=True)
python = GhPythonScript(x=item)  # -> out, a; inputs x: Brep
# ---------- python: Python ----------
from Rhino.Geometry import Brep

edges = x.Edges

a = Brep.CreateEdgeSurface(edges)
# ---------- end python ----------
panel_3 = Panel(c_script_2.out)
brep_9 = Brep(brep_6)
brep_10 = Brep(brep_6)
digit_scroller_2 = DigitScroller(Scroller_Digits=12, Scroller_Prefix="Index", Scroller_Radix=11, Scroller_Value=12)
c_script_5 = CSharpScript(geometries=brep_9)  # -> out, A; inputs geometries: list of Brep
# ---------- c_script_5: C# ----------
    double tol = 0.1;
    List<Brep> splitGeos;
    try
    {
      splitGeos = SplitGeometry(geometries, tol);
    }
    catch
    {
      Component.AddRuntimeMessage(GH_RuntimeMessageLevel.Error, "開かれたBrepが入れられました。");
      return;
    }
    A = splitGeos;
# ---------- c_script_5: C# additional code ----------
  private List<Brep> SplitGeometry(List<Brep> breps, double tol)
  {
    if (breps.Count == 1)
    {
      if (!breps[0].IsSolid) throw new Exception();
      return breps;
    }
    List<Brep> splitGeos = new List<Brep>();
    for (int i = 0; i < breps.Count; i = i + 1)
    {
      if (!breps[i].IsSolid) throw new Exception();

      List<Brep> cutterBreps = breps.FindAll(geo => geo != breps[i]);
      Brep[] splitGeo = breps[i].Split(cutterBreps, tol);
      Brep jointedBrep = Brep.JoinBreps(splitGeo, tol)[0];

      if (!jointedBrep.IsSolid) throw new Exception();

      splitGeos.Add(jointedBrep);
    }
    return splitGeos;
  }
# ---------- end c_script_5 ----------
cull_i = CullIndex(List=debrep.Faces, Indices=0, Wrap=True)
srf = Surface(<surface referenced from the Rhino model>)
split = SplitBrep(Brep=brep_4, Cutter=graft(brep_4))
srf_2 = Surface(<surface referenced from the Rhino model>)
therb = THERB()
therb_2 = THERB(Geometries=brep_5, Tolerance=number_slider)  # -> Therb, Test
therb_3 = THERB(Geometries=brep_2, Tolerance=number_slider)  # -> Therb, Test
python_2 = GhPythonScript(x=cull_i)  # -> out, flatten(a); inputs x: list of Brep
# ---------- python_2: Python ----------
from Rhino.Geometry import Brep

a = Brep.JoinBreps(x, 0.1)
# ---------- end python_2 ----------
c_script_6 = CSharpScript(splitGeos=c_script_5.A)  # -> out, A; inputs splitGeos: list of Brep
# ---------- c_script_6: C# usings ----------
using Rhino.Geometry.Collections;
# ---------- c_script_6: C# ----------
    //double tol = 0.1;
    //Roomに対する処理
    List<Surface> sl = new List<Surface>();

    foreach (Brep geo in splitGeos)
    {
      BrepFaceList srfs = geo.Faces;
      foreach (BrepFace brepface in srfs)
      {
        Surface srf = brepface;
        //Vector3d normal = srf.NormalAt(0.5, 0.5);
        //Vector3d tempNormal = reviseNormal(srf, temp);
        sl.Add(srf);
      }
    }
    A = sl;
# ---------- end c_script_6 ----------
item_2 = ListItem(Index=Slider(0, range=0..2), Wrap=True)
debrep_2 = DeconstructBrep(Brep=c_script_5.A)  # -> Faces, Edges, Vertices
therb_4 = THERB(Geometries=brep_6, Windows=srf_2, Overhangs=srf, Tolerance=Slider(0.1, range=0..0.1))  # -> Therb, Test
filterfacebyproperty = FilterFaceByProperty(Therb=therb_4.Therb, Bc=panel)  # -> TrueFace, FalseFace
c_script_7 = CSharpScript(x=brep_4)  # -> out, A; inputs x: list of Brep
# ---------- c_script_7: C# ----------
    List<Brep> results = new List<Brep>();
    foreach(Brep item in x){
      List<Brep> cutter = x.FindAll(geo => geo != item);
      Brep[] result = item.Split(cutter, 0.1);
      results.AddRange(result.ToList());
    }

    A = results;
# ---------- end c_script_7 ----------
bang = ExplodeTree(Data=split)  # -> Branch0, Branch1, Branch2, Branch3
readproperty = ReadProperty()
panel_4 = Panel(split)
item_3 = ListItem(List=flatten(debrep_2.Faces), Index=digit_scroller_2, Wrap=True)  # -> Item, Item1
readproperty_2 = ReadProperty(Therb=therb_2.Therb)
therb_5 = THERB(Geometries=python_2.a, Tolerance=0.1)  # -> Therb, Test; disabled
panel_5 = Panel(box)
therb_6 = THERB(Geometries=box, Tolerance=0.1)  # -> Therb, Test; disabled
panel_6 = Panel(python_2.a)
digit_scroller_3 = DigitScroller(Scroller_Digits=12, Scroller_Prefix="Index", Scroller_Radix=11, Scroller_Value=13)
entwine = Entwine(Branch00=bang.Branch1, Branch01=bang.Branch2, FlattenInputs=True)
unflatten = UnflattenTree(Tree=c_script_7.A, Guide=entwine)
python_3 = GhPythonScript(x=brep_6, y=srf_2)  # -> out, a; inputs x: list
# ---------- python_3: Python ----------
a = [x, y]
# ---------- end python_3 ----------
readproperty_3 = ReadProperty(Therb=therb_4.Therb)
srf_3 = Surface([item_3.Item, item_3.Item1])
rec = Rectangle(srf_3)
exportb = ExportB(Therb=therb_4.Therb)
exportr = ExportR(Therb=therb_4.Therb)
panel_7 = Panel([item_3.Item, item_3.Item1])
digit_scroller_4 = DigitScroller(Scroller_Digits=12, Scroller_Prefix="Path", Scroller_Radix=11, Scroller_Value=5)
join = BrepJoin(Breps=entwine)  # -> Breps, Closed
c_script_8 = CSharpScript(x=unflatten)  # -> out, A; inputs x: list of Brep
# ---------- c_script_8: C# ----------
    A = Brep.JoinBreps(x, 0.1);
# ---------- end c_script_8 ----------
c_script_9 = CSharpScript(geometries=brep_4)  # -> out, A, B; inputs geometries: list of Brep
# ---------- c_script_9: C# ----------
    double tol = 0.1;
    List<Brep> splitGeos;
    try
    {
      splitGeos = SplitGeometry(geometries, tol);
    }
    catch(Exception e)
    {
      Component.AddRuntimeMessage(GH_RuntimeMessageLevel.Error, e.Message);
      return;
    }

    //DataTree<Curve> results = new DataTree<Curve>();
    DataTree<Surface> results = new DataTree<Surface>();
    foreach (Brep geo in splitGeos)
    {

      var srfs = geo.Faces;
      foreach (var brepface in srfs)
      {
        Print("" + brepface.DuplicateFace(false).IsSurface);
        Brep brep = brepface.DuplicateFace(false);
        Surface srf;
        if(brepface.DuplicateFace(false).IsSurface){
          srf = brepface;
        }
        else{
          var edges = brepface.DuplicateFace(false).Edges;
          //edges = eqalEdge(edges, tol);
          if(edges.Count < 2 | 4 < edges.Count) {
            Print("" + edges.Count);
            foreach(var edge in edges){
              Print("S: " + edge.PointAtStart);
              Print("E: " + edge.PointAtEnd);
            }
            A = results;
            B = Curve.JoinCurves(edges)[0].DuplicateSegments();
            return;// throw new Exception("Edgeの分割に失敗しました。");
          }
          srf = Brep.CreateEdgeSurface(edges).Faces[0].ToNurbsSurface();
        }
        results.Add(srf);
      }
    }

    A = results;
# ---------- c_script_9: C# additional code ----------
  private List<Brep> SplitGeometry(List<Brep> breps, double tol)
  {
    if (breps.Count == 1)
    {
      if (!breps[0].IsSolid) throw new Exception();
      return breps;
    }
    List<Brep> splitGeos = new List<Brep>();
    for (int i = 0; i < breps.Count; i = i + 1)
    {
      if (!breps[i].IsSolid) throw new Exception("開かれたBrepが入れられました");

      List<Brep> cutterBreps = breps.FindAll(geo => geo != breps[i]);
      Brep[] splitGeo = breps[i].Split(cutterBreps, tol);
      Brep jointedBrep = Brep.JoinBreps(splitGeo, tol)[0];

      if (!jointedBrep.IsSolid) throw new Exception("BrepのJointが失敗しました。");

      splitGeos.Add(jointedBrep);
    }
    return splitGeos;
  }

  /*
  private List<Curve> eqalEdge(List<Curve> edges, double tol){
    List<Curve> result = new List<Curve>();
    foreach(edge in
  }
 */
# ---------- end c_script_9 ----------
panel_8 = Panel(readproperty_2)
therb_7 = THERB(BDat=exportb, RDat=exportr, Name="TEST", Run=Toggle(False))
debrep_3 = DeconstructBrep(Brep=join.Breps)  # -> flatten(Faces), Edges, Vertices
panel_9 = Panel(readproperty_3)
c_script_10 = CSharpScript(x=c_script_8.A)  # -> out, flatten(A); inputs x: list of Brep
# ---------- c_script_10: C# ----------
    List<Surface> results = new List<Surface>();
    foreach(Brep item in x){
      foreach(BrepFace itemitem in item.Faces){
        results.Add((Surface) itemitem);
      }
    }
    A = results;
# ---------- end c_script_10 ----------
item_4 = ListItem(List=readproperty_3, Index=digit_scroller_3, Wrap=True)
panel_10 = Panel(join.Breps)
panel_11 = Panel(c_script_9.A)
digit_scroller_5 = DigitScroller(Scroller_Digits=12, Scroller_Prefix="Index", Scroller_Radix=11, Scroller_Value=12)
debrep_4 = DeconstructBrep(Brep=debrep_3.Faces)  # -> flatten(Faces), Edges, Vertices
python_4 = GhPythonScript(x=c_script_10.A)  # -> out, a; inputs x: Surface
# ---------- python_4: Python ----------
print(type(x))
# ---------- end python_4 ----------
c_script_11 = CSharpScript(x=c_script_10.A)  # -> out, A; inputs x: list of Brep
# ---------- c_script_11: C# ----------
    DataTree<Curve> results = new DataTree<Curve>();
    for(int index = 0;index < x.Count; index++){
      foreach(BrepEdge itemEdge in x[index].Edges){
        results.Add((Curve) itemEdge, new GH_Path(index));
      }
    }
    A = results;
# ---------- end c_script_11 ----------

# ----
# step2. 出力をチェック
b_datファイル書き出し = Panel(exportb)
r_datファイル書き出し = Panel(exportr)

panel_12 = Panel(c_script_9.out)
branch = TreeBranch(Tree=simplify(debrep_4.Edges), Path=digit_scroller_4, MaintainPaths=True)
branch_2 = TreeBranch(Tree=simplify(c_script_11.A), Path=digit_scroller_4, MaintainPaths=True)
item_5 = ListItem(List=c_script_9.A, Index=digit_scroller_5, Wrap=True)
crv = Curve(c_script_9.B)

# ----
# step03.
# サーバーにuploadする
# ための情報を入力
# step03-1. サーバーのドメイン入力
# (今のところ、ここは変える必要ないです）
# step03-2. プロジェクト名を入力
# step03-3. Trueにするとuploadして計算開始
panel_13 = Panel("http://localhost:5000/run")

uploadtherb = UploadTherb(Url=panel_13, ProjectName="demo2", Upload=Toggle(True))
# step04.
# サーバーからのresponseが表示されます。
# successとなっていれば、以下のurlをchrome
# で表示してください
# step05.
# 計算結果をPythonを利用してさらに分析することができます。
# 以下に分析例をまとめたJupyter Notebookを置いています。
# https://github.com/becat-oss/therb-notebook
panel_14 = Panel(uploadtherb)
