# Grasshopper definition 220326_morita_NewHasp.gh (Grasshopper 1.0.7)

# ----
# input
rooms = Brep([<brep referenced from the Rhino model> x3])
windows = Surface([<surface referenced from the Rhino model> x2])

number_slider = Slider(0.1, range=0..0.1)
assignclass = CSharpScript(geos=flatten(rooms), tol=number_slider, windows=windows)  # -> out, Room, Faces, Windows, zones; inputs geos: list of Brep, tol: Double, windows: list of Surface
# ---------- assignclass: C# usings ----------
using Rhino.Geometry.Collections;
using Rhino.Geometry.Intersect;
using System.Threading.Tasks;
# ---------- assignclass: C# ----------
    List<Room> roomList = new List<Room>();
    List<Face> faceList = new List<Face>();
    //Brep同士をsplitする
    //TODO:思ったような動きをしてくれない
    List<Brep> splitGeos = new List<Brep>();

    /*
    for (int i = 0; i < geos.Count; i = i + 1){
      List<Brep> cutterBreps = geos.FindAll(geo => geo != geos[i]);
      Print("{0}", cutterBreps.Count);
      foreach(Brep cutterBrep in cutterBreps){
        Brep[] splitGeo = geos[i].Split(cutterBrep, 0.1);
        bool test1 = splitGeo[0].Join(splitGeo[1], 0.1, false);
        Print("{0}", test1);
        //for (int j = 1; j < splitGeo.Count; j = j + 1){
        //  splitGeo[0].Join(geos[j], 0.1, false);
        //}
        //foreach(Brep geo in splitGeo){
        //splitGeos.Add(geo);
        //}
        splitGeos.Add(splitGeo[0]);
      }
    }
    Print("{0}", splitGeos);
    test = splitGeos;
    */

    //BAUES用のデータをこの時点で作ってみる
    var zoneList = new List<Zone>();
    //Roomに対する処理
    foreach(Brep geo in geos){
      Room temp = new Room(geo);

      //var surfaceDetailedList = new List<object>();
      //TODO: SurfaceとFaceの違い理解
      //BrepSurfaceList srfs = geo.Surfaces;
      BrepFaceList srfs = geo.Faces;
      foreach(Surface srf in srfs){
        Vector3d normal = srf.NormalAt(0.5, 0.5);
        Vector3d tempNormal = reviseNormal(srf, temp);
        Face face = new Face(temp, srf, normal, tempNormal);
        //Print("{0}", face.centerPt);
        faceList.Add(face);
        temp.addFace(face);
        //var surfaceDetailed = new Dictionary<string, object>();
        //surfaceDetailed.Add("name", "room"+temp.id.ToString()+"_"+face.elementType);
        //surfaceDetailed.Add("surfaceType", face.face);
        //surfaceDetailed.Add("vertices", face.bauesVertices);
        //SurfaceDetailed surfaceDetailed = new SurfaceDetailed("room" + temp.id.ToString());
        //surfaceDetailedList.Add(surfaceDetailed);
      }
      roomList.Add(temp);
      /*
      var zone = new Dictionary<string, object>();
      zone.Add("name", "room" + temp.id.ToString());
      zone.Add("multiplier", 1);
      zone.Add("surfaces", surfaceDetailedList);
      */
      Zone zone = new Zone("room" + temp.id.ToString());
      zoneList.Add(zone);
    }
    //FaceのboundaryConditionを計算する処理
    List<Face> faceListBC = new List<Face>();
    //理解が進んだらboundary conditionは違うコンポーネントにうつす
    for (int i = 0; i < faceList.Count; i++){
      //テストするsurfaceを選択する
      var testFace = faceList[i];

      //違うparentを持つfaceを取得する
      List<Face> targetFaces = faceList
        .FindAll(face => face.parent != testFace.parent);
      //.Select(face => face.geometry);

      //TODO: Selectメソッドにmigrateする
      List<Surface> targetSurfaces = new List<Surface>();

      foreach(Face face in targetFaces){
        targetSurfaces.Add(face.geometry);
      }
      //Print("{0}", targetSurfaces);

      //testFacesに対して、normal directionのテストを行う
      Point3d testPt = new Point3d(testFace.centerPt);
      testPt += testFace.normal * -tol / 2;
      Ray3d testRay = new Ray3d(testPt, testFace.normal);

      if (shootIt(testRay, targetSurfaces, tol, 2)){
        testFace.bc = "interior";
        testFace.bauesBC = BoundaryCondition.Surface;
        //どのfaceにtouchしているのかをチェック
        //testFace.centerPtから一番近いtargetSurfacesが隣接しているsurfaceだと判断する
        Face adjacentFace = getClosestFaceFromFace(testFace, targetFaces);
        testFace.adjacencyRoomId = adjacentFace.parentId;
        testFace.adjacencyFaceId = adjacentFace.partId;
        //Print("{0}", testFace.id);
        //Print("{0}", adjacentFace.id);

      }else{
        //z座標<=0であれば、bc=groundとする
        //testFace.bc = boundaryCondition.outdoor;
        if(testFace.centerPt.Z <= tol){
          testFace.bc = "ground";
          testFace.bauesBC = BoundaryCondition.Ground;
        }else{
          testFace.bc = "outdoor";
          testFace.bauesBC = BoundaryCondition.Outdoors;
        }
        testFace.adjacencyRoomId = 0;
      }
      testFace.setElementType();
      testFace.setConstructionId();
      faceListBC.Add(testFace);
      Print("{0}", testFace.parent.id);
      //Print("{0}", zoneList[testFace.parent.id - 1].surfaces);
      //ここでsurfaceをzoneに追加していく
      SurfaceDetailed srfDetail = new SurfaceDetailed("room" + testFace.id.ToString(), testFace);
      zoneList[testFace.parent.id - 1].addSurface(srfDetail);
    }

    //Roomに属するfaceの属性(wall,ceiling,roof)を集計するロジック
    foreach(Room room in roomList){
      List<Face> faces = room.getFaces();
      Print("{0}", faces.Count);
      foreach(Face face in faces){
        room.groupChildFaces(face);
      }
    }
    //Print("{0}", roomList[0].roofs.Count);

    Room = roomList;

    //windowがどのwallの上にあるかどうかを判断するロジック
    List<Face> externalFaces = faceListBC
      .FindAll(face => face.bc == "outdoor");
    //Print("{0}", externalFaces.Count);

    List<Window> windowList = new List<Window>();
    foreach (Surface windowGeo in windows){
      //それぞれのwindowに対して一番近いexternalFacesをwindowが属するfaceとする
      int parentId = 0;
      double tiltAngle = 0;
      double closestDistance = 10000;
      Window window = new Window(windowGeo);
      foreach(Face exFace in externalFaces){
        double distance = window.centerPt.DistanceTo(exFace.centerPt);
        //Print("{0}", distance);
        if (distance < closestDistance){
          parentId = exFace.id;
          tiltAngle = exFace.tiltAngle;
          closestDistance = distance;
        }
      }

      if (closestDistance < 10000){
        window.parentId = parentId;
        window.tiltAngle = tiltAngle;
        //Print("{0}", window.parent);
      }else{
        //エラー処理を加える
      }
      windowList.Add(window);
      //FenestrationDetailed fenDetailed = new FenestrationDetailed(window);
      //zoneList[faceList[parentId].parentId - 1].surfaces[parentId].addWindow(fenDetailed);
      //Print("{0}", zoneList[faceList[parentId].parentId - 1].surfaces[parentId]);
    }
    //BAUESデータ書き出し用の処理を加える

    //WindowをfaceにAddする
    List<Face> faceListWindow = new List<Face>();
    foreach(Face face in faceListBC){
      foreach(Window window in windowList){
        if(window.parentId == face.id){
          face.addWindows(window);
        }
      }
      faceListWindow.Add(face);
    }

    Faces = faceListBC;
    Windows = windowList;
# ---------- assignclass: C# additional code ----------
  private Vector3d reviseNormal(Surface srf, Room parent){
    //モデルによってはsurfaceのvectorの方向が意図と逆に向いている場合があるのでそれを修正
    Point3d centroid = parent.centroid;
    AreaMassProperties areaMp = AreaMassProperties.Compute(srf);
    Point3d centerPt = areaMp.Centroid;
    Vector3d normal = srf.NormalAt(0.5, 0.5);
    //Point3d testPt = new Point(centerPt.X + normal.X, centerPt.Y + normal.Y, centerPt.Z + normal.Z);
    Point3d testPt = centerPt + normal;
    //Print("{0}", centerPt);
    //Print("{0}", testPt);
    double baseDistance = centroid.DistanceTo(centerPt);
    double testDistance = centroid.DistanceTo(testPt);
    if (baseDistance > testDistance){
      Vector3d revNormal = new Vector3d(-normal.X, -normal.Y, -normal.Z);
      //Print("{0}", normal);
      //Print("{0}", revNormal);
      return revNormal;
    }else{
      return normal;
    }

  }
  private Face getClosestFaceFromFace(Face originFace, List<Face> Faces){
    //TはFaceかWindowとしたい。ジェネリクスがよくわかっていないので

    Face closestFace = null;
    double closestDistance = 10000;
    foreach(Face face in Faces){
      //faceがwallであればwallのみでテストする
      double distance = 10000;
      if (originFace.face == "wall" && face.face == "wall"){
        distance = originFace.centerPt.DistanceTo(face.centerPt);
        //Print("{0}", distance);
      }else if (originFace.face != "wall" && face.face != "wall"){
        distance = originFace.centerPt.DistanceTo(face.centerPt);
      }
      if (distance < closestDistance){
        closestFace = face;
        closestDistance = distance;
      }
    }
    Print("{0}", closestDistance);
    return closestFace;
  }
  private bool shootIt(Ray3d ray, List<Surface> srfs, double tol, int bounce){
    Point3d[] intersectPts = Intersection.RayShoot(ray, srfs, 1);
    //Print("{0}", intersectPts.Length);
    if (intersectPts.Length > 0){
      //Print("{0}", ray.Position.DistanceTo(intersectPts[0]));
      if (ray.Position.DistanceTo(intersectPts[0]) <= tol){
        return true;
      }else{
        return false;
      }
    }else{
      return false;
    }

  }

  //基底クラスを作成する
  public class baseGeo{
    public Guid guid;
    public int id;
    public int displayName;

    //staticコンストラクタをどう継承すべきか理解必要

  }
  //BAUES Analysis用の構造体(struct)
  /*
  struct Baues{
  public List<Zone> zones;
  }
  */

  public class Zone{
    public string name;
    public int multiplier;
    public List<SurfaceDetailed> surfaces;

    public Zone(string name){
      this.name = name;
      this.multiplier = 1;
      this.surfaces = new List<SurfaceDetailed>();
    }

    public void addSurface(SurfaceDetailed surface){
      this.surfaces.Add(surface);
    }
  }

  public class SurfaceDetailed{
    public string name;
    public SurfaceType surfaceType;
    public int surfaceTypeId; //そのsurface typeのid
    public string constructionName;
    public string boundaryCondition;
    public string boundaryConditionObject;
    public List<double> vertices;
    public List<FenestrationDetailed> windows;
    public static int _totalWalls;
    public static int _totalRoofs;
    public static int _totalCeilings;
    public static int _totalFloors;

    static SurfaceDetailed(){
      _totalWalls = 0;
      _totalRoofs = 0;
      _totalCeilings = 0;
      _totalFloors = 0;
    }

    public SurfaceDetailed(string name, Face face){

      //this.surfaceType = (SurfaceType)face.face;
      //this.boundaryCondition = face.
      this.vertices = face.bauesVertices;
      switch(face.face){
        case "wall":
          this.surfaceType = SurfaceType.Wall;
          _totalWalls += 1;
          surfaceTypeId = _totalWalls;
          break;
        case "floor":
          this.surfaceType = SurfaceType.Floor;
          _totalFloors += 1;
          surfaceTypeId = _totalFloors;
          break;
        case "roof":
          if (face.elementType == "exteriorroof"){
            this.surfaceType = SurfaceType.Roof;
            _totalRoofs += 1;
            surfaceTypeId = _totalRoofs;
            break;
          }else{
            this.surfaceType = SurfaceType.Ceiling;
            _totalCeilings += 1;
            surfaceTypeId = _totalCeilings;
            break;
          }
      }
      this.name = "room" + face.parent.id + "_" + this.surfaceType.ToString() + surfaceTypeId.ToString();
    }
  }

  public class FenestrationDetailed{
    public string name;
    public string constructionName;
    public List<double> vertices;

  }

  public enum SurfaceType{
    Wall,
    Roof,
    Ceiling,
    Floor
  }

  public enum BoundaryCondition{
    Outdoors,
    Surface,
    Ground
  }


  public class Room{
    public Guid guid;
    public int id;
    public string displayName;
    public Brep geometry;
    public Point3d centroid;
    private List<Face> _faceList;
    public static int _totalRooms;
    public BrepVertexList vertices;
    public Point3d minPt;
    public Point3d maxPt;
    public List<Face> sWalls;
    public List<Face> wWalls;
    public List<Face> nWalls;
    public List<Face> eWalls;
    public List<Face> floors;
    public List<Face> roofs;
    public double area; //new hasp用のデータ
    public double floorHeight;//階高
    public double ceilingHeight;//天井高
    public double height;//地上高

    static Room(){
      _totalRooms = 0;
    }

    public Room(Brep geometry){
      this.guid = Guid.NewGuid();
      _totalRooms += 1;
      this.id = _totalRooms;
      //this.displayName = _totalRooms;
      this._faceList = new List<Face>();
      this.geometry = geometry;
      BrepVertexList vertices = geometry.Vertices;
      this.vertices = vertices;
      this.minPt = getMinCoord(vertices);
      this.maxPt = getMaxCoord(vertices);
      this.sWalls = new List<Face>();
      this.wWalls = new List<Face>();
      this.nWalls = new List<Face>();
      this.eWalls = new List<Face>();
      this.floors = new List<Face>();
      this.roofs = new List<Face>();
      VolumeMassProperties vmp = VolumeMassProperties.Compute(geometry);
      this.centroid = vmp.Centroid;
      //BAUES Analysisへの接続用データ

    }

    public void addFace(Face face){
      _faceList.Add(face);
      //TODO: this logic should be elaborated
      if (face.face == "floor"){
        this.area = face.area;
        this.height = face.centerPt.Z;
      }else if(face.face == "wall"){
        double maxZ = 0;
        double minZ = 100;
        foreach(BrepVertex vertex in face.vertices){
          Point3d pt = vertex.Location;
          if (pt.Z > maxZ){
            maxZ = pt.Z;
          }
          if (pt.Z < minZ){
            minZ = pt.Z;
          }
        }
        this.floorHeight = maxZ - minZ;
        this.ceilingHeight = this.floorHeight - 0.1;//とりあえず
      }

    }

    public void groupChildFaces(Face face){
      if (face.face == "wall"){
        switch(face.direction){
          case "S":
            this.sWalls.Add(face);
            break;
          case "N":
            this.nWalls.Add(face);
            break;
          case "W":
            this.wWalls.Add(face);
            break;
          case "E":
            this.eWalls.Add(face);
            break;
        }
      }else if(face.face == "roof"){
        this.roofs.Add(face);
      }else if(face.face == "floor"){
        this.floors.Add(face);
      }
    }

    public List<int> getDirectionList(){
      List<int> directionList = new List<int>();
      directionList.Add(this.sWalls.Count);
      directionList.Add(this.wWalls.Count);
      directionList.Add(this.nWalls.Count);
      directionList.Add(this.eWalls.Count);
      directionList.Add(this.floors.Count);
      directionList.Add(this.roofs.Count);
      int total = this.sWalls.Count + this.wWalls.Count + this.nWalls.Count + this.eWalls.Count + this.floors.Count + this.roofs.Count;
      directionList.Add(total);

      return directionList;//[S,W,N,E,F,CR,total]
    }

    public List<Face> getFaces(){
      return _faceList;
    }

    //public static string generateDisplayName{
    //}
    private Point3d getMinCoord(BrepVertexList vertices){
      Point3d origin = new Point3d(0, 0, 0);
      int i = 0;
      int minId = 0;
      double minValue = 1000;
      foreach(BrepVertex vertex in vertices){

        Point3d checkPt = vertex.Location;
        double distance = origin.DistanceTo(checkPt);
        //Print("{0}:{1}", i, distance);
        if (distance < minValue){
          minId = i;
          minValue = distance;
        }
        i += 1;
      }
      //Print("{0}:{1}", minId, minValue);

      return vertices[minId].Location;
    }

    private Point3d getMaxCoord(BrepVertexList vertices){
      Point3d origin = new Point3d(0, 0, 0);
      int i = 0;
      int maxId = 0;
      double maxValue = -1000;
      foreach(BrepVertex vertex in vertices){

        Point3d checkPt = vertex.Location;
        double distance = origin.DistanceTo(checkPt);
        //Print("{0}:{1}", i, distance);
        if (distance > maxValue){
          maxId = i;
          maxValue = distance;
        }
        i += 1;
      }
      //Print("{0}:{1}", minId, minValue);

      return vertices[maxId].Location;
    }
  }

  public class Window{
    public Guid guid;
    public int id;
    public string displayName;
    public int parentId {get; set;}
    public Surface geometry { get; private set; }
    public Vector3d normal {get; private set;}
    public Point3d centerPt;
    public double tiltAngle;
    public int constructionId; //とりあえず外壁1,内壁2,床(室内）3,屋根4,床（地面）5, 窓6　THERBのelement Idに相当
    public double area;
    public static int _totalWindows;

    static Window(){
      _totalWindows = 0;
    }

    public Window(Surface geometry){
      this.guid = Guid.NewGuid();
      _totalWindows += 1;
      this.id = _totalWindows;
      this.geometry = geometry;
      AreaMassProperties areaMp = AreaMassProperties.Compute(geometry);
      this.centerPt = areaMp.Centroid;
      this.area = areaMp.Area;
      this.constructionId = 6;
    }
  }

  public class Face{
    public Guid guid;
    public int id;
    public int partId;
    public string displayName;
    //public faceType face{get; private set;}
    public string face{get; private set;}
    //public boundaryCondition bc{get; set;}
    public string bc{get; set;} //boundary conditionのこと
    public string elementType{get; set;}
    public int constructionId; //とりあえず外壁1,内壁2,床(室内）5,屋根4,床（地面）5, 窓6　THERBのelement Idに相当/鈴木君からもらったデータにとりあえずそろえる
    //parentとparentIdをわける
    public Room parent;
    public int parentId;
    public Surface geometry { get; private set; }
    public BrepVertexList vertices;
    public Vector3d normal {get; private set;}
    public Vector3d tempNormal;
    public Point3d centerPt;
    public double tiltAngle;
    public double area;
    public string direction;
    public double dirAngle;//新しい属性
    public int adjacencyRoomId; //隣接しているRoomのId 外気に接している場合には0
    public List<Window> windows {get; private set;}
    public List<int> windowIds;
    public static int _totalFaces;
    public static int _totalExWalls;
    public static int _totalInWalls;
    public static int _totalFlrCeilings;
    public static int _totalRoofs;
    public static int _totalGrounds;
    //BAUES Analysis用の属性
    public BoundaryCondition bauesBC;
    public int adjacencyFaceId;
    public List<double> bauesVertices;

    static Face(){
      _totalFaces = 0;
      _totalExWalls = 0;
      _totalInWalls = 0;
      _totalFlrCeilings = 0;
      _totalRoofs = 0;
      _totalGrounds = 0;
    }

    public Face(Room parent, Surface geometry, Vector3d normal, Vector3d tempNormal){
      this.guid = Guid.NewGuid();
      _totalFaces += 1;
      this.id = _totalFaces;
      //全体を通してのidとelementごとのidをつける
      this.geometry = geometry;
      this.parent = parent;
      this.parentId = parent.id;
      AreaMassProperties areaMp = AreaMassProperties.Compute(geometry);
      this.centerPt = areaMp.Centroid;
      this.area = areaMp.Area;
      this.normal = tempNormal;
      BrepVertexList vertices = geometry.ToBrep().Vertices;
      this.vertices = vertices;
      this.bauesVertices = getBauesVertices();

      //方角、床、天井を判別するためにはtempNormalを使う
      this.face = getFaceType(tempNormal);
      this.dirAngle = calcDirAngle(tempNormal);
      this.direction = defineDirection(tempNormal);

      //TODO: this logic has to be elaborated
      if (this.face == "wall"){
        this.tiltAngle = 90;
      }else{
        this.tiltAngle = 0;
      }
      this.windows = new List<Window>();
      this.windowIds = new List<int>();
    }

    private double calcDirAngle(Vector3d normal){

      Vector3d northAngle = new Vector3d(0, 1, 0);
      Vector3d westAngle = new Vector3d(-1, 0, 0);

      double angle1 = (180 / Math.PI) * (Vector3d.VectorAngle(normal, northAngle));
      double angle2 = (180 / Math.PI) * (Vector3d.VectorAngle(normal, westAngle));

      if(angle2 < 90){
        return 360 - angle1;
      }else{
        return angle1;
      }
    }

    private string defineDirection(Vector3d normal){
      if (this.face == "floor"){
        return "F";
      }else if (this.face == "roof"){
        return "CR";
      }

      Vector3d northAngle = new Vector3d(0, 1, 0);
      Vector3d westAngle = new Vector3d(-1, 0, 0);

      double angle1 = (180 / Math.PI) * (Vector3d.VectorAngle(normal, northAngle));
      double angle2 = (180 / Math.PI) * (Vector3d.VectorAngle(normal, westAngle));

      //Print("{0}:{1}", normal, angle1);

      if (angle1 < 45){
        return "N";
      }else if(angle1 == 45 && angle2 == 45){
        return "N";
      }else if (angle1 > 135){
        return "S";
      }else if(angle1 == 135 && angle2 == 135){
        return "S";
      }else if(angle2 <= 45){
        return "W";
      }else{
        return "E";
      }
    }

    public List<double> getBauesVertices(){
      List<double> bauesVertices = new List<double>();
      foreach(BrepVertex vertex in this.vertices){
        Point3d pt = vertex.Location;
        bauesVertices.Add(pt.X);
        bauesVertices.Add(pt.Y);
        bauesVertices.Add(pt.Z);
      }
      return bauesVertices;
    }

    public string getFaceType(Vector3d normal){

      //better to add filter logic for internal wall
      double Z = normal.Z;
      int roofAngle = 10;
      if (Z > Math.Cos((Math.PI / 180) * roofAngle)){
        //return faceType.roof;
        return "roof";
      }else if(Z < -Math.Cos((Math.PI / 180) * 85)){
        //return faceType.floor;
        return "floor";
      }else{
        //string direction = defineDirection(normal);
        //Print("{0}:{1}", normal, direction);
        //return faceType.wall;
        return "wall";
      }
    }

    public void addWindows(Window window){
      this.windows.Add(window);
      this.windowIds.Add(window.id);
    }

    public void setElementType(){
      string firstPhrase = "";
      if (this.bc == "outdoor"){
        firstPhrase = "exterior";
      }else{
        firstPhrase = this.bc;
      }
      this.elementType = firstPhrase + this.face;
      //partIdをアサインする
      switch(this.elementType){
        case "exteriorwall":
          _totalExWalls += 1;
          this.partId = _totalExWalls;
          break;
        case "interiorwall":
          _totalInWalls += 1;
          this.partId = _totalInWalls;
          break;
        case "interiorroof":
          _totalFlrCeilings += 1;
          this.partId = _totalFlrCeilings;
          break;
        case "interiorfloor":
          _totalFlrCeilings += 1;
          this.partId = _totalFlrCeilings;
          break;
        case "exteriorroof":
          _totalRoofs += 1;
          this.partId = _totalRoofs;
          break;
        case "groundfloor":
          _totalGrounds += 1;
          this.partId = _totalGrounds;
          break;
      }
    }

    public void setConstructionId(){
      //Print("{0}", this.elementType);
      switch(this.elementType){
        case "exteriorwall":
          this.constructionId = 1;
          break;
        case "interiorwall":
          this.constructionId = 2;
          break;
        case "interiorroof":
          this.constructionId = 3;
          break;
        case "interiorfloor":
          this.constructionId = 3;
          break;
        case "exteriorroof":
          this.constructionId = 4;
          break;
        case "groundroof":
          this.constructionId = 5;
          break;
        case "groundfloor":
          this.constructionId = 5;
          break;
      }
    }
  }

  public enum faceType{
    wall,
    roof,
    floor
  }

  public enum elementType{
    exteriorWall,
    interiorWall,
    roof,
    floor,
    groundWall,
    groundFloor
  }

  private string defineDirection(Vector3d normal){
    Vector3d northAngle = new Vector3d(0, 1, 0);
    Vector3d westAngle = new Vector3d(-1, 0, 0);

    double angle1 = (180 / Math.PI) * (Vector3d.VectorAngle(normal, northAngle));
    double angle2 = (180 / Math.PI) * (Vector3d.VectorAngle(normal, westAngle));

    //Print("{0}:{1}", normal, angle1);

    if (angle1 < 45){
      return "N";
    }else if(angle1 == 45 && angle2 == 45){
      return "N";
    }else if (angle1 > 135){
      return "S";
    }else if(angle1 == 135 && angle2 == 135){
      return "S";
    }else if(angle2 <= 45){
      return "W";
    }else{
      return "E";
    }
  }

  private Point3d getMinCoord(BrepVertexList vertices){
    Point3d origin = new Point3d(0, 0, 0);
    int i = 0;
    int minId = 0;
    double minValue = 1000;
    foreach(BrepVertex vertex in vertices){

      Point3d checkPt = vertex.Location;
      double distance = origin.DistanceTo(checkPt);
      //Print("{0}:{1}", i, distance);
      if (distance < minValue){
        minId = i;
        minValue = distance;
      }
      i += 1;
    }
    //Print("{0}:{1}", minId, minValue);

    return vertices[minId].Location;
  }

  private Point3d getMaxCoord(BrepVertexList vertices){
    Point3d origin = new Point3d(0, 0, 0);
    int i = 0;
    int maxId = 0;
    double maxValue = -1000;
    foreach(BrepVertex vertex in vertices){

      Point3d checkPt = vertex.Location;
      double distance = origin.DistanceTo(checkPt);
      //Print("{0}:{1}", i, distance);
      if (distance > maxValue){
        maxId = i;
        maxValue = distance;
      }
      i += 1;
    }
    //Print("{0}:{1}", minId, minValue);

    return vertices[maxId].Location;
  }
# ---------- end assignclass ----------
assignclass_2 = CSharpScript(geos=flatten(rooms), tol=number_slider, windows=windows)  # -> out, Room, Faces, Windows, test; inputs geos: list of Brep, tol: Double, windows: list of Surface
# ---------- assignclass_2: C# ----------
    List<Room> roomList = new List<Room>();
    List<Face> faceList = new List<Face>();
    //Brep同士をsplitする
    //TODO:思ったような動きをしてくれない
    List<Brep> splitGeos = new List<Brep>();

    /*
    for (int i = 0; i < geos.Count; i = i + 1){
      List<Brep> cutterBreps = geos.FindAll(geo => geo != geos[i]);
      Print("{0}", cutterBreps.Count);
      foreach(Brep cutterBrep in cutterBreps){
        Brep[] splitGeo = geos[i].Split(cutterBrep, 0.1);
        bool test1 = splitGeo[0].Join(splitGeo[1], 0.1, false);
        Print("{0}", test1);
        //for (int j = 1; j < splitGeo.Count; j = j + 1){
        //  splitGeo[0].Join(geos[j], 0.1, false);
        //}
        //foreach(Brep geo in splitGeo){
        //splitGeos.Add(geo);
        //}
        splitGeos.Add(splitGeo[0]);
      }
    }
    Print("{0}", splitGeos);
    test = splitGeos;
    */

    //Roomに対する処理
    foreach(Brep geo in geos){
      Room temp = new Room(geo);

      BrepSurfaceList srfs = geo.Surfaces;
      foreach(Surface srf in srfs){
        Vector3d normal = srf.NormalAt(0.5, 0.5);
        Vector3d tempNormal = reviseNormal(srf, temp);
        Face face = new Face(temp.id, srf, normal, tempNormal);
        //Print("{0}", face.centerPt);
        faceList.Add(face);
        //Print("{0}", face);
        temp.addFace(face);
      }
      roomList.Add(temp);
    }
    //Print("{0}", roomList);
    //Room = roomList;

    //Faces = faceList;
    //FaceのboundaryConditionを計算する処理
    List<Face> faceListBC = new List<Face>();
    //理解が進んだらboundary conditionは違うコンポーネントにうつす
    for (int i = 0; i < faceList.Count; i++){
      //テストするsurfaceを選択する
      var testFace = faceList[i];

      //違うparentを持つfaceを取得する
      List<Face> targetFaces = faceList
        .FindAll(face => face.parent != testFace.parent);
      //.Select(face => face.geometry);

      //TODO: Selectメソッドにmigrateする
      List<Surface> targetSurfaces = new List<Surface>();

      foreach(Face face in targetFaces){
        targetSurfaces.Add(face.geometry);
      }
      //Print("{0}", targetSurfaces);

      //testFacesに対して、normal directionのテストを行う
      Point3d testPt = new Point3d(testFace.centerPt);
      testPt += testFace.normal * -tol / 2;
      Ray3d testRay = new Ray3d(testPt, testFace.normal);


      if (shootIt(testRay, targetSurfaces, tol, 2)){
        //testFace.bc = boundaryCondition.interiorWall;
        testFace.bc = "interior";
        //どのfaceにtouchしているのかをチェック
        //testFace.centerPtから一番近いtargetSurfacesが隣接しているsurfaceだと判断する
        Face adjacentFace = getClosestFaceFromFace(testFace, targetFaces);
        testFace.adjacencyId = adjacentFace.parent;
        //Print("{0}", testFace.id);
        //Print("{0}", adjacentFace.id);

      }else{
        //z座標<=0であれば、bc=groundとする
        //testFace.bc = boundaryCondition.outdoor;
        if(testFace.centerPt.Z <= tol){
          testFace.bc = "ground";
        }else{
          testFace.bc = "outdoor";
        }
        testFace.adjacencyId = 0;
      }
      testFace.setElementType();
      testFace.setConstructionId();
      Print("{0}", testFace.elementType);
      faceListBC.Add(testFace);

    }

    //Roomに属するfaceの属性(wall,ceiling,roof)を集計するロジック
    foreach(Room room in roomList){
      List<Face> faces = room.getFaces();
      Print("{0}", faces.Count);
      foreach(Face face in faces){
        room.groupChildFaces(face);
      }
    }
    //Print("{0}", roomList[0].roofs.Count);

    Room = roomList;

    //windowがどのwallの上にあるかどうかを判断するロジック
    List<Face> externalFaces = faceListBC
      .FindAll(face => face.bc == "outdoor");
    //Print("{0}", externalFaces.Count);

    List<Window> windowList = new List<Window>();
    foreach (Surface windowGeo in windows){
      //それぞれのwindowに対して一番近いexternalFacesをwindowが属するfaceとする
      int parentId = 0;
      double tiltAngle = 0;
      double closestDistance = 10000;
      Window window = new Window(windowGeo);
      foreach(Face exFace in externalFaces){
        double distance = window.centerPt.DistanceTo(exFace.centerPt);
        //Print("{0}", distance);
        if (distance < closestDistance){
          parentId = exFace.id;
          tiltAngle = exFace.tiltAngle;
          closestDistance = distance;
        }
      }

      if (closestDistance < 10000){
        window.parent = parentId;
        window.tiltAngle = tiltAngle;
        //Print("{0}", window.parent);
      }else{
        //エラー処理を加える
      }
      windowList.Add(window);
    }

    //WindowをfaceにAddする
    List<Face> faceListWindow = new List<Face>();
    foreach(Face face in faceListBC){
      foreach(Window window in windowList){
        if(window.parent == face.id){
          face.addWindows(window);
        }
      }
      faceListWindow.Add(face);
    }

    Faces = faceListBC;
    Windows = windowList;
# ---------- assignclass_2: C# additional code ----------
  private Vector3d reviseNormal(Surface srf, Room parent){
    //モデルによってはsurfaceのvectorの方向が意図と逆に向いている場合があるのでそれを修正
    Point3d centroid = parent.centroid;
    AreaMassProperties areaMp = AreaMassProperties.Compute(srf);
    Point3d centerPt = areaMp.Centroid;
    Vector3d normal = srf.NormalAt(0.5, 0.5);
    //Point3d testPt = new Point(centerPt.X + normal.X, centerPt.Y + normal.Y, centerPt.Z + normal.Z);
    Point3d testPt = centerPt + normal;
    //Print("{0}", centerPt);
    //Print("{0}", testPt);
    double baseDistance = centroid.DistanceTo(centerPt);
    double testDistance = centroid.DistanceTo(testPt);
    if (baseDistance > testDistance){
      Vector3d revNormal = new Vector3d(-normal.X, -normal.Y, -normal.Z);
      //Print("{0}", normal);
      //Print("{0}", revNormal);
      return revNormal;
    }else{
      return normal;
    }

  }
  private Face getClosestFaceFromFace(Face originFace, List<Face> Faces){
    //TはFaceかWindowとしたい。ジェネリクスがよくわかっていないので

    Face closestFace = null;
    double closestDistance = 10000;
    foreach(Face face in Faces){
      //faceがwallであればwallのみでテストする
      double distance = 10000;
      if (originFace.face == "wall" && face.face == "wall"){
        distance = originFace.centerPt.DistanceTo(face.centerPt);
        //Print("{0}", distance);
      }else if (originFace.face != "wall" && face.face != "wall"){
        distance = originFace.centerPt.DistanceTo(face.centerPt);
      }
      if (distance < closestDistance){
        closestFace = face;
        closestDistance = distance;
      }
    }
    Print("{0}", closestDistance);
    return closestFace;
  }
  private bool shootIt(Ray3d ray, List<Surface> srfs, double tol, int bounce){
    Point3d[] intersectPts = Intersection.RayShoot(ray, srfs, 1);
    //Print("{0}", intersectPts.Length);
    if (intersectPts.Length > 0){
      //Print("{0}", ray.Position.DistanceTo(intersectPts[0]));
      if (ray.Position.DistanceTo(intersectPts[0]) <= tol){
        return true;
      }else{
        return false;
      }
    }else{
      return false;
    }

  }

  //基底クラスを作成する
  public class baseGeo{
    public Guid guid;
    public int id;
    public int displayName;

    //staticコンストラクタをどう継承すべきか理解必要

  }


  public class Room{
    public Guid guid;
    public int id;
    public string displayName;
    public Brep geometry;
    public Point3d centroid;
    private List<Face> _faceList;
    public static int _totalRooms;
    public BrepVertexList vertices;
    public Point3d minPt;
    public Point3d maxPt;
    public List<Face> sWalls;
    public List<Face> wWalls;
    public List<Face> nWalls;
    public List<Face> eWalls;
    public List<Face> floors;
    public List<Face> roofs;

    static Room(){
      _totalRooms = 0;
    }

    public Room(Brep geometry){
      this.guid = Guid.NewGuid();
      _totalRooms += 1;
      this.id = _totalRooms;
      //this.displayName = _totalRooms;
      this._faceList = new List<Face>();
      this.geometry = geometry;
      BrepVertexList vertices = geometry.Vertices;
      this.vertices = vertices;
      this.minPt = getMinCoord(vertices);
      this.maxPt = getMaxCoord(vertices);
      this.sWalls = new List<Face>();
      this.wWalls = new List<Face>();
      this.nWalls = new List<Face>();
      this.eWalls = new List<Face>();
      this.floors = new List<Face>();
      this.roofs = new List<Face>();
      VolumeMassProperties vmp = VolumeMassProperties.Compute(geometry);
      this.centroid = vmp.Centroid;
      //TODO:どのタイミングで
    }

    public void addFace(Face face){
      _faceList.Add(face);
    }

    public void groupChildFaces(Face face){
      if (face.face == "wall"){
        switch(face.direction){
          case "S":
            this.sWalls.Add(face);
            break;
          case "N":
            this.nWalls.Add(face);
            break;
          case "W":
            this.wWalls.Add(face);
            break;
          case "E":
            this.eWalls.Add(face);
            break;
        }
      }else if(face.face == "roof"){
        this.roofs.Add(face);
      }else if(face.face == "floor"){
        this.floors.Add(face);
      }
    }

    public List<int> getDirectionList(){
      List<int> directionList = new List<int>();
      directionList.Add(this.sWalls.Count);
      directionList.Add(this.wWalls.Count);
      directionList.Add(this.nWalls.Count);
      directionList.Add(this.eWalls.Count);
      directionList.Add(this.floors.Count);
      directionList.Add(this.roofs.Count);
      int total = this.sWalls.Count + this.wWalls.Count + this.nWalls.Count + this.eWalls.Count + this.floors.Count + this.roofs.Count;
      directionList.Add(total);

      return directionList;//[S,W,N,E,F,CR,total]
    }

    public List<Face> getFaces(){
      return _faceList;
    }

    //public static string generateDisplayName{
    //}
    private Point3d getMinCoord(BrepVertexList vertices){
      Point3d origin = new Point3d(0, 0, 0);
      int i = 0;
      int minId = 0;
      double minValue = 1000;
      foreach(BrepVertex vertex in vertices){

        Point3d checkPt = vertex.Location;
        double distance = origin.DistanceTo(checkPt);
        //Print("{0}:{1}", i, distance);
        if (distance < minValue){
          minId = i;
          minValue = distance;
        }
        i += 1;
      }
      //Print("{0}:{1}", minId, minValue);

      return vertices[minId].Location;
    }

    private Point3d getMaxCoord(BrepVertexList vertices){
      Point3d origin = new Point3d(0, 0, 0);
      int i = 0;
      int maxId = 0;
      double maxValue = -1000;
      foreach(BrepVertex vertex in vertices){

        Point3d checkPt = vertex.Location;
        double distance = origin.DistanceTo(checkPt);
        //Print("{0}:{1}", i, distance);
        if (distance > maxValue){
          maxId = i;
          maxValue = distance;
        }
        i += 1;
      }
      //Print("{0}:{1}", minId, minValue);

      return vertices[maxId].Location;
    }
  }

  public class Window{
    public Guid guid;
    public int id;
    public string displayName;
    public int parent {get; set;}
    public Surface geometry { get; private set; }
    public Vector3d normal {get; private set;}
    public Point3d centerPt;
    public double tiltAngle;
    public int constructionId; //とりあえず外壁1,内壁2,床(室内）3,屋根4,床（地面）5, 窓6　THERBのelement Idに相当
    public double area;
    public static int _totalWindows;

    static Window(){
      _totalWindows = 0;
    }

    public Window(Surface geometry){
      this.guid = Guid.NewGuid();
      _totalWindows += 1;
      this.id = _totalWindows;
      this.geometry = geometry;
      AreaMassProperties areaMp = AreaMassProperties.Compute(geometry);
      this.centerPt = areaMp.Centroid;
      this.area = areaMp.Area;
      this.constructionId = 6;
    }
  }

  public class Face{
    public Guid guid;
    public int id;
    public string displayName;
    //public faceType face{get; private set;}
    public string face{get; private set;}
    //public boundaryCondition bc{get; set;}
    public string bc{get; set;}
    public string elementType{get; set;}
    public int constructionId; //とりあえず外壁1,内壁2,床(室内）3,屋根4,床（地面）5, 窓6　THERBのelement Idに相当
    public int parent;
    public Surface geometry { get; private set; }
    public List<Point3d> vertices;
    public Vector3d normal {get; private set;}
    public Vector3d tempNormal;
    public Point3d centerPt;
    public double tiltAngle;
    public double area;
    public string direction;
    public int adjacencyId; //隣接しているRoomのId 外気に接している場合には0
    public List<Window> windows {get; private set;}
    public List<int> windowIds;
    public static int _totalFaces;

    static Face(){
      _totalFaces = 0;
    }

    public Face(int parent, Surface geometry, Vector3d normal, Vector3d tempNormal){
      this.guid = Guid.NewGuid();
      _totalFaces += 1;
      this.id = _totalFaces;
      this.geometry = geometry;
      this.parent = parent;
      AreaMassProperties areaMp = AreaMassProperties.Compute(geometry);
      this.centerPt = areaMp.Centroid;
      this.area = areaMp.Area;
      this.normal = tempNormal;

      //方角、床、天井を判別するためにはtempNormalを使う
      this.face = getFaceType(tempNormal);
      this.direction = defineDirection(tempNormal);

      //TODO: this logic has to be elaborated
      if (this.face == "wall"){
        this.tiltAngle = 90;
      }else{
        this.tiltAngle = 0;
      }
      this.windows = new List<Window>();
      this.windowIds = new List<int>();
    }

    private string defineDirection(Vector3d normal){
      if (this.face == "floor"){
        return "F";
      }else if (this.face == "roof"){
        return "CR";
      }

      Vector3d northAngle = new Vector3d(0, 1, 0);
      Vector3d westAngle = new Vector3d(-1, 0, 0);

      double angle1 = (180 / Math.PI) * (Vector3d.VectorAngle(normal, northAngle));
      double angle2 = (180 / Math.PI) * (Vector3d.VectorAngle(normal, westAngle));

      //Print("{0}:{1}", normal, angle1);

      if (angle1 < 45){
        return "N";
      }else if(angle1 == 45 && angle2 == 45){
        return "N";
      }else if (angle1 > 135){
        return "S";
      }else if(angle1 == 135 && angle2 == 135){
        return "S";
      }else if(angle2 <= 45){
        return "W";
      }else{
        return "E";
      }
    }

    public string getFaceType(Vector3d normal){

      //better to add filter logic for internal wall
      double Z = normal.Z;
      int roofAngle = 10;
      if (Z > Math.Cos((Math.PI / 180) * roofAngle)){
        //return faceType.roof;
        return "roof";
      }else if(Z < -Math.Cos((Math.PI / 180) * 85)){
        //return faceType.floor;
        return "floor";
      }else{
        //string direction = defineDirection(normal);
        //Print("{0}:{1}", normal, direction);
        //return faceType.wall;
        return "wall";
      }
    }

    public void addWindows(Window window){
      this.windows.Add(window);
      this.windowIds.Add(window.id);
    }

    public void setElementType(){
      string firstPhrase = "";
      if (this.bc == "outdoor"){
        firstPhrase = "exterior";
      }else{
        firstPhrase = this.bc;
      }
      this.elementType = firstPhrase + this.face;
    }

    public void setConstructionId(){
      //Print("{0}", this.elementType);
      switch(this.elementType){
        case "exteriorwall":
          this.constructionId = 1;
          break;
        case "interiorwall":
          this.constructionId = 2;
          break;
        case "interiorroof":
          this.constructionId = 3;
          break;
        case "interiorfloor":
          this.constructionId = 3;
          break;
        case "exteriorroof":
          this.constructionId = 4;
          break;
        case "groundroof":
          this.constructionId = 5;
          break;
        case "groundfloor":
          this.constructionId = 5;
          break;
      }
    }
  }

  public enum faceType{
    wall,
    roof,
    floor
  }

  public enum elementType{
    exteriorWall,
    interiorWall,
    roof,
    floor,
    groundWall,
    groundFloor
  }

  public enum boundaryCondition{
    outdoor,
    ground,
    interiorWall
  }

  private string defineDirection(Vector3d normal){
    Vector3d northAngle = new Vector3d(0, 1, 0);
    Vector3d westAngle = new Vector3d(-1, 0, 0);

    double angle1 = (180 / Math.PI) * (Vector3d.VectorAngle(normal, northAngle));
    double angle2 = (180 / Math.PI) * (Vector3d.VectorAngle(normal, westAngle));

    //Print("{0}:{1}", normal, angle1);

    if (angle1 < 45){
      return "N";
    }else if(angle1 == 45 && angle2 == 45){
      return "N";
    }else if (angle1 > 135){
      return "S";
    }else if(angle1 == 135 && angle2 == 135){
      return "S";
    }else if(angle2 <= 45){
      return "W";
    }else{
      return "E";
    }
  }

  private Point3d getMinCoord(BrepVertexList vertices){
    Point3d origin = new Point3d(0, 0, 0);
    int i = 0;
    int minId = 0;
    double minValue = 1000;
    foreach(BrepVertex vertex in vertices){

      Point3d checkPt = vertex.Location;
      double distance = origin.DistanceTo(checkPt);
      //Print("{0}:{1}", i, distance);
      if (distance < minValue){
        minId = i;
        minValue = distance;
      }
      i += 1;
    }
    //Print("{0}:{1}", minId, minValue);

    return vertices[minId].Location;
  }

  private Point3d getMaxCoord(BrepVertexList vertices){
    Point3d origin = new Point3d(0, 0, 0);
    int i = 0;
    int maxId = 0;
    double maxValue = -1000;
    foreach(BrepVertex vertex in vertices){

      Point3d checkPt = vertex.Location;
      double distance = origin.DistanceTo(checkPt);
      //Print("{0}:{1}", i, distance);
      if (distance > maxValue){
        maxId = i;
        maxValue = distance;
      }
      i += 1;
    }
    //Print("{0}:{1}", minId, minValue);

    return vertices[maxId].Location;
  }
# ---------- end assignclass_2 ----------

getfaceproperties = CSharpScript(Faces=assignclass_2.Faces, element="groundfloor")  # -> out, Face, geometries, simplify(ids), simplify(windowIds), centerPts, tiltAngles, areas, directions; inputs element: String
# ---------- getfaceproperties: C# usings ----------
using System.Reflection;
using Rhino.Geometry.Intersect;
using System.Linq;
# ---------- getfaceproperties: C# ----------
    if (Faces == null) return;
    MethodInfo elementTypeGetter = Faces.GetType().GetProperty("elementType").GetGetMethod();
    string elementType = elementTypeGetter.Invoke(Faces, null) as string;
    //Print("{0}", elementType);
    if (elementType == element){
      FieldInfo idField = Faces.GetType().GetField("id");
      int id = (int) idField.GetValue(Faces);
      FieldInfo windowIdField = Faces.GetType().GetField("windowIds");
      List<int> windowId = (List<int>) windowIdField.GetValue(Faces);
      FieldInfo centerPtField = Faces.GetType().GetField("centerPt");
      Point3d centerPt = (Point3d) centerPtField.GetValue(Faces);
      double tiltAngle = (double) Faces.GetType().GetField("tiltAngle").GetValue(Faces);
      double area = (double) Faces.GetType().GetField("area").GetValue(Faces);
      string direction = (string) Faces.GetType().GetField("direction").GetValue(Faces);
      MethodInfo geoGetter = Faces.GetType().GetProperty("geometry").GetGetMethod();
      Surface geo = geoGetter.Invoke(Faces, null) as Surface;

      geometries = geo;
      ids = id;
      windowIds = windowId;
      centerPts = centerPt;
      directions = direction;
      tiltAngles = tiltAngle;
      areas = area;
      Face = Faces;
    }
# ---------- end getfaceproperties ----------
getfaceproperties_2 = CSharpScript(Faces=assignclass.Faces)  # -> out, Face, geometries, simplify(ids), simplify(windowIds), centerPts, tiltAngles, areas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
# ---------- getfaceproperties_2: C# ----------
    if (Faces == null) return;
    MethodInfo elementTypeGetter = Faces.GetType().GetProperty("elementType").GetGetMethod();
    string elementType = elementTypeGetter.Invoke(Faces, null) as string;
    FieldInfo idField = Faces.GetType().GetField("id");
    int id = (int) idField.GetValue(Faces);
    FieldInfo windowIdField = Faces.GetType().GetField("windowIds");
    List<int> windowId = (List<int>) windowIdField.GetValue(Faces);
    FieldInfo centerPtField = Faces.GetType().GetField("centerPt");
    Point3d centerPt = (Point3d) centerPtField.GetValue(Faces);
    double tiltAngle = (double) Faces.GetType().GetField("tiltAngle").GetValue(Faces);
    double area = (double) Faces.GetType().GetField("area").GetValue(Faces);
    MethodInfo geoGetter = Faces.GetType().GetProperty("geometry").GetGetMethod();
    Surface geo = geoGetter.Invoke(Faces, null) as Surface;
    int partId = (int) Faces.GetType().GetField("partId").GetValue(Faces);
    string direction = (string) Faces.GetType().GetField("direction").GetValue(Faces);
    double dirAngle = (double) Faces.GetType().GetField("dirAngle").GetValue(Faces);
    int adjacencyRoomId = (int) Faces.GetType().GetField("adjacencyRoomId").GetValue(Faces);

    geometries = geo;
    ids = id;
    windowIds = windowId;
    centerPts = centerPt;
    tiltAngles = tiltAngle;
    areas = area;
    Face = Faces;
    partIds = partId;
    elementTypes = elementType;
    directions = direction;
    dirAngles = dirAngle;
    adjacencyRoomIds = adjacencyRoomId;
# ---------- end getfaceproperties_2 ----------
# Therb側の処理
getwindowproperties = CSharpScript(Windows=assignclass_2.Windows)  # -> out, geometries, areas, tiltAngles, constructionIds
# ---------- getwindowproperties: C# ----------
    if (Windows == null) return;
    MethodInfo geometryGetter = Windows.GetType().GetProperty("geometry").GetGetMethod();
    Surface geometry = geometryGetter.Invoke(Windows, null) as Surface;
    double area = (double) Windows.GetType().GetField("area").GetValue(Windows);
    double angle = (double) Windows.GetType().GetField("tiltAngle").GetValue(Windows);
    int constructionId = (int) Windows.GetType().GetField("constructionId").GetValue(Windows);

    geometries = geometry;
    areas = Math.Round(area, 2);
    tiltAngles = angle;
    constructionIds = constructionId;
# ---------- end getwindowproperties ----------
getfaceproperties_3 = CSharpScript(Faces=assignclass_2.Faces, element="exteriorwall")  # -> out, Face, geometries, simplify(ids), simplify(windowIds), centerPts, tiltAngles, areas, directions; inputs element: String; same code as getfaceproperties
getfaceproperties_4 = CSharpScript(Faces=assignclass_2.Faces, element="interiorwall")  # -> out, Face, geometries, simplify(ids), simplify(windowIds), centerPts, tiltAngles, areas, directions; inputs element: String; same code as getfaceproperties
getfaceproperties_5 = CSharpScript(Faces=assignclass_2.Faces, element="interiorroof")  # -> out, Face, geometries, simplify(ids), simplify(windowIds), centerPts, tiltAngles, areas, directions; inputs element: String; same code as getfaceproperties
getfaceproperties_6 = CSharpScript(Faces=assignclass_2.Faces, element="exteriorroof")  # -> out, Face, geometries, simplify(ids), simplify(windowIds), centerPts, tiltAngles, areas, directions; inputs element: String; same code as getfaceproperties
getfaceproperties_7 = CSharpScript(Faces=assignclass_2.Faces, element="interiorfloor")  # -> out, Face, geometries, simplify(ids), simplify(windowIds), centerPts, tiltAngles, areas, directions; inputs element: String; same code as getfaceproperties
exps_other = EXPS_other(
    geometory_ids=getfaceproperties.ids,
    tiltangle=getfaceproperties_2.tiltAngles,
    geo=getfaceproperties.geometries,
    dirangle=getfaceproperties_2.dirAngles,
    element="groundfloor")  # -> result, area
exps_window = EXPS_Window(
    exwall_geo=getfaceproperties_3.geometries,
    window_id=getfaceproperties_3.windowIds,
    tiltangle=getfaceproperties_2.tiltAngles,
    dirangle=getfaceproperties_2.dirAngles,
    window_geo=getwindowproperties.geometries)  # -> result, y2, x1_x3, 面積
exps_other_2 = EXPS_other(
    geometory_ids=getfaceproperties_3.ids,
    tiltangle=getfaceproperties_2.tiltAngles,
    geo=getfaceproperties_3.geometries,
    dirangle=getfaceproperties_2.dirAngles,
    element="exteriorwall")  # -> result, area
exps_other_3 = EXPS_other(
    geometory_ids=getfaceproperties_4.ids,
    tiltangle=getfaceproperties_2.tiltAngles,
    geo=getfaceproperties_4.geometries,
    dirangle=getfaceproperties_2.dirAngles,
    element="interiorwall")  # -> result, area
exps_other_4 = EXPS_other(
    geometory_ids=getfaceproperties_5.ids,
    tiltangle=getfaceproperties_2.tiltAngles,
    geo=getfaceproperties_5.geometries,
    dirangle=getfaceproperties_2.dirAngles,
    element="interiorroof")  # -> result, area
exps_other_5 = EXPS_other(
    geometory_ids=getfaceproperties_6.ids,
    tiltangle=getfaceproperties_6.tiltAngles,
    geo=getfaceproperties_6.geometries,
    dirangle=getfaceproperties_2.dirAngles,
    element="exteriorroof")  # -> result, area
exps_other_6 = EXPS_other(
    geometory_ids=getfaceproperties_7.ids,
    tiltangle=getfaceproperties_2.tiltAngles,
    geo=getfaceproperties_7.geometries,
    dirangle=getfaceproperties_2.dirAngles,
    element="interiorfloor")  # -> result, area

getroomproperties = CSharpScript(Rooms=assignclass.Room)  # -> out, ids, minPts, maxPts, sCount, wCount, nCount, eCount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
# ---------- getroomproperties: C# ----------
    if (Rooms == null) return;
    FieldInfo idField = Rooms.GetType().GetField("id");
    int id = (int) idField.GetValue(Rooms);

    FieldInfo minPtField = Rooms.GetType().GetField("minPt");
    Point3d minPoint = (Point3d) minPtField.GetValue(Rooms);

    var type = Type.GetType("ExternalType");
    // Lookup the method
    var directionsGetter = Rooms.GetType().GetMethod("getDirectionList");
    Print("{0}", directionsGetter);

    double area = (double) Rooms.GetType().GetField("area").GetValue(Rooms);
    double height = (double) Rooms.GetType().GetField("height").GetValue(Rooms);
    double floorHeight = (double) Rooms.GetType().GetField("floorHeight").GetValue(Rooms);
    double ceilingHeight = (double) Rooms.GetType().GetField("ceilingHeight").GetValue(Rooms);

    //TODO:Listで返す方法がうまくいかない
    List<int> directions = (List<int>) directionsGetter.Invoke(Rooms, null);
    //Print("{0}", directions[0]);
    //MethodInfo sWallGetter = Rooms.GetType().GetProperty("sWalls").GetGetMethod();
    //List<Face> sWall = (List<Face>) sWallGetter.Invoke(Rooms, null);

    ids = id;
    minPts = minPoint;
    sCount = directions[0];
    wCount = directions[1];
    nCount = directions[2];
    eCount = directions[3];
    fCount = directions[4];
    crCount = directions[5];
    totalCount = directions[6];
    areas = area;
    heights = Math.Round(height,3);
    floorHeights = Math.Round(floorHeight,3);
    ceilingHeights = Math.Round(ceilingHeight,3);
    //sWalls = swall;
    //direcitonList = direcitons;
# ---------- end getroomproperties ----------
data = Data(simplify(graft(getroomproperties.ids)))
groupfacepropertiesbyroom = CSharpScript(Faces=assignclass_2.Faces, parentId=data)  # -> out, Face, geometries, simplify(ids), simplify(windowIds), centerPts, tiltAngles, areas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; inputs parentId: Int32
# ---------- groupfacepropertiesbyroom: C# ----------
    if (Faces == null) return;
    int parent = (int) Faces.GetType().GetField("parent").GetValue(Faces);
    if (parent == parentId){
      FieldInfo idField = Faces.GetType().GetField("id");
      int id = (int) idField.GetValue(Faces);
      FieldInfo windowIdField = Faces.GetType().GetField("windowIds");
      List<int> windowId = (List<int>) windowIdField.GetValue(Faces);
      FieldInfo centerPtField = Faces.GetType().GetField("centerPt");
      Point3d centerPt = (Point3d) centerPtField.GetValue(Faces);
      double tiltAngle = (double) Faces.GetType().GetField("tiltAngle").GetValue(Faces);
      double area = (double) Faces.GetType().GetField("area").GetValue(Faces);
      MethodInfo geoGetter = Faces.GetType().GetProperty("geometry").GetGetMethod();
      Surface geo = geoGetter.Invoke(Faces, null) as Surface;
      string direction = (string) Faces.GetType().GetField("direction").GetValue(Faces);
      int elementId = (int) Faces.GetType().GetField("constructionId").GetValue(Faces);
      int adjacencyId = (int) Faces.GetType().GetField("adjacencyId").GetValue(Faces);
      MethodInfo elementTypeGetter = Faces.GetType().GetProperty("elementType").GetGetMethod();
      string elementType = elementTypeGetter.Invoke(Faces, null) as string;
      Print("{0}", elementType);

      geometries = geo;
      ids = id;
      windowIds = windowId;
      centerPts = centerPt;
      tiltAngles = tiltAngle;
      areas = area;
      Face = Faces;
      directions = direction;
      elementIds = elementId;
      adjacencyIds = adjacencyId;
      elementTypes = elementType;
    }
# ---------- end groupfacepropertiesbyroom ----------
getfaceproperties_8 = CSharpScript(Faces=groupfacepropertiesbyroom.Face, element="exteriorwall")  # -> out, Face, simplify(geometries), simplify(ids), simplify(windowIds), centerPts, tiltAngles, areas, directions; inputs element: String; same code as getfaceproperties
getfaceproperties_9 = CSharpScript(Faces=groupfacepropertiesbyroom.Face, element="exteriorroof")  # -> out, Face, simplify(geometries), simplify(ids), simplify(windowIds), centerPts, tiltAngles, areas, directions; inputs element: String; same code as getfaceproperties
getfaceproperties_10 = CSharpScript(Faces=groupfacepropertiesbyroom.Face, element="interiorwall")  # -> out, Face, geometries, simplify(ids), simplify(windowIds), centerPts, tiltAngles, areas, directions; inputs element: String; same code as getfaceproperties
getfaceproperties_11 = CSharpScript(Faces=groupfacepropertiesbyroom.Face, element="interiorroof")  # -> out, Face, geometries, simplify(ids), simplify(windowIds), centerPts, tiltAngles, areas, directions; inputs element: String; same code as getfaceproperties
getfaceproperties_12 = CSharpScript(Faces=groupfacepropertiesbyroom.Face, element="interiorfloor")  # -> out, Face, geometries, simplify(ids), simplify(windowIds), centerPts, tiltAngles, areas, directions; inputs element: String; same code as getfaceproperties
getfaceproperties_13 = CSharpScript(Faces=groupfacepropertiesbyroom.Face, element="groundfloor")  # -> out, Face, geometries, simplify(ids), simplify(windowIds), centerPts, tiltAngles, areas, directions; inputs element: String; same code as getfaceproperties
cluster = Cluster_11(exps_result=exps_other_2.result, Element_ids=getfaceproperties_8.ids)  # -> owal_exps, number
cluster_2 = Cluster_11(exps_result=exps_other_5.result, Element_ids=getfaceproperties_9.ids)  # -> owal_exps, number
cluster_3 = Cluster_11(exps_result=exps_other_3.result, Element_ids=getfaceproperties_10.ids)  # -> owal_exps, number
cluster_4 = Cluster_11(exps_result=exps_other_4.result, Element_ids=getfaceproperties_11.ids)  # -> owal_exps, number
cluster_5 = Cluster_11(exps_result=exps_other_6.result, Element_ids=getfaceproperties_12.ids)  # -> owal_exps, number
cluster_6 = Cluster_11(exps_result=exps_other.result, Element_ids=getfaceproperties_13.ids)  # -> owal_exps, number

list = ValueList({"単板ガラス・ブラインド室内側": 0, "複層ガラス(中間層6mm)・ブラインド室内側": 1, "複層ガラス(中間層12mm)・ブラインド室内側": 2, "複層ガラス・ブラインド内蔵": 3}, selected="複層ガラス(中間層6mm)・ブラインド室内側")
list_2 = ValueList({"ブラインドなし": 0, "明色ブラインド": 1, "中間色ブラインド": 2, "暗色ブラインド": 3}, selected="ブラインドなし")
list_3 = ValueList({"窓を選択": 12, "No1": 0, "No2": 1, "No3": 2, "No4": 3, "No5": 4}, selected="No2")
list_4 = ValueList({"一般窓": 0, "AFW": 1, "PPW": 2}, selected="一般窓")
python = GhPythonScript(x=exps_window.面積)  # -> a; same code as python
pshift = ShiftPaths(Data=getfaceproperties_8.windowIds, Offset=-1)
python_2 = GhPythonScript(x=exps_window.x1_x3)  # -> a; same code as python
python_3 = GhPythonScript(x=list)  # -> a
# ---------- python_3: Python ----------
__author__ = "81803"
__version__ = "2021.07.20"

import rhinoscriptsyntax as rs
x = str(x)
if x == "0":
    q = "No1透明フロートガラス&No2透明網入りガラス&No3熱反クリア&No4高性能夏反シルバー系(SS20)"
    s = "&"
    a1 = q.split(s)
elif x =="1":
    q = "No1透明フロート二層&No2透明フロート三重&No3透明クリア+透明&No4low-εクリア(CVD)+透明&No5透明+low-εクリア(CVD)&No6low-εクリア(CVD)+透明(アルゴン封入)"
    s = "&"
    a1 = q.split(s)
elif x =="2":
    q = "No1透明フロート二層&No2透明フロート三重&No3透明網入り+透明フロート&No4low-εクリア(CVD)+透明&No5透明+low-εクリア(CVD)"
    s = "&"
    a1 = q.split(s)
elif x =="3":
    q = "No1透明フロート二層&No2透明網入り+透明フロート"
    s = "&"
    a1 = q.split(s)
else:
    a1 = ""
a = a1
# ---------- end python_3 ----------
該当窓種類 = Panel(python_3)
cluster_7 = Cluster_11(exps_result=exps_window.result, Element_ids=pshift)  # -> owal_exps, number
python_4 = GhPythonScript(x=list, y=list_3)  # -> a
# ---------- python_4: Python ----------
__author__ = "81803"
__version__ = "2021.07.20"

import rhinoscriptsyntax as rs
x = str(x)
y = str(y)
if x =="0" and y == "0":
    a1 = "  1"
elif x =="0" and y == "1":
    a1 = "  9"
elif x =="0" and y == "2":
    a1 = " 39"
elif x =="0" and y == "3":
    a1 = " 87"
elif x =="1" and y == "0":
    a1 = "  1"
elif x =="1" and y == "1":
    a1 = "  9"
elif x =="1" and y == "2":
    a1 = " 47"
elif x =="1" and y == "3":
    a1 = "115"
elif x =="1" and y == "4":
    a1 = "167"
elif x =="2" and y == "0":
    a1 = "  1"
elif x =="2" and y == "1":
    a1 = "  9"
elif x =="2" and y == "2":
    a1 = " 17"
elif x =="2" and y == "3":
    a1 = "115"
elif x =="2" and y == "4":
    a1 = "141"
elif x =="3" and y == "0":
    a1 = "  1"
elif x =="3" and y == "1":
    a1 = "  9"
elif x =="3" and y == "2":
    a1 = " 87"
else:
    a1 = "該当するものがありません"
a = a1
# ---------- end python_4 ----------
python_5 = GhPythonScript(x=list_2)  # -> a; same code as python_3
tstat = TreeStatistics(Tree=python)  # -> Paths, Length, Count
python_6 = GhPythonScript(x=exps_window.y2)  # -> a; same code as python
python_7 = GhPythonScript(x=list, y=list_4)  # -> a
# ---------- python_7: Python ----------
__author__ = "81803"
__version__ = "2021.07.20"

import rhinoscriptsyntax as rs

x = str(x)
y = str(y)
if x =="0" and y =="0":
    q = "SNGL"
elif x =="1" and y =="0":
    q = "DL06"
elif x =="2" and y =="0":
    q = "DL12"
elif x =="3" and y =="0":
    q = "DLBT"
elif x =="3" and y =="1":
    q = "AFWN"
elif x =="1" and y =="2":
    q = "PP06"
elif x =="2" and y =="2":
    q = "PP12"
else:
    q = "WNDOが指定できません。再調整してください"
a = q
# ---------- end python_7 ----------
要確認 = Panel(python_7)
tstat_2 = TreeStatistics(Tree=python_2)  # -> Paths, Length, Count
tstat_3 = TreeStatistics(Tree=cluster_7.owal_exps)  # -> Paths, Length, Count
tstat_4 = TreeStatistics(Tree=python_6)  # -> Paths, Length, Count
replace = ReplacePaths(Data=python_6, Search=tstat_4.Paths, Replace=tstat_3.Paths)
replace_2 = ReplacePaths(Data=python_2, Search=tstat_2.Paths, Replace=tstat_3.Paths)
replace_3 = ReplacePaths(Data=python, Search=tstat.Paths, Replace=tstat_3.Paths)
concat = Concatenate(
    FragmentA="WNDW ",
    FragmentB=python_7,
    FragmentC=cluster_7.owal_exps,
    FragmentA_2=" ",
    FragmentD=python_4,
    FragmentE=python_5,
    FragmentF="     0",
    FragmentA_3=" 40",
    FragmentG=replace,
    FragmentH=replace_2,
    FragmentI=replace_3)

debrep = DeconstructBrep(Brep=getfaceproperties_3.geometries)  # -> Faces, Edges, Vertices
# Haspへコンバート
敷地の地面 = ValueList({"草": 9, "裸の地面": 15, "黒土": 11, "雪": 82, "アスファルト": 9}, selected="草")
cluster_8 = Cluster_12(観測点=debrep.Vertices)  # -> flatten(Z)
list_5 = ValueList({"北海道": 0, "東京": 1, "名古屋": 2, "大阪": 3, "広島": 4, "福岡": 5, "鹿児島": 6}, selected="福岡")
sort = SortList(Keys=cluster_8)  # -> Keys, ValuesA
item = ListItem(List=sort.Keys, Index=0, Wrap=True)  # -> Item1, Item
python_8 = GhPythonScript(x=list_5)  # -> a
# ---------- python_8: Python ----------
__author__ = "moritayuutarou"

import rhinoscriptsyntax as rs

x = str(x)
if x == "0":
    a1 = "43.081"
elif x == "1":
    a1 = "35.680"
elif x == "2":
    a1 = "35.171"
elif x == "3":
    a1 = "34.702"
elif x == "4":
    a1 = "33.602"
elif x == "5":
    a1 = "34.396"
else:
    a1 = "aaaaa"
a = a1
# ---------- end python_8 ----------
限界日射取得_w_６桁以内 = Panel("0")
設定温湿度_25度_50 = Panel("1")
python_9 = GhPythonScript(x=python_8)  # -> a; same code as python_2
python_10 = GhPythonScript(x=python_8)  # -> a
# ---------- python_10: Python ----------
__author__ = "moritayuutarou"

import rhinoscriptsyntax as rs

x = str(x)
if x == "43.081":
    a1 = "141.34"
elif x == "35.680":
    a1 = "139.76"
elif x == "35.171":
    a1 = "136.88"
elif x == "34.702":
    a1 = "135.49"
elif x == "33.602":
    a1 = "130.26"
elif x == "34.396":
    a1 = "132.47"
else:
    a1 = "aaaaa"
a = a1
# ---------- end python_10 ----------
python_11 = GhPythonScript(x="7")  # -> a; same code as python
python_12 = GhPythonScript(x=限界日射取得_w_６桁以内)  # -> a; same code as python_2
python_13 = GhPythonScript(x=python_10)  # -> a; same code as python_2
python_14 = GhPythonScript(x=item.Item1)  # -> a; same code as python_2
python_15 = GhPythonScript(x=設定温湿度_25度_50)  # -> a, b
# ---------- python_15: Python ----------
__author__ = "81803"
__version__ = "2021.06.22"

import rhinoscriptsyntax as rs
x1 = int(x)
if x1 == 1:
    xx = "24"
    xy = "50"
else:
    xx = "22.5"
    xy = "50"

y0 = len(xx)
y1 = len(xy)
z = " "
q = 6 - y0
r = 6 - y1
a = z*q+xx
b = z*r+xy
# ---------- end python_15 ----------
python_16 = GhPythonScript(x=敷地の地面)  # -> a; same code as python
python_17 = GhPythonScript(x="27")  # -> a; same code as python
concat_2 = Concatenate(
    FragmentA="BUIL",
    FragmentB=python_11,
    FragmentC=python_9,
    FragmentD=python_13,
    FragmentE=python_14,
    FragmentF=python_16,
    FragmentG=python_15.a,
    FragmentH=python_15.b,
    限界日射取得量W=python_12,
    FragmentJ=python_17)

concat_3 = Concatenate(FragmentC=" OWA", FragmentA=cluster.owal_exps)
concat_4 = Concatenate(FragmentB=" OWA", FragmentA=cluster_2.owal_exps)
merge = Merge(Data1=concat_3, Data2=concat_4)
list_6 = ValueList({"明色": 0, "黒": 1, "コンクリート": 3, "中等色": 4, "白タイル": 5, "光沢　アルミ": 6, "白ペイント": 7}, selected="コンクリート")
data_2 = Data(flatten([exps_other_3.area, exps_other_2.area, exps_other_4.area, exps_other_5.area, exps_other_6.area, exps_other.area]))
txt = Text(list_6)
item_2 = ListItem(List=data_2, Index=[cluster.number, cluster_2.number], Wrap=True)
python_18 = GhPythonScript(x=txt)  # -> a
# ---------- python_18: Python ----------
__author__ = "81803"
__version__ = "2021.07.19"

import rhinoscriptsyntax as rs

x = str(x)
if x =="0":
    q = " 72 90"
elif x =="1":
    q = " 90 95"
elif x =="3":
    q = " 90 95"
elif x =="4":
    q = " 60 90"
elif x =="5":
    q = " 40 90"
elif x =="6":
    q = " 40 50"
elif x =="7":
    q = " 35 92"
else:
    q = ""
a = q
# ---------- end python_18 ----------
cluster_9 = Cluster_5()
concat_5 = Concatenate(
    FragmentA="OWAL",
    FragmentA_2=" ",
    FragmentC=merge,
    FragmentD=" ",
    FragmentE=python_18,
    FragmentF="  0",
    FragmentG=cluster_9,
    FragmentH=item_2)

list_7 = ValueList({"内装仕上げの色を選択してください": 0, "明色": 1, "中等色": 2, "暗色": 3}, selected="中等色")
cluster_10 = Cluster_11(exps_result=exps_other_2.result, Element_ids=getfaceproperties_8.ids)  # -> owal_exps, number
lng = ListLength(List=getroomproperties.ids)
series = Series(Start="1", Step="1", Count=lng)  # -> simplify(Series)
python_19 = GhPythonScript(x=getroomproperties.heights)  # -> a; same code as python_12
python_20 = GhPythonScript(x=getroomproperties.floorHeights)  # -> a; same code as python_12
python_21 = GhPythonScript(x=getroomproperties.ceilingHeights)  # -> a; same code as python_12
python_22 = GhPythonScript(x=getroomproperties.areas)  # -> a; same code as python_12
python_23 = GhPythonScript(x=list_7)  # -> a; same code as python_3
python_24 = GhPythonScript(x=series)  # -> a; inputs x: Int32
# ---------- python_24: Python ----------
__author__ = "81803"
__version__ = "2022.03.04"

import rhinoscriptsyntax as rs
"""Provides a scripting component.
    Inputs:
        x: The x script variable
        y: The y script variable
    Output:
        a: The a output variable"""

__author__ = "81803"
__version__ = "2022.03.04"

import rhinoscriptsyntax as rs
x=str(x)
x1=len(x)
print 
x2=3-x1
x3="_"*x2
#y=str(y)
#y1=y[0]
#y2=y1.upper()
#print y2
#x4=y2+x3+str(x)
#a=x4
#    a=()
#else:
#    a=x4
#    a=x4+"  "
a="S"+x3+x
# ---------- end python_24 ----------
python_25 = GhPythonScript(x=python_19)  # -> a; same code as python_2
python_26 = GhPythonScript(x=python_20)  # -> a; same code as python_2
python_27 = GhPythonScript(x=python_21)  # -> a; same code as python_2
python_28 = GhPythonScript(x=python_22)  # -> a; same code as python_2
panel = Panel("aaaaaa")
concat_6 = Concatenate(
    FragmentA="SPAC ",
    FragmentB=simplify(graft(python_24)),
    FragmentA_2="WS01 ",
    FragmentA_3=simplify(graft(python_25)),
    FragmentA_4=simplify(graft(python_26)),
    FragmentA_5=simplify(graft(python_27)),
    FragmentA_6=python_23,
    FragmentA_7="        ",
    FragmentA_8=simplify(graft(python_28)))

人 = Slider(4, range=0..10)
txt_2 = Text(flatten(getroomproperties.areas))
txt_3 = Text(simplify(flatten(getroomproperties.areas)))
txt_4 = Text(人)
lng_2 = ListLength(List=txt_2)
cluster_11 = Cluster_4(人数=txt_4, 床面積=txt_3)
series_2 = Series(Start="1", Step="1", Count=lng_2)
cluster_12 = Cluster_17(A="opc", B=series_2)
concat_7 = Concatenate(
    B="OPCO ",
    C="opc",
    A=series_2,
    OPCO導入="   10 20 20   ",
    夏季冬季中間期="  8 26 26 50 50  0  8 22 22 40 40  0  8 24 24 50 50",
    外気量=cluster_11)  # -> flatten(Result)

計算目的を選択 = ValueList({"計算目的を選択": "計算目的", "ノーマル": 0, "熱負荷計算": 1}, selected="ノーマル")
計算量 = ValueList({"簡易": 0, "詳細": 1}, selected="簡易")
日 = Slider(1, range=1..31)
日_2 = Slider(31, range=1..31)
月 = Slider(12, range=1..12)
日_3 = Slider(15, range=1..31)
月_2 = Slider(1, range=1..12)
月_3 = Slider(12, range=1..12)
list_8 = ValueList({"×0.01MJ/㎡h": 0, "kcal/㎡h": 1}, selected="×0.01MJ/㎡h")
cluster_13 = Cluster(txt=月_3, txt_2=日_2)
cluster_14 = Cluster(txt=月, txt_2=日_3)
cluster_15 = Cluster(txt=月_2, txt_2=日)
cluster_16 = Cluster_2(x=list_8, x_2=計算目的を選択, x_3=計算量, 助走開始=cluster_14, 計算開始=cluster_15, 計算終了=cluster_13)

toggle = BooleanToggle(True)
clean = CleanTree(RemoveNulls=toggle, RemoveInvalid=toggle, RemoveEmpty=toggle, Tree=groupfacepropertiesbyroom.adjacencyIds)  # -> flatten(Tree)
data_3 = Data(flatten([exps_other_3.area, exps_other_2.area, exps_other_4.area, exps_other_5.area, exps_other_6.area, exps_other.area]))
data_4 = Data([cluster_3.number, cluster_4.number, cluster_5.number])
item_3 = ListItem(List=clean, Index=data_4, Wrap=True)
item_4 = ListItem(List=data_3, Index=data_4, Wrap=True)
python_29 = GhPythonScript(x=item_3)  # -> a; inputs x: Int32; same code as python_24
python_30 = GhPythonScript(x="17")  # -> a; same code as python
concat_8 = Concatenate(
    FragmentA="IWAL ",
    FragmentB=" IWA",
    FragmentC="    3      ",
    FragmentB_2=python_29,
    FragmentD=python_30,
    FragmentE=item_4)

list_9 = ValueList({"蛍光灯　埋め込み": 1, "蛍光灯　直付け": 2, "蛍光灯　吊り下げ": 3, "白熱灯　埋め込み": 4, "白熱灯　直付け": 5, "白熱灯　吊り下げ": 6}, selected="白熱灯　吊り下げ")
list_10 = ValueList({"静座": 1, "軽作業": 2, "軽い走行": 3, "立つ座る歩く": 4, "座学": 5, "着席作業": 6, "ダンス": 7}, selected="静座")
list_11 = ValueList({"自然冷却": 1, "強制冷却": 2}, selected="自然冷却")
list_12 = ValueList({"W/㎡": 1, "ｋW": 2}, selected="ｋW")
list_13 = ValueList({"白熱灯": 100, "蛍光灯": 90, "LED": 40}, selected="LED")
list_14 = ValueList({"家": 0.3, "学校": 0.2, "オフィス": 0.6, "劇場": 0.05, "店": 0.4}, selected="家")
cluster_17 = Cluster_15(x_2=list_9, N=lng_2, x=list_12)
cluster_18 = Cluster_14(N=lng_2, x=list_10, txt=txt_4)
cluster_19 = Cluster_13(inputa=list_11, inputb=list_13, N=lng_2, inputc=list_14, B=txt_3)  # -> D, heat_2
cluster_20 = Cluster_18(N=lng_2)
cluster_21 = Cluster_16(N=lng_2)
fin = Data(0)

data_5 = Data(flatten([exps_other_3.area, exps_other_2.area, exps_other_4.area, exps_other_5.area, exps_other_6.area, exps_other.area]))
data_6 = Data(cluster_6.number)
python_31 = GhPythonScript(x="32")  # -> a; same code as python
item_5 = ListItem(List=data_5, Index=data_6, Wrap=True)
concat_9 = Concatenate(FragmentA="GWAL ", FragmentB=" GWA", FragmentA_2=python_31, FragmentE=item_5)  # -> flatten(Result)

内壁の厚さ = Panel("100")
柱太さ_mm = Panel("160")
list_15 = ValueList({"構造を選択": 0, "木造": 1, "RC": 2}, selected="RC")
list_16 = ValueList({"外壁を選択": 0, "窯業": 31, "金属": 6, "モルタル": 27, "木質系": 52}, selected="外壁を選択")
外壁の厚さ_柱含む_mm = Panel("250")
cluster_22 = Cluster_3(外表面=list_16, 構造決定=list_15, 外壁厚さ=外壁の厚さ_柱含む_mm, 内壁=内壁の厚さ, 柱=柱太さ_mm)

python_32 = GhPythonScript(x="7")  # -> a; same code as python
data_7 = Data(flatten([exps_window.result, exps_other_3.result, exps_other_4.result, exps_other_5.result, exps_other_6.result, exps_other.result, exps_other_2.result]))
concat_10 = Concatenate(FragmentA="HRAT", FragmentB=python_32, FragmentC="100100100100100100100100100")

ジョブ名_テスト名を入れてください = Panel("     Ventilation test 001")

cluster_23 = Cluster_7(
    spac=concat_6,
    owal=concat_5,
    iwal=concat_8,
    gwal=concat_9,
    wndw=concat,
    ligh=cluster_17,
    ocup=cluster_18,
    heat=cluster_19.D,
    furn=cluster_20,
    sopc=cluster_12,
    data=cluster_21)  # -> flatten(R)
cluster_24 = Cluster_8(
    job名=ジョブ名_テスト名を入れてください,
    buil=concat_2,
    cntl=cluster_16,
    hrat=concat_10,
    exps=data_7,
    wcon=cluster_22,
    seas="SEAS         2  2  2  3  3  1  1  1  1  3  3  2",
    wsch="WSCH WS01    1  1  1  1  1  2  2  2  2",
    dsch="DSCH MtoF    9100 18 50 21 10 23",
    dsch1="+      StoS  9100 16 80 22 30 23",
    opco=flatten(concat_7),
    fin=fin)
cluster_25 = Cluster_6(d1=cluster_24, d2=cluster_23)
# OutPut&書き出し
panel_2 = Panel(cluster_25)
ファイル名 = Panel("20220326")
拡張子 = Panel("txt")
ファイル保存先 = Panel("C:\Users\81803\Downloads\NewHasp\起動ソフト\NewHASP")
# IDとリスト番号が違うための処理
# 窓と壁の分離
# 窓付き_処理
# 外壁_Plane生成
# 外屋根_Plane生成
# 内壁_Plane生成
# 外壁_処理
# 外屋根_処理
# 内壁_処理
# EWAL,IWAL用データ
# dirAngles:方角情報
# adjacencyRoomIds:接している室id
python_33 = FileCreator(name=ファイル名, ext=拡張子, save=ファイル保存先, lines=panel_2, write=Toggle(False))  # inputs lines: list, write: Boolean
# ---------- python_33: Python ----------
"""
Creates a file with a given ndame and extension.
    Inputs:
        name: Desired file name.
        ext: Desired file extension.
        lines: Text to write.
        write: Set to True to write.
"""

# Stephen P. Maher /  2015

ghenv.Component.Name = "File Creator"

import Grasshopper as gh
import os

gh_path = save # Get GH file path
print(gh_path)
#file = os.path.dirname(os.path.realpath(gh_path)) # Get GH file directory to save to
#print(file)
#file=gh_path
#print('file',file)
if "." not in ext: ext = "." + ext
else: pass

if os.path.exists(gh_path) == False: # Test if file already exists; if it doesn't, proceed
    file = name  # Set file name and extension
print(file)
if os.path.exists(gh_path) == True: # If it does exists, follow the next steps
    file = gh_path+"/"+name + ext 
print('file',file)
if write:
    filePath = open(file, "w") # Open the file
    for line in lines: # Iterate through lines
        filePath.write(line + "\n") # Write separate lines
    filePath.close() # Close the file
else:
    msg = "Set 'write' to True."
    ghenv.Component.AddRuntimeMessage(gh.Kernel.GH_RuntimeMessageLevel.Warning, msg)
# ---------- end python_33 ----------

# ==== cluster Cluster
txt = ClusterInput()
txt_2 = ClusterInput()
panel = Panel("2000")
txt_3 = Text(" ")
txt_4 = Text(txt)
txt_5 = Text(txt_2)
python = GhPythonScript(x=txt_3)  # -> a
# ---------- python: Python ----------
__author__ = "81803"
__version__ = "2021.06.22"

import rhinoscriptsyntax as rs
xx = str(x)
y = len(xx)
z = " "
q = 3 - y
a = z*q+xx
# ---------- end python ----------
python_2 = GhPythonScript(x=txt_4)  # -> a; same code as python
python_3 = GhPythonScript(x=txt_5)  # -> a; same code as python
concat = Concatenate(FragmentA=python, FragmentB=python_2, FragmentC=python_3)
R = ClusterOutput(concat)

# ==== cluster Cluster_2

python = GhPythonScript(x="7")  # -> a
# ---------- python: Python ----------
__author__ = "81803"
__version__ = "2021.06.22"

import rhinoscriptsyntax as rs
x = int(x)
z = " "
a = z * x
# ---------- end python ----------

x = ClusterInput()
x_2 = ClusterInput()

python_2 = GhPythonScript(x="24")  # -> a; same code as python

x_3 = ClusterInput()
python_3 = GhPythonScript(x=x)  # -> a; same code as python
python_4 = GhPythonScript(x=x_2)  # -> a, b
# ---------- python_4: Python ----------
__author__ = "81803"
__version__ = "2021.06.22"

import rhinoscriptsyntax as rs
xx = str(x)
y = len(xx)
z = " "
q = 3 - y
a = z*q+xx
if x == 0:
    bb = 0
else:
    bb = 0
r = 3 - bb
b = z*q+str(bb)
# ---------- end python_4 ----------
python_5 = GhPythonScript(x=x_3)  # -> a; same code as python
助走開始 = ClusterInput()
計算開始 = ClusterInput()
計算終了 = ClusterInput()
concat = Concatenate(
    FragmentA="CNTL",
    FragmentB=python,
    FragmentC=python_4.a,
    FragmentD=python_5,
    FragmentE="  0",
    FragmentF=python_3,
    FragmentG=python_4.b,
    FragmentH=助走開始,
    FragmentA_2=計算開始,
    FragmentB_2=計算終了,
    FragmentC_2="  1",
    FragmentA_3=python_2)
R = ClusterOutput(concat)

# ==== cluster Cluster_3
内壁 = ClusterInput()
柱 = ClusterInput()
外表面 = ClusterInput()
外壁厚さ = ClusterInput()
内壁_2 = Data(内壁)
構造決定 = ClusterInput()
柱_2 = Data(柱)
外表面_2 = Data(外表面)
外壁厚さ_2 = Data(外壁厚さ)
構造決定_2 = Data(構造決定)
構造 = Data(構造決定_2)
kouzo = GhPythonScript(x=構造決定_2)  # -> a, b, c
# ---------- kouzo: Python ----------
__author__ = "81803"
__version__ = "2021.07.11"

import rhinoscriptsyntax as rs
x0 = int(x)
if x0 == 0:
    x1 = "構造を選択してください"
elif x0 == 1:
    x1 = " 27  1 32  7"
else :
    x1 = " 32 31"
if x1 == " 27  1 32  7":
    x2 = 16
elif x1 == " 32 31":
    x2 = 62
else:
    x2 = "構造を選択してください"
if x2 == 16:
    x3 = " 32  7 27  1"
elif x2 == 62:
    x3 = " 31 32"
else:
    x3 = ""
a = x1
b = x2
c = x3
# ---------- end kouzo ----------
python = GhPythonScript(x=外表面_2)  # -> a
# ---------- python: Python ----------
__author__ = "81803"
__version__ = "2021.06.22"

import rhinoscriptsyntax as rs
x0 = int(x)
if x0 == 0:
    x1 = "外壁を選択してください"
else:
    x1 = x0
a = x1
# ---------- end python ----------
python_2 = GhPythonScript(x=構造決定_2)  # -> a, b, c; same code as kouzo
txt = Text(構造)
subtraction = Subtraction(A=柱_2, B=kouzo.b)
subtraction_2 = Subtraction(A=内壁_2, B=python_2.b)
python_3 = GhPythonScript(x=txt)  # -> a
# ---------- python_3: Python ----------
__author__ = "81803"
__version__ = "2021.06.22"

import rhinoscriptsyntax as rs
x0 = int(x)
if x0 == 0:
    x1 = "構造を選択してください"
elif x0 == 1:
    x1 = " 52 28"
else :
    x1 = " 86 10"
a = x1
# ---------- end python_3 ----------
python_4 = GhPythonScript(x=python)  # -> a
# ---------- python_4: Python ----------
__author__ = "81803"
__version__ = "2021.06.22"

import rhinoscriptsyntax as rs
x = str(x)
y = len(x)
z = " "
qa = " 20"
q = 3 - y
a = z*q+x+qa
# ---------- end python_4 ----------
python_5 = GhPythonScript(x=python_3)  # -> a
# ---------- python_5: Python ----------
__author__ = "81803"
__version__ = "2021.06.22"

import rhinoscriptsyntax as rs
x0 = str(x)
if x0 == " 52 28":
    x1 = 28
elif x0 == 1:
    x1 = " 86 10"
else :
    x1 = 10
a = x1
# ---------- end python_5 ----------
python_6 = GhPythonScript(y=構造決定_2, x=subtraction)  # -> a
# ---------- python_6: Python ----------
__author__ = "81803"
__version__ = "2021.06.22"

import rhinoscriptsyntax as rs
y = str(y)
if y == "1":
    qa = " 52"
else:
    qa = " 72"

w = str(x)
e = len(w)
z = " "
q = 3 - e
a = qa+z*q+w
# ---------- end python_6 ----------
python_7 = GhPythonScript(y=構造決定_2, x=subtraction_2)  # -> a; same code as python_6
python_8 = GhPythonScript(x=python_5)  # -> a
# ---------- python_8: Python ----------
__author__ = "81803"
__version__ = "2021.06.22"

import rhinoscriptsyntax as rs
x0 = str(x)
if x0 == "10":
    x1 = 20
else :
    x1 = x0
a = x1
# ---------- end python_8 ----------
panel = Panel(python_4)
python_9 = GhPythonScript(x=python_8)  # -> a
# ---------- python_9: Python ----------
__author__ = "81803"
__version__ = "2021.07.11"

import rhinoscriptsyntax as rs
x = str(x)
if x == "28":
    x1 = "20"
else:
    x1 = ""
a = x1
# ---------- end python_9 ----------
subtraction_3 = Subtraction(A=外壁厚さ_2, B=python_9, C=python_8)
python_10 = GhPythonScript(y=python_8, x=subtraction_3)  # -> a
# ---------- python_10: Python ----------
__author__ = "81803"
__version__ = "2021.06.22"

import rhinoscriptsyntax as rs
y = str(y)
if y == "20":
    qa = " 22"
    qb = " 86 10"
else:
    qa = " 71"
    qb = ""

w = str(x)
e = len(w)
z = " "
q = 3 - e
a = qa+z*q+w+qb
# ---------- end python_10 ----------
concat = Concatenate(FragmentD="WCON  BEC  ", FragmentA=kouzo.a, FragmentB=python_6, FragmentC=kouzo.c)
concat_2 = Concatenate(FragmentD="WCON  IWA  ", FragmentA=python_2.a, FragmentB=python_7, FragmentC=python_2.c)
bec = Data(concat)
iwa = Data(concat_2)
python_11 = GhPythonScript(y=python_3, x=python_4, z=python_10)  # -> a
# ---------- python_11: Python ----------
__author__ = "81803"
__version__ = "2021.06.22"

import rhinoscriptsyntax as rs
x = str(x)
y = str(y)
z = str(z)
if y ==" 52 28":
    x1 = x
    z1 = z
else:
    x1 = ""
    z1 = z

a1 = x1 + y +z1
a = a1
# ---------- end python_11 ----------
panel_2 = Panel(python_11)
concat_3 = Concatenate(FragmentA="WCON  GWA  ", FragmentB=python_11)
concat_4 = Concatenate(FragmentA="WCON  OWA  ", FragmentB=python_11)
gwa = Data(concat_3)
owa = Data(concat_4)
merge = Merge(Data1=owa, Data2=iwa, Data3=gwa, Data4=bec)
wcon = ClusterOutput(merge)

# ==== cluster Cluster_4
人数 = ClusterInput()
床面積 = ClusterInput()
人数_2 = Data(人数)
床面積_2 = Data(床面積)
multiplication = Multiplication(A=人数_2, B="20")
division = Division(A=multiplication, B=床面積_2)
num = Number(division)
小数点変更 = GhPythonScript(x=num)  # -> a
# ---------- 小数点変更: Python ----------
__author__ = "81803"
__version__ = "2021.07.04"

import rhinoscriptsyntax as rs
x
a = ('{:.1f}'.format(x))
# ---------- end 小数点変更 ----------
python = GhPythonScript(x=小数点変更)  # -> a
# ---------- python: Python ----------
__author__ = "81803"
__version__ = "2021.06.22"

import rhinoscriptsyntax as rs
xx = str(x)
y = len(xx)
z = " "
q = 6 - y
a = z*q+xx
# ---------- end python ----------
a = ClusterOutput(python)

# ==== cluster Cluster_5
python = GhPythonScript(x="18")  # -> a; same code as python
a = ClusterOutput(python)

# ==== cluster Cluster_6
d1 = ClusterInput()
d2 = ClusterInput()
txt = Text("CMPL")
merge = Merge(Data1=d1, Data2=d2)  # -> flatten(Result)
cmpl = Text(txt)
merge_2 = Merge(Data1=merge, Data2=cmpl)
R = ClusterOutput(merge_2)

# ==== cluster Cluster_7
infl = ClusterInput()
ligh = ClusterInput()
ocup = ClusterInput()
heat = ClusterInput()
furn = ClusterInput()
sopc = ClusterInput()
spac = ClusterInput()
owal = ClusterInput()
iwal = ClusterInput()
gwal = ClusterInput()
beco = ClusterInput()
wndw = ClusterInput()
data = ClusterInput()
infl_2 = Data(infl)
ligh_2 = Text(ligh)
ocup_2 = Text(ocup)
heat_2 = Text(heat)
furn_2 = Text(furn)
sopc_2 = Text(sopc)
spac_2 = Data(spac)
owal_2 = Data(owal)
iwal_2 = Data(iwal)
gwal_2 = Data(gwal)
beco_2 = Data(beco)
wndw_2 = Data(wndw)
data_2 = Data(data)
階層データ = Merge(
    Data1=spac_2,
    Data2=owal_2,
    Data3=iwal_2,
    Data4=gwal_2,
    Data5=beco_2,
    Data6=wndw_2,
    Data7=infl_2,
    Data8=ligh_2,
    Data9=ocup_2,
    Data10=heat_2,
    Data11=furn_2,
    Data12=sopc_2,
    Data13=data_2)
R = ClusterOutput(階層データ)

# ==== cluster Cluster_8
fin = ClusterInput()
fin_2 = Data(fin)
panel = Panel(fin_2)
python = GhPythonScript(x=panel)  # -> out, a; same code as python
job名 = ClusterInput()
buil = ClusterInput()
cntl = ClusterInput()
hrat = ClusterInput()
exps = ClusterInput()
wcon = ClusterInput()
seas = ClusterInput()
wsch = ClusterInput()
dsch = ClusterInput()
dsch1 = ClusterInput()
opco = ClusterInput()
job名_2 = Text(job名)
buil_2 = Text(buil)
cntl_2 = Text(cntl)
hrat_2 = Text(hrat)
exps_2 = Text(exps)
wcon_2 = Text(wcon)
seas_2 = Text(seas)
wsch_2 = Text(wsch)
dsch_2 = Text(dsch)
dsch1_2 = Text(dsch1)
opco_2 = Text(opco)
fin_3 = Text(python.a)
merge = Merge(
    Data1=job名_2,
    Data2=buil_2,
    Data3=cntl_2,
    Data4=hrat_2,
    Data5=exps_2,
    Data6=wcon_2,
    Data7=seas_2,
    Data8=wsch_2,
    Data9=dsch_2,
    Data10=dsch1_2,
    Data11=opco_2,
    Data12=fin_3)
R = ClusterOutput(merge)

# ==== cluster EXPS_other
element = ClusterInput()
element_2 = Data(element)
geometory_ids = ClusterInput()
geo = ClusterInput()
geo_2 = Geometry(geo)

# ----
# 内壁_Plane生成
md_slider = MDSlider(SliderMode=0, slider_value=Point(0, 0, 0.5), x_domain=Domain(0, 1), y_domain=Domain(0, 1), z_domain=Domain(0, 1))
evalsrf = EvaluateSurface(Surface=reparameterize(geo_2), Point=md_slider)  # -> Point, Normal, UDirection, VDirection, Frame

# ----
# 内壁_処理
xy = XYPlane(Origin=Point(0, 0, 0))
orient = Orient(Geometry=geo_2, Source=evalsrf.Frame, Target=xy)  # -> simplify(graft(Geometry)), Transform
toggle = BooleanToggle(True)
clean = CleanTree(RemoveNulls=toggle, RemoveInvalid=toggle, RemoveEmpty=toggle, Tree=orient.Geometry)
roomc_1wall = Brep(clean)
crv = Curve(roomc_1wall)
explode = Explode(Curve=crv, Recursive=True)  # -> Segments, Vertices
sunion = SetUnion(SetA=explode.Vertices)
pdecon = Deconstruct(Point=sunion)  # -> XComponent, YComponent, ZComponent
cluster = Cluster_9(input_expswall=pdecon.XComponent)  # -> simplify(D)
cluster_2 = Cluster_9(input_expswall=pdecon.YComponent)  # -> simplify(D)

multiplication = Multiplication(A=cluster, B=cluster_2)
tstat = TreeStatistics(Tree=cluster)  # -> simplify(Paths), Length, Count
area = ClusterOutput(multiplication)  # Area
addition = Addition(A=geometory_ids)
dirangle = ClusterInput()  # dirAngle
tiltangle = ClusterInput()  # tiltAngle
python = GhPythonScript(x=addition, y=element_2)  # -> simplify(a)
# ---------- python: Python ----------
__author__ = "81803"
__version__ = "2022.03.04"

import rhinoscriptsyntax as rs
"""Provides a scripting component.
    Inputs:
        x: The x script variable
        y: The y script variable
    Output:
        a: The a output variable"""

__author__ = "81803"
__version__ = "2022.03.04"

import rhinoscriptsyntax as rs
x=str(x)
x1=len(x)
x2=3-x1
x3="_"*x2
y=str(y)
y1=y[0]
print y1
y2=y1.upper()
#print y2
x4=y2+x3+str(x)
a=x4
if a ==y2+"None":
    a=()
else:
    a=x4
    a=x4+"  "
# ---------- end python ----------
toggle_2 = BooleanToggle(True)
split = SplitTree(Data=simplify(graft(tiltangle)), Masks=flatten(tstat.Paths))  # -> Positive, Negative
split_2 = SplitTree(Data=simplify(graft(dirangle)), Masks=flatten(tstat.Paths))  # -> Positive, Negative
clean_2 = CleanTree(RemoveNulls=toggle_2, RemoveInvalid=toggle_2, RemoveEmpty=toggle_2, Tree=python)  # -> simplify(Tree)
python_2 = GhPythonScript(x=split.Positive)  # -> simplify(a); same code as python_2
python_3 = GhPythonScript(x=split_2.Positive)  # -> simplify(a); same code as python_2
panel = Panel(clean_2)
concat = Concatenate(
    EXPS="EXPS ",
    EXPS名=clean_2,
    傾斜角=python_2,
    方位角=python_3,
    隣棟距離="  0",
    隣棟高さ="  0",
    Zy="     0",
    y1="     0",
    y2="     0",
    y3=cluster_2,
    Zx="     0",
    x1="     0",
    x2="     0",
    x3=cluster)
result = ClusterOutput(concat)

# ==== cluster EXPS_Window
exwall_geo = ClusterInput()
exwall_geo_2 = Brep(exwall_geo)
window_id = ClusterInput()
window_geo = ClusterInput()
tiltangle = ClusterInput()
dirangle = ClusterInput()

exterior_geo = Brep(graft(exwall_geo_2))
window_id_2 = Data(window_id)
window_geo_2 = Data(window_geo)
input_exteriorwall = Brep(exwall_geo_2)
tstat = TreeStatistics(Tree=exterior_geo)  # -> Paths, Length, Count

tstat_2 = TreeStatistics(Tree=simplify(exterior_geo))  # -> Paths, Length, Count
rep = ReplaceText(Text=tstat_2.Paths, Find="{", RecursiveReplace=False)
rep_2 = ReplaceText(Text=rep, Find="}", RecursiveReplace=False)
path = ConstructPath(Indices=graft(rep_2))  # -> simplify(Branch)
cull_i = CullIndex(List=path, Indices="0", Wrap=True)  # -> simplify(List)
panel = Panel(cull_i)
window_id_3 = Data(window_id_2)
merge = Merge(Data1=cull_i, Data2=window_id_2)

# ----
# IDとリスト番号が違うための処理
addition = Addition(A=merge, B=-1)
addition_2 = Addition(A=merge)
python = GhPythonScript(x=addition)  # -> a
# ---------- python: Python ----------
__author__ = "81803"
__version__ = "2022.03.03"

import rhinoscriptsyntax as rs
if x == -1:
    a= ()
else:
    a=x
# ---------- end python ----------

item = ListItem(List=window_geo_2, Index=python, Wrap=True)

panel_2 = Panel(item)

# ---- group: 基盤となるデータ構造
tstat_3 = TreeStatistics(Tree=item)  # -> Paths, Length, Count

# ----
# 外壁_Plane生成
md_slider = MDSlider(SliderMode=0, slider_value=Point(0, 0, 0.5), x_domain=Domain(0, 1), y_domain=Domain(0, 1), z_domain=Domain(0, 1))
evalsrf = EvaluateSurface(Surface=reparameterize(input_exteriorwall), Point=md_slider)  # -> Point, Normal, UDirection, VDirection, Frame
data = Data(graft(evalsrf.Frame))
tstat_4 = TreeStatistics(Tree=data)  # -> Paths, Length, Count
replace = ReplacePaths(Data=data, Search=tstat_4.Paths, Replace=tstat_3.Paths)

# ----
# 窓付き_処理
replace_2 = ReplacePaths(Data=exterior_geo, Search=tstat.Paths, Replace=tstat_3.Paths)
toggle = BooleanToggle(True)
merge_2 = Merge(Data1=item, Data2=replace_2)
clean = CleanTree(RemoveNulls=toggle, RemoveInvalid=toggle, RemoveEmpty=toggle, Tree=merge_2)
lng = ListLength(List=clean)
python_2 = GhPythonScript(x=lng)  # -> a
# ---------- python_2: Python ----------
__author__ = "81803"
__version__ = "2022.03.02"

import rhinoscriptsyntax as rs
if x <= 1:
    a = "false"
else:
    a = "true"
# ---------- end python_2 ----------
mindex = MemberIndex(Set=python_2, Member="true")  # -> Index, Count
xy = XYPlane(Origin=Point(0, 0, 0))

# ---- group: ちょっと怖い
pshift = ShiftPaths(Data=mindex.Index, Offset=-1)

# ----
clean_2 = CleanTree(RemoveNulls=toggle, RemoveInvalid=toggle, RemoveEmpty=toggle, Tree=pshift)
tstat_5 = TreeStatistics(Tree=clean_2)  # -> Paths, Length, Count

# ---- group: Plane
split = SplitTree(Data=replace, Masks=flatten(tstat_5.Paths))  # -> Positive, Negative

# ---- group: オブジェクト
split_2 = SplitTree(Data=merge_2, Masks=flatten(tstat_5.Paths))  # -> Positive, Negative

# ----
orient = Orient(Geometry=split_2.Positive, Source=split.Positive, Target=xy)  # -> Geometry, Transform

# ----
# 窓と壁の分離
area = Area(Geometry=orient.Geometry)  # -> Area, Centroid
tstat_6 = TreeStatistics(Tree=orient.Geometry)  # -> Paths, Length, Count
sort = SortList(Keys=area.Area)  # -> Keys, ValuesA
item_2 = ListItem(List=sort.Keys, Index=0, Wrap=True)  # -> Item1, Item
mindex_2 = MemberIndex(Set=area.Area, Member=item_2.Item1)  # -> Index, Count

# ---- group: 窓
cull_i_2 = CullIndex(List=orient.Geometry, Indices=mindex_2.Index, Wrap=True)

# ---- group: 壁
item_3 = ListItem(List=orient.Geometry, Index=mindex_2.Index, Wrap=True)

# ----
tstat_7 = TreeStatistics(Tree=cull_i_2)  # -> Paths, Length, Count
tstat_8 = TreeStatistics(Tree=item_3)  # -> Paths, Length, Count
replace_3 = ReplacePaths(Data=cull_i_2, Search=tstat_7.Paths, Replace=tstat_6.Paths)
replace_4 = ReplacePaths(Data=item_3, Search=tstat_8.Paths, Replace=tstat_6.Paths)

roomc_1window = Brep(replace_3)
roomc_1wall = Brep(replace_4)
tstat_9 = TreeStatistics(Tree=roomc_1window)  # -> Paths, Length, Count
cluster = Cluster_10(roomc_1window=roomc_1window, roomc_1wall=roomc_1wall)  # -> output_exps_x2_2, output_exps_y2_2, output_exps_x3_2, output_exps_x1_2, output_exps_y3_2, output_exps_y1_2
split_3 = SplitTree(Data=simplify(graft(tiltangle)), Masks=flatten(tstat_9.Paths))  # -> Positive, Negative
split_4 = SplitTree(Data=simplify(graft(dirangle)), Masks=flatten(tstat_9.Paths))  # -> Positive, Negative
python_3 = GhPythonScript(x=addition_2)  # -> a
# ---------- python_3: Python ----------
__author__ = "81803"
__version__ = "2022.03.04"

import rhinoscriptsyntax as rs
x=str(x)
x1=len(x)
x2=3-x1
x3="_"*x2
x4="D"+x3+str(x)
a=x4
if a =="DNone":
    a=()
else:
    a=x4
    a=x4+"  "
# ---------- end python_3 ----------
toggle_2 = BooleanToggle(True)
python_4 = GhPythonScript(x=split_3.Positive)  # -> simplify(a); same code as python_2
python_5 = GhPythonScript(x=split_4.Positive)  # -> simplify(a); same code as python_2
clean_3 = CleanTree(RemoveNulls=toggle_2, RemoveInvalid=toggle_2, RemoveEmpty=toggle_2, Tree=python_3)
python_6 = GhPythonScript(x=cluster.output_exps_y1_2)  # -> simplify(a); same code as python_2
python_7 = GhPythonScript(x=cluster.output_exps_y2_2)  # -> simplify(a); same code as python_2
python_8 = GhPythonScript(x=cluster.output_exps_y3_2)  # -> simplify(a); same code as python_2
python_9 = GhPythonScript(x=cluster.output_exps_x1_2)  # -> simplify(a); same code as python_2
python_10 = GhPythonScript(x=cluster.output_exps_x2_2)  # -> simplify(a); same code as python_2
python_11 = GhPythonScript(x=cluster.output_exps_x3_2)  # -> simplify(a); same code as python_2
concat = Concatenate(
    EXPS="EXPS ",
    EXPS名=clean_3,
    傾斜角=python_4,
    方位角=python_5,
    隣棟距離="  0",
    隣棟高さ="  0",
    Zy="     0",
    y1=python_6,
    y2=python_7,
    y3=python_8,
    Zx="     0",
    x1=python_9,
    x2=python_10,
    x3=python_11)

addition_3 = Addition(A=cluster.output_exps_x2_2, B=cluster.output_exps_x3_2, C=cluster.output_exps_x1_2)
addition_4 = Addition(A=cluster.output_exps_y2_2)
multiplication = Multiplication(A=cluster.output_exps_y2_2, B=cluster.output_exps_x2_2)
python_12 = GhPythonScript(x=addition_3)  # -> a
# ---------- python_12: Python ----------
__author__ = "81803"
__version__ = "2021.09.09"

import rhinoscriptsyntax as rs
x = str(x)
w = x.find('.')
w2 = w+2
if w == -1:
    a = x
else:
    a = x[0:w2]
# ---------- end python_12 ----------
python_13 = GhPythonScript(x=multiplication)  # -> a; same code as python_12
python_14 = GhPythonScript(x=addition_4)  # -> a; same code as python_12
y2 = ClusterOutput(python_14)  # Y2
面積 = ClusterOutput(python_13)  # 面積
x1_x3 = ClusterOutput(python_12)  # X1~X3
result = ClusterOutput(concat)

# ==== cluster Cluster_11
exps_result = ClusterInput()
panel = Panel(ClusterInput())
exps_number = GhPythonScript(x=exps_result)  # -> flatten(a)
# ---------- exps_number: Python ----------
__author__ = "81803"
__version__ = "2022.03.07"

import rhinoscriptsyntax as rs
a=x[5:9]
# ---------- end exps_number ----------
toggle = BooleanToggle(True)
panel_2 = Panel(exps_number)
clean = CleanTree(RemoveNulls=toggle, RemoveInvalid=toggle, RemoveEmpty=toggle, Tree=panel)
tstat = TreeStatistics(Tree=clean)  # -> Paths, Length, Count
toggle_2 = BooleanToggle(False)
lng = ListLength(List=tstat.Length)
dup = DuplicateData(Data="A", Number=lng, Order=toggle_2)  # -> simplify(Data)
split = TextSplit(Text=exps_number, Separators="_")
panel_3 = Panel(dup)
dup_2 = DuplicateData(Data=simplify(graft(dup)), Number=simplify(graft(tstat.Length)), Order=toggle_2)  # -> simplify(Data)
item = ListItem(List=split, Index=0, Wrap=True)  # -> flatten(Item1), Item
keysearch = KeyValueSearch(Keys=clean, Values=dup_2, Search=item.Item1)
panel_4 = Panel(keysearch)
mindex = MemberIndex(Set=keysearch, Member="A")  # -> simplify(Index), Count
item_2 = ListItem(List=exps_number, Index=mindex.Index, Wrap=True)  # -> simplify(Item)
panel_5 = Panel(item_2)
tstat_2 = TreeStatistics(Tree=item_2)  # -> Paths, Length, Count
split_2 = TextSplit(Text=item_2, Separators="_")
replace = ReplacePaths(Data=item_2, Search=tstat_2.Paths, Replace=tstat.Paths)
item_3 = ListItem(List=split_2, Index=0, Wrap=True)  # -> Item1, Item
pshift = ShiftPaths(Data=item_3.Item1, Offset=-1)
tstat_3 = TreeStatistics(Tree=pshift)  # -> Paths, Length, Count
owal_exps = ClusterOutput(replace)
replace_2 = ReplacePaths(Data=pshift, Search=tstat_3.Paths, Replace=tstat.Paths)
subtraction = Subtraction(A=replace_2, B=1)
number = ClusterOutput(subtraction)  # number

# ==== cluster Cluster_12
観測点 = ClusterInput()
観測点_2 = Point(観測点)
原点 = Point(Point(0, 0, 0))
ln = Line(StartPoint=原点, EndPoint=観測点_2)

# ---- group: 長さを計測して、最大、最小の順番を抽出
len = Length(Curve=ln)
sort = SortList(Keys=len)  # -> Keys, ValuesA
item = ListItem(List=sort.Keys, Index="-1", Wrap=True)  # -> Item, Item1
最大 = Data(item.Item)
最小 = Data(item.Item1)
mindex = MemberIndex(Set=len, Member=最大)  # -> Index, Count
mindex_2 = MemberIndex(Set=len, Member=最小)  # -> Index, Count

# ---- group: 最小の点
item_2 = ListItem(List=観測点_2, Index=mindex_2.Index, Wrap=True)

# ---- group: 最大の点
item_3 = ListItem(List=観測点_2, Index=mindex.Index, Wrap=True)

# ----
format = Format(Format="{0:0.00}", Culture=127, Data0=item_2)
format_2 = Format(Format="{0:0.00}", Culture=127, Data0=item_3)
pdecon = Deconstruct(Point=format_2)  # -> XComponent, YComponent, ZComponent
pdecon_2 = Deconstruct(Point=format)  # -> XComponent, YComponent, ZComponent
Z = ClusterOutput(pdecon.ZComponent)

# ==== cluster Cluster_13
inputa = ClusterInput()
inputb = ClusterInput()
inputc = ClusterInput()
python = GhPythonScript(x="5")  # -> a; same code as python
python_2 = GhPythonScript(x="1")  # -> a; same code as python
パソコン何台使うか = Panel("4")
int = Integer(パソコン何台使うか)
division = Division(A=inputb, B="100")
python_3 = GhPythonScript(x=inputa)  # -> a
# ---------- python_3: Python ----------
__author__ = "81803"
__version__ = "2021.06.22"

import rhinoscriptsyntax as rs
x = str(x)
y = len(x)
z = " "
q = 3 - y
a = z*q+x
# ---------- end python_3 ----------
multiplication = Multiplication(A=int, B=200, C=inputc)
B = ClusterInput()
division_2 = Division(A=multiplication, B=B)
ma = MassAddition(Input=[division, division_2])  # -> Result, PartialResults
小数点変更 = GhPythonScript(x=ma.Result)  # -> a
# ---------- 小数点変更: Python ----------
__author__ = "81803"
__version__ = "2021.07.04"

import rhinoscriptsyntax as rs
x = float(x)
a = ('{:.1f}'.format(x))
# ---------- end 小数点変更 ----------
python_4 = GhPythonScript(x=小数点変更)  # -> a
# ---------- python_4: Python ----------
__author__ = "81803"
__version__ = "2021.06.22"

import rhinoscriptsyntax as rs
x = str(x)
y = len(x)
z = " "
q = 6 - y
a = z*q+x
# ---------- end python_4 ----------
concat = Concatenate(
    FragmentA="HEAT",
    FragmentB=python_2,
    FragmentC="MtoF",
    FragmentD=python,
    FragmentE=python_3,
    FragmentF=python_4,
    FragmentG="     0",
    FragmentH="  1")
N = ClusterInput()
dup = DuplicateData(Data=concat, Number=N, Order="False")  # -> simplify(graft(Data))
heat = Data(dup)
D = ClusterOutput(dup)
heat_2 = ClusterOutput(heat)

# ==== cluster Cluster_14
x = ClusterInput()
txt = ClusterInput()

python = GhPythonScript(x="5")  # -> a; same code as python
python_2 = GhPythonScript(x="1")  # -> a; same code as python
python_3 = GhPythonScript(x=x)  # -> a; same code as python_3
txt_2 = Text(txt)
python_4 = GhPythonScript(x=txt_2)  # -> a; same code as python_4
concat = Concatenate(
    FragmentA="OCUP",
    FragmentB=python_2,
    FragmentC="MtoF",
    FragmentD=python,
    FragmentE=python_3,
    FragmentF=python_4,
    FragmentG="  2")

N = ClusterInput()
dup = DuplicateData(Data=concat, Number=N, Order="False")  # -> simplify(graft(Data))
D = ClusterOutput(dup)
panel = Panel(dup)

# ==== cluster Cluster_15
x = ClusterInput()
x_2 = ClusterInput()
N = ClusterInput()

python = GhPythonScript(x="6")  # -> a; same code as python
python_2 = GhPythonScript(x="1")  # -> a; same code as python
python_3 = GhPythonScript(x="5")  # -> a; same code as python
python_4 = GhPythonScript(x=x_2)  # -> a; same code as python_3
python_5 = GhPythonScript(x="20")  # -> a; same code as python_4
python_6 = GhPythonScript(x=x)  # -> a; same code as python_3
concat = Concatenate(
    FragmentA="LIGH",
    FragmentB=python_2,
    FragmentC="MtoF",
    FragmentD=python_3,
    FragmentE=python_4,
    FragmentF=python_5,
    FragmentG=python_6,
    FragmentH=python,
    FragmentI="   400")
panel = Panel(concat)

dup = DuplicateData(Data=panel, Number=N, Order="False")  # -> simplify(graft(Data))
D = ClusterOutput(dup)

# ==== cluster Cluster_16
N = ClusterInput()

txt = Text("    ")
dup = DuplicateData(Data=txt, Number=N, Order="False")  # -> simplify(graft(Data))

D = ClusterOutput(dup)

# ==== cluster Cluster_17
A = ClusterInput()
B = ClusterInput()

concat = Concatenate(FragmentA=A, FragmentB=B)
python = GhPythonScript()  # -> a, b
# ---------- python: Python ----------
__author__ = "81803"
__version__ = "2021.07.22"

import rhinoscriptsyntax as rs

a = "SOPC "
b = "     100   100   100   100      "
# ---------- end python ----------
concat_2 = Concatenate(FragmentA=python.a, FragmentC=concat, FragmentB=python.b)  # -> simplify(graft(Result))

R = ClusterOutput(concat_2)

# ==== cluster Cluster_18
N = ClusterInput()

list = ValueList({"家": 0, "学校": 1, "オフィス": 2, "劇場": 3, "店": 4}, selected="オフィス")
python = GhPythonScript(x="10")  # -> a; same code as python
python_2 = GhPythonScript(x=list)  # -> a
# ---------- python_2: Python ----------
__author__ = "81803"
__version__ = "2021.07.22"

import rhinoscriptsyntax as rs
x = str(x)
if x =="2":
    a1 = "    40    80"
else:
    a1 = "ごめんなさい、まだ対応してません"
a = a1
# ---------- end python_2 ----------
concat = Concatenate(FragmentA="FURN", FragmentB=python, FragmentC=python_2)
dup = DuplicateData(Data=concat, Number=N, Order="False")  # -> simplify(graft(Data))

D = ClusterOutput(dup)

# ==== cluster Cluster_9
input_expswall = ClusterInput()
input_expswall_2 = Data(input_expswall)
sunion = SetUnion(SetA=input_expswall_2)
sort = SortList(Keys=sunion)  # -> Keys, ValuesA
item = ListItem(List=sort.Keys, Index=0, Wrap=True)  # -> Item1, Item
max = Data(item.Item1)
min = Data(item.Item)
subtraction = Subtraction(A=max, B=min)
python = GhPythonScript(x=subtraction)  # -> a
# ---------- python: Python ----------
__author__ = "81803"
__version__ = "2021.09.09"

import rhinoscriptsyntax as rs
x = str(x)
w = x.find('.')
w2 = w+3
if w == -1:
    a = x
else:
    a = x[0:w2]
# ---------- end python ----------
python_2 = GhPythonScript(x=python)  # -> a
# ---------- python_2: Python ----------
__author__ = "81803"
__version__ = "2021.06.22"

import rhinoscriptsyntax as rs
y = len(x)
z = " "
q = 6 - y
a = z*q+x
# ---------- end python_2 ----------
output = Data(python_2)
pshift = ShiftPaths(Data=output, Offset=-1)
D = ClusterOutput(pshift)

# ==== cluster Cluster_10
roomc_1window = ClusterInput()
roomc_1wall = ClusterInput()
roomc_1window_2 = Brep(roomc_1window)
roomc_1wall_2 = Brep(roomc_1wall)
explode = Explode(Curve=roomc_1wall_2, Recursive=True)  # -> Segments, Vertices
explode_2 = Explode(Curve=roomc_1window_2, Recursive=True)  # -> Segments, Vertices
sunion = SetUnion(SetA=explode.Vertices)
sunion_2 = SetUnion(SetA=explode_2.Vertices)
pdecon = Deconstruct(Point=sunion)  # -> XComponent, YComponent, ZComponent
pdecon_2 = Deconstruct(Point=sunion_2)  # -> XComponent, YComponent, ZComponent

input_exps_wall_window用 = Data(pdecon_2.XComponent)
input_exps_wall_window用_2 = Data(input_exps_wall_window用)
sunion_3 = SetUnion(SetA=input_exps_wall_window用_2)
sort = SortList(Keys=sunion_3)  # -> Keys, ValuesA
item = ListItem(List=sort.Keys, Index=0, Wrap=True)  # -> Item1, Item
min = Data(item.Item)
max = Data(item.Item1)
subtraction = Subtraction(A=max, B=min)
python = GhPythonScript(x=subtraction)  # -> a; same code as python
output_exps_x2 = Data(python)

input_expwindow = Data(pdecon.XComponent)
input_expwindow_2 = Data(input_expwindow)
sunion_4 = SetUnion(SetA=input_expwindow_2)
sort_2 = SortList(Keys=sunion_4)  # -> Keys, ValuesA
item_2 = ListItem(List=sort_2.Keys, Index=0, Wrap=True)  # -> Item1, Item
max_2 = Data(item_2.Item1)
min_2 = Data(item_2.Item)
subtraction_2 = Subtraction(A=max_2, B=max)
subtraction_3 = Subtraction(A=min, B=min_2)
python_2 = GhPythonScript(x=subtraction_3)  # -> a; same code as python
python_3 = GhPythonScript(x=subtraction_2)  # -> a; same code as python
output_exps_x1 = Data(python_2)
output_exps_x3 = Data(python_3)

input_exps_wall_window用_3 = Data(pdecon_2.YComponent)
input_exps_wall_window用_4 = Data(input_exps_wall_window用_3)
sunion_5 = SetUnion(SetA=input_exps_wall_window用_4)
sort_3 = SortList(Keys=sunion_5)  # -> Keys, ValuesA
item_3 = ListItem(List=sort_3.Keys, Index=0, Wrap=True)  # -> Item1, Item
max_3 = Data(item_3.Item1)
min_3 = Data(item_3.Item)
subtraction_4 = Subtraction(A=max_3, B=min_3)
python_4 = GhPythonScript(x=subtraction_4)  # -> a; same code as python
output_exps_y2 = Data(python_4)

input_expwindow_3 = Data(pdecon.YComponent)
input_expwindow_4 = Data(input_expwindow_3)
sunion_6 = SetUnion(SetA=input_expwindow_4)
sort_4 = SortList(Keys=sunion_6)  # -> Keys, ValuesA
item_4 = ListItem(List=sort_4.Keys, Index=0, Wrap=True)  # -> Item1, Item
max_4 = Data(item_4.Item1)
min_4 = Data(item_4.Item)
subtraction_5 = Subtraction(A=max_4, B=max_3)
subtraction_6 = Subtraction(A=min_3, B=min_4)
python_5 = GhPythonScript(x=subtraction_6)  # -> a; same code as python
python_6 = GhPythonScript(x=subtraction_5)  # -> a; same code as python
output_exps_y1 = Data(python_5)
output_exps_y3 = Data(python_6)

output_exps_x1_2 = ClusterOutput(output_exps_x1)
output_exps_y1_2 = ClusterOutput(output_exps_y1)
output_exps_x2_2 = ClusterOutput(output_exps_x2)
output_exps_y2_2 = ClusterOutput(output_exps_y2)
output_exps_x3_2 = ClusterOutput(output_exps_x3)
output_exps_y3_2 = ClusterOutput(output_exps_y3)
