# Grasshopper definition Create0521.gh (Grasshopper 1.0.7)

data = Data(["1", "0", "1", "0", "0", "0", "0", "0", "0", "0"])
exporttherb = CSharpScript(input2=data)  # -> out, output2; inputs input2: list of String
# ---------- exporttherb: C# usings ----------
using Rhino.Geometry.Collections;
using Rhino.Geometry.Intersect;
using System.Threading.Tasks;
# ---------- exporttherb: C# ----------
    string data = "";
    foreach(string row in input2){
      Print("{0}", row);
      //TODO:string interpolationを使いたい
      data += convertFormat(row, 4);
    }
    output2 = data;
# ---------- exporttherb: C# additional code ----------
  private string convertFormat(string input, int totalLength)
  {
    int inputLength = input.Length;
    string emptyString = new string(' ', totalLength - inputLength);

    return emptyString + input;
  }
# ---------- end exporttherb ----------
panel = Panel(data)
number_slider = Slider(9, range=0..10)
number_slider_2 = Slider(4, range=0..10)
panel_2 = Panel("""1.0
0.0
1.112
0.0
0.0
0.0
0.0
0.0
0.0
0.0""")
panel_3 = Panel(exporttherb.output2)
c_script = CSharpScript(InputData=data, NumberofSpace=number_slider, NumberofDecimal=number_slider_2)  # -> out, A; inputs InputData: list of String, NumberofSpace: Int32, NumberofDecimal: Int32
# ---------- c_script: C# ----------
    string data = "";
    string data1 = "";
    var NewList = new List<string>();
    foreach(string row in InputData){
      data =  ChangeFloat(row, NumberofDecimal);
      NewList.Add(data);
    }
    foreach(string row in NewList){
      Print("{0}", row);
      //TODO:string interpolationを使いたい
      data1 += convertFormat(row, NumberofSpace);
    }
    A = data1;
# ---------- c_script: C# additional code ----------
  private string ChangeFloat(string inputE, int FloatLength){
    int inputELength = inputE.Length;
    if (FloatLength != 0){
      if(inputE.Contains(".")){
      }
      else{
        inputE = inputE + "." + new String('0', FloatLength);
      }
    }
    else{}
      
    return inputE;
  }  

  private string convertFormat(string input, int totalLength)
  {
    int inputLength = input.Length;
    string emptyString = new string(' ', totalLength - inputLength);

    return emptyString + input;
  }
# ---------- end c_script ----------
# 試作版です。初めて書いたので、
# 例外の処理をまだ考えてないですが、こんなイメージで作りました。
c_script_2 = CSharpScript(InputData=panel_2, NumberofSpace=number_slider, NumberofDecimal=number_slider_2)  # -> out, A; inputs InputData: list of String, NumberofSpace: Int32, NumberofDecimal: Int32
# ---------- c_script_2: C# ----------
    string data = "";
    string data1 = "";
    var NewList = new List<string>();
    foreach(string row in InputData){
      data = ChangeFloat(row, NumberofDecimal);
      NewList.Add(data);
    }
    foreach(string row in NewList){
      Print("{0}", row);
      //TODO:string interpolationを使いたい
      data1 += convertFormat(row, NumberofSpace);
    }
    A = data1;
# ---------- c_script_2: C# additional code ----------
  private string ChangeFloat(string inputE, int FloatLength){
    int inputELength = inputE.Length;
    string a1 = "F" + FloatLength;
    Print("{0}", a1);
    //    decimal divide = Decimal.Parse(inputE)%1;
    //    Print("{0}", divide);
    //    string divide1 = divide.Tostring();
    if (FloatLength != 0){
      if(inputE.Contains(".")){
        inputE = Double.Parse(inputE).ToString(a1);
      }
      else{
        inputE = inputE + "." + new String('0', FloatLength);
      }
    }
    else{}

    return inputE;
  }

  private string convertFormat(string input, int totalLength)
  {
    int inputLength = input.Length;
    string emptyString = new string(' ', totalLength - inputLength);

    return emptyString + input;
  }
# ---------- end c_script_2 ----------
panel_4 = Panel(c_script_2.A)
panel_5 = Panel(c_script.A)
