# Grasshopper definition type exchange.gh (Grasshopper 1.0.5)

c_script = CSharpScript(x="Type Example", y=Slider(4, range=-10..10), z=ColourSwatch(SwatchColor=RGB(189, 0, 0)))  # -> out, T; inputs x: String, y: Int32, z: Color
# ---------- c_script: C# ----------
    MyType instance = new MyType(x, y, z);
    T = instance.ToXml();
# ---------- c_script: C# additional code ----------
  private class MyType
  {
    private readonly int _number;
    private readonly string _text;
    private readonly Color _colour;
    
    public MyType(string text, int number, Color colour)
    {
      _text = text;
      _number = number;
      _colour = colour;
    }
    public string Text { get { return _text; } }
    public int Number { get { return _number; } }
    public Color Colour { get { return _colour; } }

    /// <summary>
    /// Serialize this data to an xml string.
    /// </summary>
    /// <returns>Xml description of this instance.</returns>
    public string ToXml()
    {
      var chunk = new GH_LooseChunk("MyTypeData");
      chunk.SetString("Text", Text);
      chunk.SetInt32("Number", Number);
      chunk.SetDrawingColor("Colour", Colour);

      return chunk.Serialize_Xml();
    }

    /// <summary>
    /// Deserialize an xml string.
    /// </summary>
    /// <param name="xml">Xml description.</param>
    public MyType(string xml)
    {
      var chunk = new GH_LooseChunk("MyTypeData");
      chunk.Deserialize_Xml(xml);

      _text = chunk.GetString("Text");
      _number = chunk.GetInt32("Number");
      _colour = chunk.GetDrawingColor("Colour");
    }
  }
# ---------- end c_script ----------
panel = Panel(c_script.T)
c_script_2 = CSharpScript(T=c_script.T)  # -> out, A, B, C; inputs T: String
# ---------- c_script_2: C# ----------
    var instance = new MyType(T);
    A = instance.Text;
    B = instance.Number;
    C = instance.Colour;
# ---------- c_script_2: C# additional code ----------
  private class MyType
  {
    private readonly int _number;
    private readonly string _text;
    private readonly Color _colour;

    public MyType(string text, int number, Color colour)
    {
      _text = text;
      _number = number;
      _colour = colour;
    }
    public string Text { get { return _text; } }
    public int Number { get { return _number; } }
    public Color Colour { get { return _colour; } }

    /// <summary>
    /// Serialize this data to an xml string.
    /// </summary>
    /// <returns>Xml description of this instance.</returns>
    public string ToXml()
    {
      var chunk = new GH_LooseChunk("MyTypeData");
      chunk.SetString("Text", Text);
      chunk.SetInt32("Number", Number);
      chunk.SetDrawingColor("Colour", Colour);

      return chunk.Serialize_Xml();
    }

    /// <summary>
    /// Deserialize an xml string.
    /// </summary>
    /// <param name="xml">Xml description.</param>
    public MyType(string xml)
    {
      var chunk = new GH_LooseChunk("MyTypeData");
      chunk.Deserialize_Xml(xml);

      _text = chunk.GetString("Text");
      _number = chunk.GetInt32("Number");
      _colour = chunk.GetDrawingColor("Colour");
    }
  }
# ---------- end c_script_2 ----------
panel_2 = Panel([c_script_2.A, c_script_2.B, c_script_2.C])
